# Grasshopper definition 01_2_Lineaments.gh (Grasshopper 1.0.7)
# plug-ins: Human, LunchBox

# Variables + Controls
radius_of_circle_a = Panel("60")
center_of_drawing = Panel("0,0,0")
polygon_a_sides = Panel("3")
division = Division(A="360", B="60")
division_2 = Division(A="60", B=polygon_a_sides)
integer = Integer(division)
integer_2 = Integer(division_2)
series = Series(Start=0, Step=integer, Count=integer_2)

# ---- group: Defining Circle
xy_plane = XYPlane(Origin=center_of_drawing)
rotate_plane = RotatePlane(Plane=xy_plane, Angle=degrees(series))
# A
ellipse = Ellipse(Plane=rotate_plane, Radius1=radius_of_circle_a, Radius2=radius_of_circle_a)  # -> Ellipse, Focus1, Focus2

# ---- group: Polygons
# Operations
divide_curve = DivideCurve(Curve=ellipse.Ellipse, Count=polygon_a_sides, Kinks=False)  # -> Points, Tangents, Parameters
polyline = PolyLine(Vertices=divide_curve.Points, Closed=Toggle(True))  # -> flatten(Polyline)
region_union = RegionUnion(Curves=polyline)

# ---- group: dome radius
explode = Explode(Curve=polyline, Recursive=True)  # -> Segments, Vertices
point_on_curve = PointOnCurve(explode.Segments, parameter=0.5)
line = Line(StartPoint=center_of_drawing, EndPoint=explode.Vertices)
# B
# Output Geometry
list_item = ListItem(List=point_on_curve, Index=0, Wrap=True)

# ----
list_item_2 = ListItem(List=rotate_plane, Index=0, Wrap=True)
distance = Distance(PointA=list_item, PointB=list_item_2)
index_of_max = PythonScript(values=flatten(distance))  # -> IMin, IMax; inputs values: list
# ---------- index_of_max: Python ----------
q=[values]
for i in values:
    IMax=list.index(values,max(values))
    IMin=list.index(values,min(values))
# ---------- end index_of_max ----------
list_item_3 = ListItem(List=flatten(distance), Index=index_of_max.IMin, Wrap=True)
circle = Circle(Plane=list_item_2, Radius=list_item_3)
# C
# Views
centerline = Panel("""1
.5
.5
.5""")
above_line = Panel(""".5
.25""")
# D
# Line Type
dash_pattern = DashPattern(Curve=line, Pattern=centerline)  # -> Dashes, Gaps
dash_pattern_2 = DashPattern(Curve=circle, Pattern=above_line)  # -> Dashes, Gaps
# E
# Layers
base_circle = Geometry(ellipse.Ellipse)

# ---- group: TEXT LABELS
# F
# Preview and Bake
text_size = Panel("1")
point = Point(center_of_drawing)
add_text = Panel("X")
list_length = ListLength(List=point)
linear_gradient = GhPythonScript(R="0", G="0", B="0", Percent="1")  # -> Color
# ---------- linear_gradient: Python ----------
__author__ = "ericsonm"
__version__ = "2019.01.15"

import rhinoscriptsyntax as rs

def LinearColorGradient(R,G,B,R2,G2,B2,ColorPercentage):
    
    if ColorPercentage > 1:
        R3 = None
        G3 = None
        B3 = None
    else:
        #This function defines linear color gradient by treating R,G,B as coordinates on a 3D line.
        #The base color that will be altered by the percentage should be entered in the second R2,G2,B2 valu
    
        Rdiff = float(R2) - float(R)
        Gdiff = float(G2) - float(G)
        Bdiff = float(B2) - float(B)


        t = float(ColorPercentage)


        R3 = float(R) + Rdiff*t
        G3 = float(G) + Gdiff*t
        B3 = float(B) + Bdiff*t



    return R3,G3,B3


if (R or G or B or Percent) is None:
    Color = None
else: 
    Color1 = LinearColorGradient(255,255,255,R,G,B,Percent)

    R3 = Color1[0]
    G3 = Color1[1]
    B3 = Color1[2]

    Color = rs.CreateColor(R3,G3,B3)
# ---------- end linear_gradient ----------
series_2 = Series(Start=0, Step=1, Count=list_length)
integer_3 = Integer(series_2)
concatenate = Concatenate(FragmentA=integer_3, FragmentB=add_text)
text_tag_3d = TextTag3D(Location=point, Text=concatenate, Size=text_size, Colour=linear_gradient, Justification=5)

point_2 = Point(flatten(divide_curve.Points))
text_size_2 = Panel("1")
add_text_2 = Panel("a")
list_length_2 = ListLength(List=point_2)
linear_gradient_2 = GhPythonScript(R="0", G="0", B="0", Percent="1")  # -> Color; same code as linear_gradient
series_3 = Series(Start=0, Step=1, Count=list_length_2)
integer_4 = Integer(series_3)
concatenate_2 = Concatenate(FragmentA=integer_4, FragmentB=add_text_2)

# ----
scale = Scale(Geometry=point_2, Center=Point(0, 0, 0), Factor="1.025")  # -> Geometry, Transform

# ---- group: TEXT LABELS (continued)
text_tag_3d_2 = TextTag3D(Location=scale.Geometry, Text=concatenate_2, Size=text_size_2, Colour=linear_gradient_2, Justification=5)

# ---- group: Preview and Bake
get_name = GhPythonScript(Component=base_circle)  # -> Geometry, Name
# ---------- get_name: Python ----------
# Mark Ericson 1.17.19
   #take from forum discussion thread https://www.grasshopper3d.com/forum/topics/python-get-label-name-of-input-components
    #edited version of code  by Mostapha Sadeghipour Roudsari

def GetComponentName():
    Comp = ghenv.Component.Params.Input[0]
    sources = Comp.Sources

    if sources.Count == 0: 
        return components

    for source in sources:
        attr = source.Attributes
        if (attr is None) or (attr.GetTopLevel is None):
            pass
        else:

            component = attr.GetTopLevel.DocObject
            componentName = component.NickName

            return componentName

if Component == None:
    pass
else:
    Name = GetComponentName()
    Geometry = Component
# ---------- end get_name ----------
linear_gradient_3 = GhPythonScript(R="0", G="0", B="0", Percent=".5")  # -> Color; same code as linear_gradient
custom_preview = CustomPreview(Geometry=get_name.Geometry, Material=linear_gradient_3)

# ----
panel = Panel(get_name.Name)

# ---- group: Preview and Bake (continued)
object_bake = ObjectBake(
    BakeToggle=Button(),
    GeometryObjects=get_name.Geometry,
    Layer=panel,
    ObjectName=panel,
    ObjectColor=linear_gradient_3,
    LayerColor=linear_gradient_3)

# ----
custom_preview_lineweights = CustomPreviewLineweights(Geometry=get_name.Geometry, Shader=linear_gradient_3, Thickness=".0025", Absolute=Toggle(True))

# ---- group: Preview and Bake
get_name_2 = GhPythonScript(Component=polyline)  # -> Geometry, Name; same code as get_name
linear_gradient_4 = GhPythonScript(R="0", G="0", B="0", Percent=".5")  # -> Color; same code as linear_gradient
custom_preview_2 = CustomPreview(Geometry=get_name_2.Geometry, Material=linear_gradient_4)

# ----
panel_2 = Panel(get_name_2.Name)

# ---- group: Preview and Bake (continued)
object_bake_2 = ObjectBake(
    BakeToggle=Button(),
    GeometryObjects=get_name_2.Geometry,
    Layer=panel_2,
    ObjectName=panel_2,
    ObjectColor=linear_gradient_4,
    LayerColor=linear_gradient_4)

# ----
custom_preview_lineweights_2 = CustomPreviewLineweights(Geometry=get_name_2.Geometry, Shader=linear_gradient_4, Thickness=".0025", Absolute=Toggle(True))

# ---- group: Preview and Bake
get_name_3 = GhPythonScript(Component=region_union)  # -> Geometry, Name; same code as get_name
linear_gradient_5 = GhPythonScript(R="0", G="0", B="0", Percent="1")  # -> Color; same code as linear_gradient
custom_preview_3 = CustomPreview(Geometry=get_name_3.Geometry, Material=linear_gradient_5)

# ----
panel_3 = Panel(get_name_3.Name)

# ---- group: Preview and Bake (continued)
object_bake_3 = ObjectBake(
    BakeToggle=Button(),
    GeometryObjects=get_name_3.Geometry,
    Layer=panel_3,
    ObjectName=panel_3,
    ObjectColor=linear_gradient_5,
    LayerColor=linear_gradient_5)

# ----
custom_preview_lineweights_3 = CustomPreviewLineweights(Geometry=get_name_3.Geometry, Shader=linear_gradient_5, Thickness=".1", Absolute=Toggle(True))

# ---- group: Preview and Bake
get_name_4 = GhPythonScript(Component=dash_pattern.Dashes)  # -> Geometry, Name; same code as get_name
linear_gradient_6 = GhPythonScript(R="0", G="0", B="0", Percent=".8")  # -> Color; same code as linear_gradient
custom_preview_4 = CustomPreview(Geometry=get_name_4.Geometry, Material=linear_gradient_6)

# ----
panel_4 = Panel(get_name_4.Name)

# ---- group: Preview and Bake (continued)
object_bake_4 = ObjectBake(
    BakeToggle=Button(),
    GeometryObjects=get_name_4.Geometry,
    Layer=panel_4,
    ObjectName=panel_4,
    ObjectColor=linear_gradient_6,
    LayerColor=linear_gradient_6)

# ----
custom_preview_lineweights_4 = CustomPreviewLineweights(Geometry=get_name_4.Geometry, Shader=linear_gradient_6, Thickness=".0025", Absolute=Toggle(True))

# ---- group: Preview and Bake
get_name_5 = GhPythonScript(Component=dash_pattern_2.Dashes)  # -> Geometry, Name; same code as get_name
linear_gradient_7 = GhPythonScript(R="0", G="0", B="0", Percent="1")  # -> Color; same code as linear_gradient
custom_preview_5 = CustomPreview(Geometry=get_name_5.Geometry, Material=linear_gradient_7)

# ----
panel_5 = Panel(get_name_5.Name)

# ---- group: Preview and Bake (continued)
object_bake_5 = ObjectBake(
    BakeToggle=Button(),
    GeometryObjects=get_name_5.Geometry,
    Layer=panel_5,
    ObjectName=panel_5,
    ObjectColor=linear_gradient_7,
    LayerColor=linear_gradient_7)

# ----
custom_preview_lineweights_5 = CustomPreviewLineweights(Geometry=get_name_5.Geometry, Shader=linear_gradient_7, Thickness=".08", Absolute=Toggle(True))
