# Grasshopper definition 01_Template.gh (Grasshopper 1.0.7)
# plug-ins: Human, LunchBox

# Variables + Controls
# Operations
list_of_points_to_label = Point()
# A
# B
# C
# D
# E
# F
# Output Geometry
# Views
# Line Type
# Layers
geometry = Geometry()

# ---- group: TEXT LABELS
text_size = Panel(".02")
point = Point(list_of_points_to_label)
add_text = Panel("a")
list_length = ListLength(List=point)
linear_gradient = GhPythonScript(R="0", G="0", B="0", Percent=".5")  # -> Color
# ---------- linear_gradient: Python ----------
__author__ = "ericsonm"
__version__ = "2019.01.15"

import rhinoscriptsyntax as rs

def LinearColorGradient(R,G,B,R2,G2,B2,ColorPercentage):
    
    if ColorPercentage > 1:
        R3 = None
        G3 = None
        B3 = None
    else:
        #This function defines linear color gradient by treating R,G,B as coordinates on a 3D line.
        #The base color that will be altered by the percentage should be entered in the second R2,G2,B2 valu
    
        Rdiff = float(R2) - float(R)
        Gdiff = float(G2) - float(G)
        Bdiff = float(B2) - float(B)


        t = float(ColorPercentage)


        R3 = float(R) + Rdiff*t
        G3 = float(G) + Gdiff*t
        B3 = float(B) + Bdiff*t



    return R3,G3,B3


if (R or G or B or Percent) is None:
    Color = None
else: 
    Color1 = LinearColorGradient(255,255,255,R,G,B,Percent)

    R3 = Color1[0]
    G3 = Color1[1]
    B3 = Color1[2]

    Color = rs.CreateColor(R3,G3,B3)
# ---------- end linear_gradient ----------
series = Series(Start=0, Step=1, Count=list_length)
integer = Integer(series)
concatenate = Concatenate(FragmentA=integer, FragmentB=add_text)
text_tag_3d = TextTag3D(Location=point, Text=concatenate, Size=text_size, Colour=linear_gradient, Justification=5)

# ---- group: Preview and Bake
# Preview and Bake
button = Button()
get_name = GhPythonScript(Component=geometry)  # -> Geometry, Name
# ---------- get_name: Python ----------
# Mark Ericson 1.17.19
   #take from forum discussion thread https://www.grasshopper3d.com/forum/topics/python-get-label-name-of-input-components
    #edited version of code  by Mostapha Sadeghipour Roudsari

def GetComponentName():
    Comp = ghenv.Component.Params.Input[0]
    sources = Comp.Sources

    if sources.Count == 0: 
        return components

    for source in sources:
        attr = source.Attributes
        if (attr is None) or (attr.GetTopLevel is None):
            pass
        else:

            component = attr.GetTopLevel.DocObject
            componentName = component.NickName

            return componentName

if Component == None:
    pass
else:
    Name = GetComponentName()
    Geometry = Component
# ---------- end get_name ----------
linear_gradient_2 = GhPythonScript(R="0", G="0", B="0", Percent="1")  # -> Color; same code as linear_gradient
custom_preview = CustomPreview(Geometry=get_name.Geometry, Material=linear_gradient_2)

# ----
panel = Panel(get_name.Name)

# ---- group: Preview and Bake (continued)
object_bake = ObjectBake(
    BakeToggle=button,
    GeometryObjects=get_name.Geometry,
    Layer=panel,
    ObjectName=panel,
    ObjectColor=linear_gradient_2,
    LayerColor=linear_gradient_2)

# ----
custom_preview_lineweights = CustomPreviewLineweights(Geometry=get_name.Geometry, Shader=linear_gradient_2, Thickness=".0025", Absolute=Toggle(True))
