# Grasshopper definition List and Tree.gh (Grasshopper 1.0.7)

series = Series(Start="0", Step="1", Count="10")
number = Number(graft(series))
number_2 = Number(series)
panel = Panel(series)
panel_2 = Panel(number_2)
panel_3 = Panel(number)
number_3 = Number(panel)
multiplication = Multiplication(A=panel_2, B=number_3)
multiplication_2 = Multiplication(A=flatten(number_3), B=panel_3)
panel_4 = Panel(multiplication)
panel_5 = Panel(multiplication_2)
list_item = ListItem(List=panel_4, Index="0", Wrap=True)
list_item_2 = ListItem(List=panel_5, Index="0", Wrap=True)
panel_6 = Panel(list_item)
panel_7 = Panel(list_item_2)
