# Grasshopper definition DrawHypotenuse.gh (Grasshopper 1.0.7)

hypotenuse = GhPythonScript()  # -> Line; inputs point: Point3d
# ---------- hypotenuse: Python ----------
__author__ = "ericsonm"
__version__ = "2019.01.31"

import rhinoscriptsyntax as rs
import math
import Rhino as rh




def vectoratAngle(angle):
    if angle == None:
        vector = None
    else:
        c=rs.AddPoint(0,0,0)
        f=math.radians(float(angle))
        l=rs.AddPoint(math.cos(f),math.sin(f),0)
        d=rs.VectorCreate(l,c)
        vector =rs.VectorUnitize(d)
        return(vector)



def drawhypotenuse(point,baseline,rotation):

    if (point or baseline or rotation) == None:
        pass
    else:
        rot = float(rotation)
        X = (rh.Geometry.Point3d.X.GetValue(point))
        Y = (rh.Geometry.Point3d.Y.GetValue(point))
        Z = (rh.Geometry.Point3d.Z.GetValue(point)) 
        point2 = rs.AddPoint(X + 1,Y,Z)
        Xline = rs.AddLine(point,point2)
        angle1 = rs.Angle2(Xline,baseline)[0]
        angle2 = 360 - angle1
        angle3 = angle2 + rot
        
        Vector1 = vectoratAngle(angle3)
        Vector2 = vectoratAngle(angle2)
        angle4 = rs.VectorAngle(Vector1,Vector2)
        adjacent = (rs.CurveLength(baseline))
        hyp = adjacent/(math.cos(math.radians(angle4)))
        
        x2 = math.cos(math.radians(angle3))*hyp + X
        y2 = math.sin(math.radians(angle3))*hyp + Y
        endpoint = rs.AddPoint(x2,y2,Z)
        
        line = rs.AddLine(point,endpoint)
        return (line)
        
Line = drawhypotenuse(point,baseline,rotation)
# ---------- end hypotenuse ----------
