# Grasshopper definition Python_Index of Max.gh (Grasshopper 1.0.7)

index_of_max = PythonScript(values=0)  # -> IMin, IMax; inputs values: list
# ---------- index_of_max: Python ----------
q=[values]
for i in values:
    IMax=list.index(values,max(values))
    IMin=list.index(values,min(values))
# ---------- end index_of_max ----------
