# Grasshopper definition Python_Project.gh (Grasshopper 1.0.7)

projection = PythonScript()  # -> lines
# ---------- projection: Python ----------
import rhinoscriptsyntax as rs
import math
if (points or geometry or angle) == None:
    lines = None
else:
    c=rs.AddPoint(0,0,0)
    f=math.radians(float(angle))
    l=rs.AddPoint(math.cos(f),math.sin(f),0)
    d=rs.VectorCreate(l,c)
    n=rs.VectorUnitize(d)
    e=rs.ExtrudeCurveStraight(geometry,(0,0,0),(0,0,1))
    q=rs.ProjectPointToSurface(points,e,n)
    p2=rs.AddPoints(q)
    for i in p2:
        lines=rs.AddLine(points,i)
    if p2:
        del p2
# ---------- end projection ----------
projection_2 = PythonScript()  # -> lines
# ---------- projection_2: Python ----------
import rhinoscriptsyntax as rs
import math
if (points or geometry or vector) == None:
    lines = None
else:

    d= vector
    n=rs.VectorUnitize(d)
    e=rs.ExtrudeCurveStraight(geometry,(0,0,0),(0,0,1))
    q=rs.ProjectPointToSurface(points,e,n)
    p2=rs.AddPoints(q)
    for i in p2:
        lines=rs.AddLine(points,i)
    if p2:
        del p2
# ---------- end projection_2 ----------
