# Grasshopper definition example.gh (Grasshopper 1.0.7)
# plug-ins: Human, LunchBox

# A
# Variables + Controls
panel = Panel("0,0,0")
rectangle = Rectangle(Plane=panel, XSize="10", YSize="11", Radius=0)  # -> Rectangle, Length
rectangle_2 = Rectangle(Plane="0,0,0", XSize="5", YSize="15", Radius=0)  # -> Rectangle, Length
rectangle_3 = Rectangle(Plane="0,0,0", XSize="10", YSize="11", Radius=0)  # -> Rectangle, Length
rectangle_4 = Rectangle(Plane="0,0,0", XSize="5", YSize="5", Radius=0)  # -> Rectangle, Length

# ---- group: barrel vault
plan_rectangle = Geometry(rectangle_3.Rectangle)
explode = Explode(Curve=plan_rectangle, Recursive=True)  # -> Segments, Vertices
explode_2 = Explode(Curve=plan_rectangle, Recursive=True)  # -> Segments, Vertices
length = Length(Curve=explode.Segments)
split_list = SplitList(List=explode_2.Vertices, Index="2")  # -> ListA, ListB
index_of_max = PythonScript(values=length)  # -> IMin, IMax; inputs values: list
# ---------- index_of_max: Python ----------
q=[values]
for i in values:
    IMax=list.index(values,max(values))
    IMin=list.index(values,min(values))
# ---------- end index_of_max ----------
unit_z = UnitZ(Factor=1)
split_list_2 = SplitList(List=split_list.ListA, Index="1")  # -> ListA, ListB
list_item = ListItem(List=length, Index=index_of_max.IMax, Wrap=True)
line = Line(StartPoint=split_list_2.ListA, EndPoint=split_list_2.ListB)
arc_sed = ArcSED(Start=split_list_2.ListA, End=split_list_2.ListB, Direction=unit_z)  # -> Arc, Plane, Radius
join_curves = JoinCurves(Curves=[line, arc_sed.Arc], Preserve=False)
perpendicular = GhPythonScript(line=line)  # -> Perp; inputs line: Line
# ---------- perpendicular: Python ----------
__author__ = "mericson"
__version__ = "2019.01.11"

import rhinoscriptsyntax as rs
import math
import Rhino as rh

if line == None:
    line = None
else:
    a = 0,0,0
    b = 0,0,1
    Z = rs.VectorCreate(a,b)
    c = rh.Geometry.Line.PointAt(line,1)
    d = rh.Geometry.Line.PointAt(line,0)
    vector2 = rs.VectorCreate(c,d)
    Perp = rs.VectorRotate(vector2,90,Z)
# ---------- end perpendicular ----------
amplitude = Amplitude(Vector=perpendicular, Amplitude=list_item)
boundary_surfaces = BoundarySurfaces(Edges=join_curves)
reverse = Reverse(Vector=amplitude)
extrude = Extrude(Base=boundary_surfaces, Direction=reverse)
brep = Brep(extrude)

plan_rectangle_2 = Geometry(rectangle.Rectangle)
explode_3 = Explode(Curve=plan_rectangle_2, Recursive=True)  # -> Segments, Vertices
explode_4 = Explode(Curve=plan_rectangle_2, Recursive=True)  # -> Segments, Vertices
# Operations
length_2 = Length(Curve=explode_3.Segments)
split_list_3 = SplitList(List=explode_4.Vertices, Index="2")  # -> ListA, ListB
index_of_max_2 = PythonScript(values=length_2)  # -> IMin, IMax; inputs values: list; same code as index_of_max
unit_z_2 = UnitZ(Factor=1)
split_list_4 = SplitList(List=split_list_3.ListA, Index="1")  # -> ListA, ListB
list_item_2 = ListItem(List=length_2, Index=index_of_max_2.IMax, Wrap=True)
line_2 = Line(StartPoint=split_list_4.ListA, EndPoint=split_list_4.ListB)
arc_sed_2 = ArcSED(Start=split_list_4.ListA, End=split_list_4.ListB, Direction=unit_z_2)  # -> Arc, Plane, Radius
join_curves_2 = JoinCurves(Curves=[line_2, arc_sed_2.Arc], Preserve=False)
perpendicular_2 = GhPythonScript(line=line_2)  # -> Perp; inputs line: Line; same code as perpendicular
amplitude_2 = Amplitude(Vector=perpendicular_2, Amplitude=list_item_2)
boundary_surfaces_2 = BoundarySurfaces(Edges=join_curves_2)
reverse_2 = Reverse(Vector=amplitude_2)
extrude_2 = Extrude(Base=boundary_surfaces_2, Direction=reverse_2)
brep_2 = Brep(extrude_2)

# ----
xy_plane = XYPlane(Origin=Point(0, 0, 0))
unit_z_3 = UnitZ(Factor="-60")
list_of_points_to_label = Point()

# ---- group: TEXT LABELS
text_size = Panel(".02")
point = Point(list_of_points_to_label)
add_text = Panel("a")
list_length = ListLength(List=point)
linear_gradient = GhPythonScript(R="0", G="0", B="0", Percent=".5")  # -> Color
# ---------- linear_gradient: Python ----------
__author__ = "ericsonm"
__version__ = "2019.01.15"

import rhinoscriptsyntax as rs

def LinearColorGradient(R,G,B,R2,G2,B2,ColorPercentage):
    
    if ColorPercentage > 1:
        R3 = None
        G3 = None
        B3 = None
    else:
        #This function defines linear color gradient by treating R,G,B as coordinates on a 3D line.
        #The base color that will be altered by the percentage should be entered in the second R2,G2,B2 valu
    
        Rdiff = float(R2) - float(R)
        Gdiff = float(G2) - float(G)
        Bdiff = float(B2) - float(B)


        t = float(ColorPercentage)


        R3 = float(R) + Rdiff*t
        G3 = float(G) + Gdiff*t
        B3 = float(B) + Bdiff*t



    return R3,G3,B3


if (R or G or B or Percent) is None:
    Color = None
else: 
    Color1 = LinearColorGradient(255,255,255,R,G,B,Percent)

    R3 = Color1[0]
    G3 = Color1[1]
    B3 = Color1[2]

    Color = rs.CreateColor(R3,G3,B3)
# ---------- end linear_gradient ----------
series = Series(Start=0, Step=1, Count=list_length)
integer = Integer(series)
concatenate = Concatenate(FragmentA=integer, FragmentB=add_text)
text_tag_3d = TextTag3D(Location=point, Text=concatenate, Size=text_size, Colour=linear_gradient, Justification=5)

# ---- group: rail revolve
height = Panel(".4")
plan_geometry = Geometry(rectangle_4.Rectangle)
point_on_curve = PointOnCurve(plan_geometry, parameter=0.376)
area = Area(Geometry=plan_geometry)  # -> Area, Centroid
distance = Distance(PointA=point_on_curve, PointB=area.Centroid)
unit_z_4 = UnitZ(Factor=1)
addition = Addition(A=height, B=distance)
unit_z_5 = UnitZ(Factor=addition)
line_sdl = LineSDL(Start=area.Centroid, Direction=unit_z_5, Length=1)

# ---- group: rail revolve / section profile
line_sdl_2 = LineSDL(Start=point_on_curve, Direction=unit_z_4, Length=height)
move = Move(Geometry=area.Centroid, Motion=unit_z_5)  # -> Geometry, Transform
end_points = EndPoints(Curve=line_sdl_2)  # -> Start, End
arc_sed_3 = ArcSED(Start=end_points.End, End=move.Geometry, Direction=unit_z_5)  # -> Arc, Plane, Radius
join_curves_3 = JoinCurves(Curves=[line_sdl_2, arc_sed_3.Arc], Preserve=False)

# ---- group: rail revolve (continued)
rail_revolution = RailRevolution(Curve=join_curves_3, Rail=plan_geometry, Axis=line_sdl, Scale=False)
cap_holes = CapHoles(Brep=rail_revolution)
brep_3 = Brep(cap_holes)

# ----
solid_difference = SolidDifference(BrepsA=brep, BrepsB=brep_3)
brep_plane = BrepPlane(Brep=solid_difference, Plane=xy_plane)  # -> Curves, Points
area_2 = Area(Geometry=brep_plane.Curves)  # -> Area, Centroid
move_2 = Move(Geometry=area_2.Centroid, Motion=unit_z_3)  # -> Geometry, Transform

# ---- group: rail revolve
height_2 = Panel("4")
plan_geometry_2 = Geometry(rectangle_2.Rectangle)
point_on_curve_2 = PointOnCurve(plan_geometry_2, parameter=0.5)
area_3 = Area(Geometry=plan_geometry_2)  # -> Area, Centroid
distance_2 = Distance(PointA=point_on_curve_2, PointB=area_3.Centroid)
unit_z_6 = UnitZ(Factor=1)
addition_2 = Addition(A=height_2, B=distance_2)
unit_z_7 = UnitZ(Factor=addition_2)
line_sdl_3 = LineSDL(Start=area_3.Centroid, Direction=unit_z_7, Length=1)

# ---- group: rail revolve / section profile
line_sdl_4 = LineSDL(Start=point_on_curve_2, Direction=unit_z_6, Length=height_2)
move_3 = Move(Geometry=area_3.Centroid, Motion=unit_z_7)  # -> Geometry, Transform
end_points_2 = EndPoints(Curve=line_sdl_4)  # -> Start, End
arc_sed_4 = ArcSED(Start=end_points_2.End, End=move_3.Geometry, Direction=unit_z_7)  # -> Arc, Plane, Radius
join_curves_4 = JoinCurves(Curves=[line_sdl_4, arc_sed_4.Arc], Preserve=False)

# ---- group: rail revolve (continued)
rail_revolution_2 = RailRevolution(Curve=join_curves_4, Rail=plan_geometry_2, Axis=line_sdl_3, Scale=False)
cap_holes_2 = CapHoles(Brep=rail_revolution_2)
brep_4 = Brep(cap_holes_2)

# ----
# B
solid_union = SolidUnion(Breps=flatten([brep_2, brep_4]))
# C
# Output Geometry
# Views
solid_difference_2 = SolidDifference(BrepsA=solid_union, BrepsB=solid_difference)
relay = Relay([solid_difference, solid_difference_2])

geometry = Geometry(relay)
center_of_object_at_top = Point(move_2.Geometry)
radius_of_base_circle = Number("60")
boolean = Boolean(Toggle(True))
center_of_object_at_base = Point(area_2.Centroid)
point_2 = Point(center_of_object_at_top)
radius_of_base_circle_2 = Number(radius_of_base_circle)
shear_rotation = Number("45")
negative = Negative(Value=radius_of_base_circle_2)
unit_y = UnitY(Factor=negative)
rotate = Rotate(Geometry=unit_y, Angle=degrees(shear_rotation), Plane=PlaneXY(0, 0, 0))  # -> Geometry, Transform
move_4 = Move(Geometry=point_2, Motion=rotate.Geometry)  # -> Geometry, Transform
center_of_roof_displaced = Point(move_4.Geometry)
center_of_roof_original = Point(point_2)
center_of_object = Point(center_of_object_at_base)
shear = Shear(Geometry=geometry, Base=center_of_object, Grip=center_of_roof_original, Target=center_of_roof_displaced)  # -> Geometry, Transform
xy_plane_2 = XYPlane(Origin=center_of_object)
mirror = Mirror(Geometry=shear.Geometry, Plane=xy_plane_2)  # -> Geometry, Transform
stream_filter = StreamFilter(Gate=boolean, Stream0=geometry, Stream1=shear.Geometry)
sheared_object = Geometry(stream_filter)

split_list_5 = SplitList(List=sheared_object, Index="1")  # -> ListA, ListB
geometry_2 = Geometry(split_list_5.ListB)
# D
# E
# F
# Line Type
# Layers
geometry_3 = Geometry(split_list_5.ListA)

# ---- group: Preview and Bake
get_name = GhPythonScript(Component=geometry_2)  # -> Geometry, Name
# ---------- get_name: Python ----------
# Mark Ericson 1.17.19
   #take from forum discussion thread https://www.grasshopper3d.com/forum/topics/python-get-label-name-of-input-components
    #edited version of code  by Mostapha Sadeghipour Roudsari

def GetComponentName():
    Comp = ghenv.Component.Params.Input[0]
    sources = Comp.Sources

    if sources.Count == 0: 
        return components

    for source in sources:
        attr = source.Attributes
        if (attr is None) or (attr.GetTopLevel is None):
            pass
        else:

            component = attr.GetTopLevel.DocObject
            componentName = component.NickName

            return componentName

if Component == None:
    pass
else:
    Name = GetComponentName()
    Geometry = Component
# ---------- end get_name ----------
linear_gradient_2 = GhPythonScript(R="60", G="100", B="120", Percent="1")  # -> Color; same code as linear_gradient
custom_preview = CustomPreview(Geometry=get_name.Geometry, Material=linear_gradient_2)

# ----
panel_2 = Panel(get_name.Name)

# ---- group: Preview and Bake (continued)
object_bake = ObjectBake(
    BakeToggle=Button(),
    GeometryObjects=get_name.Geometry,
    Layer=panel_2,
    ObjectName=panel_2,
    ObjectColor=linear_gradient_2,
    LayerColor=linear_gradient_2)

# ----
custom_preview_lineweights = CustomPreviewLineweights(Geometry=get_name.Geometry, Shader=linear_gradient_2, Thickness=".0025", Absolute=Toggle(True))

# ---- group: Preview and Bake
# Preview and Bake
button = Button()
get_name_2 = GhPythonScript(Component=geometry_3)  # -> Geometry, Name; same code as get_name
linear_gradient_3 = GhPythonScript(R="60", G="120", B="120", Percent=".5")  # -> Color; same code as linear_gradient
custom_preview_2 = CustomPreview(Geometry=get_name_2.Geometry, Material=linear_gradient_3)

# ----
panel_3 = Panel(get_name_2.Name)

# ---- group: Preview and Bake (continued)
object_bake_2 = ObjectBake(
    BakeToggle=button,
    GeometryObjects=get_name_2.Geometry,
    Layer=panel_3,
    ObjectName=panel_3,
    ObjectColor=linear_gradient_3,
    LayerColor=linear_gradient_3)

# ----
custom_preview_lineweights_2 = CustomPreviewLineweights(Geometry=get_name_2.Geometry, Shader=linear_gradient_3, Thickness=".0025", Absolute=Toggle(True))
