# Grasshopper definition 01_Lineaments.gh (Grasshopper 1.0.7)
# plug-ins: Human, LunchBox

# Variables + Controls
radius_of_circle_a = Panel("60")
panel = Panel("10")
polygon_a_sides = Panel("4")
exterior_wall_sides = Panel("4")
division = Division(A="90", B="10")
division_2 = Division(A="10", B=polygon_a_sides)
series = Series(Start=0, Step=division, Count=division_2)

# ---- group: Defining Circle
xy_plane = XYPlane(Origin="0,0,0")
rotate_plane = RotatePlane(Plane=xy_plane, Angle=degrees(series))
# A
ellipse = Ellipse(Plane=rotate_plane, Radius1=radius_of_circle_a, Radius2=radius_of_circle_a)  # -> Ellipse, Focus1, Focus2

# ----
# Operations
divide_curve = DivideCurve(Curve=ellipse.Ellipse, Count=polygon_a_sides, Kinks=False)  # -> Points, Tangents, Parameters
polyline = PolyLine(Vertices=divide_curve.Points, Closed=Toggle(True))  # -> flatten(Polyline)
region_union = RegionUnion(Curves=polyline)

list_item = ListItem(List=ellipse.Ellipse, Index=polygon_a_sides, Wrap=True)
divide_curve_2 = DivideCurve(Curve=list_item, Count=panel, Kinks=False)  # -> Points, Tangents, Parameters
point = Point(divide_curve_2.Points)
list_length = ListLength(List=point)
division_3 = Division(A=list_length, B=exterior_wall_sides)
partition_list = PartitionList(List=point, Size=division_3)
list_item_2 = ListItem(List=partition_list, Index=division_3, Wrap=True)
polyline_2 = PolyLine(Vertices=flatten(list_item_2), Closed=Toggle(True))

panel_2 = Panel("1")
explode = Explode(Curve=polyline_2, Recursive=True)  # -> Segments, Vertices
line = Line(StartPoint="0,0,0", EndPoint=explode.Vertices)
curve_curve = CurveCurve(CurveA=polyline, CurveB=line)  # -> Points, ParamsA, ParamsB
list_item_3 = ListItem(List=rotate_plane, Index=0, Wrap=True)
distance = Distance(PointA=curve_curve.Points, PointB=list_item_3)
index_of_max = PythonScript(values=flatten(distance))  # -> IMin, IMax; inputs values: list
# ---------- index_of_max: Python ----------
q=[values]
for i in values:
    IMax=list.index(values,max(values))
    IMin=list.index(values,min(values))
# ---------- end index_of_max ----------
list_item_4 = ListItem(List=flatten(distance), Index=index_of_max.IMin, Wrap=True)
# B
# C
# Output Geometry
# Views
region_union_2 = RegionUnion(Curves=flatten([region_union, polyline_2]))
circle = Circle(Plane=list_item_3, Radius=list_item_4)
dash_pattern = Panel(""".5
.25""")
dash_pattern_2 = Panel("""1
.5
.5
.5""")
dash_pattern_3 = DashPattern(Curve=circle, Pattern=dash_pattern)  # -> Dashes, Gaps
# D
# Line Type
dash_pattern_4 = DashPattern(Curve=line, Pattern=dash_pattern_2)  # -> Dashes, Gaps
# E
# Layers
base_circle = Geometry(ellipse.Ellipse)
wall = Geometry(region_union_2)

# ---- group: TEXT LABELS
# F
# Preview and Bake
text_size = Panel("1")
point_2 = Point("0,0,0")
add_text = Panel("X")
list_length_2 = ListLength(List=point_2)
linear_gradient = GhPythonScript(R="0", G="0", B="0", Percent="1")  # -> Color
# ---------- linear_gradient: Python ----------
__author__ = "ericsonm"
__version__ = "2019.01.15"

import rhinoscriptsyntax as rs

def LinearColorGradient(R,G,B,R2,G2,B2,ColorPercentage):
    
    if ColorPercentage > 1:
        R3 = None
        G3 = None
        B3 = None
    else:
        #This function defines linear color gradient by treating R,G,B as coordinates on a 3D line.
        #The base color that will be altered by the percentage should be entered in the second R2,G2,B2 valu
    
        Rdiff = float(R2) - float(R)
        Gdiff = float(G2) - float(G)
        Bdiff = float(B2) - float(B)


        t = float(ColorPercentage)


        R3 = float(R) + Rdiff*t
        G3 = float(G) + Gdiff*t
        B3 = float(B) + Bdiff*t



    return R3,G3,B3


if (R or G or B or Percent) is None:
    Color = None
else: 
    Color1 = LinearColorGradient(255,255,255,R,G,B,Percent)

    R3 = Color1[0]
    G3 = Color1[1]
    B3 = Color1[2]

    Color = rs.CreateColor(R3,G3,B3)
# ---------- end linear_gradient ----------
series_2 = Series(Start=0, Step=1, Count=list_length_2)
integer = Integer(series_2)
concatenate = Concatenate(FragmentA=integer, FragmentB=add_text)
text_tag_3d = TextTag3D(Location=point_2, Text=concatenate, Size=text_size, Colour=linear_gradient, Justification=5)

# ---- group: Preview and Bake
get_name = GhPythonScript(Component=base_circle)  # -> Geometry, Name
# ---------- get_name: Python ----------
# Mark Ericson 1.17.19
   #take from forum discussion thread https://www.grasshopper3d.com/forum/topics/python-get-label-name-of-input-components
    #edited version of code  by Mostapha Sadeghipour Roudsari

def GetComponentName():
    Comp = ghenv.Component.Params.Input[0]
    sources = Comp.Sources

    if sources.Count == 0: 
        return components

    for source in sources:
        attr = source.Attributes
        if (attr is None) or (attr.GetTopLevel is None):
            pass
        else:

            component = attr.GetTopLevel.DocObject
            componentName = component.NickName

            return componentName

if Component == None:
    pass
else:
    Name = GetComponentName()
    Geometry = Component
# ---------- end get_name ----------
linear_gradient_2 = GhPythonScript(R="0", G="0", B="0", Percent=".5")  # -> Color; same code as linear_gradient
custom_preview = CustomPreview(Geometry=get_name.Geometry, Material=linear_gradient_2)

# ----
panel_3 = Panel(get_name.Name)

# ---- group: Preview and Bake (continued)
object_bake = ObjectBake(
    BakeToggle=Button(),
    GeometryObjects=get_name.Geometry,
    Layer=panel_3,
    ObjectName=panel_3,
    ObjectColor=linear_gradient_2,
    LayerColor=linear_gradient_2)

# ----
custom_preview_lineweights = CustomPreviewLineweights(Geometry=get_name.Geometry, Shader=linear_gradient_2, Thickness=".0025", Absolute=Toggle(True))

# ---- group: TEXT LABELS
point_3 = Point(flatten(divide_curve.Points))
text_size_2 = Panel("1")
add_text_2 = Panel("a")
list_length_3 = ListLength(List=point_3)
linear_gradient_3 = GhPythonScript(R="0", G="0", B="0", Percent="1")  # -> Color; same code as linear_gradient
series_3 = Series(Start=0, Step=1, Count=list_length_3)
integer_2 = Integer(series_3)
concatenate_2 = Concatenate(FragmentA=integer_2, FragmentB=add_text_2)

# ----
scale = Scale(Geometry=point_3, Center=Point(0, 0, 0), Factor="1.025")  # -> Geometry, Transform

# ---- group: TEXT LABELS (continued)
text_tag_3d_2 = TextTag3D(Location=scale.Geometry, Text=concatenate_2, Size=text_size_2, Colour=linear_gradient_3, Justification=5)

# ---- group: Preview and Bake
get_name_2 = GhPythonScript(Component=polyline)  # -> Geometry, Name; same code as get_name
linear_gradient_4 = GhPythonScript(R="0", G="0", B="0", Percent=".5")  # -> Color; same code as linear_gradient
custom_preview_2 = CustomPreview(Geometry=get_name_2.Geometry, Material=linear_gradient_4)

# ----
panel_4 = Panel(get_name_2.Name)

# ---- group: Preview and Bake (continued)
object_bake_2 = ObjectBake(
    BakeToggle=Button(),
    GeometryObjects=get_name_2.Geometry,
    Layer=panel_4,
    ObjectName=panel_4,
    ObjectColor=linear_gradient_4,
    LayerColor=linear_gradient_4)

# ----
custom_preview_lineweights_2 = CustomPreviewLineweights(Geometry=get_name_2.Geometry, Shader=linear_gradient_4, Thickness=".0025", Absolute=Toggle(True))

# ---- group: Preview and Bake
get_name_3 = GhPythonScript(Component=wall)  # -> Geometry, Name; same code as get_name
linear_gradient_5 = GhPythonScript(R="0", G="0", B="0", Percent="1")  # -> Color; same code as linear_gradient
custom_preview_3 = CustomPreview(Geometry=get_name_3.Geometry, Material=linear_gradient_5)

# ----
panel_5 = Panel(get_name_3.Name)

# ---- group: Preview and Bake (continued)
object_bake_3 = ObjectBake(
    BakeToggle=Button(),
    GeometryObjects=get_name_3.Geometry,
    Layer=panel_5,
    ObjectName=panel_5,
    ObjectColor=linear_gradient_5,
    LayerColor=linear_gradient_5)

# ----
custom_preview_lineweights_3 = CustomPreviewLineweights(Geometry=get_name_3.Geometry, Shader=linear_gradient_5, Thickness=".1", Absolute=Toggle(True))

# ---- group: Preview and Bake
get_name_4 = GhPythonScript(Component=dash_pattern_4.Dashes)  # -> Geometry, Name; same code as get_name
linear_gradient_6 = GhPythonScript(R="0", G="0", B="0", Percent=".8")  # -> Color; same code as linear_gradient
custom_preview_4 = CustomPreview(Geometry=get_name_4.Geometry, Material=linear_gradient_6)

# ----
panel_6 = Panel(get_name_4.Name)

# ---- group: Preview and Bake (continued)
object_bake_4 = ObjectBake(
    BakeToggle=Button(),
    GeometryObjects=get_name_4.Geometry,
    Layer=panel_6,
    ObjectName=panel_6,
    ObjectColor=linear_gradient_6,
    LayerColor=linear_gradient_6)

# ----
custom_preview_lineweights_4 = CustomPreviewLineweights(Geometry=get_name_4.Geometry, Shader=linear_gradient_6, Thickness=".0025", Absolute=Toggle(True))

# ---- group: Preview and Bake
get_name_5 = GhPythonScript(Component=dash_pattern_3.Dashes)  # -> Geometry, Name; same code as get_name
linear_gradient_7 = GhPythonScript(R="0", G="0", B="0", Percent="1")  # -> Color; same code as linear_gradient
custom_preview_5 = CustomPreview(Geometry=get_name_5.Geometry, Material=linear_gradient_7)

# ----
panel_7 = Panel(get_name_5.Name)

# ---- group: Preview and Bake (continued)
object_bake_5 = ObjectBake(
    BakeToggle=Button(),
    GeometryObjects=get_name_5.Geometry,
    Layer=panel_7,
    ObjectName=panel_7,
    ObjectColor=linear_gradient_7,
    LayerColor=linear_gradient_7)

# ----
custom_preview_lineweights_5 = CustomPreviewLineweights(Geometry=get_name_5.Geometry, Shader=linear_gradient_7, Thickness=".08", Absolute=Toggle(True))
