# Grasshopper definition Hatch Lines.gh (Grasshopper 1.0.7)

brep = Brep()

# ---- group: Hatch Group
boundary_surfaces = BoundarySurfaces(Edges=brep)
vector_at_angle = PythonScript(angle="45")  # -> vector
# ---------- vector_at_angle: Python ----------
import rhinoscriptsyntax as rs
import math
if angle == None:
    Vector = None
else:
    c=rs.AddPoint(0,0,0)
    f=math.radians(float(angle))
    l=rs.AddPoint(math.cos(f),math.sin(f),0)
    d=rs.VectorCreate(l,c)
    vector =rs.VectorUnitize(d)
# ---------- end vector_at_angle ----------
contour = Contour(Shape=boundary_surfaces, Point=Point(0, 0, 0), Direction=vector_at_angle, Distance=".5")

# ----
hatch_lines = Geometry(contour)
