# Grasshopper definition Point on Curve.gh (Grasshopper 1.0.7)

unit_y = UnitY(Factor=1)
line_sdl = LineSDL(Start="0,0,0", Direction=unit_y, Length="20")
line = Line(line_sdl)
end_points = EndPoints(Curve=line)  # -> Start, End
point = Point(end_points.End)
point_2 = Point(end_points.Start)

addition = Addition(A=point_2, B=point)
multiplication = Multiplication(A=addition, B=".5")

point_on_curve = Point(multiplication)
