# Grasshopper definition Wall_Geometry.gh (Grasshopper 1.0.7)

point = Point("0,0,0")
circle = Circle(Plane=point, Radius="60")
divide_curve = DivideCurve(Curve=circle, Count="8", Kinks=False)  # -> Points, Tangents, Parameters
list_of_points_on_circle = Point(divide_curve.Points)
list_subdivision = Panel("2")

# ---- group: wall
partition_list = PartitionList(List=list_of_points_on_circle, Size=list_subdivision)
list_item = ListItem(List=partition_list, Index="0", Wrap=True)  # -> flatten(Item)
polyline = PolyLine(Vertices=list_item, Closed=Toggle(True))

# ----
wall_polyline = Geometry(polyline)
