# Grasshopper definition Wall_Group.gh (Grasshopper 1.0.7)

drawing_cetner = Panel("0,0,0")
drawing_center = Plane(drawing_cetner)
circle = Circle(Plane=drawing_center, Radius="60")
divide_curve = DivideCurve(Curve=circle, Count="10", Kinks=False)  # -> Points, Tangents, Parameters
divisor_of_points = Integer("2")
list_of_points = Point(divide_curve.Points)

# ---- group: Outer wall
partition_list = PartitionList(List=list_of_points, Size=divisor_of_points)
list_item = ListItem(List=partition_list, Index="1", Wrap=True)
polyline = PolyLine(Vertices=flatten(list_item), Closed=Toggle(True))

# ----
exterior_wall = Geometry(polyline)
