# Grasshopper definition 01_Ericson_1_3.gh (Grasshopper 1.0.7)
# plug-ins: Human, LunchBox

variant = Panel("0")
# Variables + Controls
drawing_cetner = Panel("0,0,0")
circle_a_radius = Panel("60")
start = Panel("0")
total_degrees = Panel("360")
division = Panel("40")
polygon_a_sides = Panel("""2
3""")
scalar_for_wall_thickness = Panel("1.15")
exterior_wall_geometry = Panel("4")
division_2 = Division(A=total_degrees, B=division)
division_3 = Division(A=division, B=polygon_a_sides)
drawing_center = Plane(drawing_cetner)
series = Series(Start=start, Step=division_2, Count=division_3)
division_4 = Division(A=circle_a_radius, B=scalar_for_wall_thickness)
radians = Radians(Degrees=series)
rotate_plane = RotatePlane(Plane=drawing_center, Angle=radians)
# A
circle = Circle(Plane=rotate_plane, Radius=division_4)
list_item = ListItem(List=circle, Index=0, Wrap=True)
# Operations
divide_curve = DivideCurve(Curve=circle, Count=polygon_a_sides, Kinks=False)  # -> Points, Tangents, Parameters

# ---- group: Polyon Interior
list_item_2 = ListItem(List=flatten(list_item), Index=0, Wrap=True)
divide_curve_2 = DivideCurve(Curve=list_item_2, Count="6", Kinks=False)  # -> Points, Tangents, Parameters
polyline = PolyLine(Vertices=divide_curve_2.Points, Closed=Toggle(True))

# ----
scale = Scale(Geometry=list_item, Center=drawing_center, Factor=scalar_for_wall_thickness)  # -> Geometry, Transform
polyline_2 = PolyLine(Vertices=divide_curve.Points, Closed=Toggle(True))
divide_curve_3 = DivideCurve(Curve=scale.Geometry, Count=division_3, Kinks=False)  # -> Points, Tangents, Parameters
divisor_of_points = Integer(exterior_wall_geometry)
list_of_points = Point(flatten(divide_curve_3.Points))
line = Line(StartPoint=drawing_center, EndPoint=divide_curve.Points)

# ---- group: Outer wall
partition_list = PartitionList(List=list_of_points, Size=divisor_of_points)
list_item_3 = ListItem(List=partition_list, Index="0", Wrap=True)
polyline_3 = PolyLine(Vertices=flatten(list_item_3), Closed=Toggle(True))

# ---- group: dome
list_item_4 = ListItem(List=polyline_2, Index=0, Wrap=True)
explode = Explode(Curve=list_item_4, Recursive=True)  # -> Segments, Vertices
list_item_5 = ListItem(List=explode.Segments, Index=0, Wrap=True)
point_on_curve = PointOnCurve(list_item_5, parameter=0.5)
distance = Distance(PointA=point_on_curve, PointB=drawing_center)
circle_2 = Circle(Plane=drawing_center, Radius=distance)

# ----
explode_2 = Explode(Curve=polyline, Recursive=True)  # -> Segments, Vertices
point_on_curve_2 = PointOnCurve(explode_2.Segments, parameter=0.5)
exterior_wall = Geometry(polyline_3)
line_on_polygon = Line(explode_2.Segments)
center_of_niche = Point(point_on_curve_2)

rotate = Rotate(Geometry=line_on_polygon, Angle=degrees("90"), Plane=center_of_niche)  # -> Geometry, Transform
length = Length(Curve=line_on_polygon)
construct_plane = ConstructPlane(Origin=center_of_niche, XAxis=line_on_polygon, YAxis=rotate.Geometry)
division_5 = Division(A="90", B="3")
rotate_plane_2 = RotatePlane(Plane=construct_plane, Angle=degrees(division_5))
division_6 = Division(A=length, B="6")
polygon = Polygon(Plane=rotate_plane_2, Radius=division_6, Segments="3", FilletRadius=0)  # -> Polygon, Length

niche = Geometry(polygon.Polygon)
region_union = RegionUnion(Curves=flatten([polyline, niche]))
stream_filter = StreamFilter(Gate=variant, Stream0=list_item, Stream1=polyline, Stream2=region_union)

# ---- group: Wall thickness
boundary_surfaces = BoundarySurfaces(Edges=exterior_wall)
list_item_6 = ListItem(List=flatten(stream_filter), Index=0, Wrap=True)
# Output Geometry
curve = Curve(boundary_surfaces)
region_difference = RegionDifference(CurvesA=curve, CurvesB=list_item_6)

# ----
dome_above = Geometry(circle_2)
# B
# C
# Views
center_lines = Line(line)
panel = Panel("""1
.5""")
panel_2 = Panel("""1
.5
.5
.5""")
dash_pattern = DashPattern(Curve=dome_above, Pattern=panel)  # -> Dashes, Gaps
# D
# Line Type
dash_pattern_2 = DashPattern(Curve=center_lines, Pattern=panel_2)  # -> Dashes, Gaps

# ---- group: Hatch Group
boundary_surfaces_2 = BoundarySurfaces(Edges=region_difference)
vector_at_angle = PythonScript(angle="45")  # -> vector
# ---------- vector_at_angle: Python ----------
import rhinoscriptsyntax as rs
import math
if angle == None:
    Vector = None
else:
    c=rs.AddPoint(0,0,0)
    f=math.radians(float(angle))
    l=rs.AddPoint(math.cos(f),math.sin(f),0)
    d=rs.VectorCreate(l,c)
    vector =rs.VectorUnitize(d)
# ---------- end vector_at_angle ----------
contour = Contour(Shape=boundary_surfaces_2, Point=Point(0, 0, 0), Direction=vector_at_angle, Distance=".5")

# ----
dome_above_2 = Geometry(dash_pattern.Dashes)
centerlines_a = Geometry(dash_pattern_2.Dashes)
geometry = Geometry(region_difference)
point = Point(flatten(divide_curve.Points))
# E
# F
# Layers
circle_a = Geometry(circle)
point_2 = Point(drawing_center)
polygon_2 = Geometry(polyline_2)
cull_duplicates = CullDuplicates(Points=point, Tolerance=0.1, CullMode=3)  # -> Points, Indices, Valence

# ---- group: Preview and Bake
get_name = GhPythonScript(Component=circle_a)  # -> Geometry, Name
# ---------- get_name: Python ----------
# Mark Ericson 1.17.19
   #take from forum discussion thread https://www.grasshopper3d.com/forum/topics/python-get-label-name-of-input-components
    #edited version of code  by Mostapha Sadeghipour Roudsari

def GetComponentName():
    Comp = ghenv.Component.Params.Input[0]
    sources = Comp.Sources

    if sources.Count == 0: 
        return components

    for source in sources:
        attr = source.Attributes
        if (attr is None) or (attr.GetTopLevel is None):
            pass
        else:

            component = attr.GetTopLevel.DocObject
            componentName = component.NickName

            return componentName

if Component == None:
    pass
else:
    Name = GetComponentName()
    Geometry = Component
# ---------- end get_name ----------
linear_gradient = GhPythonScript(R="0", G="0", B="0", Percent=".5")  # -> Color
# ---------- linear_gradient: Python ----------
__author__ = "ericsonm"
__version__ = "2019.01.15"

import rhinoscriptsyntax as rs

def LinearColorGradient(R,G,B,R2,G2,B2,ColorPercentage):
    
    if ColorPercentage > 1:
        R3 = None
        G3 = None
        B3 = None
    else:
        #This function defines linear color gradient by treating R,G,B as coordinates on a 3D line.
        #The base color that will be altered by the percentage should be entered in the second R2,G2,B2 valu
    
        Rdiff = float(R2) - float(R)
        Gdiff = float(G2) - float(G)
        Bdiff = float(B2) - float(B)


        t = float(ColorPercentage)


        R3 = float(R) + Rdiff*t
        G3 = float(G) + Gdiff*t
        B3 = float(B) + Bdiff*t



    return R3,G3,B3


if (R or G or B or Percent) is None:
    Color = None
else: 
    Color1 = LinearColorGradient(255,255,255,R,G,B,Percent)

    R3 = Color1[0]
    G3 = Color1[1]
    B3 = Color1[2]

    Color = rs.CreateColor(R3,G3,B3)
# ---------- end linear_gradient ----------
custom_preview = CustomPreview(Geometry=get_name.Geometry, Material=linear_gradient)

# ----
panel_3 = Panel(get_name.Name)

# ---- group: Preview and Bake (continued)
object_bake = ObjectBake(
    BakeToggle=Button(),
    GeometryObjects=get_name.Geometry,
    Layer=panel_3,
    ObjectName=panel_3,
    ObjectColor=linear_gradient,
    LayerColor=linear_gradient)

# ----
# Preview and Bake
custom_preview_lineweights = CustomPreviewLineweights(Geometry=get_name.Geometry, Shader=linear_gradient, Thickness=".0025", Absolute=Toggle(True))

# ---- group: Preview and Bake
get_name_2 = GhPythonScript(Component=polygon_2)  # -> Geometry, Name; same code as get_name
linear_gradient_2 = GhPythonScript(R="0", G="0", B="0", Percent=".4")  # -> Color; same code as linear_gradient
custom_preview_2 = CustomPreview(Geometry=get_name_2.Geometry, Material=linear_gradient_2)

# ----
panel_4 = Panel(get_name_2.Name)

# ---- group: Preview and Bake (continued)
object_bake_2 = ObjectBake(
    BakeToggle=Button(),
    GeometryObjects=get_name_2.Geometry,
    Layer=panel_4,
    ObjectName=panel_4,
    ObjectColor=linear_gradient_2,
    LayerColor=linear_gradient_2)

# ----
custom_preview_lineweights_2 = CustomPreviewLineweights(Geometry=get_name_2.Geometry, Shader=linear_gradient_2, Thickness=".0025", Absolute=Toggle(True))

# ---- group: TEXT LABELS
text_size = Panel("1")
point_3 = Point(cull_duplicates.Points)
add_text = Panel("a")
linear_gradient_3 = GhPythonScript(R="0", G="0", B="0", Percent=".5")  # -> Color; same code as linear_gradient

# ----
scale_2 = Scale(Geometry=point_3, Center=point_2, Factor="1.025")  # -> Geometry, Transform

# ---- group: TEXT LABELS (continued)
list_length = ListLength(List=scale_2.Geometry)
series_2 = Series(Start=0, Step=1, Count=list_length)
integer = Integer(series_2)
concatenate = Concatenate(FragmentA=integer, FragmentB=add_text)
text_tag_3d = TextTag3D(Location=scale_2.Geometry, Text=concatenate, Size=text_size, Colour=linear_gradient_3, Justification=5)

# ---- group: Preview and Bake
get_name_3 = GhPythonScript(Component=centerlines_a)  # -> Geometry, Name; same code as get_name
linear_gradient_4 = GhPythonScript(R="0", G="0", B="0", Percent="1")  # -> Color; same code as linear_gradient
custom_preview_3 = CustomPreview(Geometry=get_name_3.Geometry, Material=linear_gradient_4)

# ----
panel_5 = Panel(get_name_3.Name)

# ---- group: Preview and Bake (continued)
object_bake_3 = ObjectBake(
    BakeToggle=Button(),
    GeometryObjects=get_name_3.Geometry,
    Layer=panel_5,
    ObjectName=panel_5,
    ObjectColor=linear_gradient_4,
    LayerColor=linear_gradient_4)

# ----
custom_preview_lineweights_3 = CustomPreviewLineweights(Geometry=get_name_3.Geometry, Shader=linear_gradient_4, Thickness=".0025", Absolute=Toggle(True))

# ---- group: Preview and Bake
get_name_4 = GhPythonScript(Component=dome_above_2)  # -> Geometry, Name; same code as get_name
linear_gradient_5 = GhPythonScript(R="0", G="0", B="0", Percent="1")  # -> Color; same code as linear_gradient
custom_preview_4 = CustomPreview(Geometry=get_name_4.Geometry, Material=linear_gradient_5)

# ----
panel_6 = Panel(get_name_4.Name)

# ---- group: Preview and Bake (continued)
object_bake_4 = ObjectBake(
    BakeToggle=Button(),
    GeometryObjects=get_name_4.Geometry,
    Layer=panel_6,
    ObjectName=panel_6,
    ObjectColor=linear_gradient_5,
    LayerColor=linear_gradient_5)

# ----
custom_preview_lineweights_4 = CustomPreviewLineweights(Geometry=get_name_4.Geometry, Shader=linear_gradient_5, Thickness=".1", Absolute=Toggle(True))

# ---- group: Preview and Bake
get_name_5 = GhPythonScript(Component=geometry)  # -> Geometry, Name; same code as get_name
linear_gradient_6 = GhPythonScript(R="0", G="0", B="0", Percent="1")  # -> Color; same code as linear_gradient
custom_preview_5 = CustomPreview(Geometry=get_name_5.Geometry, Material=linear_gradient_6)

# ----
panel_7 = Panel(get_name_5.Name)

# ---- group: Preview and Bake (continued)
object_bake_5 = ObjectBake(
    BakeToggle=Button(),
    GeometryObjects=get_name_5.Geometry,
    Layer=panel_7,
    ObjectName=panel_7,
    ObjectColor=linear_gradient_6,
    LayerColor=linear_gradient_6)

# ----
custom_preview_lineweights_5 = CustomPreviewLineweights(Geometry=get_name_5.Geometry, Shader=linear_gradient_6, Thickness=".1", Absolute=Toggle(True))

# ---- group: Preview and Bake
get_name_6 = GhPythonScript(Component=contour)  # -> Geometry, Name; same code as get_name
linear_gradient_7 = GhPythonScript(R="0", G="0", B="0", Percent="1")  # -> Color; same code as linear_gradient
custom_preview_6 = CustomPreview(Geometry=get_name_6.Geometry, Material=linear_gradient_7)

# ----
panel_8 = Panel(get_name_6.Name)

# ---- group: Preview and Bake (continued)
object_bake_6 = ObjectBake(
    BakeToggle=Button(),
    GeometryObjects=get_name_6.Geometry,
    Layer=panel_8,
    ObjectName=panel_8,
    ObjectColor=linear_gradient_7,
    LayerColor=linear_gradient_7)

# ----
custom_preview_lineweights_6 = CustomPreviewLineweights(Geometry=get_name_6.Geometry, Shader=linear_gradient_7, Thickness=".05", Absolute=Toggle(True))
