# Grasshopper definition 01_Ericson_1_3A_inclass.gh (Grasshopper 1.0.7)
# plug-ins: Human, LunchBox

polygon_a_sides = Panel("2")
interior_wall_options = Panel("3")
# Variables + Controls
drawing_cetner = Panel("0,0,0")
circle_a_radius = Panel("60")
start = Panel("0")
total_degrees = Panel("360")
wall_scalar = Panel("1.5")
exterior_wall_subdivision = Panel("2")
interior_wall_subdivision = Panel("2")
interior_wall_rotation = Panel("3")
exterior_wall_rotation = Panel("0")
division = Panel("12")
division_2 = Division(A=total_degrees, B=division)
division_3 = Division(A=division, B=polygon_a_sides)
drawing_center = Plane(drawing_cetner)
division_4 = Division(A=circle_a_radius, B=wall_scalar)
series = Series(Start=start, Step=division_2, Count=division_3)
radians = Radians(Degrees=series)
rotate_plane = RotatePlane(Plane=drawing_center, Angle=radians)
circle = Circle(Plane=rotate_plane, Radius=division_4)
list_item = ListItem(List=circle, Index=0, Wrap=True)
# A
divide_curve = DivideCurve(Curve=circle, Count=polygon_a_sides, Kinks=False)  # -> Points, Tangents, Parameters
polyline = PolyLine(Vertices=divide_curve.Points, Closed=Toggle(True))
# Operations
list_length = ListLength(List=flatten(divide_curve.Points))
number_of_points_on_inner_circle = Number(list_length)
scale = Scale(Geometry=list_item, Center=drawing_center, Factor=wall_scalar)  # -> Geometry, Transform
line = Line(StartPoint=drawing_center, EndPoint=divide_curve.Points)
divide_curve_2 = DivideCurve(Curve=scale.Geometry, Count=number_of_points_on_inner_circle, Kinks=False)  # -> Points, Tangents, Parameters
divide_curve_3 = DivideCurve(Curve=list_item, Count=number_of_points_on_inner_circle, Kinks=False)  # -> Points, Tangents, Parameters

# ---- group: dome
list_item_2 = ListItem(List=polyline, Index=0, Wrap=True)
explode = Explode(Curve=list_item_2, Recursive=True)  # -> Segments, Vertices
list_item_3 = ListItem(List=explode.Segments, Index=0, Wrap=True)
point_on_curve = PointOnCurve(list_item_3, parameter=0.5)
distance = Distance(PointA=point_on_curve, PointB=drawing_center)
circle_2 = Circle(Plane=drawing_center, Radius=distance)

# ----
list_of_points_on_circle = Point(divide_curve_2.Points)
list_of_points_on_circle_2 = Point(divide_curve_3.Points)

# ---- group: wall
partition_list = PartitionList(List=list_of_points_on_circle, Size=exterior_wall_subdivision)
panel = Panel(exterior_wall_rotation)
list_item_4 = ListItem(List=partition_list, Index=panel, Wrap=True)  # -> flatten(Item)
polyline_2 = PolyLine(Vertices=list_item_4, Closed=Toggle(True))

# ---- group: interior wall b
partition_list_2 = PartitionList(List=list_of_points_on_circle_2, Size=interior_wall_subdivision)
panel_2 = Panel(interior_wall_rotation)
list_item_5 = ListItem(List=partition_list_2, Index=panel_2, Wrap=True)  # -> flatten(Item)
polyline_3 = PolyLine(Vertices=list_item_5, Closed=Toggle(True))

# ----
wall_polyline = Geometry(polyline_2)
boundary_surfaces = BoundarySurfaces(Edges=wall_polyline)
wall_polyline_2 = Geometry(polyline_3)
explode_2 = Explode(Curve=wall_polyline_2, Recursive=True)  # -> Segments, Vertices

# ---- group: NICHE GROUP
panel_3 = Panel("""0
1""")
sift_pattern = SiftPattern(List=explode_2.Segments, SiftPattern=panel_3)  # -> Output0, Output1
list_length_2 = ListLength(List=explode_2.Segments)
multiplication = Multiplication(A="1", B=list_length_2)
multiplication_2 = Multiplication(A=list_length_2, B="6")
asides = Geometry(sift_pattern.Output0)
bsides = Geometry(sift_pattern.Output1)
niche = NICHE(niche_rotation="0", point_value=".5", polygon_side=bsides, niche_sides=multiplication_2, niche_prop="4")
niche_2 = NICHE(niche_rotation="0", point_value=".5", polygon_side=asides, niche_sides=multiplication, niche_prop="4")

# ----
niche_b = Geometry(niche)
niche_a = Geometry(niche_2)
region_union = RegionUnion(Curves=flatten([niche_a, niche_b, list_item]))
region_union_2 = RegionUnion(Curves=flatten([wall_polyline_2, niche_a, niche_b]))
exterior_wall = Curve(boundary_surfaces)
panel_4 = Panel("2")
stream_filter = StreamFilter(Gate=interior_wall_options, Stream0=list_item, Stream1=wall_polyline_2, Stream2=region_union_2, Stream3=region_union)
# B
# Output Geometry
region_difference = RegionDifference(CurvesA=exterior_wall, CurvesB=stream_filter)
dome_above = Geometry(circle_2)
# C
# Views
center_lines = Line(line)
panel_5 = Panel("""1
.5
.5
.5""")
panel_6 = Panel("""1
.5""")
# D
# Line Type
dash_pattern = DashPattern(Curve=center_lines, Pattern=panel_5)  # -> Dashes, Gaps
stream_filter_2 = StreamFilter(Gate=Toggle(True), Stream1=region_difference)
dash_pattern_2 = DashPattern(Curve=dome_above, Pattern=panel_6)  # -> Dashes, Gaps
brep = Brep(stream_filter_2)

# ---- group: Hatch Group
boundary_surfaces_2 = BoundarySurfaces(Edges=brep)
vector_at_angle = PythonScript(angle="45")  # -> vector
# ---------- vector_at_angle: Python ----------
import rhinoscriptsyntax as rs
import math
if angle == None:
    Vector = None
else:
    c=rs.AddPoint(0,0,0)
    f=math.radians(float(angle))
    l=rs.AddPoint(math.cos(f),math.sin(f),0)
    d=rs.VectorCreate(l,c)
    vector =rs.VectorUnitize(d)
# ---------- end vector_at_angle ----------
contour = Contour(Shape=boundary_surfaces_2, Point=Point(0, 0, 0), Direction=vector_at_angle, Distance="1")

# ----
dome_above_2 = Geometry(dash_pattern_2.Dashes)
centerlines_a = Geometry(dash_pattern.Dashes)
hatch_lines = Geometry(contour)
point = Point(flatten(divide_curve.Points))
# E
# F
# Layers
circle_a = Geometry(circle)
point_2 = Point(drawing_center)
geometry = Geometry(region_difference)
polygon = Geometry(polyline)

# ---- group: Preview and Bake
get_name = GhPythonScript(Component=polygon)  # -> Geometry, Name
# ---------- get_name: Python ----------
# Mark Ericson 1.17.19
   #take from forum discussion thread https://www.grasshopper3d.com/forum/topics/python-get-label-name-of-input-components
    #edited version of code  by Mostapha Sadeghipour Roudsari

def GetComponentName():
    Comp = ghenv.Component.Params.Input[0]
    sources = Comp.Sources

    if sources.Count == 0: 
        return components

    for source in sources:
        attr = source.Attributes
        if (attr is None) or (attr.GetTopLevel is None):
            pass
        else:

            component = attr.GetTopLevel.DocObject
            componentName = component.NickName

            return componentName

if Component == None:
    pass
else:
    Name = GetComponentName()
    Geometry = Component
# ---------- end get_name ----------
linear_gradient = GhPythonScript(R="0", G="0", B="0", Percent=".4")  # -> Color
# ---------- linear_gradient: Python ----------
__author__ = "ericsonm"
__version__ = "2019.01.15"

import rhinoscriptsyntax as rs

def LinearColorGradient(R,G,B,R2,G2,B2,ColorPercentage):
    
    if ColorPercentage > 1:
        R3 = None
        G3 = None
        B3 = None
    else:
        #This function defines linear color gradient by treating R,G,B as coordinates on a 3D line.
        #The base color that will be altered by the percentage should be entered in the second R2,G2,B2 valu
    
        Rdiff = float(R2) - float(R)
        Gdiff = float(G2) - float(G)
        Bdiff = float(B2) - float(B)


        t = float(ColorPercentage)


        R3 = float(R) + Rdiff*t
        G3 = float(G) + Gdiff*t
        B3 = float(B) + Bdiff*t



    return R3,G3,B3


if (R or G or B or Percent) is None:
    Color = None
else: 
    Color1 = LinearColorGradient(255,255,255,R,G,B,Percent)

    R3 = Color1[0]
    G3 = Color1[1]
    B3 = Color1[2]

    Color = rs.CreateColor(R3,G3,B3)
# ---------- end linear_gradient ----------
custom_preview = CustomPreview(Geometry=get_name.Geometry, Material=linear_gradient)

# ----
panel_7 = Panel(get_name.Name)

# ---- group: Preview and Bake (continued)
object_bake = ObjectBake(
    BakeToggle=Button(),
    GeometryObjects=get_name.Geometry,
    Layer=panel_7,
    ObjectName=panel_7,
    ObjectColor=linear_gradient,
    LayerColor=linear_gradient)

# ----
custom_preview_lineweights = CustomPreviewLineweights(Geometry=get_name.Geometry, Shader=linear_gradient, Thickness=".0025", Absolute=Toggle(True))

# ---- group: TEXT LABELS
text_size = Panel("1")
point_3 = Point(point)
add_text = Panel("a")
linear_gradient_2 = GhPythonScript(R="0", G="0", B="0", Percent=".5")  # -> Color; same code as linear_gradient

# ----
scale_2 = Scale(Geometry=point_3, Center=point_2, Factor="1.025")  # -> Geometry, Transform

# ---- group: TEXT LABELS (continued)
list_length_3 = ListLength(List=scale_2.Geometry)
series_2 = Series(Start=0, Step=1, Count=list_length_3)
integer = Integer(series_2)
concatenate = Concatenate(FragmentA=integer, FragmentB=add_text)
text_tag_3d = TextTag3D(Location=scale_2.Geometry, Text=concatenate, Size=text_size, Colour=linear_gradient_2, Justification=5)

# ---- group: Preview and Bake
get_name_2 = GhPythonScript(Component=hatch_lines)  # -> Geometry, Name; same code as get_name
linear_gradient_3 = GhPythonScript(R="0", G="0", B="0", Percent=".5")  # -> Color; same code as linear_gradient
custom_preview_2 = CustomPreview(Geometry=get_name_2.Geometry, Material=linear_gradient_3)

# ----
panel_8 = Panel(get_name_2.Name)

# ---- group: Preview and Bake (continued)
object_bake_2 = ObjectBake(
    BakeToggle=Button(),
    GeometryObjects=get_name_2.Geometry,
    Layer=panel_8,
    ObjectName=panel_8,
    ObjectColor=linear_gradient_3,
    LayerColor=linear_gradient_3)

# ----
custom_preview_lineweights_2 = CustomPreviewLineweights(Geometry=get_name_2.Geometry, Shader=linear_gradient_3, Thickness=".1", Absolute=Toggle(True))

# ---- group: Preview and Bake
# Preview and Bake
button = Button()
get_name_3 = GhPythonScript(Component=circle_a)  # -> Geometry, Name; same code as get_name
linear_gradient_4 = GhPythonScript(R="0", G="0", B="0", Percent=".5")  # -> Color; same code as linear_gradient
custom_preview_3 = CustomPreview(Geometry=get_name_3.Geometry, Material=linear_gradient_4)

# ----
panel_9 = Panel(get_name_3.Name)

# ---- group: Preview and Bake (continued)
object_bake_3 = ObjectBake(
    BakeToggle=button,
    GeometryObjects=get_name_3.Geometry,
    Layer=panel_9,
    ObjectName=panel_9,
    ObjectColor=linear_gradient_4,
    LayerColor=linear_gradient_4)

# ----
custom_preview_lineweights_3 = CustomPreviewLineweights(Geometry=get_name_3.Geometry, Shader=linear_gradient_4, Thickness=".0025", Absolute=Toggle(True))

# ---- group: Preview and Bake
get_name_4 = GhPythonScript(Component=centerlines_a)  # -> Geometry, Name; same code as get_name
linear_gradient_5 = GhPythonScript(R="0", G="0", B="0", Percent="1")  # -> Color; same code as linear_gradient
custom_preview_4 = CustomPreview(Geometry=get_name_4.Geometry, Material=linear_gradient_5)

# ----
panel_10 = Panel(get_name_4.Name)

# ---- group: Preview and Bake (continued)
object_bake_4 = ObjectBake(
    BakeToggle=Button(),
    GeometryObjects=get_name_4.Geometry,
    Layer=panel_10,
    ObjectName=panel_10,
    ObjectColor=linear_gradient_5,
    LayerColor=linear_gradient_5)

# ----
custom_preview_lineweights_4 = CustomPreviewLineweights(Geometry=get_name_4.Geometry, Shader=linear_gradient_5, Thickness=".0025", Absolute=Toggle(True))

# ---- group: Preview and Bake
get_name_5 = GhPythonScript(Component=dome_above_2)  # -> Geometry, Name; same code as get_name
linear_gradient_6 = GhPythonScript(R="0", G="0", B="0", Percent="1")  # -> Color; same code as linear_gradient
custom_preview_5 = CustomPreview(Geometry=get_name_5.Geometry, Material=linear_gradient_6)

# ----
panel_11 = Panel(get_name_5.Name)

# ---- group: Preview and Bake (continued)
object_bake_5 = ObjectBake(
    BakeToggle=Button(),
    GeometryObjects=get_name_5.Geometry,
    Layer=panel_11,
    ObjectName=panel_11,
    ObjectColor=linear_gradient_6,
    LayerColor=linear_gradient_6)

# ----
custom_preview_lineweights_5 = CustomPreviewLineweights(Geometry=get_name_5.Geometry, Shader=linear_gradient_6, Thickness=".1", Absolute=Toggle(True))

# ---- group: Preview and Bake
get_name_6 = GhPythonScript(Component=geometry)  # -> Geometry, Name; same code as get_name
linear_gradient_7 = GhPythonScript(R="0", G="0", B="0", Percent="1")  # -> Color; same code as linear_gradient
custom_preview_6 = CustomPreview(Geometry=get_name_6.Geometry, Material=linear_gradient_7)

# ----
panel_12 = Panel(get_name_6.Name)

# ---- group: Preview and Bake (continued)
object_bake_6 = ObjectBake(
    BakeToggle=Button(),
    GeometryObjects=get_name_6.Geometry,
    Layer=panel_12,
    ObjectName=panel_12,
    ObjectColor=linear_gradient_7,
    LayerColor=linear_gradient_7)

# ----
custom_preview_lineweights_6 = CustomPreviewLineweights(Geometry=get_name_6.Geometry, Shader=linear_gradient_7, Thickness=".1", Absolute=Toggle(True))

# ==== cluster NICHE
niche_prop = ClusterInput()
niche_rotation = ClusterInput()
point_value = ClusterInput()
polygon_side = ClusterInput()
niche_sides = ClusterInput()

niche_prop_2 = Number(niche_prop)
niche_rotation_2 = Number(niche_rotation)
point_value_2 = Number(point_value)
polygon_side_2 = Line(polygon_side)
niche_sides_2 = Number(niche_sides)
point_on = PointOn(line=polygon_side_2, number=point_value_2)
rotate = Rotate(Geometry=polygon_side_2, Angle=degrees("90"), Plane=point_on)  # -> Geometry, Transform
construct_plane = ConstructPlane(Origin=point_on, XAxis=polygon_side_2, YAxis=rotate.Geometry)
length = Length(Curve=polygon_side_2)
rotate_2 = Rotate(Geometry=construct_plane, Angle=degrees(niche_rotation_2), Plane=point_on)  # -> Geometry, Transform
division = Division(A=length, B=niche_prop_2)
polygon = Polygon(Plane=rotate_2.Geometry, Radius=division, Segments=niche_sides_2, FilletRadius=0)  # -> Polygon, Length
niche = Geometry(polygon.Polygon)

niche_2 = ClusterOutput(niche)

# ==== cluster PointOn
line = ClusterInput()
number = ClusterInput()

line_2 = Line(line)
number_2 = Number(number)
end_points = EndPoints(Curve=line_2)  # -> Start, End
addition = Addition(A=end_points.Start, B=end_points.End)
multiplication = Multiplication(A=addition, B=number_2)

result = ClusterOutput(multiplication)
