# Grasshopper definition NICHE CLUSTER.gh (Grasshopper 1.0.7)

niche = NICHE()

# ==== cluster NICHE
niche_prop = ClusterInput()
niche_rotation = ClusterInput()
point_value = ClusterInput()
polygon_side = ClusterInput()
niche_sides = ClusterInput()

niche_prop_2 = Number(niche_prop)
niche_rotation_2 = Number(niche_rotation)
point_value_2 = Number(point_value)
polygon_side_2 = Line(polygon_side)
niche_sides_2 = Number(niche_sides)
point_on = PointOn(line=polygon_side_2, number=point_value_2)
rotate = Rotate(Geometry=polygon_side_2, Angle=degrees("90"), Plane=point_on)  # -> Geometry, Transform
construct_plane = ConstructPlane(Origin=point_on, XAxis=polygon_side_2, YAxis=rotate.Geometry)
length = Length(Curve=polygon_side_2)
rotate_2 = Rotate(Geometry=construct_plane, Angle=degrees(niche_rotation_2), Plane=point_on)  # -> Geometry, Transform
division = Division(A=length, B=niche_prop_2)
polygon = Polygon(Plane=rotate_2.Geometry, Radius=division, Segments=niche_sides_2, FilletRadius=0)  # -> Polygon, Length
niche = Geometry(polygon.Polygon)

niche_2 = ClusterOutput(niche)

# ==== cluster PointOn
line = ClusterInput()
number = ClusterInput()

line_2 = Line(line)
number_2 = Number(number)
end_points = EndPoints(Curve=line_2)  # -> Start, End
addition = Addition(A=end_points.Start, B=end_points.End)
multiplication = Multiplication(A=addition, B=number_2)

result = ClusterOutput(multiplication)
