# Grasshopper definition Niche Group.gh (Grasshopper 1.0.7)

polygon = Polygon(Plane=PlaneXY(0, 0, 0), Radius="20", Segments=6, FilletRadius=0)  # -> Polygon, Length
explode = Explode(Curve=polygon.Polygon, Recursive=True)  # -> Segments, Vertices
line = Line(explode.Segments)
end_points = EndPoints(Curve=line)  # -> Start, End
point = Point(end_points.Start)
point_2 = Point(end_points.End)

# ---- group: point on curve
addition = Addition(A=point, B=point_2)
multiplication = Multiplication(A=addition, B=".5")

# ----
point_on_curve = Point(multiplication)
line_on_polygon = Line(line)
center_of_niche = Point(point_on_curve)
cluster = Cluster(
    polygon_sides="4",
    divisor_of_niche_ratio="4",
    angle_of_niche_rotation="45",
    polygon_side=line_on_polygon,
    center_of_niche=center_of_niche)
niche = Geometry(cluster)

perpendicular = GhPythonScript(line=line_on_polygon)  # -> Perp; inputs line: Line; same code as perpendicular
length = Length(Curve=line_on_polygon)
construct_plane = ConstructPlane(Origin=center_of_niche, XAxis=line_on_polygon, YAxis=perpendicular)
division = Division(A=length, B="4")
rotate = Rotate(Geometry=construct_plane, Angle=degrees("45"), Plane=center_of_niche)  # -> Geometry, Transform
polygon_2 = Polygon(Plane=rotate.Geometry, Radius=division, Segments="4", FilletRadius=0)  # -> Polygon, Length

niche_2 = Geometry(polygon_2.Polygon)
consecutive_domains = ConsecutiveDomains(Numbers=[0, 0.5, 1, 1.5, 2], Additive=True)

# ==== cluster Cluster
polygon_side = ClusterInput()
polygon_sides = ClusterInput()
divisor_of_niche_ratio = ClusterInput()
center_of_niche = ClusterInput()
angle_of_niche_rotation = ClusterInput()

perpendicular = GhPythonScript(line=polygon_side)  # -> Perp; inputs line: Line
# ---------- perpendicular: Python ----------
__author__ = "mericson"
__version__ = "2019.01.11"

import rhinoscriptsyntax as rs
import math
import Rhino as rh

if line == None:
    line = None
else:
    a = 0,0,0
    b = 0,0,1
    Z = rs.VectorCreate(a,b)
    c = rh.Geometry.Line.PointAt(line,1)
    d = rh.Geometry.Line.PointAt(line,0)
    vector2 = rs.VectorCreate(c,d)
    Perp = rs.VectorRotate(vector2,90,Z)
# ---------- end perpendicular ----------
length = Length(Curve=polygon_side)
construct_plane = ConstructPlane(Origin=center_of_niche, XAxis=polygon_side, YAxis=perpendicular)
division = Division(A=length, B=divisor_of_niche_ratio)
rotate = Rotate(Geometry=construct_plane, Angle=degrees(angle_of_niche_rotation), Plane=center_of_niche)  # -> Geometry, Transform
polygon = Polygon(Plane=rotate.Geometry, Radius=division, Segments=polygon_sides, FilletRadius=0)  # -> Polygon, Length

polygon_2 = ClusterOutput(polygon.Polygon)
