# Grasshopper definition Point on Curve.gh (Grasshopper 1.0.7)

unit_y = UnitY(Factor=1)
unit_y_2 = UnitY(Factor=1)
line_sdl = LineSDL(Start="0,0,0", Direction=unit_y, Length="20")
line_sdl_2 = LineSDL(Start="0,0,0", Direction=unit_y_2, Length="20")
line = Line(line_sdl)
line_2 = Line(line_sdl_2)
point_value = Number(".5")

# ---- group: point on curv
end_points = EndPoints(Curve=line)  # -> Start, End
panel = Panel(point_value)
point = Point(end_points.Start)
point_2 = Point(end_points.End)
addition = Addition(A=point, B=point_2)
multiplication = Multiplication(A=addition, B=panel)

# ----
cluster = Cluster(curve=line_2, point_value=".5")
point_on_curve = Point(multiplication)
point_on_curve_2 = Point(cluster)

# ==== cluster Cluster
point_value = ClusterInput()
curve = ClusterInput()
point_value_2 = Number(point_value)

# ---- group: point on curv
end_points = EndPoints(Curve=curve)  # -> Start, End
panel = Panel(point_value_2)
point = Point(end_points.Start)
point_2 = Point(end_points.End)
addition = Addition(A=point, B=point_2)
multiplication = Multiplication(A=addition, B=panel)

# ----
result = ClusterOutput(multiplication)
