# Grasshopper definition Point on.gh (Grasshopper 1.0.7)

unit_y = UnitY(Factor=1)
unit_y_2 = UnitY(Factor=1)
unit_y_3 = UnitY(Factor=1)
# Dummy
line_sdl = LineSDL(Start="0,0,0", Direction=unit_y, Length="10")
# Dummy
line_sdl_2 = LineSDL(Start="0,0,0", Direction=unit_y_2, Length="10")
# Dummy
line_sdl_3 = LineSDL(Start="0,0,0", Direction=unit_y_3, Length="10")

line = Line(line_sdl)
number = Number(".5")
end_points = EndPoints(Curve=line)  # -> Start, End
addition = Addition(A=end_points.Start, B=end_points.End)
multiplication = Multiplication(A=addition, B=number)
point = Point(multiplication)

line_2 = Line(line_sdl_2)
line_3 = Line(line_sdl_3)
number_2 = Number(".5")
end_points_2 = EndPoints(Curve=line_2)  # -> Start, End
addition_2 = Addition(A=end_points_2.Start, B=end_points_2.End)
point_on = PointOn(line=line_3, number=number_2)
multiplication_2 = Multiplication(A=addition_2, B=".5")
point_2 = Point(multiplication_2)
point_3 = Point(point_on)

# ==== cluster PointOn
line = ClusterInput()
number = ClusterInput()

line_2 = Line(line)
number_2 = Number(number)
end_points = EndPoints(Curve=line_2)  # -> Start, End
addition = Addition(A=end_points.Start, B=end_points.End)
multiplication = Multiplication(A=addition, B=number_2)
point = Point(multiplication)

point_2 = ClusterOutput(point)
