# Grasshopper definition niche_inclass.gh (Grasshopper 1.0.7)

unit_y = UnitY(Factor=1)
xy_plane = XYPlane(Origin=Point(0, 0, 0))
# dummy!!
line_sdl = LineSDL(Start="0,0,0", Direction=unit_y, Length="20")
polygon = Polygon(Plane=xy_plane, Radius="60", Segments="6", FilletRadius=0)  # -> Polygon, Length
explode = Explode(Curve=polygon.Polygon, Recursive=True)  # -> Segments, Vertices

# ---- group: NICHE GROUP
panel = Panel("""0
1""")
sift_pattern = SiftPattern(List=explode.Segments, SiftPattern=panel)  # -> Output0, Output1
list_length = ListLength(List=explode.Segments)
multiplication = Multiplication(A="1", B=list_length)
multiplication_2 = Multiplication(A=list_length, B="6")
bsides = Geometry(sift_pattern.Output1)
asides = Geometry(sift_pattern.Output0)
niche = NICHE(niche_rotation="0", point_value=".5", polygon_side=asides, niche_sides=multiplication, niche_prop="4")
niche_2 = NICHE(niche_rotation="0", point_value=".5", polygon_side=bsides, niche_sides=multiplication_2, niche_prop="4")

# ----
niche_b = Geometry(niche_2)
niche_a = Geometry(niche)

# ==== cluster NICHE
niche_prop = ClusterInput()
niche_rotation = ClusterInput()
point_value = ClusterInput()
polygon_side = ClusterInput()
niche_sides = ClusterInput()

niche_prop_2 = Number(niche_prop)
niche_rotation_2 = Number(niche_rotation)
point_value_2 = Number(point_value)
polygon_side_2 = Line(polygon_side)
niche_sides_2 = Number(niche_sides)
point_on = PointOn(line=polygon_side_2, number=point_value_2)
rotate = Rotate(Geometry=polygon_side_2, Angle=degrees("90"), Plane=point_on)  # -> Geometry, Transform
construct_plane = ConstructPlane(Origin=point_on, XAxis=polygon_side_2, YAxis=rotate.Geometry)
length = Length(Curve=polygon_side_2)
rotate_2 = Rotate(Geometry=construct_plane, Angle=degrees(niche_rotation_2), Plane=point_on)  # -> Geometry, Transform
division = Division(A=length, B=niche_prop_2)
polygon = Polygon(Plane=rotate_2.Geometry, Radius=division, Segments=niche_sides_2, FilletRadius=0)  # -> Polygon, Length
niche = Geometry(polygon.Polygon)

niche_2 = ClusterOutput(niche)

# ==== cluster PointOn
line = ClusterInput()
number = ClusterInput()

line_2 = Line(line)
number_2 = Number(number)
end_points = EndPoints(Curve=line_2)  # -> Start, End
addition = Addition(A=end_points.Start, B=end_points.End)
multiplication = Multiplication(A=addition, B=number_2)

result = ClusterOutput(multiplication)
