# Grasshopper definition Perpendicular to sideGroup.gh (Grasshopper 1.0.7)

division = Division(A="360", B="12")
xy_plane = XYPlane(Origin=Point(0, 0, 0))
series = Series(Start=0, Step=division, Count="12")
circle = Circle(Plane=xy_plane, Radius="60")
rotate_plane = RotatePlane(Plane=xy_plane, Angle=degrees(series))
polygon = Polygon(Plane=rotate_plane, Radius="60", Segments="4", FilletRadius=0)  # -> Polygon, Length

# ---- group: get polygon edge
list_item = ListItem(List=polygon.Polygon, Index=0, Wrap=True)
explode = Explode(Curve=list_item, Recursive=True)  # -> Segments, Vertices
list_item_2 = ListItem(List=explode.Segments, Index="0", Wrap=True)

# ----
line = Line(list_item_2)

# ---- group: perpendicular plane
point_on_curve = PointOnCurve(line, parameter=1)
point_on_curve_2 = PointOnCurve(line, parameter=0)
reverse = Reverse(Vector=line)
perpendicular = GhPythonScript(line=line)  # -> Perp; inputs line: Line
# ---------- perpendicular: Python ----------
__author__ = "mericson"
__version__ = "2019.01.11"

import rhinoscriptsyntax as rs
import math
import Rhino as rh

if line == None:
    line = None
else:
    a = 0,0,0
    b = 0,0,1
    Z = rs.VectorCreate(a,b)
    c = rh.Geometry.Line.PointAt(line,1)
    d = rh.Geometry.Line.PointAt(line,0)
    vector2 = rs.VectorCreate(c,d)
    Perp = rs.VectorRotate(vector2,90,Z)
# ---------- end perpendicular ----------
construct_plane = ConstructPlane(Origin=[point_on_curve_2, point_on_curve], XAxis=[line, reverse], YAxis=perpendicular)
