# Grasshopper definition Rail Revolve Group_Inclass.gh (Grasshopper 1.0.7)

# ---- group: dummy plan
panel = Panel("0,0,0")
circle = Circle(Plane=panel, Radius="60")
polygon = Polygon(Plane=panel, Radius="60", Segments="5", FilletRadius=0)  # -> Polygon, Length
divide_curve = DivideCurve(Curve=circle, Count="2", Kinks=False)  # -> Points, Tangents, Parameters
list_item = ListItem(List=divide_curve.Points, Index="0", Wrap=True)
line = Line(StartPoint=panel, EndPoint=list_item)

# ----
line_2 = Line(line)
center_of_drawing = Point(panel)
rail = Geometry(polygon.Polygon)

# ---- group: Perpendicular to Section line
end_points = EndPoints(Curve=line_2)  # -> Start, End
reverse = Reverse(Vector=line_2)
perpendicular = GhPythonScript(line=line_2)  # -> Perp; inputs line: Line
# ---------- perpendicular: Python ----------
__author__ = "mericson"
__version__ = "2019.01.11"

import rhinoscriptsyntax as rs
import math
import Rhino as rh

if line == None:
    line = None
else:
    a = 0,0,0
    b = 0,0,1
    Z = rs.VectorCreate(a,b)
    c = rh.Geometry.Line.PointAt(line,1)
    d = rh.Geometry.Line.PointAt(line,0)
    vector2 = rs.VectorCreate(c,d)
    Perp = rs.VectorRotate(vector2,90,Z)
# ---------- end perpendicular ----------
construct_plane = ConstructPlane(Origin=[end_points.Start, end_points.End], XAxis=[line_2, reverse], YAxis=perpendicular)

# ----
line_3 = Line(line_2)
plane = Plane(construct_plane)
vector = Vector(perpendicular)
plane_2 = Plane(plane)
number = Number(".5")

# ---- group: 2d section
length = Length(Curve=line_3)
multiplication = Multiplication(A=length, B=number)
line_sdl = LineSDL(Start=plane_2, Direction=vector, Length=multiplication)
list_item_2 = ListItem(List=plane_2, Index="1", Wrap=True)
point_on_curve = PointOnCurve(line_sdl, parameter=0)
move = Move(Geometry=plane_2, Motion=line_sdl)  # -> Geometry, Transform
list_item_3 = ListItem(List=point_on_curve, Index=0, Wrap=True)
distance = Distance(PointA=list_item_3, PointB=list_item_2)
radians = Radians(Degrees="90")
arc = Arc(Plane=move.Geometry, Radius=distance, Angle=radians)  # -> Arc, Length
list_item_4 = ListItem(List=line_sdl, Index="1", Wrap=True)
list_item_5 = ListItem(List=arc.Arc, Index=0, Wrap=True)
join_curves = JoinCurves(Curves=[list_item_4, list_item_5], Preserve=False)

# ----
section = Geometry(join_curves)

# ---- group: rail revolve
section_2 = Geometry(section)
line_4 = Line(line_2)
rail_2 = Geometry(rail)
point = Point(center_of_drawing)
point_on_curve_2 = PointOnCurve(line_4, parameter=0.5)
reverse_2 = Reverse(Vector=line_4)
rotate_3d = Rotate3D(Geometry=section_2, Angle=degrees("90"), Center=point_on_curve_2, Axis=reverse_2)  # -> Geometry, Transform
unit_z = UnitZ(Factor=1)
line_sdl_2 = LineSDL(Start=point, Direction=unit_z, Length=1)
rail_revolution = RailRevolution(Curve=rotate_3d.Geometry, Rail=rail_2, Axis=line_sdl_2, Scale=False)

# ----
brep = Brep(rail_revolution)
