# Grasshopper definition Surface Group.gh (Grasshopper 1.0.7)

division = Division(A="360", B="12")
xy_plane = XYPlane(Origin=Point(0, 0, 0))
series = Series(Start=0, Step=division, Count="12")
circle = Circle(Plane=xy_plane, Radius="60")
rotate_plane = RotatePlane(Plane=xy_plane, Angle=degrees(series))
polygon = Polygon(Plane=rotate_plane, Radius="60", Segments="4", FilletRadius=0)  # -> Polygon, Length

# ---- group: get polygon edge
list_item = ListItem(List=polygon.Polygon, Index=0, Wrap=True)
explode = Explode(Curve=list_item, Recursive=True)  # -> Segments, Vertices
list_item_2 = ListItem(List=explode.Segments, Index="0", Wrap=True)

# ----
line = Line(list_item_2)

# ---- group: perpendicular plane
point_on_curve = PointOnCurve(line, parameter=1)
point_on_curve_2 = PointOnCurve(line, parameter=0)
reverse = Reverse(Vector=line)
perpendicular = GhPythonScript(line=line)  # -> Perp; inputs line: Line
# ---------- perpendicular: Python ----------
__author__ = "mericson"
__version__ = "2019.01.11"

import rhinoscriptsyntax as rs
import math
import Rhino as rh

if line == None:
    line = None
else:
    a = 0,0,0
    b = 0,0,1
    Z = rs.VectorCreate(a,b)
    c = rh.Geometry.Line.PointAt(line,1)
    d = rh.Geometry.Line.PointAt(line,0)
    vector2 = rs.VectorCreate(c,d)
    Perp = rs.VectorRotate(vector2,90,Z)
# ---------- end perpendicular ----------
construct_plane = ConstructPlane(Origin=[point_on_curve_2, point_on_curve], XAxis=[line, reverse], YAxis=perpendicular)

# ----
plane = Plane(construct_plane)
vector = Vector(perpendicular)
number = Number("4")
line_2 = Line(line)

# ---- group: 2D sections
end_points = EndPoints(Curve=line_2)  # -> Start, End
distance = Distance(PointA=end_points.Start, PointB=end_points.End)
division_2 = Division(A=distance, B=number)
line_sdl = LineSDL(Start=[end_points.Start, end_points.End], Direction=vector, Length=division_2)
radians = Radians(Degrees="60")
move = Move(Geometry=plane, Motion=line_sdl)  # -> Geometry, Transform
arc = Arc(Plane=move.Geometry, Radius=distance, Angle=radians)  # -> Arc, Length
join_curves = JoinCurves(Curves=[line_sdl, arc.Arc], Preserve=False)

# ----
geometry = Geometry(join_curves)

# ---- group: 3D Sections
point = Point(xy_plane)
number_2 = Number("12")
line_3 = Line(line_2)
point_on_curve_3 = PointOnCurve(line_3, parameter=0.5)
reverse_2 = Reverse(Vector=line_3)
rotate_3d = Rotate3D(Geometry=geometry, Angle=degrees("90"), Center=point_on_curve_3, Axis=reverse_2)  # -> Geometry, Transform
point_on_curve_4 = PointOnCurve(rotate_3d.Geometry, parameter=0.5)
division_3 = Division(A=number_2, B="2")
polar_array = PolarArray(Geometry=rotate_3d.Geometry, Plane=point, Count=division_3, Angle=degrees("360"))  # -> Geometry, Transform
point_2 = Point(point_on_curve_4)

# ----
top_point_of_vault = Point(point_2)

# ---- group: get maximum z
deconstruct = Deconstruct(Point=top_point_of_vault)  # -> XComponent, YComponent, ZComponent

# ---- group: Surface
number_of_polygons = Number(number_2)
geometry_2 = Geometry(polar_array.Geometry)
number_3 = Number("20")
maximum_z = Number(deconstruct.ZComponent)
division_4 = Division(A=maximum_z, B=number_3)
series_2 = Series(Start=0, Step=division_4, Count=number_3)
xy_plane_2 = XYPlane(Origin=Point(0, 0, 0))
unit_z = UnitZ(Factor=graft(series_2))
move_2 = Move(Geometry=xy_plane_2, Motion=unit_z)  # -> Geometry, Transform
panel = Panel(number_of_polygons)
curve_plane = CurvePlane(Curve=flatten(geometry_2), Plane=move_2.Geometry)  # -> flatten(Points), ParamsC, ParamsP
partition_list = PartitionList(List=curve_plane.Points, Size=panel)
convex_hull = ConvexHull(Points=partition_list, Plane=move_2.Geometry)  # -> Hull, HullZ, Indices
curve = Curve(convex_hull.Hull)
loft = Loft(Curves=flatten(curve), Options={Adjust=False, Closed=False, LoftEnds=0, LoftSimp=0, LoftType=0, Rebuild=10, Refit=0.01})

# ----
brep = Brep(loft)
