# Grasshopper definition 01_Ericson_1_3_inclass.gh (Grasshopper 1.0.7)
# plug-ins: Human, LunchBox

polygon_a_sides = Panel("2")
# Variables + Controls
drawing_cetner = Panel("0,0,0")
circle_a_radius = Panel("60")
start = Panel("0")
total_degrees = Panel("360")
wall_scalar = Panel("1.3")
exterior_wall_subdivision = Panel("2")
exterior_wall_rotation = Panel("0")
interior_wall_options = Panel("2")
interior_wall_subdivision = Panel("2")
interior_wall_rotation = Panel("2")
division = Panel("12")
angle_of_niche_rotation = Panel("""5
10
15
25
30""")
niche_proportion_divisor = Panel("""4
2
1.5
3
2""")
niche_sides = Panel("""4
5
5
4
4""")
division_2 = Division(A=total_degrees, B=division)
division_3 = Division(A=division, B=polygon_a_sides)
drawing_center = Plane(drawing_cetner)
division_4 = Division(A=circle_a_radius, B=wall_scalar)
series = Series(Start=start, Step=division_2, Count=division_3)
radians = Radians(Degrees=series)
rotate_plane = RotatePlane(Plane=drawing_center, Angle=radians)
circle = Circle(Plane=rotate_plane, Radius=division_4)
list_item = ListItem(List=circle, Index=0, Wrap=True)
divide_curve = DivideCurve(Curve=circle, Count=polygon_a_sides, Kinks=False)  # -> Points, Tangents, Parameters
polyline = PolyLine(Vertices=divide_curve.Points, Closed=Toggle(True))
list_length = ListLength(List=flatten(divide_curve.Points))
# A
list_item_2 = ListItem(List=flatten(divide_curve.Points), Index=0, Wrap=True)
number_of_points_on_inner_circle = Number(list_length)
scale = Scale(Geometry=list_item, Center=drawing_center, Factor=wall_scalar)  # -> Geometry, Transform
# Operations
line = Line(StartPoint=circle, EndPoint=list_item_2)
line_2 = Line(StartPoint=drawing_center, EndPoint=divide_curve.Points)
divide_curve_2 = DivideCurve(Curve=scale.Geometry, Count=number_of_points_on_inner_circle, Kinks=False)  # -> Points, Tangents, Parameters
divide_curve_3 = DivideCurve(Curve=list_item, Count=number_of_points_on_inner_circle, Kinks=False)  # -> Points, Tangents, Parameters

# ---- group: SECTION LINE B
list_item_3 = ListItem(List=divide_curve_2.Points, Index=0, Wrap=True)
line_3 = Line(StartPoint=scale.Geometry, EndPoint=list_item_3)

# ---- group: dome
list_item_4 = ListItem(List=polyline, Index=0, Wrap=True)
explode = Explode(Curve=list_item_4, Recursive=True)  # -> Segments, Vertices
list_item_5 = ListItem(List=explode.Segments, Index=0, Wrap=True)
point_on_curve = PointOnCurve(list_item_5, parameter=0.5)
distance = Distance(PointA=point_on_curve, PointB=drawing_center)
circle_2 = Circle(Plane=drawing_center, Radius=distance)

# ----
list_of_points_on_circle = Point(divide_curve_2.Points)
list_of_points_on_circle_2 = Point(divide_curve_3.Points)

# ---- group: wall
partition_list = PartitionList(List=list_of_points_on_circle, Size=exterior_wall_subdivision)
panel = Panel(exterior_wall_rotation)
list_item_6 = ListItem(List=partition_list, Index=panel, Wrap=True)  # -> flatten(Item)
polyline_2 = PolyLine(Vertices=list_item_6, Closed=Toggle(True))

# ---- group: interior wall b
partition_list_2 = PartitionList(List=list_of_points_on_circle_2, Size=interior_wall_subdivision)
panel_2 = Panel(interior_wall_rotation)
list_item_7 = ListItem(List=partition_list_2, Index=panel_2, Wrap=True)  # -> flatten(Item)
polyline_3 = PolyLine(Vertices=list_item_7, Closed=Toggle(True))

# ----
wall_polyline = Geometry(polyline_2)
wall_polyline_2 = Geometry(polyline_3)

# ---- group: niche
explode_2 = Explode(Curve=wall_polyline_2, Recursive=True)  # -> Segments, Vertices
point_on_line = PointOnLine(curve=explode_2.Segments, point_value=".5")
niche = Niche(
    polygon_sides=niche_sides,
    divisor_of_niche_ratio=niche_proportion_divisor,
    angle_of_niche_rotation=angle_of_niche_rotation,
    polygon_side=explode_2.Segments,
    center_of_niche=point_on_line)

# ----
boundary_surfaces = BoundarySurfaces(Edges=wall_polyline)
region_union = RegionUnion(Curves=flatten([wall_polyline_2, niche]))
exterior_wall = Curve(boundary_surfaces)
stream_filter = StreamFilter(Gate=interior_wall_options, Stream0=list_item, Stream1=wall_polyline_2, Stream2=region_union)
region_difference = RegionDifference(CurvesA=exterior_wall, CurvesB=stream_filter)
list_item_8 = ListItem(List=line, Index=0, Wrap=True)
unit_z = UnitZ(Factor=1)
# B
# Output Geometry
deconstruct_arc = DeconstructArc(Arc=circle)  # -> BasePlane, Radius, Angle
# C
# Views
list_item_9 = ListItem(List=deconstruct_arc.Radius, Index=0, Wrap=True)
dome_above = Geometry(circle_2)
center_lines = Line(line_2)
panel_3 = Panel("""1
.5
.5
.5""")
panel_4 = Panel("""1
.5""")
# D
# Line Type
dash_pattern = DashPattern(Curve=center_lines, Pattern=panel_3)  # -> Dashes, Gaps
stream_filter_2 = StreamFilter(Gate=Toggle(True), Stream1=region_difference)
dash_pattern_2 = DashPattern(Curve=dome_above, Pattern=panel_4)  # -> Dashes, Gaps
brep = Brep(stream_filter_2)

# ---- group: Hatch Group
boundary_surfaces_2 = BoundarySurfaces(Edges=brep)
vector_at_angle = PythonScript(angle="45")  # -> vector
# ---------- vector_at_angle: Python ----------
import rhinoscriptsyntax as rs
import math
if angle == None:
    Vector = None
else:
    c=rs.AddPoint(0,0,0)
    f=math.radians(float(angle))
    l=rs.AddPoint(math.cos(f),math.sin(f),0)
    d=rs.VectorCreate(l,c)
    vector =rs.VectorUnitize(d)
# ---------- end vector_at_angle ----------
contour = Contour(Shape=boundary_surfaces_2, Point=Point(0, 0, 0), Direction=vector_at_angle, Distance="1")

# ----
dome_above_2 = Geometry(dash_pattern_2.Dashes)
centerlines_a = Geometry(dash_pattern.Dashes)
point = Point(flatten(divide_curve.Points))
hatch_lines = Geometry(contour)
# E
# F
# Layers
circle_a = Geometry(circle)
point_2 = Point(drawing_center)
geometry = Geometry(region_difference)
polygon = Geometry(polyline)

center_of_drawing = Point(drawing_center)
rail = Geometry(stream_filter)
sect_line = Line(list_item_8)
line_4 = Line(sect_line)
number = Number(".5")

# ---- group: Perpendicular to Section line
end_points = EndPoints(Curve=sect_line)  # -> Start, End
reverse = Reverse(Vector=sect_line)
perpendicular = GhPythonScript(line=sect_line)  # -> Perp; inputs line: Line; same code as perpendicular
construct_plane = ConstructPlane(Origin=[end_points.Start, end_points.End], XAxis=[sect_line, reverse], YAxis=perpendicular)

# ----
center_of_drawing_2 = Point(drawing_center)
rail_2 = Geometry(exterior_wall)
sect_line_2 = Line(line_3)
line_5 = Line(sect_line_2)
number_2 = Number(".5")

# ---- group: Perpendicular to Section line
end_points_2 = EndPoints(Curve=sect_line_2)  # -> Start, End
reverse_2 = Reverse(Vector=sect_line_2)
perpendicular_2 = GhPythonScript(line=sect_line_2)  # -> Perp; inputs line: Line; same code as perpendicular
construct_plane_2 = ConstructPlane(Origin=[end_points_2.Start, end_points_2.End], XAxis=[sect_line_2, reverse_2], YAxis=perpendicular_2)

# ----
plane = Plane(construct_plane)
vector = Vector(perpendicular)
plane_2 = Plane(plane)

# ---- group: 2d section
length = Length(Curve=line_4)
multiplication = Multiplication(A=length, B=number)
line_sdl = LineSDL(Start=plane_2, Direction=vector, Length=multiplication)
list_item_10 = ListItem(List=plane_2, Index="1", Wrap=True)
point_on_curve_2 = PointOnCurve(line_sdl, parameter=0)
move = Move(Geometry=plane_2, Motion=line_sdl)  # -> Geometry, Transform
list_item_11 = ListItem(List=point_on_curve_2, Index=0, Wrap=True)
distance_2 = Distance(PointA=list_item_11, PointB=list_item_10)
radians_2 = Radians(Degrees="90")
arc = Arc(Plane=move.Geometry, Radius=distance_2, Angle=radians_2)  # -> Arc, Length
list_item_12 = ListItem(List=line_sdl, Index="1", Wrap=True)
list_item_13 = ListItem(List=arc.Arc, Index=0, Wrap=True)
join_curves = JoinCurves(Curves=[list_item_12, list_item_13], Preserve=False)

# ----
plane_3 = Plane(construct_plane_2)
vector_2 = Vector(perpendicular_2)
plane_4 = Plane(plane_3)

# ---- group: 2d section
length_2 = Length(Curve=line_5)
multiplication_2 = Multiplication(A=length_2, B=number_2)
line_sdl_2 = LineSDL(Start=plane_4, Direction=vector_2, Length=multiplication_2)
list_item_14 = ListItem(List=plane_4, Index="1", Wrap=True)
point_on_curve_3 = PointOnCurve(line_sdl_2, parameter=0)
move_2 = Move(Geometry=plane_4, Motion=line_sdl_2)  # -> Geometry, Transform
list_item_15 = ListItem(List=point_on_curve_3, Index=0, Wrap=True)
distance_3 = Distance(PointA=list_item_15, PointB=list_item_14)
radians_3 = Radians(Degrees="90")
arc_2 = Arc(Plane=move_2.Geometry, Radius=distance_3, Angle=radians_3)  # -> Arc, Length
list_item_16 = ListItem(List=line_sdl_2, Index="1", Wrap=True)
list_item_17 = ListItem(List=arc_2.Arc, Index=0, Wrap=True)
join_curves_2 = JoinCurves(Curves=[list_item_16, list_item_17], Preserve=False)

# ----
section = Geometry(join_curves)

# ---- group: rail revolve
section_2 = Geometry(section)
line_6 = Line(sect_line)
rail_3 = Geometry(rail)
point_3 = Point(center_of_drawing)
point_on_curve_4 = PointOnCurve(line_6, parameter=0.5)
reverse_3 = Reverse(Vector=line_6)
rotate_3d = Rotate3D(Geometry=section_2, Angle=degrees("90"), Center=point_on_curve_4, Axis=reverse_3)  # -> Geometry, Transform
unit_z_2 = UnitZ(Factor=1)
line_sdl_3 = LineSDL(Start=point_3, Direction=unit_z_2, Length=1)
rail_revolution = RailRevolution(Curve=rotate_3d.Geometry, Rail=rail_3, Axis=line_sdl_3, Scale=False)

# ----
brep_2 = Brep(rail_revolution)

cap_holes = CapHoles(Brep=brep_2)

section_3 = Geometry(join_curves_2)

# ---- group: rail revolve
point_4 = Point(center_of_drawing_2)
section_4 = Geometry(section_3)
line_7 = Line(sect_line_2)
rail_4 = Geometry(rail_2)
point_on_curve_5 = PointOnCurve(line_7, parameter=0.5)
reverse_4 = Reverse(Vector=line_7)
rotate_3d_2 = Rotate3D(Geometry=section_4, Angle=degrees("90"), Center=point_on_curve_5, Axis=reverse_4)  # -> Geometry, Transform
unit_z_3 = UnitZ(Factor=1)
line_sdl_4 = LineSDL(Start=point_4, Direction=unit_z_3, Length=1)
rail_revolution_2 = RailRevolution(Curve=rotate_3d_2.Geometry, Rail=rail_4, Axis=line_sdl_4, Scale=False)

# ----
point_on_curve_6 = PointOnCurve(rotate_3d_2.Geometry, parameter=1)

brep_3 = Brep(rail_revolution_2)

cap_holes_2 = CapHoles(Brep=brep_3)
solid_difference = SolidDifference(BrepsA=cap_holes_2, BrepsB=cap_holes)
contour_2 = Contour(Shape=solid_difference, Point=Point(0, 0, 0), Direction=unit_z, Distance="2")
merge = Merge(Data1=solid_difference, Data2=contour_2)
_3d_object = Geometry(merge)

center_of_object_at_base = Point(drawing_center)
center_of_object_at_top = Point(point_on_curve_6)
geometry_2 = Geometry(_3d_object)
radius_of_base_circle = Number(list_item_9)
boolean = Boolean(Toggle(True))
radius_of_base_circle_2 = Number(radius_of_base_circle)
point_5 = Point(center_of_object_at_top)
shear_rotation = Number("180")
negative = Negative(Value=radius_of_base_circle_2)
unit_y = UnitY(Factor=negative)
rotate = Rotate(Geometry=unit_y, Angle=degrees(shear_rotation), Plane=PlaneXY(0, 0, 0))  # -> Geometry, Transform
move_3 = Move(Geometry=point_5, Motion=rotate.Geometry)  # -> Geometry, Transform
center_of_roof_displaced = Point(move_3.Geometry)
center_of_roof_original = Point(point_5)
center_of_object = Point(center_of_object_at_base)
shear = Shear(Geometry=geometry_2, Base=center_of_object, Grip=center_of_roof_original, Target=center_of_roof_displaced)  # -> Geometry, Transform
xy_plane = XYPlane(Origin=center_of_object)
mirror = Mirror(Geometry=shear.Geometry, Plane=xy_plane)  # -> Geometry, Transform
stream_filter_3 = StreamFilter(Gate=boolean, Stream0=geometry_2, Stream1=mirror.Geometry)
sheared_object = Geometry(stream_filter_3)

geometry_3 = Geometry(sheared_object)
contours = Curve(sheared_object)

# ---- group: Preview and Bake
get_name = GhPythonScript(Component=polygon)  # -> Geometry, Name
# ---------- get_name: Python ----------
# Mark Ericson 1.17.19
   #take from forum discussion thread https://www.grasshopper3d.com/forum/topics/python-get-label-name-of-input-components
    #edited version of code  by Mostapha Sadeghipour Roudsari

def GetComponentName():
    Comp = ghenv.Component.Params.Input[0]
    sources = Comp.Sources

    if sources.Count == 0: 
        return components

    for source in sources:
        attr = source.Attributes
        if (attr is None) or (attr.GetTopLevel is None):
            pass
        else:

            component = attr.GetTopLevel.DocObject
            componentName = component.NickName

            return componentName

if Component == None:
    pass
else:
    Name = GetComponentName()
    Geometry = Component
# ---------- end get_name ----------
linear_gradient = GhPythonScript(R="0", G="0", B="0", Percent=".4")  # -> Color
# ---------- linear_gradient: Python ----------
__author__ = "ericsonm"
__version__ = "2019.01.15"

import rhinoscriptsyntax as rs

def LinearColorGradient(R,G,B,R2,G2,B2,ColorPercentage):
    
    if ColorPercentage > 1:
        R3 = None
        G3 = None
        B3 = None
    else:
        #This function defines linear color gradient by treating R,G,B as coordinates on a 3D line.
        #The base color that will be altered by the percentage should be entered in the second R2,G2,B2 valu
    
        Rdiff = float(R2) - float(R)
        Gdiff = float(G2) - float(G)
        Bdiff = float(B2) - float(B)


        t = float(ColorPercentage)


        R3 = float(R) + Rdiff*t
        G3 = float(G) + Gdiff*t
        B3 = float(B) + Bdiff*t



    return R3,G3,B3


if (R or G or B or Percent) is None:
    Color = None
else: 
    Color1 = LinearColorGradient(255,255,255,R,G,B,Percent)

    R3 = Color1[0]
    G3 = Color1[1]
    B3 = Color1[2]

    Color = rs.CreateColor(R3,G3,B3)
# ---------- end linear_gradient ----------
custom_preview = CustomPreview(Geometry=get_name.Geometry, Material=linear_gradient)

# ----
panel_5 = Panel(get_name.Name)

# ---- group: Preview and Bake (continued)
object_bake = ObjectBake(
    BakeToggle=Button(),
    GeometryObjects=get_name.Geometry,
    Layer=panel_5,
    ObjectName=panel_5,
    ObjectColor=linear_gradient,
    LayerColor=linear_gradient)

# ----
custom_preview_lineweights = CustomPreviewLineweights(Geometry=get_name.Geometry, Shader=linear_gradient, Thickness=".0025", Absolute=Toggle(True))

# ---- group: TEXT LABELS
text_size = Panel("1")
point_6 = Point(point)
add_text = Panel("a")
linear_gradient_2 = GhPythonScript(R="0", G="0", B="0", Percent=".5")  # -> Color; same code as linear_gradient

# ----
scale_2 = Scale(Geometry=point_6, Center=point_2, Factor="1.025")  # -> Geometry, Transform

# ---- group: TEXT LABELS (continued)
list_length_2 = ListLength(List=scale_2.Geometry)
series_2 = Series(Start=0, Step=1, Count=list_length_2)
integer = Integer(series_2)
concatenate = Concatenate(FragmentA=integer, FragmentB=add_text)
text_tag_3d = TextTag3D(Location=scale_2.Geometry, Text=concatenate, Size=text_size, Colour=linear_gradient_2, Justification=5)

# ---- group: Preview and Bake
# Preview and Bake
button = Button()
get_name_2 = GhPythonScript(Component=circle_a)  # -> Geometry, Name; same code as get_name
linear_gradient_3 = GhPythonScript(R="0", G="0", B="0", Percent=".5")  # -> Color; same code as linear_gradient
custom_preview_2 = CustomPreview(Geometry=get_name_2.Geometry, Material=linear_gradient_3)

# ----
panel_6 = Panel(get_name_2.Name)

# ---- group: Preview and Bake (continued)
object_bake_2 = ObjectBake(
    BakeToggle=button,
    GeometryObjects=get_name_2.Geometry,
    Layer=panel_6,
    ObjectName=panel_6,
    ObjectColor=linear_gradient_3,
    LayerColor=linear_gradient_3)

# ----
custom_preview_lineweights_2 = CustomPreviewLineweights(Geometry=get_name_2.Geometry, Shader=linear_gradient_3, Thickness=".0025", Absolute=Toggle(True))

# ---- group: Preview and Bake
get_name_3 = GhPythonScript(Component=centerlines_a)  # -> Geometry, Name; same code as get_name
linear_gradient_4 = GhPythonScript(R="0", G="0", B="0", Percent="1")  # -> Color; same code as linear_gradient
custom_preview_3 = CustomPreview(Geometry=get_name_3.Geometry, Material=linear_gradient_4)

# ----
panel_7 = Panel(get_name_3.Name)

# ---- group: Preview and Bake (continued)
object_bake_3 = ObjectBake(
    BakeToggle=Button(),
    GeometryObjects=get_name_3.Geometry,
    Layer=panel_7,
    ObjectName=panel_7,
    ObjectColor=linear_gradient_4,
    LayerColor=linear_gradient_4)

# ----
custom_preview_lineweights_3 = CustomPreviewLineweights(Geometry=get_name_3.Geometry, Shader=linear_gradient_4, Thickness=".0025", Absolute=Toggle(True))

# ---- group: Preview and Bake
get_name_4 = GhPythonScript(Component=dome_above_2)  # -> Geometry, Name; same code as get_name
linear_gradient_5 = GhPythonScript(R="0", G="0", B="0", Percent="1")  # -> Color; same code as linear_gradient
custom_preview_4 = CustomPreview(Geometry=get_name_4.Geometry, Material=linear_gradient_5)

# ----
panel_8 = Panel(get_name_4.Name)

# ---- group: Preview and Bake (continued)
object_bake_4 = ObjectBake(
    BakeToggle=Button(),
    GeometryObjects=get_name_4.Geometry,
    Layer=panel_8,
    ObjectName=panel_8,
    ObjectColor=linear_gradient_5,
    LayerColor=linear_gradient_5)

# ----
custom_preview_lineweights_4 = CustomPreviewLineweights(Geometry=get_name_4.Geometry, Shader=linear_gradient_5, Thickness=".1", Absolute=Toggle(True))

# ---- group: Preview and Bake
get_name_5 = GhPythonScript(Component=contours)  # -> Geometry, Name; same code as get_name
linear_gradient_6 = GhPythonScript(R="0", G="0", B="0", Percent="0")  # -> Color; same code as linear_gradient
custom_preview_5 = CustomPreview(Geometry=get_name_5.Geometry, Material=linear_gradient_6)

# ----
panel_9 = Panel(get_name_5.Name)

# ---- group: Preview and Bake (continued)
object_bake_5 = ObjectBake(
    BakeToggle=Button(),
    GeometryObjects=get_name_5.Geometry,
    Layer=panel_9,
    ObjectName=panel_9,
    ObjectColor=linear_gradient_6,
    LayerColor=linear_gradient_6)

# ----
custom_preview_lineweights_5 = CustomPreviewLineweights(Geometry=get_name_5.Geometry, Shader=linear_gradient_6, Thickness=".1", Absolute=Toggle(True))

# ---- group: Preview and Bake
get_name_6 = GhPythonScript(Component=geometry_3)  # -> Geometry, Name; same code as get_name
linear_gradient_7 = GhPythonScript(R="0", G="0", B="0", Percent=".5")  # -> Color; same code as linear_gradient
custom_preview_6 = CustomPreview(Geometry=get_name_6.Geometry, Material=linear_gradient_7)

# ----
panel_10 = Panel(get_name_6.Name)

# ---- group: Preview and Bake (continued)
object_bake_6 = ObjectBake(
    BakeToggle=Button(),
    GeometryObjects=get_name_6.Geometry,
    Layer=panel_10,
    ObjectName=panel_10,
    ObjectColor=linear_gradient_7,
    LayerColor=linear_gradient_7)

# ----
custom_preview_lineweights_6 = CustomPreviewLineweights(Geometry=get_name_6.Geometry, Shader=linear_gradient_7, Thickness=".1", Absolute=Toggle(True))

# ---- group: Preview and Bake
get_name_7 = GhPythonScript(Component=hatch_lines)  # -> Geometry, Name; same code as get_name
linear_gradient_8 = GhPythonScript(R="255", G="0", B="0", Percent=".4")  # -> Color; same code as linear_gradient
custom_preview_7 = CustomPreview(Geometry=get_name_7.Geometry, Material=linear_gradient_8)

# ----
panel_11 = Panel(get_name_7.Name)

# ---- group: Preview and Bake (continued)
object_bake_7 = ObjectBake(
    BakeToggle=Button(),
    GeometryObjects=get_name_7.Geometry,
    Layer=panel_11,
    ObjectName=panel_11,
    ObjectColor=linear_gradient_8,
    LayerColor=linear_gradient_8)

# ----
custom_preview_lineweights_7 = CustomPreviewLineweights(Geometry=get_name_7.Geometry, Shader=linear_gradient_8, Thickness=".1", Absolute=Toggle(True))

# ---- group: Preview and Bake
get_name_8 = GhPythonScript(Component=geometry)  # -> Geometry, Name; same code as get_name
linear_gradient_9 = GhPythonScript(R="0", G="0", B="0", Percent="1")  # -> Color; same code as linear_gradient
custom_preview_8 = CustomPreview(Geometry=get_name_8.Geometry, Material=linear_gradient_9)

# ----
panel_12 = Panel(get_name_8.Name)

# ---- group: Preview and Bake (continued)
object_bake_8 = ObjectBake(
    BakeToggle=Button(),
    GeometryObjects=get_name_8.Geometry,
    Layer=panel_12,
    ObjectName=panel_12,
    ObjectColor=linear_gradient_9,
    LayerColor=linear_gradient_9)

# ----
custom_preview_lineweights_8 = CustomPreviewLineweights(Geometry=get_name_8.Geometry, Shader=linear_gradient_9, Thickness=".1", Absolute=Toggle(True))

# ==== cluster Niche
angle_of_niche_rotation = ClusterInput()
divisor_of_niche_ratio = ClusterInput()
polygon_sides = ClusterInput()
polygon_side = ClusterInput()
center_of_niche = ClusterInput()

perpendicular = GhPythonScript(line=polygon_side)  # -> Perp; inputs line: Line
# ---------- perpendicular: Python ----------
__author__ = "mericson"
__version__ = "2019.01.11"

import rhinoscriptsyntax as rs
import math
import Rhino as rh

if line == None:
    line = None
else:
    a = 0,0,0
    b = 0,0,1
    Z = rs.VectorCreate(a,b)
    c = rh.Geometry.Line.PointAt(line,1)
    d = rh.Geometry.Line.PointAt(line,0)
    vector2 = rs.VectorCreate(c,d)
    Perp = rs.VectorRotate(vector2,90,Z)
# ---------- end perpendicular ----------
length = Length(Curve=polygon_side)
construct_plane = ConstructPlane(Origin=center_of_niche, XAxis=polygon_side, YAxis=perpendicular)
division = Division(A=length, B=divisor_of_niche_ratio)
rotate = Rotate(Geometry=construct_plane, Angle=degrees(angle_of_niche_rotation), Plane=center_of_niche)  # -> Geometry, Transform
polygon = Polygon(Plane=rotate.Geometry, Radius=division, Segments=polygon_sides, FilletRadius=0)  # -> Polygon, Length

polygon_2 = ClusterOutput(polygon.Polygon)

# ==== cluster PointOnLine
point_value = ClusterInput()
curve = ClusterInput()
point_value_2 = Number(point_value)

# ---- group: point on curv
end_points = EndPoints(Curve=curve)  # -> Start, End
panel = Panel(point_value_2)
point = Point(end_points.Start)
point_2 = Point(end_points.End)
addition = Addition(A=point, B=point_2)
multiplication = Multiplication(A=addition, B=panel)

# ----
result = ClusterOutput(multiplication)
