# Grasshopper definition 01_Ericson_1_4 with make 2d.gh (Grasshopper 1.0.7)
# plug-ins: Human, LunchBox

polygon_a_sides = Panel("4")
wall_scalar = Panel(".55")
# Variables + Controls
drawing_cetner = Panel("0,0,0")
circle_a_radius = Panel("60")
start = Panel("0")
total_degrees = Panel("90")
exterior_wall_subdivision = Panel("2")
exterior_wall_rotation = Panel("1")
boolean_toggle = BooleanToggle(True)
interior_wall_options = Panel("2")
interior_wall_subdivision = Panel("4")
interior_wall_rotation = Panel("2")
wall_scalar_2 = Panel(".9")
division = Panel("6")
niche_proportion_divisor = Panel("4")
angle_of_niche_rotation = Panel("0")
niche_sides = Panel("60")
division_2 = Division(A=total_degrees, B=division)
division_3 = Division(A=division, B=polygon_a_sides)
drawing_center = Plane(drawing_cetner)
division_4 = Division(A=circle_a_radius, B=wall_scalar_2)
series = Series(Start=start, Step=division_2, Count=division_3)
radians = Radians(Degrees=series)
rotate_plane = RotatePlane(Plane=drawing_center, Angle=radians)
circle = Circle(Plane=rotate_plane, Radius=division_4)
number = Number(division)
list_item = ListItem(List=circle, Index=0, Wrap=True)
# A
divide_curve = DivideCurve(Curve=circle, Count=polygon_a_sides, Kinks=False)  # -> Points, Tangents, Parameters
polyline = PolyLine(Vertices=divide_curve.Points, Closed=Toggle(True))
# Operations
list_length = ListLength(List=flatten(divide_curve.Points))
number_of_points_on_inner_circle = Number(list_length)
scale = Scale(Geometry=list_item, Center=drawing_center, Factor=wall_scalar_2)  # -> Geometry, Transform
line = Line(StartPoint=drawing_center, EndPoint=divide_curve.Points)
divide_curve_2 = DivideCurve(Curve=list_item, Count=number_of_points_on_inner_circle, Kinks=False)  # -> Points, Tangents, Parameters
divide_curve_3 = DivideCurve(Curve=scale.Geometry, Count=number_of_points_on_inner_circle, Kinks=False)  # -> Points, Tangents, Parameters

# ---- group: dome
list_item_2 = ListItem(List=polyline, Index=0, Wrap=True)
explode = Explode(Curve=list_item_2, Recursive=True)  # -> Segments, Vertices
list_item_3 = ListItem(List=explode.Segments, Index=0, Wrap=True)
point_on_curve = PointOnCurve(list_item_3, parameter=0.5)
distance = Distance(PointA=point_on_curve, PointB=drawing_center)
circle_2 = Circle(Plane=drawing_center, Radius=distance)

# ----
list_of_points_on_circle = Point(divide_curve_2.Points)
geometry = Geometry(circle)
list_of_points_on_circle_2 = Point(divide_curve_3.Points)

# ---- group: interior wall b
partition_list = PartitionList(List=list_of_points_on_circle, Size=interior_wall_subdivision)
panel = Panel(interior_wall_rotation)
list_item_4 = ListItem(List=partition_list, Index=panel, Wrap=True)  # -> flatten(Item)
polyline_2 = PolyLine(Vertices=list_item_4, Closed=Toggle(True))

# ----
outermost_circle = Geometry(geometry)

# ---- group: wall
partition_list_2 = PartitionList(List=list_of_points_on_circle_2, Size=exterior_wall_subdivision)
panel_2 = Panel(exterior_wall_rotation)
list_item_5 = ListItem(List=partition_list_2, Index=panel_2, Wrap=True)  # -> flatten(Item)
polyline_3 = PolyLine(Vertices=list_item_5, Closed=Toggle(True))

# ----
scale_2 = Scale(Geometry=geometry, Center=geometry, Factor=wall_scalar_2)  # -> Geometry, Transform
divide_curve_4 = DivideCurve(Curve=scale_2.Geometry, Count=number_of_points_on_inner_circle, Kinks=False)  # -> Points, Tangents, Parameters
boolean_toggle_2 = BooleanToggle(True)
polyline_4 = PolyLine(Vertices=divide_curve_4.Points, Closed=boolean_toggle_2)

scale_3 = Scale(Geometry=geometry, Center=geometry, Factor=wall_scalar)  # -> Geometry, Transform
divide_curve_5 = DivideCurve(Curve=scale_3.Geometry, Count=10, Kinks=False)  # -> Points, Tangents, Parameters
polyline_5 = PolyLine(Vertices=divide_curve_5.Points, Closed=boolean_toggle_2)

wall_polyline = Geometry(polyline_3)
wall_polyline_2 = Geometry(polyline_2)

# ---- group: niche
explode_2 = Explode(Curve=wall_polyline_2, Recursive=True)  # -> Segments, Vertices
point_on_line = PointOnLine(curve=explode_2.Segments, point_value=".5")
niche = Niche(
    polygon_sides=niche_sides,
    divisor_of_niche_ratio=niche_proportion_divisor,
    angle_of_niche_rotation=angle_of_niche_rotation,
    polygon_side=explode_2.Segments,
    center_of_niche=point_on_line)

# ----
boundary_surfaces = BoundarySurfaces(Edges=wall_polyline)
region_union = RegionUnion(Curves=flatten([wall_polyline_2, niche]))
exterior_wall = Curve(boundary_surfaces)
stream_filter = StreamFilter(Gate=interior_wall_options, Stream0=list_item, Stream1=wall_polyline_2, Stream2=region_union)
region_difference = RegionDifference(CurvesA=exterior_wall, CurvesB=stream_filter)
# B
# C
geometry_2 = Geometry(circle)
deconstruct_arc = DeconstructArc(Arc=geometry_2)  # -> BasePlane, Radius, Angle
list_item_6 = ListItem(List=deconstruct_arc.Radius, Index=0, Wrap=True)
center_of_object_at_base = Point(drawing_center)
radius_of_base_circle = Number(list_item_6)
shear_rotation = Number("180")
dome_above = Geometry(circle_2)
# Views
center_lines = Line(line)
panel_3 = Panel("""1
.5
.5
.5""")
panel_4 = Panel("""1
.5""")
# D
# Line Type
dash_pattern = DashPattern(Curve=center_lines, Pattern=panel_3)  # -> Dashes, Gaps
dash_pattern_2 = DashPattern(Curve=dome_above, Pattern=panel_4)  # -> Dashes, Gaps
dome_above_2 = Geometry(dash_pattern_2.Dashes)
centerlines_a = Geometry(dash_pattern.Dashes)
point = Point(flatten(divide_curve.Points))
# E
# F
# Layers
circle_a = Geometry(circle)
point_2 = Point(drawing_center)
geometry_3 = Geometry(region_difference)
polygon = Geometry(geometry)

polygon_2 = Geometry(flatten(polyline))
center_of_drawing = Plane(drawing_center)
number_of_polygons = Number(number)
panel_5 = Panel(".25")
number_2 = Number(panel_5)
center_of_drawing_2 = Plane(center_of_drawing)
number_of_polygons_2 = Number(number_of_polygons)
division_5 = Division(A=number_of_polygons_2, B="2")

# ---- group: Polygon Side
list_item_7 = ListItem(List=polygon_2, Index=0, Wrap=True)
explode_3 = Explode(Curve=list_item_7, Recursive=True)  # -> Segments, Vertices
list_item_8 = ListItem(List=explode_3.Segments, Index=0, Wrap=True)

# ----
polygon_3 = Geometry(flatten(polyline_4))
center_of_drawing_3 = Plane(drawing_center)
number_of_polygons_3 = Number(number)
panel_6 = Panel(".25")
number_3 = Number(panel_6)
center_of_drawing_4 = Plane(center_of_drawing_3)
number_of_polygons_4 = Number(number_of_polygons_3)
division_6 = Division(A=number_of_polygons_4, B="2")

# ---- group: Polygon Side
list_item_9 = ListItem(List=polygon_3, Index=0, Wrap=True)
explode_4 = Explode(Curve=list_item_9, Recursive=True)  # -> Segments, Vertices
list_item_10 = ListItem(List=explode_4.Segments, Index=0, Wrap=True)

# ----
polygon_4 = Geometry(flatten(polyline_5))
center_of_drawing_5 = Plane(drawing_center)
number_of_polygons_5 = Number(number)
panel_7 = Panel(".25")
number_4 = Number(panel_7)
center_of_drawing_6 = Plane(center_of_drawing_5)
number_of_polygons_6 = Number(number_of_polygons_5)
division_7 = Division(A=number_of_polygons_6, B="2")

# ---- group: Polygon Side
list_item_11 = ListItem(List=polygon_4, Index=0, Wrap=True)
explode_5 = Explode(Curve=list_item_11, Recursive=True)  # -> Segments, Vertices
list_item_12 = ListItem(List=explode_5.Segments, Index=0, Wrap=True)

# ----
line_2 = Line(list_item_8)
line_3 = Line(line_2)
line_4 = Line(line_3)

# ---- group: Perpendicular to Section line
end_points = EndPoints(Curve=line_2)  # -> Start, End
reverse = Reverse(Vector=line_2)
perpendicular = GhPythonScript(line=line_2)  # -> Perp; inputs line: Line; same code as perpendicular
construct_plane = ConstructPlane(Origin=[end_points.Start, end_points.End], XAxis=[line_2, reverse], YAxis=perpendicular)

# ----
line_5 = Line(list_item_10)
line_6 = Line(line_5)
line_7 = Line(line_6)

# ---- group: Perpendicular to Section line
end_points_2 = EndPoints(Curve=line_5)  # -> Start, End
reverse_2 = Reverse(Vector=line_5)
perpendicular_2 = GhPythonScript(line=line_5)  # -> Perp; inputs line: Line; same code as perpendicular
construct_plane_2 = ConstructPlane(Origin=[end_points_2.Start, end_points_2.End], XAxis=[line_5, reverse_2], YAxis=perpendicular_2)

# ----
line_8 = Line(list_item_12)
line_9 = Line(line_8)
line_10 = Line(line_9)

# ---- group: Perpendicular to Section line
end_points_3 = EndPoints(Curve=line_8)  # -> Start, End
reverse_3 = Reverse(Vector=line_8)
perpendicular_3 = GhPythonScript(line=line_8)  # -> Perp; inputs line: Line; same code as perpendicular
construct_plane_3 = ConstructPlane(Origin=[end_points_3.Start, end_points_3.End], XAxis=[line_8, reverse_3], YAxis=perpendicular_3)

# ----
plane = Plane(construct_plane)
vector = Vector(perpendicular)

# ---- group: 2d section
length = Length(Curve=line_3)
multiplication = Multiplication(A=length, B=number_2)
line_sdl = LineSDL(Start=plane, Direction=vector, Length=multiplication)
point_on_curve_2 = PointOnCurve(line_sdl, parameter=0)
list_item_13 = ListItem(List=plane, Index="1", Wrap=True)
list_item_14 = ListItem(List=point_on_curve_2, Index=0, Wrap=True)
move = Move(Geometry=plane, Motion=line_sdl)  # -> Geometry, Transform
radians_2 = Radians(Degrees="60")
distance_2 = Distance(PointA=list_item_14, PointB=list_item_13)
arc = Arc(Plane=move.Geometry, Radius=distance_2, Angle=radians_2)  # -> Arc, Length
join_curves = JoinCurves(Curves=[line_sdl, arc.Arc], Preserve=False)

# ----
plane_2 = Plane(construct_plane_2)
vector_2 = Vector(perpendicular_2)

# ---- group: 2d section
length_2 = Length(Curve=line_6)
multiplication_2 = Multiplication(A=length_2, B=number_3)
line_sdl_2 = LineSDL(Start=plane_2, Direction=vector_2, Length=multiplication_2)
point_on_curve_3 = PointOnCurve(line_sdl_2, parameter=0)
list_item_15 = ListItem(List=plane_2, Index="1", Wrap=True)
list_item_16 = ListItem(List=point_on_curve_3, Index=0, Wrap=True)
move_2 = Move(Geometry=plane_2, Motion=line_sdl_2)  # -> Geometry, Transform
radians_3 = Radians(Degrees="60")
distance_3 = Distance(PointA=list_item_16, PointB=list_item_15)
arc_2 = Arc(Plane=move_2.Geometry, Radius=distance_3, Angle=radians_3)  # -> Arc, Length
join_curves_2 = JoinCurves(Curves=[line_sdl_2, arc_2.Arc], Preserve=False)

# ----
curve = Curve(join_curves_2)

# ---- group: section 3d
reverse_4 = Reverse(Vector=line_7)
point_on_curve_4 = PointOnCurve(line_7, parameter=0.5)
rotate_3d = Rotate3D(Geometry=curve, Angle=degrees("90"), Center=point_on_curve_4, Axis=reverse_4)  # -> Geometry, Transform
polar_array = PolarArray(Geometry=rotate_3d.Geometry, Plane=center_of_drawing_4, Count=division_6, Angle=6.283185307)  # -> Geometry, Transform

# ----
plane_3 = Plane(construct_plane_3)
vector_3 = Vector(perpendicular_3)

# ---- group: 2d section
length_3 = Length(Curve=line_9)
multiplication_3 = Multiplication(A=length_3, B=number_4)
line_sdl_3 = LineSDL(Start=plane_3, Direction=vector_3, Length=multiplication_3)
point_on_curve_5 = PointOnCurve(line_sdl_3, parameter=0)
list_item_17 = ListItem(List=plane_3, Index="1", Wrap=True)
list_item_18 = ListItem(List=point_on_curve_5, Index=0, Wrap=True)
move_3 = Move(Geometry=plane_3, Motion=line_sdl_3)  # -> Geometry, Transform
radians_4 = Radians(Degrees="60")
distance_4 = Distance(PointA=list_item_18, PointB=list_item_17)
arc_3 = Arc(Plane=move_3.Geometry, Radius=distance_4, Angle=radians_4)  # -> Arc, Length
join_curves_3 = JoinCurves(Curves=[line_sdl_3, arc_3.Arc], Preserve=False)

# ----
curve_2 = Curve(join_curves_3)

# ---- group: section 3d
reverse_5 = Reverse(Vector=line_10)
point_on_curve_6 = PointOnCurve(line_10, parameter=0.5)
rotate_3d_2 = Rotate3D(Geometry=curve_2, Angle=degrees("90"), Center=point_on_curve_6, Axis=reverse_5)  # -> Geometry, Transform
polar_array_2 = PolarArray(Geometry=rotate_3d_2.Geometry, Plane=center_of_drawing_6, Count=division_7, Angle=6.283185307)  # -> Geometry, Transform

# ----
curve_3 = Curve(join_curves)

# ---- group: section 3d
reverse_6 = Reverse(Vector=line_4)
point_on_curve_7 = PointOnCurve(line_4, parameter=0.5)
rotate_3d_3 = Rotate3D(Geometry=curve_3, Angle=degrees("90"), Center=point_on_curve_7, Axis=reverse_6)  # -> Geometry, Transform
polar_array_3 = PolarArray(Geometry=rotate_3d_3.Geometry, Plane=center_of_drawing_2, Count=division_5, Angle=6.283185307)  # -> Geometry, Transform

# ----
point_on_curve_8 = PointOnCurve(rotate_3d_3.Geometry, parameter=0.5)

deconstruct = Deconstruct(Point=point_on_curve_8)  # -> XComponent, YComponent, ZComponent
arrayed_sections = Geometry(polar_array_3.Geometry)
plane_4 = Plane(center_of_drawing_2)
division_8 = Division(A=deconstruct.ZComponent, B="60")
series_2 = Series(Start="0", Step=division_8, Count="60")
unit_z = UnitZ(Factor=series_2)
move_4 = Move(Geometry=plane_4, Motion=graft(unit_z))  # -> Geometry, Transform
curve_plane = CurvePlane(Curve=arrayed_sections, Plane=move_4.Geometry)  # -> flatten(Points), ParamsC, ParamsP
partition_list_3 = PartitionList(List=curve_plane.Points, Size=number_of_polygons_2)
convex_hull = ConvexHull(Points=partition_list_3, Plane=move_4.Geometry)  # -> Hull, HullZ, Indices

deconstruct_2 = Deconstruct(Point=point_on_curve_8)  # -> XComponent, YComponent, ZComponent
panel_8 = Panel("60")
arrayed_sections_2 = Geometry(polar_array.Geometry)
plane_5 = Plane(center_of_drawing_4)
division_9 = Division(A=deconstruct_2.ZComponent, B=panel_8)
series_3 = Series(Start="0", Step=division_9, Count=panel_8)
unit_z_2 = UnitZ(Factor=series_3)
move_5 = Move(Geometry=plane_5, Motion=graft(unit_z_2))  # -> Geometry, Transform
curve_plane_2 = CurvePlane(Curve=arrayed_sections_2, Plane=move_5.Geometry)  # -> flatten(Points), ParamsC, ParamsP
partition_list_4 = PartitionList(List=curve_plane_2.Points, Size=number_of_polygons_4)
convex_hull_2 = ConvexHull(Points=partition_list_4, Plane=move_5.Geometry)  # -> Hull, HullZ, Indices

deconstruct_3 = Deconstruct(Point=point_on_curve_8)  # -> XComponent, YComponent, ZComponent
panel_9 = Panel("60")
arrayed_sections_3 = Geometry(polar_array_2.Geometry)
plane_6 = Plane(center_of_drawing_6)
division_10 = Division(A=deconstruct_3.ZComponent, B=panel_9)
series_4 = Series(Start="0", Step=division_10, Count=panel_9)
unit_z_3 = UnitZ(Factor=series_4)
move_6 = Move(Geometry=plane_6, Motion=graft(unit_z_3))  # -> Geometry, Transform
curve_plane_3 = CurvePlane(Curve=arrayed_sections_3, Plane=move_6.Geometry)  # -> flatten(Points), ParamsC, ParamsP
partition_list_5 = PartitionList(List=curve_plane_3.Points, Size=number_of_polygons_6)
convex_hull_3 = ConvexHull(Points=partition_list_5, Plane=move_6.Geometry)  # -> Hull, HullZ, Indices

panel_10 = Panel(division_9)
geometry_4 = Geometry(convex_hull_3.Hull)
region_union_2 = RegionUnion(Curves=[convex_hull.Hull, convex_hull_2.Hull])
merge = Merge(Data1=region_union_2, Data2=geometry_4)
boundary_surfaces_2 = BoundarySurfaces(Edges=flatten(merge))  # -> flatten(Surfaces)

# ---- group: make solid
stream_filter_2 = StreamFilter(Gate=Toggle(True), Stream1=boundary_surfaces_2)
unit_z_4 = UnitZ(Factor=panel_10)
extrude = Extrude(Base=stream_filter_2, Direction=unit_z_4)
cap_holes = CapHoles(Brep=extrude)

# ----
# Output Geometry
list_item_19 = ListItem(List=boundary_surfaces_2, Index=0, Wrap=True)
merge_2 = Merge(Data1=merge, Data2=cap_holes, Data3=geometry_4)
unit_z_5 = UnitZ(Factor=deconstruct_2.ZComponent)
move_7 = Move(Geometry=drawing_center, Motion=unit_z_5)  # -> Geometry, Transform
center_of_object_at_top = Point(move_7.Geometry)
geometry_5 = Geometry(merge_2)

radius_of_base_circle_2 = Number(radius_of_base_circle)
point_3 = Point(center_of_object_at_top)
negative = Negative(Value=radius_of_base_circle_2)
unit_y = UnitY(Factor=negative)
rotate = Rotate(Geometry=unit_y, Angle=degrees(shear_rotation), Plane=PlaneXY(0, 0, 0))  # -> Geometry, Transform
move_8 = Move(Geometry=point_3, Motion=rotate.Geometry)  # -> Geometry, Transform
center_of_roof_displaced = Point(move_8.Geometry)
center_of_roof_original = Point(point_3)
center_of_object = Point(center_of_object_at_base)
shear = Shear(Geometry=geometry_5, Base=center_of_object, Grip=center_of_roof_original, Target=center_of_roof_displaced)  # -> Geometry, Transform
xy_plane = XYPlane(Origin=center_of_object)
mirror = Mirror(Geometry=shear.Geometry, Plane=xy_plane)  # -> Geometry, Transform
stream_filter_3 = StreamFilter(Gate=Toggle(True), Stream0=geometry_5, Stream1=mirror.Geometry)

# ---- group: Hatch Group
vector_at_angle = PythonScript(angle="45")  # -> vector
# ---------- vector_at_angle: Python ----------
import rhinoscriptsyntax as rs
import math
if angle == None:
    Vector = None
else:
    c=rs.AddPoint(0,0,0)
    f=math.radians(float(angle))
    l=rs.AddPoint(math.cos(f),math.sin(f),0)
    d=rs.VectorCreate(l,c)
    vector =rs.VectorUnitize(d)
# ---------- end vector_at_angle ----------
contour = Contour(Shape=list_item_19, Point=Point(0, 0, 0), Direction=vector_at_angle, Distance=".5")

# ----
sheared_object = Geometry(stream_filter_3)
brep = Brep(sheared_object)

sheared_object_2 = Geometry(brep)
xy_plane_2 = XYPlane(Origin=Point(0, 0, 0))
make2d_rhino_view = Make2DRhinoView(Name="top", Clip=True)
make2d = Make2D(
    Geometry=sheared_object_2,
    ClippingPlanes=xy_plane_2,
    View=make2d_rhino_view,
    TangentEdges=False,
    TangentSeams=False,
    AutoComputeMake2D=False)  # -> VisibleCurves, VisibleIndex, VisibleType, HiddenCurves, HiddenIndex, HiddenType
join_curves_4 = JoinCurves(Curves=flatten(make2d.VisibleCurves), Preserve=False)
area = Area(Geometry=join_curves_4)  # -> Area, Centroid
list_item_20 = ListItem(List=area.Centroid, Index=0, Wrap=True)
vector_2pt = Vector2Pt(PointA=list_item_20, PointB=xy_plane_2, Unitize=False)  # -> Vector, Length
move_9 = Move(Geometry=make2d.VisibleCurves, Motion=vector_2pt.Vector)  # -> flatten(Geometry), Transform
move_10 = Move(Geometry=make2d.HiddenCurves, Motion=vector_2pt.Vector)  # -> flatten(Geometry), Transform

hatch_lines = Geometry(contour)
visible = Geometry(move_9.Geometry)
hidden = Geometry(move_10.Geometry)
exterior_contours = Geometry(visible)
exterior_contours_2 = Geometry(visible)

# ---- group: Preview and Bake
get_name = GhPythonScript(Component=exterior_contours)  # -> Geometry, Name
# ---------- get_name: Python ----------
# Mark Ericson 1.17.19
   #take from forum discussion thread https://www.grasshopper3d.com/forum/topics/python-get-label-name-of-input-components
    #edited version of code  by Mostapha Sadeghipour Roudsari

def GetComponentName():
    Comp = ghenv.Component.Params.Input[0]
    sources = Comp.Sources

    if sources.Count == 0: 
        return components

    for source in sources:
        attr = source.Attributes
        if (attr is None) or (attr.GetTopLevel is None):
            pass
        else:

            component = attr.GetTopLevel.DocObject
            componentName = component.NickName

            return componentName

if Component == None:
    pass
else:
    Name = GetComponentName()
    Geometry = Component
# ---------- end get_name ----------
linear_gradient = GhPythonScript(R="0", G="0", B="0", Percent=".5")  # -> Color
# ---------- linear_gradient: Python ----------
__author__ = "ericsonm"
__version__ = "2019.01.15"

import rhinoscriptsyntax as rs

def LinearColorGradient(R,G,B,R2,G2,B2,ColorPercentage):
    
    if ColorPercentage > 1:
        R3 = None
        G3 = None
        B3 = None
    else:
        #This function defines linear color gradient by treating R,G,B as coordinates on a 3D line.
        #The base color that will be altered by the percentage should be entered in the second R2,G2,B2 valu
    
        Rdiff = float(R2) - float(R)
        Gdiff = float(G2) - float(G)
        Bdiff = float(B2) - float(B)


        t = float(ColorPercentage)


        R3 = float(R) + Rdiff*t
        G3 = float(G) + Gdiff*t
        B3 = float(B) + Bdiff*t



    return R3,G3,B3


if (R or G or B or Percent) is None:
    Color = None
else: 
    Color1 = LinearColorGradient(255,255,255,R,G,B,Percent)

    R3 = Color1[0]
    G3 = Color1[1]
    B3 = Color1[2]

    Color = rs.CreateColor(R3,G3,B3)
# ---------- end linear_gradient ----------
custom_preview = CustomPreview(Geometry=get_name.Geometry, Material=linear_gradient)

# ----
panel_11 = Panel(get_name.Name)

# ---- group: Preview and Bake (continued)
object_bake = ObjectBake(
    BakeToggle=Button(),
    GeometryObjects=get_name.Geometry,
    Layer=panel_11,
    ObjectName=panel_11,
    ObjectColor=linear_gradient,
    LayerColor=linear_gradient)

# ----
custom_preview_lineweights = CustomPreviewLineweights(Geometry=get_name.Geometry, Shader=linear_gradient, Thickness=".1", Absolute=Toggle(True))

# ---- group: Preview and Bake
get_name_2 = GhPythonScript(Component=polygon)  # -> Geometry, Name; same code as get_name
linear_gradient_2 = GhPythonScript(R="0", G="0", B="0", Percent=".4")  # -> Color; same code as linear_gradient
custom_preview_2 = CustomPreview(Geometry=get_name_2.Geometry, Material=linear_gradient_2)

# ----
panel_12 = Panel(get_name_2.Name)

# ---- group: Preview and Bake (continued)
object_bake_2 = ObjectBake(
    BakeToggle=Button(),
    GeometryObjects=get_name_2.Geometry,
    Layer=panel_12,
    ObjectName=panel_12,
    ObjectColor=linear_gradient_2,
    LayerColor=linear_gradient_2)

# ----
custom_preview_lineweights_2 = CustomPreviewLineweights(Geometry=get_name_2.Geometry, Shader=linear_gradient_2, Thickness=".0025", Absolute=Toggle(True))

# ---- group: Preview and Bake
get_name_3 = GhPythonScript(Component=hatch_lines)  # -> Geometry, Name; same code as get_name
linear_gradient_3 = GhPythonScript(R="12", G="59", B="101", Percent=".5")  # -> Color; same code as linear_gradient
custom_preview_3 = CustomPreview(Geometry=get_name_3.Geometry, Material=linear_gradient_3)

# ----
panel_13 = Panel(get_name_3.Name)

# ---- group: Preview and Bake (continued)
object_bake_3 = ObjectBake(
    BakeToggle=Button(),
    GeometryObjects=get_name_3.Geometry,
    Layer=panel_13,
    ObjectName=panel_13,
    ObjectColor=linear_gradient_3,
    LayerColor=linear_gradient_3)

# ----
custom_preview_lineweights_3 = CustomPreviewLineweights(Geometry=get_name_3.Geometry, Shader=linear_gradient_3, Thickness=".1", Absolute=Toggle(True))

# ---- group: TEXT LABELS
text_size = Panel("1")
point_4 = Point(point)
add_text = Panel("a")
linear_gradient_4 = GhPythonScript(R="0", G="0", B="0", Percent=".5")  # -> Color; same code as linear_gradient

# ----
scale_4 = Scale(Geometry=point_4, Center=point_2, Factor="1.025")  # -> Geometry, Transform

# ---- group: TEXT LABELS (continued)
list_length_2 = ListLength(List=scale_4.Geometry)
series_5 = Series(Start=0, Step=1, Count=list_length_2)
integer = Integer(series_5)
concatenate = Concatenate(FragmentA=integer, FragmentB=add_text)
text_tag_3d = TextTag3D(Location=scale_4.Geometry, Text=concatenate, Size=text_size, Colour=linear_gradient_4, Justification=5)

# ---- group: Preview and Bake
# Preview and Bake
button = Button()
get_name_4 = GhPythonScript(Component=circle_a)  # -> Geometry, Name; same code as get_name
linear_gradient_5 = GhPythonScript(R="0", G="0", B="0", Percent=".5")  # -> Color; same code as linear_gradient
custom_preview_4 = CustomPreview(Geometry=get_name_4.Geometry, Material=linear_gradient_5)

# ----
panel_14 = Panel(get_name_4.Name)

# ---- group: Preview and Bake (continued)
object_bake_4 = ObjectBake(
    BakeToggle=button,
    GeometryObjects=get_name_4.Geometry,
    Layer=panel_14,
    ObjectName=panel_14,
    ObjectColor=linear_gradient_5,
    LayerColor=linear_gradient_5)

# ----
custom_preview_lineweights_4 = CustomPreviewLineweights(Geometry=get_name_4.Geometry, Shader=linear_gradient_5, Thickness=".0025", Absolute=Toggle(True))

# ---- group: Preview and Bake
get_name_5 = GhPythonScript(Component=centerlines_a)  # -> Geometry, Name; same code as get_name
linear_gradient_6 = GhPythonScript(R="0", G="0", B="0", Percent="1")  # -> Color; same code as linear_gradient
custom_preview_5 = CustomPreview(Geometry=get_name_5.Geometry, Material=linear_gradient_6)

# ----
panel_15 = Panel(get_name_5.Name)

# ---- group: Preview and Bake (continued)
object_bake_5 = ObjectBake(
    BakeToggle=Button(),
    GeometryObjects=get_name_5.Geometry,
    Layer=panel_15,
    ObjectName=panel_15,
    ObjectColor=linear_gradient_6,
    LayerColor=linear_gradient_6)

# ----
custom_preview_lineweights_5 = CustomPreviewLineweights(Geometry=get_name_5.Geometry, Shader=linear_gradient_6, Thickness=".0025", Absolute=Toggle(True))

# ---- group: Preview and Bake
get_name_6 = GhPythonScript(Component=dome_above_2)  # -> Geometry, Name; same code as get_name
linear_gradient_7 = GhPythonScript(R="0", G="0", B="0", Percent="1")  # -> Color; same code as linear_gradient
custom_preview_6 = CustomPreview(Geometry=get_name_6.Geometry, Material=linear_gradient_7)

# ----
panel_16 = Panel(get_name_6.Name)

# ---- group: Preview and Bake (continued)
object_bake_6 = ObjectBake(
    BakeToggle=Button(),
    GeometryObjects=get_name_6.Geometry,
    Layer=panel_16,
    ObjectName=panel_16,
    ObjectColor=linear_gradient_7,
    LayerColor=linear_gradient_7)

# ----
custom_preview_lineweights_6 = CustomPreviewLineweights(Geometry=get_name_6.Geometry, Shader=linear_gradient_7, Thickness=".1", Absolute=Toggle(True))

# ---- group: Preview and Bake
get_name_7 = GhPythonScript(Component=exterior_contours_2)  # -> Geometry, Name; same code as get_name
linear_gradient_8 = GhPythonScript(R="0", G="0", B="0", Percent=".5")  # -> Color; same code as linear_gradient
custom_preview_7 = CustomPreview(Geometry=get_name_7.Geometry, Material=linear_gradient_8)

# ----
panel_17 = Panel(get_name_7.Name)

# ---- group: Preview and Bake (continued)
object_bake_7 = ObjectBake(
    BakeToggle=Button(),
    GeometryObjects=get_name_7.Geometry,
    Layer=panel_17,
    ObjectName=panel_17,
    ObjectColor=linear_gradient_8,
    LayerColor=linear_gradient_8)

# ----
custom_preview_lineweights_7 = CustomPreviewLineweights(Geometry=get_name_7.Geometry, Shader=linear_gradient_8, Thickness=".1", Absolute=Toggle(True))

# ---- group: Preview and Bake
get_name_8 = GhPythonScript(Component=geometry_3)  # -> Geometry, Name; same code as get_name
linear_gradient_9 = GhPythonScript(R="0", G="0", B="0", Percent="1")  # -> Color; same code as linear_gradient
custom_preview_8 = CustomPreview(Geometry=get_name_8.Geometry, Material=linear_gradient_9)

# ----
panel_18 = Panel(get_name_8.Name)

# ---- group: Preview and Bake (continued)
object_bake_8 = ObjectBake(
    BakeToggle=Button(),
    GeometryObjects=get_name_8.Geometry,
    Layer=panel_18,
    ObjectName=panel_18,
    ObjectColor=linear_gradient_9,
    LayerColor=linear_gradient_9)

# ----
custom_preview_lineweights_8 = CustomPreviewLineweights(Geometry=get_name_8.Geometry, Shader=linear_gradient_9, Thickness=".1", Absolute=Toggle(True))

# ==== cluster Niche
angle_of_niche_rotation = ClusterInput()
divisor_of_niche_ratio = ClusterInput()
polygon_sides = ClusterInput()
polygon_side = ClusterInput()
center_of_niche = ClusterInput()

perpendicular = GhPythonScript(line=polygon_side)  # -> Perp; inputs line: Line
# ---------- perpendicular: Python ----------
__author__ = "mericson"
__version__ = "2019.01.11"

import rhinoscriptsyntax as rs
import math
import Rhino as rh

if line == None:
    line = None
else:
    a = 0,0,0
    b = 0,0,1
    Z = rs.VectorCreate(a,b)
    c = rh.Geometry.Line.PointAt(line,1)
    d = rh.Geometry.Line.PointAt(line,0)
    vector2 = rs.VectorCreate(c,d)
    Perp = rs.VectorRotate(vector2,90,Z)
# ---------- end perpendicular ----------
length = Length(Curve=polygon_side)
construct_plane = ConstructPlane(Origin=center_of_niche, XAxis=polygon_side, YAxis=perpendicular)
division = Division(A=length, B=divisor_of_niche_ratio)
rotate = Rotate(Geometry=construct_plane, Angle=degrees(angle_of_niche_rotation), Plane=center_of_niche)  # -> Geometry, Transform
polygon = Polygon(Plane=rotate.Geometry, Radius=division, Segments=polygon_sides, FilletRadius=0)  # -> Polygon, Length

polygon_2 = ClusterOutput(polygon.Polygon)

# ==== cluster PointOnLine
point_value = ClusterInput()
curve = ClusterInput()
point_value_2 = Number(point_value)

# ---- group: point on curv
end_points = EndPoints(Curve=curve)  # -> Start, End
panel = Panel(point_value_2)
point = Point(end_points.Start)
point_2 = Point(end_points.End)
addition = Addition(A=point, B=point_2)
multiplication = Multiplication(A=addition, B=panel)

# ----
result = ClusterOutput(multiplication)
