# Grasshopper definition 191001_Section to Form_Inclass.gh (Grasshopper 1.0.7)

division = Division(A="360", B="12")
xy_plane = XYPlane(Origin=Point(0, 0, 0))
series = Series(Start=0, Step=division, Count="12")
circle = Circle(Plane=xy_plane, Radius="60")
rotate_plane = RotatePlane(Plane=xy_plane, Angle=degrees(series))
polygon = Polygon(Plane=rotate_plane, Radius="60", Segments="4", FilletRadius=0)  # -> Polygon, Length

# ---- group: Polygon Side
list_item = ListItem(List=polygon.Polygon, Index=0, Wrap=True)
explode = Explode(Curve=list_item, Recursive=True)  # -> Segments, Vertices
list_item_2 = ListItem(List=explode.Segments, Index=0, Wrap=True)

# ---- group: Karbandi
center_of_drawing = Point(xy_plane)
number_of_polygons = Number("12")
side_of_polygon = Line(list_item_2)
number = Number(".5")
line = Line(side_of_polygon)
center_of_drawing_2 = Plane(center_of_drawing)
line_2 = Line(line)
division_2 = Division(A=number_of_polygons, B="2")

# ---- group: Karbandi / Perpendicular to Section line
end_points = EndPoints(Curve=side_of_polygon)  # -> Start, End
reverse = Reverse(Vector=side_of_polygon)
perpendicular = GhPythonScript(line=side_of_polygon)  # -> Perp; inputs line: Line
# ---------- perpendicular: Python ----------
__author__ = "mericson"
__version__ = "2019.01.11"

import rhinoscriptsyntax as rs
import math
import Rhino as rh

if line == None:
    line = None
else:
    a = 0,0,0
    b = 0,0,1
    Z = rs.VectorCreate(a,b)
    c = rh.Geometry.Line.PointAt(line,1)
    d = rh.Geometry.Line.PointAt(line,0)
    vector2 = rs.VectorCreate(c,d)
    Perp = rs.VectorRotate(vector2,90,Z)
# ---------- end perpendicular ----------
construct_plane = ConstructPlane(Origin=[end_points.Start, end_points.End], XAxis=[side_of_polygon, reverse], YAxis=perpendicular)

# ---- group: Karbandi (continued)
plane = Plane(construct_plane)
vector = Vector(perpendicular)

# ---- group: Karbandi / 2d section
length = Length(Curve=line)
multiplication = Multiplication(A=length, B=number)
line_sdl = LineSDL(Start=plane, Direction=vector, Length=multiplication)
point_on_curve = PointOnCurve(line_sdl, parameter=0)
list_item_3 = ListItem(List=plane, Index="1", Wrap=True)
list_item_4 = ListItem(List=point_on_curve, Index=0, Wrap=True)
move = Move(Geometry=plane, Motion=line_sdl)  # -> Geometry, Transform
radians = Radians(Degrees="60")
distance = Distance(PointA=list_item_4, PointB=list_item_3)
arc = Arc(Plane=move.Geometry, Radius=distance, Angle=radians)  # -> Arc, Length
join_curves = JoinCurves(Curves=[line_sdl, arc.Arc], Preserve=False)

# ---- group: Karbandi (continued)
curve = Curve(join_curves)

# ---- group: Karbandi / section 3d
reverse_2 = Reverse(Vector=line_2)
point_on_curve_2 = PointOnCurve(line_2, parameter=0.5)
rotate_3d = Rotate3D(Geometry=curve, Angle=degrees("90"), Center=point_on_curve_2, Axis=reverse_2)  # -> Geometry, Transform
polar_array = PolarArray(Geometry=rotate_3d.Geometry, Plane=center_of_drawing_2, Count=division_2, Angle=6.283185307)  # -> Geometry, Transform

# ---- group: Karbandi (continued)
point_on_curve_3 = PointOnCurve(rotate_3d.Geometry, parameter=0.5)

deconstruct = Deconstruct(Point=point_on_curve_3)  # -> XComponent, YComponent, ZComponent
arrayed_sections = Geometry(polar_array.Geometry)
plane_2 = Plane(center_of_drawing_2)
division_3 = Division(A=deconstruct.ZComponent, B="90")
series_2 = Series(Start="0", Step=division_3, Count="90")
unit_z = UnitZ(Factor=series_2)
move_2 = Move(Geometry=plane_2, Motion=graft(unit_z))  # -> Geometry, Transform
curve_plane = CurvePlane(Curve=arrayed_sections, Plane=move_2.Geometry)  # -> flatten(Points), ParamsC, ParamsP
partition_list = PartitionList(List=curve_plane.Points, Size=number_of_polygons)
convex_hull = ConvexHull(Points=partition_list, Plane=move_2.Geometry)  # -> Hull, HullZ, Indices

geometry = Geometry(convex_hull.Hull)
