# Grasshopper definition variation 1.gh (Grasshopper 1.0.7)
# plug-ins: Human

gate = Panel("1")
radius = Panel("60")
polygone_a = Panel("6")
polygone_b = Panel("6")
scale_factor_circle_b = Panel("1.35")
size_niches = Panel("1")
size_aperture = Panel("0.55")
plane = Panel("0,0,0")
plane_2 = Plane(plane)
multiplication_polygon_b = Panel("1.1691")
polygon = Polygon(Plane=PlaneXY(0, 0, 0), Radius=radius, Segments=polygone_a, FilletRadius=0)  # -> Polygon, Length
multiplication = Multiplication(A=radius, B=multiplication_polygon_b)
polygon_2 = Polygon(Plane=PlaneXY(0, 0, 0), Radius=multiplication, Segments=polygone_b, FilletRadius=0)  # -> Polygon, Length
explode = Explode(Curve=polygon.Polygon, Recursive=True)  # -> Segments, Vertices
panel = Panel("""0
1
2
4
5""")
point_on_curve = PointOnCurve(explode.Segments, parameter=0.5)
region_difference = RegionDifference(CurvesA=polygon_2.Polygon, CurvesB=polygon.Polygon)
cull_index = CullIndex(List=point_on_curve, Indices=panel, Wrap=True)
explode_2 = Explode(Curve=polygon_2.Polygon, Recursive=True)  # -> Segments, Vertices
circle = Circle(Plane=PlaneXY(0, 0, 0), Radius=cull_index)
scale = Scale(Geometry=circle, Center=Point(0, 0, 0), Factor=scale_factor_circle_b)  # -> Geometry, Transform
divide_curve = DivideCurve(Curve=scale.Geometry, Count=polygone_b, Kinks=False)  # -> Points, Tangents, Parameters
point = Point(divide_curve.Points)
line = Line(StartPoint=plane_2, EndPoint=point)
trim_with_region = TrimWithRegion(Curve=line, Region=polygon.Polygon)  # -> Inside, Outside
geometry = Geometry(trim_with_region.Outside)
line_2 = Line(geometry)
length = Length(Curve=line_2)
length_2 = Length(Curve=line_2)
line_3 = Line(explode_2.Segments)
multiplication_2 = Multiplication(A=length, B=size_niches)
multiplication_3 = Multiplication(A=length_2, B=size_aperture)

# ---- group: niche
panel_2 = Panel("""0
1""")
sift_pattern = SiftPattern(List=line_3, SiftPattern=panel_2)  # -> Output0, Output1, Output2
list_length = ListLength(List=line_3)
multiplication_4 = Multiplication(A=list_length, B="1")
multiplication_5 = Multiplication(A="1", B=list_length)
side_a = Geometry(sift_pattern.Output0)
side_b = Geometry(sift_pattern.Output1)
niche = Niche(niche_rotation="0", point_value="0.5", polygone_side=side_a, niche_sides=multiplication_5, niche_prop=multiplication_2)
niche_2 = Niche(niche_rotation="0", point_value="0.5", polygone_side=side_b, niche_sides=multiplication_4, niche_prop=multiplication_2)

# ----
geometry_2 = Geometry(niche)
geometry_3 = Geometry(niche_2)

# ---- group: niche 2
niche_3 = Niche(niche_rotation="0", point_value="0.5", polygone_side=line_3, niche_sides="6", niche_prop=multiplication_3)
geometry_4 = Geometry(niche_3)
rotate = Rotate(Geometry=geometry_4, Angle=degrees("90"), Plane=PlaneXY(0, 0, 0))  # -> Geometry, Transform
panel_3 = Panel("""0
1
2""")
sift_pattern_2 = SiftPattern(List=rotate.Geometry, SiftPattern=panel_3)  # -> Output0, Output1, Output2
geometry_5 = Geometry(flatten(sift_pattern_2.Output1))

# ----
region_difference_2 = RegionDifference(CurvesA=polygon_2.Polygon, CurvesB=[geometry_2, geometry_3])

# ---- group: list
panel_4 = Panel("""1
4
7
10
13
16""")
partition_list = PartitionList(List=geometry_5, Size=[3, 2])  # -> flatten(Chunks)
list_item = ListItem(List=partition_list, Index=panel_4, Wrap=True)  # -> flatten(Item)
geometry_6 = Geometry(list_item)

# ----
geometry_7 = Geometry(polygon.Polygon)
region_difference_3 = RegionDifference(CurvesA=region_difference_2, CurvesB=geometry_6)
region_difference_4 = RegionDifference(CurvesA=region_difference_3, CurvesB=geometry_7)
region_difference_5 = RegionDifference(CurvesA=scale.Geometry, CurvesB=polygon_2.Polygon)

# ---- group: hatch 1
stream_filter = StreamFilter(Gate=0, Stream0=region_difference_4)
boundary_surfaces = BoundarySurfaces(Edges=stream_filter)
vector_at_angle = PythonScript(angle="45")  # -> vector
# ---------- vector_at_angle: Python ----------
import rhinoscriptsyntax as rs
import math
if angle == None:
    Vector = None
else:
    c=rs.AddPoint(0,0,0)
    f=math.radians(float(angle))
    l=rs.AddPoint(math.cos(f),math.sin(f),0)
    d=rs.VectorCreate(l,c)
    vector =rs.VectorUnitize(d)
# ---------- end vector_at_angle ----------
contour = Contour(Shape=boundary_surfaces, Point=Point(0, 0, 0), Direction=vector_at_angle, Distance="2")

# ---- group: hatch 2
stream_filter_2 = StreamFilter(Gate=0, Stream0=region_difference_5)
boundary_surfaces_2 = BoundarySurfaces(Edges=stream_filter_2)
vector_at_angle_2 = PythonScript(angle="45")  # -> vector; same code as vector_at_angle
contour_2 = Contour(Shape=boundary_surfaces_2, Point=Point(0, 0, 0), Direction=vector_at_angle_2, Distance="2")

# ----
geometry_8 = Geometry(contour)
geometry_9 = Geometry(contour_2)
list_of_points_to_label = Point(plane_2)
exterior_walls = Geometry(region_difference_4)
circle_b = Geometry(scale.Geometry)
circle_a = Geometry(circle)
axis = Geometry(line)
apeture = Geometry(geometry_5)
region_difference_6 = RegionDifference(CurvesA=circle_b, CurvesB=apeture)
region_difference_7 = RegionDifference(CurvesA=exterior_walls, CurvesB=apeture)
region_difference_8 = RegionDifference(CurvesA=region_difference_6, CurvesB=exterior_walls)
region_difference_9 = RegionDifference(CurvesA=region_difference_8, CurvesB=geometry_7)

# ---- group: hatch 0
stream_filter_3 = StreamFilter(Gate=0, Stream0=region_difference_9)
boundary_surfaces_3 = BoundarySurfaces(Edges=stream_filter_3)
vector_at_angle_3 = PythonScript(angle="45")  # -> vector; same code as vector_at_angle
contour_3 = Contour(Shape=boundary_surfaces_3, Point=Point(0, 0, 0), Direction=vector_at_angle_3, Distance="2")

stream_filter_4 = StreamFilter(Gate=0, Stream0=region_difference_7)
boundary_surfaces_4 = BoundarySurfaces(Edges=stream_filter_4)
vector_at_angle_4 = PythonScript(angle="45")  # -> vector; same code as vector_at_angle
contour_4 = Contour(Shape=boundary_surfaces_4, Point=Point(0, 0, 0), Direction=vector_at_angle_4, Distance="2")

# ----
geometry_10 = Geometry(contour_4)
geometry_11 = Geometry(contour_3)
circle_a_2 = Circle(circle_a)
list_of_points_to_label_2 = Point(list_of_points_to_label)
geometry_12 = Geometry(flatten(region_difference_9))
exterior_walls_2 = Geometry(region_difference_4)
axis_2 = Geometry(axis)
circle_b_2 = Geometry(circle_b)

# ---- group: exterior wall
panel_5 = Panel("""0
1""")
list_item_2 = ListItem(List=geometry_12, Index=panel_5, Wrap=True)
explode_3 = Explode(Curve=list_item_2, Recursive=True)  # -> Segments, Vertices
panel_6 = Panel("""17
34""")
list_item_3 = ListItem(List=flatten(explode_3.Segments), Index=panel_6, Wrap=True)
scale_2 = Scale(Geometry=list_item_3, Center=Point(0, 0, 0), Factor="1.1")  # -> Geometry, Transform
end_points = EndPoints(Curve=list_item_3)  # -> Start, End
end_points_2 = EndPoints(Curve=scale_2.Geometry)  # -> Start, End
line_4 = Line(StartPoint=end_points.Start, EndPoint=end_points_2.Start)
line_5 = Line(StartPoint=end_points.End, EndPoint=end_points_2.End)
join_curves = JoinCurves(Curves=[scale_2.Geometry, line_5, line_4, list_item_3], Preserve=False)

# ----
list_item_4 = ListItem(List=axis_2, Index=0, Wrap=True)

# ---- group: hatch 0
stream_filter_5 = StreamFilter(Gate=0, Stream0=join_curves)
boundary_surfaces_5 = BoundarySurfaces(Edges=stream_filter_5)
vector_at_angle_5 = PythonScript(angle="45")  # -> vector; same code as vector_at_angle
contour_5 = Contour(Shape=boundary_surfaces_5, Point=Point(0, 0, 0), Direction=vector_at_angle_5, Distance="2")

# ----
geometry_13 = Geometry(contour_5)
geometry_14 = Geometry(join_curves)
stream_filter_6 = StreamFilter(Gate=gate, Stream0=geometry_11, Stream1=[geometry_8, geometry_13], Stream2=geometry_9, Stream3=geometry_10)

# ---- group: Preview and Bake
button = Button()
get_name = GhPythonScript(Component=circle_a_2)  # -> Geometry, Name
# ---------- get_name: Python ----------
# Mark Ericson 1.17.19
   #take from forum discussion thread https://www.grasshopper3d.com/forum/topics/python-get-label-name-of-input-components
    #edited version of code  by Mostapha Sadeghipour Roudsari

def GetComponentName():
    Comp = ghenv.Component.Params.Input[0]
    sources = Comp.Sources

    if sources.Count == 0: 
        return components

    for source in sources:
        attr = source.Attributes
        if (attr is None) or (attr.GetTopLevel is None):
            pass
        else:

            component = attr.GetTopLevel.DocObject
            componentName = component.NickName

            return componentName

if Component == None:
    pass
else:
    Name = GetComponentName()
    Geometry = Component
# ---------- end get_name ----------
linear_gradient = GhPythonScript(R="0", G="0", B="0", Percent="0.5")  # -> Color
# ---------- linear_gradient: Python ----------
__author__ = "ericsonm"
__version__ = "2019.01.15"

import rhinoscriptsyntax as rs

def LinearColorGradient(R,G,B,R2,G2,B2,ColorPercentage):
    
    if ColorPercentage > 1:
        R3 = None
        G3 = None
        B3 = None
    else:
        #This function defines linear color gradient by treating R,G,B as coordinates on a 3D line.
        #The base color that will be altered by the percentage should be entered in the second R2,G2,B2 valu
    
        Rdiff = float(R2) - float(R)
        Gdiff = float(G2) - float(G)
        Bdiff = float(B2) - float(B)


        t = float(ColorPercentage)


        R3 = float(R) + Rdiff*t
        G3 = float(G) + Gdiff*t
        B3 = float(B) + Bdiff*t



    return R3,G3,B3


if (R or G or B or Percent) is None:
    Color = None
else: 
    Color1 = LinearColorGradient(255,255,255,R,G,B,Percent)

    R3 = Color1[0]
    G3 = Color1[1]
    B3 = Color1[2]

    Color = rs.CreateColor(R3,G3,B3)
# ---------- end linear_gradient ----------
custom_preview = CustomPreview(Geometry=get_name.Geometry, Material=linear_gradient)

# ---- group: TEXT LABELS
text_size = Panel("2")
point_2 = Point(list_of_points_to_label_2)
add_text = Panel("O1")
list_length_2 = ListLength()
linear_gradient_2 = GhPythonScript(R="0", G="0", B="0", Percent=".5")  # -> Color; same code as linear_gradient
series = Series(Start=0, Step=1, Count=list_length_2)
integer = Integer(series)
concatenate = Concatenate(FragmentA=integer, FragmentB=add_text)
text_tag_3d = TextTag3D(Location=point_2, Text=concatenate, Size=text_size, Colour=linear_gradient_2, Justification=5)

# ---- group: Preview and Bake
button_2 = Button()
get_name_2 = GhPythonScript(Component=axis_2)  # -> Geometry, Name; same code as get_name
linear_gradient_3 = GhPythonScript(R="0", G="0", B="0", Percent="0.5")  # -> Color; same code as linear_gradient
custom_preview_2 = CustomPreview(Geometry=get_name_2.Geometry, Material=linear_gradient_3)

button_3 = Button()
get_name_3 = GhPythonScript(Component=geometry_14)  # -> Geometry, Name; same code as get_name
linear_gradient_4 = GhPythonScript(R="0", G="0", B="0", Percent="1")  # -> Color; same code as linear_gradient
custom_preview_3 = CustomPreview(Geometry=get_name_3.Geometry, Material=linear_gradient_4)

button_4 = Button()
get_name_4 = GhPythonScript(Component=exterior_walls_2)  # -> Geometry, Name; same code as get_name
linear_gradient_5 = GhPythonScript(R="0", G="0", B="0", Percent="1")  # -> Color; same code as linear_gradient
custom_preview_4 = CustomPreview(Geometry=get_name_4.Geometry, Material=linear_gradient_5)

button_5 = Button()
get_name_5 = GhPythonScript(Component=stream_filter_6)  # -> Geometry, Name; same code as get_name
linear_gradient_6 = GhPythonScript(R="0", G="0", B="0", Percent="0.25")  # -> Color; same code as linear_gradient
custom_preview_5 = CustomPreview(Geometry=get_name_5.Geometry, Material=linear_gradient_6)

# ----
panel_7 = Panel(get_name.Name)
panel_8 = Panel(get_name_2.Name)
panel_9 = Panel(get_name_3.Name)
panel_10 = Panel(get_name_4.Name)
panel_11 = Panel(get_name_5.Name)
custom_preview_lineweights = CustomPreviewLineweights(Geometry=get_name.Geometry, Shader=linear_gradient, Thickness=".0025", Absolute=Toggle(True))
custom_preview_lineweights_2 = CustomPreviewLineweights(Geometry=get_name_2.Geometry, Shader=linear_gradient_3, Thickness=".0025", Absolute=Toggle(True))
custom_preview_lineweights_3 = CustomPreviewLineweights(Geometry=get_name_3.Geometry, Shader=linear_gradient_4, Thickness=".0025", Absolute=Toggle(True))
custom_preview_lineweights_4 = CustomPreviewLineweights(Geometry=get_name_4.Geometry, Shader=linear_gradient_5, Thickness=".0025", Absolute=Toggle(True))
custom_preview_lineweights_5 = CustomPreviewLineweights(Geometry=get_name_5.Geometry, Shader=linear_gradient_6, Thickness=".0025", Absolute=Toggle(True))

# ---- group: section and 3d / wall
panel_12 = Panel("""0
1""")
polygone_with_niches = Geometry(region_difference_4)
polygone_b_2 = Geometry(polygon_2.Polygon)
list_item_5 = ListItem(List=flatten(polygone_with_niches), Index=panel_12, Wrap=True)
explode_4 = Explode(Curve=list_item_5, Recursive=True)  # -> flatten(Segments), Vertices
panel_13 = Panel("""0
1
2
3
4
5
6
22
23
24
25
26
42
43""")
cull_index_2 = CullIndex(List=explode_4.Segments, Indices=panel_13, Wrap=True)
list_item_6 = ListItem(List=cull_index_2, Index="5", Wrap=True)
join_curves_2 = JoinCurves(Curves=cull_index_2, Preserve=False)
line_6 = Line(list_item_6)
line_7 = Line(line_6)
point_on_curve_2 = PointOnCurve(line_7, parameter=0.5)
line_8 = Line(list_item_4)
length_3 = Length(Curve=line_8)
multiplication_6 = Multiplication(A=length_3, B="1/2")
radians = Radians(Degrees="60")
point_3 = Point(point_on_curve_2)
reverse = Reverse(Vector=line_7)
division = Division(A="12", B="2")
panel_14 = Panel("""0
1
4
5""")

# ---- group: section and 3d / wall / perpendicular to section lines
end_points_3 = EndPoints(Curve=line_6)  # -> Start, End
perpendicular = GhPythonScript(line=line_6)  # -> Perp; inputs line: Line
# ---------- perpendicular: Python ----------
__author__ = "mericson"
__version__ = "2019.01.11"

import rhinoscriptsyntax as rs
import math
import Rhino as rh

if line == None:
    line = None
else:
    a = 0,0,0
    b = 0,0,1
    Z = rs.VectorCreate(a,b)
    c = rh.Geometry.Line.PointAt(line,1)
    d = rh.Geometry.Line.PointAt(line,0)
    vector2 = rs.VectorCreate(c,d)
    Perp = rs.VectorRotate(vector2,90,Z)
# ---------- end perpendicular ----------
reverse_2 = Reverse(Vector=line_6)
construct_plane = ConstructPlane(Origin=[end_points_3.Start, end_points_3.End], XAxis=[line_6, reverse_2], YAxis=perpendicular)

# ---- group: dome a
circle_a_3 = Geometry(circle_a_2)
divide_curve_2 = DivideCurve(Curve=circle_a_3, Count="2", Kinks=False)  # -> Points, Tangents, Parameters
list_item_7 = ListItem(List=flatten(divide_curve_2.Points), Index=0, Wrap=True)
line_9 = Line(StartPoint=plane_2, EndPoint=list_item_7)
line_10 = Line(line_9)
line_11 = Line(line_10)
point_on_curve_3 = PointOnCurve(line_11, parameter=0.5)
line_12 = Line(list_item_4)
length_4 = Length(Curve=line_12)
multiplication_7 = Multiplication(A=length_4, B="1/2")
radians_2 = Radians(Degrees="90")
point_4 = Point(point_on_curve_3)
reverse_3 = Reverse(Vector=point_4)
unit_z = UnitZ(Factor=1)
geometry_15 = Geometry(circle_a_3)
line_sdl = LineSDL(Start=geometry_15, Direction=unit_z, Length=1)

# ---- group: dome a / perpendicular to section lines
end_points_4 = EndPoints(Curve=line_10)  # -> Start, End
perpendicular_2 = GhPythonScript(line=line_10)  # -> Perp; inputs line: Line; same code as perpendicular
reverse_4 = Reverse(Vector=line_10)
construct_plane_2 = ConstructPlane(Origin=[end_points_4.Start, end_points_4.End], XAxis=[line_10, reverse_4], YAxis=perpendicular_2)

# ---- group: dome a (continued)
vector = Vector(perpendicular_2)
plane_3 = Plane(construct_plane_2)
line_sdl_2 = LineSDL(Start=plane_3, Direction=vector, Length=multiplication_7)
move = Move(Geometry=plane_3, Motion=line_sdl_2)  # -> Geometry, Transform
point_on_curve_4 = PointOnCurve(line_sdl_2, parameter=0)
list_item_8 = ListItem(List=line_sdl_2, Index="1", Wrap=True)
list_item_9 = ListItem(List=point_on_curve_4, Index=0, Wrap=True)
list_item_10 = ListItem(List=point_on_curve_4, Index="1", Wrap=True)
distance = Distance(PointA=list_item_10, PointB=list_item_9)
arc = Arc(Plane=move.Geometry, Radius=distance, Angle=radians_2)  # -> Arc, Length
list_item_11 = ListItem(List=arc.Arc, Index=0, Wrap=True)
join_curves_3 = JoinCurves(Curves=[list_item_11, list_item_8], Preserve=False)
scale_3 = Scale(Geometry=join_curves_3, Center=point_4, Factor=".85")  # -> Geometry, Transform
rotate_3d = Rotate3D(Geometry=join_curves_3, Angle=degrees("90"), Center=point_4, Axis=reverse_3)  # -> Geometry, Transform
rail_revolution = RailRevolution(Curve=rotate_3d.Geometry, Rail=geometry_15, Axis=line_sdl, Scale=False)

# ----
join_curves_4 = JoinCurves(Curves=[arc.Arc, line_sdl_2], Preserve=False)
geometry_16 = Geometry(join_curves_4)
dome_a = Geometry(rail_revolution)

# ---- group: dome b
circle_b_3 = Geometry(circle_b_2)
divide_curve_3 = DivideCurve(Curve=circle_b_3, Count="2", Kinks=False)  # -> Points, Tangents, Parameters
list_item_12 = ListItem(List=flatten(divide_curve_3.Points), Index=0, Wrap=True)
line_13 = Line(StartPoint=plane_2, EndPoint=list_item_12)
line_14 = Line(line_13)
line_15 = Line(line_14)
point_on_curve_5 = PointOnCurve(line_15, parameter=0.5)
line_16 = Line(list_item_4)
length_5 = Length(Curve=line_16)
multiplication_8 = Multiplication(A=length_5, B="1/2")
radians_3 = Radians(Degrees="90")
point_5 = Point(point_on_curve_5)
reverse_5 = Reverse(Vector=point_5)
unit_z_2 = UnitZ(Factor=1)
geometry_17 = Geometry(circle_b_3)
line_sdl_3 = LineSDL(Start=geometry_17, Direction=unit_z_2, Length=1)

# ---- group: dome b / perpendicular to section lines
end_points_5 = EndPoints(Curve=line_14)  # -> Start, End
perpendicular_3 = GhPythonScript(line=line_14)  # -> Perp; inputs line: Line; same code as perpendicular
reverse_6 = Reverse(Vector=line_14)
construct_plane_3 = ConstructPlane(Origin=[end_points_5.Start, end_points_5.End], XAxis=[line_14, reverse_6], YAxis=perpendicular_3)

# ---- group: dome b (continued)
vector_2 = Vector(perpendicular_3)
plane_4 = Plane(construct_plane_3)
line_sdl_4 = LineSDL(Start=plane_4, Direction=vector_2, Length=multiplication_8)
move_2 = Move(Geometry=plane_4, Motion=line_sdl_4)  # -> Geometry, Transform
point_on_curve_6 = PointOnCurve(line_sdl_4, parameter=0)
list_item_13 = ListItem(List=line_sdl_4, Index="1", Wrap=True)
list_item_14 = ListItem(List=point_on_curve_6, Index=0, Wrap=True)
list_item_15 = ListItem(List=point_on_curve_6, Index="1", Wrap=True)
distance_2 = Distance(PointA=list_item_15, PointB=list_item_14)
arc_2 = Arc(Plane=move_2.Geometry, Radius=distance_2, Angle=radians_3)  # -> Arc, Length
list_item_16 = ListItem(List=arc_2.Arc, Index=0, Wrap=True)
join_curves_5 = JoinCurves(Curves=[list_item_16, list_item_13], Preserve=False)
scale_4 = Scale(Geometry=join_curves_5, Center=point_5, Factor=".85")  # -> Geometry, Transform
rotate_3d_2 = Rotate3D(Geometry=join_curves_5, Angle=degrees("90"), Center=point_5, Axis=reverse_5)  # -> Geometry, Transform
rail_revolution_2 = RailRevolution(Curve=rotate_3d_2.Geometry, Rail=geometry_17, Axis=line_sdl_3, Scale=False)

# ----
join_curves_6 = JoinCurves(Curves=[line_sdl_4, arc_2.Arc], Preserve=False)
section_circle_b = Geometry(join_curves_6)
dome_b = Geometry(rail_revolution_2)

# ---- group: section and 3d / wall (continued)
plane_5 = Plane(construct_plane)
vector_3 = Vector(perpendicular)
line_sdl_5 = LineSDL(Start=plane_5, Direction=vector_3, Length=multiplication_6)
move_3 = Move(Geometry=plane_5, Motion=line_sdl_5)  # -> Geometry, Transform
point_on_curve_7 = PointOnCurve(line_sdl_5, parameter=0)
list_item_17 = ListItem(List=point_on_curve_7, Index=0, Wrap=True)
list_item_18 = ListItem(List=point_on_curve_7, Index="1", Wrap=True)
distance_3 = Distance(PointA=list_item_18, PointB=list_item_17)
arc_3 = Arc(Plane=move_3.Geometry, Radius=distance_3, Angle=radians)  # -> Arc, Length
join_curves_7 = JoinCurves(Curves=[arc_3.Arc, line_sdl_5], Preserve=False)
scale_5 = Scale(Geometry=join_curves_7, Center=point_3, Factor=".85")  # -> Geometry, Transform
rotate_3d_3 = Rotate3D(Geometry=join_curves_7, Angle=degrees("90"), Center=point_3, Axis=reverse)  # -> Geometry, Transform
polar_array = PolarArray(Geometry=rotate_3d_3.Geometry, Plane=plane_2, Count=division, Angle=degrees("360"))  # -> Geometry, Transform
geometry_18 = Geometry(polar_array.Geometry)
mirror = Mirror(Geometry=geometry_18, Plane=PlaneYZ(0, 0, 0))  # -> Geometry, Transform
geometry_19 = Geometry(mirror.Geometry)
list_item_19 = ListItem(List=geometry_19, Index=panel_14, Wrap=True)

point_on_curve_8 = PointOnCurve(rotate_3d_3.Geometry, parameter=0.5)
deconstruct = Deconstruct(Point=point_on_curve_8)  # -> XComponent, YComponent, ZComponent
division_2 = Division(A=deconstruct.ZComponent, B="10")
series_2 = Series(Start="0", Step=division_2, Count=10)
unit_z_3 = UnitZ(Factor=series_2)
move_4 = Move(Geometry=plane_2, Motion=graft(unit_z_3))  # -> Geometry, Transform

curve_plane = CurvePlane(Curve=geometry_19, Plane=move_4.Geometry)  # -> flatten(Points), ParamsC, ParamsP
partition_list_2 = PartitionList(List=curve_plane.Points, Size="12")  # -> flatten(Chunks)
convex_hull = ConvexHull(Points=partition_list_2, Plane=move_4.Geometry)  # -> Hull, HullZ, Indices
loft = Loft(
    Curves=flatten(convex_hull.Hull),
    Options={Adjust=False, Closed=False, LoftEnds=0, LoftSimp=0, LoftType=0, Rebuild=10, Refit=0.01})

# ----
geometry_20 = Geometry(scale_5.Geometry)
wall = Geometry(loft)
arch_1 = Geometry(join_curves_7)
walls = Geometry(wall)
stream_filter_7 = StreamFilter(Gate=Toggle(False), Stream0=[dome_a, walls], Stream1=[dome_b, dome_a])

# ---- group: Preview and Bake
button_6 = Button()
get_name_6 = GhPythonScript(Component=stream_filter_7)  # -> Geometry, Name; same code as get_name
linear_gradient_7 = GhPythonScript(R="0", G="0", B="0", Percent="0")  # -> Color; same code as linear_gradient
custom_preview_6 = CustomPreview(Geometry=get_name_6.Geometry, Material=linear_gradient_7)

button_7 = Button()
get_name_7 = GhPythonScript(Component=[arch_1, section_circle_b, geometry_16])  # -> Geometry, Name; same code as get_name
linear_gradient_8 = GhPythonScript(R="0", G="0", B="0", Percent=".75")  # -> Color; same code as linear_gradient
custom_preview_7 = CustomPreview(Geometry=get_name_7.Geometry, Material=linear_gradient_8)

# ----
panel_15 = Panel(get_name_6.Name)
panel_16 = Panel(get_name_7.Name)
custom_preview_lineweights_6 = CustomPreviewLineweights(Geometry=get_name_6.Geometry, Shader=linear_gradient_7, Thickness=".0025", Absolute=Toggle(True))
custom_preview_lineweights_7 = CustomPreviewLineweights(Geometry=get_name_7.Geometry, Shader=linear_gradient_8, Thickness=".0025", Absolute=Toggle(True))

# ==== cluster Niche
niche_rotation = ClusterInput()
point_value = ClusterInput()
polygone_side = ClusterInput()
niche_sides = ClusterInput()
niche_prop = ClusterInput()

niche_rotation_2 = Number(niche_rotation)
point_value_2 = Number(point_value)
polygone_side_2 = Line(polygone_side)
niche_sides_2 = Number(niche_sides)
niche_prop_2 = Number(niche_prop)
point_on_line = PointOnLine(line=polygone_side_2, number=point_value_2)
length = Length(Curve=polygone_side_2)
division = Division(A=length, B=niche_prop_2)
rotate = Rotate(Geometry=polygone_side_2, Angle=degrees("90"), Plane=point_on_line)  # -> Geometry, Transform
construct_plane = ConstructPlane(Origin=point_on_line, XAxis=polygone_side_2, YAxis=rotate.Geometry)
rotate_2 = Rotate(Geometry=construct_plane, Angle=degrees(niche_rotation_2), Plane=point_on_line)  # -> Geometry, Transform
polygon = Polygon(Plane=rotate_2.Geometry, Radius=division, Segments=niche_sides_2, FilletRadius=0)  # -> Polygon, Length
niche = Geometry(polygon.Polygon)

niche_2 = ClusterOutput(niche)

# ==== cluster PointOnLine
line = ClusterInput()
number = ClusterInput()

line_2 = Line(line)
number_2 = Number(number)
end_points = EndPoints(Curve=line_2)  # -> Start, End
addition = Addition(A=end_points.Start, B=end_points.End)
multiplication = Multiplication(A=addition, B=number_2)

point = Point(multiplication)
point_2 = ClusterOutput(point)
