# Grasshopper definition variation 2.gh (Grasshopper 1.0.7)
# plug-ins: Human

plans_2 = Panel("20")
origin = Panel("0,0,0")
polygon = Panel("6")
radius = Panel("60")
polygon_2 = Polygon(Plane=origin, Radius=radius, Segments=polygon, FilletRadius=0)  # -> Polygon, Length
wall_scale = Panel("0.75")
circle = Circle(Plane=origin, Radius=radius)
origin_2 = Point(origin)
explode = Explode(Curve=polygon_2.Polygon, Recursive=True)  # -> Segments, Vertices
divide_curve = DivideCurve(Curve=polygon_2.Polygon, Count=plans_2, Kinks=False)  # -> Points, Tangents, Parameters
scale = Scale(Geometry=circle, Center=origin, Factor=wall_scale)  # -> Geometry, Transform
length = Length(Curve=explode.Segments)
division = Panel("5")
point = Point(divide_curve.Points)
circle_b = Geometry(circle)
circle_a = Geometry(scale.Geometry)
division_2 = Division(A=length, B=division)
polygone = Geometry(polygon_2.Polygon)
panel = Panel("""0
1
2""")
sift_pattern = SiftPattern(List=point, SiftPattern=panel)  # -> Output0, Output1, Output2
geometry = Geometry(sift_pattern.Output1)
geometry_2 = Geometry(sift_pattern.Output0)
geometry_3 = Geometry(sift_pattern.Output2)

panel_2 = Panel("""0
10""")
list_item = ListItem(List=point, Index=panel_2, Wrap=True)
polygon_3 = Polygon(Plane=list_item, Radius=division_2, Segments="6", FilletRadius=0)  # -> Polygon, Length
scale_2 = Scale(Geometry=polygon_3.Polygon, Center=list_item, Factor="1.2")  # -> Geometry, Transform
rotate = Rotate(Geometry=scale_2.Geometry, Angle=degrees("90"), Plane=list_item)  # -> Geometry, Transform

panel_3 = Panel("""3
6
9
12
15""")
list_item_2 = ListItem(List=geometry_2, Index=panel_3, Wrap=True)
polygon_4 = Polygon(Plane=list_item_2, Radius=division_2, Segments="7", FilletRadius=0)  # -> Polygon, Length
rotate_2 = Rotate(Geometry=polygon_4.Polygon, Angle=degrees("0"), Plane=list_item_2)  # -> Geometry, Transform
scale_3 = Scale(Geometry=polygon_4.Polygon, Center=list_item_2, Factor="0.75")  # -> Geometry, Transform

panel_4 = Panel("""2
8
11
14
17""")
list_item_3 = ListItem(List=geometry_3, Index=panel_4, Wrap=True)
polygon_5 = Polygon(Plane=list_item_3, Radius=division_2, Segments="6", FilletRadius=0)  # -> Polygon, Length
rotate_3 = Rotate(Geometry=polygon_5.Polygon, Angle=degrees("0"), Plane=list_item_3)  # -> Geometry, Transform

panel_5 = Panel("""1
4
7
16
19""")
list_item_4 = ListItem(List=geometry, Index=panel_5, Wrap=True)
polygon_6 = Polygon(Plane=list_item_4, Radius=division_2, Segments="4", FilletRadius=0)  # -> Polygon, Length
rotate_4 = Rotate(Geometry=polygon_6.Polygon, Angle=degrees("0"), Plane=list_item_4)  # -> Geometry, Transform
scale_4 = Scale(Geometry=polygon_6.Polygon, Center=list_item_4, Factor="1.1")  # -> Geometry, Transform

pillar = Geometry(rotate.Geometry)
region_union = RegionUnion(Curves=[rotate_3.Geometry, scale_3.Geometry, scale_4.Geometry, rotate.Geometry])
region_union_2 = RegionUnion(Curves=[rotate_3.Geometry, scale_3.Geometry, scale_4.Geometry])
stream_filter = StreamFilter(Gate=Toggle(False), Stream0=region_union, Stream1=region_union_2)
exterior_wall = Geometry(stream_filter)
circle_b_2 = Geometry(circle_b)
region_difference = RegionDifference(CurvesA=exterior_wall, CurvesB=circle_a)
circle_b_3 = Geometry(circle_b_2)

# ---- group: Hatch Group
boundary_surfaces = BoundarySurfaces(Edges=region_difference)
vector_at_angle = PythonScript(angle="45")  # -> vector
# ---------- vector_at_angle: Python ----------
import rhinoscriptsyntax as rs
import math
if angle == None:
    Vector = None
else:
    c=rs.AddPoint(0,0,0)
    f=math.radians(float(angle))
    l=rs.AddPoint(math.cos(f),math.sin(f),0)
    d=rs.VectorCreate(l,c)
    vector =rs.VectorUnitize(d)
# ---------- end vector_at_angle ----------
contour = Contour(Shape=boundary_surfaces, Point=Point(0, 0, 0), Direction=vector_at_angle, Distance="2")

# ----
hatch_exterior_wall = Geometry(contour)
circle_a_2 = Geometry(circle_a)
exterior_wall_2 = Geometry(region_difference)
pillar_2 = Geometry(pillar)

list_item_5 = ListItem(List=exterior_wall_2, Index=0, Wrap=True)
list_item_6 = ListItem(List=exterior_wall_2, Index="1", Wrap=True)
list_item_7 = ListItem(List=exterior_wall_2, Index="2", Wrap=True)
explode_2 = Explode(Curve=list_item_5, Recursive=True)  # -> Segments, Vertices
explode_3 = Explode(Curve=list_item_6, Recursive=True)  # -> Segments, Vertices
explode_4 = Explode(Curve=list_item_7, Recursive=True)  # -> Segments, Vertices
panel_6 = Panel("""0
1
2
3
4
5
6
31
30
29
28
27
26
25
24""")
panel_7 = Panel("""7
8
9
10
11
12
13
14
15
16
17
18
19
20
21
22
23
24
25
26
27
28""")
panel_8 = Panel("""6
5
4
7
8
9
10
11
12
13
14
15""")
list_item_8 = ListItem(List=explode_2.Segments, Index=panel_6, Wrap=True)
list_item_9 = ListItem(List=explode_3.Segments, Index=panel_7, Wrap=True)
list_item_10 = ListItem(List=explode_4.Segments, Index=panel_8, Wrap=True)
join_curves = JoinCurves(Curves=[list_item_8, list_item_9, list_item_10], Preserve=False)

end_points = EndPoints(Curve=join_curves)  # -> Start, End

list_item_11 = ListItem(List=end_points.Start, Index=0, Wrap=True)
list_item_12 = ListItem(List=end_points.End, Index="5", Wrap=True)
line = Line(StartPoint=list_item_11, EndPoint=list_item_12)

list_item_13 = ListItem(List=end_points.Start, Index="1", Wrap=True)
list_item_14 = ListItem(List=end_points.End, Index="0", Wrap=True)
line_2 = Line(StartPoint=list_item_13, EndPoint=list_item_14)

list_item_15 = ListItem(List=end_points.Start, Index="2", Wrap=True)
list_item_16 = ListItem(List=end_points.End, Index="4", Wrap=True)
line_3 = Line(StartPoint=list_item_15, EndPoint=list_item_16)

divide_curve_2 = DivideCurve(Curve=circle_a_2, Count=10, Kinks=False)  # -> Points, Tangents, Parameters
list_item_17 = ListItem(List=divide_curve_2.Points, Index="0", Wrap=True)
line_4 = Line(StartPoint=origin, EndPoint=list_item_17)

divide_curve_3 = DivideCurve(Curve=circle_b_3, Count=10, Kinks=False)  # -> Points, Tangents, Parameters
list_item_18 = ListItem(List=divide_curve_3.Points, Index="0", Wrap=True)
line_5 = Line(StartPoint=origin, EndPoint=list_item_18)

join_curves_2 = JoinCurves(Curves=[line_2, line, line_3, join_curves], Preserve=False)
outline_exterior_wall = Geometry(join_curves_2)
geometry_4 = Geometry(explode.Segments)

curve = Curve(outline_exterior_wall)
divide_curve_4 = DivideCurve(Curve=curve, Count="6", Kinks=False)  # -> Points, Tangents, Parameters
list_item_19 = ListItem(List=divide_curve_4.Points, Index="0", Wrap=True)
line_6 = Line(StartPoint=origin, EndPoint=list_item_19)

line_7 = Line(geometry_4)
line_8 = Line(geometry_4)
explode_5 = Explode(Curve=line_7, Recursive=True)  # -> flatten(Segments), Vertices
explode_6 = Explode(Curve=line_8, Recursive=True)  # -> flatten(Segments), Vertices
length_2 = Length(Curve=explode_5.Segments)
length_3 = Length(Curve=explode_6.Segments)
explode_7 = Explode(Curve=explode.Segments, Recursive=True)  # -> flatten(Segments), Vertices
length_4 = Length(Curve=explode_7.Segments)
circle_b_4 = Geometry(circle_b_3)
circle_2 = Circle(circle_b_3)
origin_3 = Point(origin_2)
circle_a_3 = Circle(circle_a_2)
circle_a_4 = Geometry(circle_a_3)
outlnie_exterior_wall = Geometry(outline_exterior_wall)
divide_curve_5 = DivideCurve(Curve=polygone, Count="6", Kinks=False)  # -> Points, Tangents, Parameters
hatch_exterior_wall_2 = Geometry(hatch_exterior_wall)
exterior_wall_3 = Geometry(exterior_wall_2)
circle_a_5 = Geometry(circle_a_3)
circle_b_5 = Geometry(circle_2)
polygon_7 = Geometry(divide_curve_5.Points)
pillar_3 = Geometry(pillar_2)

# ---- group: Preview and Bake
button = Button()
get_name = GhPythonScript(Component=hatch_exterior_wall_2)  # -> Geometry, Name
# ---------- get_name: Python ----------
# Mark Ericson 1.17.19
   #take from forum discussion thread https://www.grasshopper3d.com/forum/topics/python-get-label-name-of-input-components
    #edited version of code  by Mostapha Sadeghipour Roudsari

def GetComponentName():
    Comp = ghenv.Component.Params.Input[0]
    sources = Comp.Sources

    if sources.Count == 0: 
        return components

    for source in sources:
        attr = source.Attributes
        if (attr is None) or (attr.GetTopLevel is None):
            pass
        else:

            component = attr.GetTopLevel.DocObject
            componentName = component.NickName

            return componentName

if Component == None:
    pass
else:
    Name = GetComponentName()
    Geometry = Component
# ---------- end get_name ----------
linear_gradient = GhPythonScript(R="0", G="0", B="0", Percent=".25")  # -> Color
# ---------- linear_gradient: Python ----------
__author__ = "ericsonm"
__version__ = "2019.01.15"

import rhinoscriptsyntax as rs

def LinearColorGradient(R,G,B,R2,G2,B2,ColorPercentage):
    
    if ColorPercentage > 1:
        R3 = None
        G3 = None
        B3 = None
    else:
        #This function defines linear color gradient by treating R,G,B as coordinates on a 3D line.
        #The base color that will be altered by the percentage should be entered in the second R2,G2,B2 valu
    
        Rdiff = float(R2) - float(R)
        Gdiff = float(G2) - float(G)
        Bdiff = float(B2) - float(B)


        t = float(ColorPercentage)


        R3 = float(R) + Rdiff*t
        G3 = float(G) + Gdiff*t
        B3 = float(B) + Bdiff*t



    return R3,G3,B3


if (R or G or B or Percent) is None:
    Color = None
else: 
    Color1 = LinearColorGradient(255,255,255,R,G,B,Percent)

    R3 = Color1[0]
    G3 = Color1[1]
    B3 = Color1[2]

    Color = rs.CreateColor(R3,G3,B3)
# ---------- end linear_gradient ----------
custom_preview = CustomPreview(Geometry=get_name.Geometry, Material=linear_gradient)

button_2 = Button()
get_name_2 = GhPythonScript(Component=pillar_3)  # -> Geometry, Name; same code as get_name
linear_gradient_2 = GhPythonScript(R="0", G="0", B="0", Percent="1")  # -> Color; same code as linear_gradient
custom_preview_2 = CustomPreview(Geometry=get_name_2.Geometry, Material=linear_gradient_2)

button_3 = Button()
get_name_3 = GhPythonScript(Component=exterior_wall_3)  # -> Geometry, Name; same code as get_name
linear_gradient_3 = GhPythonScript(R="0", G="0", B="0", Percent="1")  # -> Color; same code as linear_gradient
custom_preview_3 = CustomPreview(Geometry=get_name_3.Geometry, Material=linear_gradient_3)

button_4 = Button()
get_name_4 = GhPythonScript(Component=circle_b_5)  # -> Geometry, Name; same code as get_name
linear_gradient_4 = GhPythonScript(R="0", G="0", B="0", Percent=".5")  # -> Color; same code as linear_gradient
custom_preview_4 = CustomPreview(Geometry=get_name_4.Geometry, Material=linear_gradient_4)

button_5 = Button()
get_name_5 = GhPythonScript(Component=circle_a_5)  # -> Geometry, Name; same code as get_name
linear_gradient_5 = GhPythonScript(R="0", G="0", B="0", Percent=".5")  # -> Color; same code as linear_gradient
custom_preview_5 = CustomPreview(Geometry=get_name_5.Geometry, Material=linear_gradient_5)

# ---- group: TEXT LABELS
text_size = Panel("2")
point_2 = Point(polygon_7)
add_text = Panel("A")
list_length = ListLength(List=point_2)
linear_gradient_6 = GhPythonScript(R="0", G="0", B="0", Percent="0.75")  # -> Color; same code as linear_gradient
series = Series(Start=0, Step=1, Count=list_length)
integer = Integer(series)
concatenate = Concatenate(FragmentA=integer, FragmentB=add_text)
text_tag_3d = TextTag3D(Location=point_2, Text=concatenate, Size=text_size, Colour=linear_gradient_6, Justification=5)

# ---- group: Preview and Bake
button_6 = Button()
get_name_6 = GhPythonScript(Component=polygone)  # -> Geometry, Name; same code as get_name
linear_gradient_7 = GhPythonScript(R="0", G="0", B="0", Percent="0.5")  # -> Color; same code as linear_gradient
custom_preview_6 = CustomPreview(Geometry=get_name_6.Geometry, Material=linear_gradient_7)

# ----
panel_9 = Panel(get_name.Name)
panel_10 = Panel(get_name_2.Name)
panel_11 = Panel(get_name_3.Name)
panel_12 = Panel(get_name_4.Name)
panel_13 = Panel(get_name_5.Name)
panel_14 = Panel(get_name_6.Name)
custom_preview_lineweights = CustomPreviewLineweights(Geometry=get_name.Geometry, Shader=linear_gradient, Thickness=".0025", Absolute=Toggle(True))
custom_preview_lineweights_2 = CustomPreviewLineweights(Geometry=get_name_2.Geometry, Shader=linear_gradient_2, Thickness=".0025", Absolute=Toggle(True))
custom_preview_lineweights_3 = CustomPreviewLineweights(Geometry=get_name_3.Geometry, Shader=linear_gradient_3, Thickness=".0025", Absolute=Toggle(True))
custom_preview_lineweights_4 = CustomPreviewLineweights(Geometry=get_name_4.Geometry, Shader=linear_gradient_4, Thickness=".0025", Absolute=Toggle(True))
custom_preview_lineweights_5 = CustomPreviewLineweights(Geometry=get_name_5.Geometry, Shader=linear_gradient_5, Thickness=".0025", Absolute=Toggle(True))
custom_preview_lineweights_6 = CustomPreviewLineweights(Geometry=get_name_6.Geometry, Shader=linear_gradient_7, Thickness=".0025", Absolute=Toggle(True))

list_item_20 = ListItem(List=line_4, Index=0, Wrap=True)
explode_8 = Explode(Curve=list_item_20, Recursive=True)  # -> Segments, Vertices
list_item_21 = ListItem(List=explode_8.Segments, Index="4", Wrap=True)
line_9 = Line(list_item_21)
number = Number("1/2")

end_points_2 = EndPoints(Curve=line_9)  # -> Start, End
reverse = Reverse(Vector=line_9)
perpendicular = GhPythonScript(line=line_9)  # -> Perp; inputs line: Line
# ---------- perpendicular: Python ----------
__author__ = "mericson"
__version__ = "2019.01.11"

import rhinoscriptsyntax as rs
import math
import Rhino as rh

if line == None:
    line = None
else:
    a = 0,0,0
    b = 0,0,1
    Z = rs.VectorCreate(a,b)
    c = rh.Geometry.Line.PointAt(line,1)
    d = rh.Geometry.Line.PointAt(line,0)
    vector2 = rs.VectorCreate(c,d)
    Perp = rs.VectorRotate(vector2,90,Z)
# ---------- end perpendicular ----------
construct_plane = ConstructPlane(Origin=[end_points_2.Start, end_points_2.End], XAxis=[line_9, reverse], YAxis=perpendicular)

line_10 = Line(line_9)

list_item_22 = ListItem(List=line_5, Index=0, Wrap=True)
explode_9 = Explode(Curve=list_item_22, Recursive=True)  # -> Segments, Vertices
list_item_23 = ListItem(List=explode_9.Segments, Index="4", Wrap=True)
line_11 = Line(list_item_23)
number_2 = Number("1/2")

end_points_3 = EndPoints(Curve=line_11)  # -> Start, End
reverse_2 = Reverse(Vector=line_11)
perpendicular_2 = GhPythonScript(line=line_11)  # -> Perp; inputs line: Line; same code as perpendicular
construct_plane_2 = ConstructPlane(Origin=[end_points_3.Start, end_points_3.End], XAxis=[line_11, reverse_2], YAxis=perpendicular_2)

line_12 = Line(line_11)

list_item_24 = ListItem(List=line_6, Index="1", Wrap=True)
explode_10 = Explode(Curve=list_item_24, Recursive=True)  # -> Segments, Vertices
list_item_25 = ListItem(List=explode_10.Segments, Index="11", Wrap=True)
line_13 = Line(list_item_25)
line_14 = Line(line_13)
number_3 = Number("1/2")
line_15 = Line(line_14)

line_16 = Line(line_13)

reverse_3 = Reverse(Vector=line_13)
end_points_4 = EndPoints(Curve=line_13)  # -> Start, End
perpendicular_3 = GhPythonScript(line=line_13)  # -> Perp; inputs line: Line; same code as perpendicular
construct_plane_3 = ConstructPlane(Origin=[end_points_4.Start, end_points_4.End], XAxis=[line_13, reverse_3], YAxis=perpendicular_3)

axis = Geometry(line_16)

# ---- group: Preview and Bake
button_7 = Button()
get_name_7 = GhPythonScript(Component=axis)  # -> Geometry, Name; same code as get_name
linear_gradient_8 = GhPythonScript(R="0", G="0", B="0", Percent=".75")  # -> Color; same code as linear_gradient
custom_preview_7 = CustomPreview(Geometry=get_name_7.Geometry, Material=linear_gradient_8)

# ----
panel_15 = Panel(get_name_7.Name)
custom_preview_lineweights_7 = CustomPreviewLineweights(Geometry=get_name_7.Geometry, Shader=linear_gradient_8, Thickness=".0025", Absolute=Toggle(True))

plane = Plane(construct_plane)
vector = Vector(perpendicular)

# ---- group: 2d sections
multiplication = Multiplication(A=length_3, B=number)
line_sdl = LineSDL(Start=plane, Direction=vector, Length=multiplication)
point_on_curve = PointOnCurve(line_sdl, parameter=0)
list_item_26 = ListItem(List=plane, Index="1", Wrap=True)
move = Move(Geometry=plane, Motion=line_sdl)  # -> Geometry, Transform
list_item_27 = ListItem(List=point_on_curve, Index=0, Wrap=True)
distance = Distance(PointA=list_item_27, PointB=list_item_26)
radians = Radians(Degrees="90")
arc = Arc(Plane=move.Geometry, Radius=distance, Angle=radians)  # -> Arc, Length
join_curves_3 = JoinCurves(Curves=[arc.Arc, line_sdl], Preserve=False)

# ----
list_item_28 = ListItem(List=arc.Arc, Index=0, Wrap=True)
list_item_29 = ListItem(List=line_sdl, Index="1", Wrap=True)
curve_2 = Curve(join_curves_3)
join_curves_4 = JoinCurves(Curves=[list_item_29, list_item_28], Preserve=False)

curve_3 = Curve(curve_2)
curve_4 = Curve(join_curves_4)

reverse_4 = Reverse(Vector=line_10)
point_on_curve_2 = PointOnCurve(line_10, parameter=0.5)
rotate_3d = Rotate3D(Geometry=curve_4, Angle=degrees("90"), Center=point_on_curve_2, Axis=reverse_4)  # -> Geometry, Transform
geometry_5 = Geometry(rotate_3d.Geometry)
rotate_5 = Rotate(Geometry=geometry_5, Angle=degrees("180"), Plane=PlaneXY(0, 0, 0))  # -> Geometry, Transform
unit_z = UnitZ(Factor=1)
line_sdl_2 = LineSDL(Start=circle_a_4, Direction=unit_z, Length=1)
rail_revolution = RailRevolution(Curve=rotate_5.Geometry, Rail=circle_a_4, Axis=line_sdl_2, Scale=False)

section_dome_a = Geometry(curve_3)

# ---- group: Preview and Bake
button_8 = Button()
get_name_8 = GhPythonScript(Component=section_dome_a)  # -> Geometry, Name; same code as get_name
linear_gradient_9 = GhPythonScript(R="0", G="0", B="0", Percent=".75")  # -> Color; same code as linear_gradient
custom_preview_8 = CustomPreview(Geometry=get_name_8.Geometry, Material=linear_gradient_9)

# ----
panel_16 = Panel(get_name_8.Name)
custom_preview_lineweights_8 = CustomPreviewLineweights(Geometry=get_name_8.Geometry, Shader=linear_gradient_9, Thickness=".0025", Absolute=Toggle(True))

vector_2 = Vector(perpendicular_2)
plane_2 = Plane(construct_plane_2)

# ---- group: 2d sections
multiplication_2 = Multiplication(A=length_2, B=number_2)
line_sdl_3 = LineSDL(Start=plane_2, Direction=vector_2, Length=multiplication_2)
point_on_curve_3 = PointOnCurve(line_sdl_3, parameter=0)
list_item_30 = ListItem(List=plane_2, Index="1", Wrap=True)
move_2 = Move(Geometry=plane_2, Motion=line_sdl_3)  # -> Geometry, Transform
list_item_31 = ListItem(List=point_on_curve_3, Index=0, Wrap=True)
distance_2 = Distance(PointA=list_item_31, PointB=list_item_30)
radians_2 = Radians(Degrees="90")
arc_2 = Arc(Plane=move_2.Geometry, Radius=distance_2, Angle=radians_2)  # -> Arc, Length

# ----
list_item_32 = ListItem(List=arc_2.Arc, Index=0, Wrap=True)
list_item_33 = ListItem(List=line_sdl_3, Index="1", Wrap=True)
join_curves_5 = JoinCurves(Curves=[list_item_33, list_item_32], Preserve=False)
curve_5 = Curve(join_curves_5)

curve_6 = Curve(join_curves_5)

reverse_5 = Reverse(Vector=line_12)
point_on_curve_4 = PointOnCurve(line_12, parameter=0.5)
rotate_3d_2 = Rotate3D(Geometry=curve_6, Angle=degrees("90"), Center=point_on_curve_4, Axis=reverse_5)  # -> Geometry, Transform
geometry_6 = Geometry(rotate_3d_2.Geometry)
rotate_6 = Rotate(Geometry=geometry_6, Angle=degrees("180"), Plane=PlaneXY(0, 0, 0))  # -> Geometry, Transform
unit_z_2 = UnitZ(Factor=1)
line_sdl_4 = LineSDL(Start=circle_b_4, Direction=unit_z_2, Length=1)
rail_revolution_2 = RailRevolution(Curve=rotate_6.Geometry, Rail=circle_b_4, Axis=line_sdl_4, Scale=False)

section_dome_b = Curve(curve_5)

# ---- group: Preview and Bake
button_9 = Button()
get_name_9 = GhPythonScript(Component=section_dome_b)  # -> Geometry, Name; same code as get_name
linear_gradient_10 = GhPythonScript(R="0", G="0", B="0", Percent="0.75")  # -> Color; same code as linear_gradient
custom_preview_9 = CustomPreview(Geometry=get_name_9.Geometry, Material=linear_gradient_10)

# ----
panel_17 = Panel(get_name_9.Name)
custom_preview_lineweights_9 = CustomPreviewLineweights(Geometry=get_name_9.Geometry, Shader=linear_gradient_10, Thickness=".0025", Absolute=Toggle(True))

vector_3 = Vector(perpendicular_3)
plane_3 = Plane(construct_plane_3)

# ---- group: 2d sections
multiplication_3 = Multiplication(A=length_4, B=number_3)
line_sdl_5 = LineSDL(Start=plane_3, Direction=vector_3, Length=multiplication_3)
point_on_curve_5 = PointOnCurve(line_sdl_5, parameter=0)
list_item_34 = ListItem(List=plane_3, Index="1", Wrap=True)
move_3 = Move(Geometry=plane_3, Motion=line_sdl_5)  # -> Geometry, Transform
list_item_35 = ListItem(List=point_on_curve_5, Index=0, Wrap=True)
distance_3 = Distance(PointA=list_item_35, PointB=list_item_34)
radians_3 = Radians(Degrees="90")
arc_3 = Arc(Plane=move_3.Geometry, Radius=distance_3, Angle=radians_3)  # -> Arc, Length
join_curves_6 = JoinCurves(Curves=[arc_3.Arc, line_sdl_5], Preserve=False)

# ----
list_item_36 = ListItem(List=arc_3.Arc, Index=0, Wrap=True)
list_item_37 = ListItem(List=line_sdl_5, Index="1", Wrap=True)
curve_7 = Curve(join_curves_6)
join_curves_7 = JoinCurves(Curves=[list_item_37, list_item_36], Preserve=False)

curve_8 = Curve(join_curves_7)

reverse_6 = Reverse(Vector=line_15)
point_on_curve_6 = PointOnCurve(line_15, parameter=0.5)
rotate_3d_3 = Rotate3D(Geometry=curve_8, Angle=degrees("90"), Center=point_on_curve_6, Axis=reverse_6)  # -> Geometry, Transform
geometry_7 = Geometry(rotate_3d_3.Geometry)
unit_z_3 = UnitZ(Factor=1)
line_sdl_6 = LineSDL(Start=origin_3, Direction=unit_z_3, Length=1)
rail_revolution_3 = RailRevolution(Curve=geometry_7, Rail=outlnie_exterior_wall, Axis=line_sdl_6, Scale=False)

stream_filter_2 = StreamFilter(Gate=Toggle(True), Stream0=[rail_revolution_2, rail_revolution], Stream1=rail_revolution_3)
section_b = Geometry(curve_7)

# ---- group: Preview and Bake
button_10 = Button()
get_name_10 = GhPythonScript(Component=section_b)  # -> Geometry, Name; same code as get_name
linear_gradient_11 = GhPythonScript(R="0", G="0", B="0", Percent=".75")  # -> Color; same code as linear_gradient
custom_preview_10 = CustomPreview(Geometry=get_name_10.Geometry, Material=linear_gradient_11)

button_11 = Button()
get_name_11 = GhPythonScript(Component=stream_filter_2)  # -> Geometry, Name; same code as get_name
linear_gradient_12 = GhPythonScript(R="0", G="0", B="0", Percent="0")  # -> Color; same code as linear_gradient
custom_preview_11 = CustomPreview(Geometry=get_name_11.Geometry, Material=linear_gradient_12)

# ----
panel_18 = Panel(get_name_10.Name)
panel_19 = Panel(get_name_11.Name)
custom_preview_lineweights_10 = CustomPreviewLineweights(Geometry=get_name_10.Geometry, Shader=linear_gradient_11, Thickness=".0025", Absolute=Toggle(True))
custom_preview_lineweights_11 = CustomPreviewLineweights(Geometry=get_name_11.Geometry, Shader=linear_gradient_12, Thickness=".0025", Absolute=Toggle(True))
