# Grasshopper definition Najarian_Partofapart.gh (Grasshopper 1.0.7)
# plug-ins: Human

gate_control = Panel("0")
octagon_rotate_angle = Panel("22.5")
octagon_sides = Panel("4")
origin = Panel("0,0,0")
octagon_sides_2 = Panel("24")
divide_scalar = Panel("16")
# Variables + Controls
point = Point(origin)
octagon = Polygon(Plane=point, Radius=Slider(100, range=0..100), Segments=octagon_sides, FilletRadius=0)  # -> Polygon, Length
point_2 = Point(point)
rotate = Rotate(Geometry=octagon.Polygon, Angle=degrees(octagon_rotate_angle), Plane=point)  # -> Geometry, Transform
octagon_rotated = DivideCurve(Curve=rotate.Geometry, Count=divide_scalar, Kinks=False)  # -> Points, Tangents, Parameters
list_item = ListItem(List=octagon_rotated.Points, Index="7", Wrap=True)
list_item_2 = ListItem(List=octagon_rotated.Points, Index="15", Wrap=True)
list_of_points_on_circle = Point(octagon_rotated.Points)
list_item_3 = ListItem(List=octagon_rotated.Points, Index="3", Wrap=True)
distance = Distance(PointA=point, PointB=list_item_3)
circle = Circle(Plane=point, Radius=distance)
list_subdivision = Panel("2")
partition_list = PartitionList(List=list_of_points_on_circle, Size=list_subdivision)
circle_a = Geometry(circle)
# A
list_item_4 = ListItem(List=partition_list, Index="0", Wrap=True)  # -> flatten(Item)
polyline = PolyLine(Vertices=list_item_4, Closed=Toggle(True))
wall_polyline = Geometry(polyline)
panel = Panel("""1
3""")
divide_curve = DivideCurve(Curve=circle_a, Count=octagon_sides_2, Kinks=False)  # -> Points, Tangents, Parameters

distance_2 = Distance(PointA=list_item, PointB=list_item_2)
dom = Domain(DomainStart=expr("-x/2", distance_2), DomainEnd=expr("x/2", distance_2))
dom_2 = Domain(DomainStart=expr("-x/2", distance_2), DomainEnd=expr("x/2", distance_2))
inner_rectangle = Rectangle(Plane=point, XSize=dom, YSize=dom_2, Radius=0)  # -> Rectangle, Length
# Operations
boundary_surfaces = BoundarySurfaces(Edges=inner_rectangle.Rectangle)

explode = Explode(Curve=inner_rectangle.Rectangle, Recursive=True)  # -> Segments, Vertices
point_3 = Point(divide_curve.Points)
list_item_5 = ListItem(List=explode.Segments, Index=panel, Wrap=True)
polyline_2 = PolyLine(Vertices=divide_curve.Points, Closed=Toggle(True))
line = Line(StartPoint=point_3, EndPoint=point_2)
list_item_6 = ListItem(List=polyline_2, Index=0, Wrap=True)
explode_2 = Explode(Curve=inner_rectangle.Rectangle, Recursive=True)  # -> Segments, Vertices
explode_3 = Explode(Curve=list_item_6, Recursive=True)  # -> Segments, Vertices
list_item_7 = ListItem(List=explode_2.Segments, Index="1", Wrap=True)
list_item_8 = ListItem(List=explode_3.Segments, Index=0, Wrap=True)

# ---- group: Perpendicular Section Line
line_2 = Line(list_item_7)
end_points = EndPoints(Curve=line_2)  # -> Start, End
reverse = Reverse(Vector=line_2)
perpendicular = GhPythonScript(line=line_2)  # -> Perp; inputs line: Line
# ---------- perpendicular: Python ----------
__author__ = "mericson"
__version__ = "2019.01.11"

import rhinoscriptsyntax as rs
import math
import Rhino as rh

if line == None:
    line = None
else:
    a = 0,0,0
    b = 0,0,1
    Z = rs.VectorCreate(a,b)
    c = rh.Geometry.Line.PointAt(line,1)
    d = rh.Geometry.Line.PointAt(line,0)
    vector2 = rs.VectorCreate(c,d)
    Perp = rs.VectorRotate(vector2,90,Z)
# ---------- end perpendicular ----------
construct_plane = ConstructPlane(Origin=[end_points.Start, end_points.End], XAxis=[line_2, reverse], YAxis=perpendicular)

# ----
point_on_curve = PointOnCurve(list_item_8, parameter=0)
point_on_curve_2 = PointOnCurve(list_item_8, parameter=1)
incircle = InCircle(CornerA=point_on_curve, CornerB=point_2, CornerC=point_on_curve_2)  # -> Circle, Plane, Radius
line_3 = Line(line_2)
multiplication = Multiplication(A=incircle.Radius, B="2")
offset_curve = OffsetCurve(Curve=inner_rectangle.Rectangle, Distance=multiplication, Plane=PlaneXY(0, 0, 0), Corners=1)
explode_4 = Explode(Curve=offset_curve, Recursive=True)  # -> Segments, Vertices
list_item_9 = ListItem(List=explode_4.Segments, Index="1", Wrap=True)

# ---- group: Perpendicular Section Line
line_4 = Line(list_item_9)
end_points_2 = EndPoints(Curve=line_4)  # -> Start, End
reverse_2 = Reverse(Vector=line_4)
perpendicular_2 = GhPythonScript(line=line_4)  # -> Perp; inputs line: Line; same code as perpendicular
construct_plane_2 = ConstructPlane(Origin=[end_points_2.Start, end_points_2.End], XAxis=[line_4, reverse_2], YAxis=perpendicular_2)

# ----
line_5 = Line(line_4)
plane = Plane(construct_plane)
vector = Vector(perpendicular)
plane_2 = Plane(construct_plane_2)

# ---- group: 2D Section
line_6 = Line(list_item_7)
number = Number(".5")
length = Length(Curve=line_6)
multiplication_2 = Multiplication(A=length, B=number)
line_sdl = LineSDL(Start=plane, Direction=vector, Length=multiplication_2)
point_on_curve_3 = PointOnCurve(line_sdl, parameter=0)
move = Move(Geometry=plane, Motion=line_sdl)  # -> Geometry, Transform
list_item_10 = ListItem(List=point_on_curve_3, Index=0, Wrap=True)
list_item_11 = ListItem(List=plane, Index="1", Wrap=True)
radians = Radians(Degrees="60")
distance_3 = Distance(PointA=list_item_10, PointB=list_item_11)
arc = Arc(Plane=move.Geometry, Radius=distance_3, Angle=radians)  # -> Arc, Length
join_curves = JoinCurves(Curves=[arc.Arc, line_sdl], Preserve=False)

# ----
vector_2 = Vector(perpendicular_2)

# ---- group: 2D Section
line_7 = Line(list_item_9)
number_2 = Number(".5")
length_2 = Length(Curve=line_7)
multiplication_3 = Multiplication(A=length_2, B=number_2)
line_sdl_2 = LineSDL(Start=plane_2, Direction=vector_2, Length=multiplication_3)
point_on_curve_4 = PointOnCurve(line_sdl_2, parameter=0)
move_2 = Move(Geometry=plane_2, Motion=line_sdl_2)  # -> Geometry, Transform
list_item_12 = ListItem(List=point_on_curve_4, Index=0, Wrap=True)
list_item_13 = ListItem(List=plane_2, Index="1", Wrap=True)
radians_2 = Radians(Degrees="60")
distance_4 = Distance(PointA=list_item_12, PointB=list_item_13)
arc_2 = Arc(Plane=move_2.Geometry, Radius=distance_4, Angle=radians_2)  # -> Arc, Length
join_curves_2 = JoinCurves(Curves=[arc_2.Arc, line_sdl_2], Preserve=False)

# ----
explode_5 = Explode(Curve=offset_curve, Recursive=True)  # -> Segments, Vertices
point_on_curve_5 = PointOnCurve(explode_5.Segments, parameter=0.5)
distance_5 = Distance(PointA=point, PointB=point_on_curve_5)
# B
# Output Geometry
boundary_surfaces_2 = BoundarySurfaces(Edges=offset_curve)
number_of_circles = Panel("24")
arc_3 = Arc(Plane=PlaneXY(0, 0, 0), Radius=distance_5, Angle="3.14/2")  # -> Arc, Length
angle_of_array = Panel("360")
polar_array = PolarArray(Geometry=incircle.Circle, Plane=PlaneXY(0, 0, 0), Count=number_of_circles, Angle=degrees(angle_of_array))  # -> Geometry, Transform
unit_x = UnitX(Factor=1)

# ---- group: Niche Group
panel_2 = Panel("""1
0
0
1""")
sift_pattern = SiftPattern(List=list_item_5, SiftPattern=panel_2)  # -> Output0, Output1
list_length = ListLength(List=list_item_5)
point_value = Panel(".5")
niche_rotation = Panel("45")
b_sides = Geometry(sift_pattern.Output1)
multiplication_4 = Multiplication(A=list_length, B="2")
multiplication_5 = Multiplication(A="2", B=list_length)
a_sides = Geometry(sift_pattern.Output0)
panel_3 = Panel("1.5")
cluster = Cluster(
    niche_rotation=niche_rotation,
    point_value=point_value,
    polygon_side=a_sides,
    niche_sides=multiplication_5,
    niche_prop="6")

# ----
cluster_2 = Cluster(
    niche_rotation=niche_rotation,
    point_value=point_value,
    polygon_side=b_sides,
    niche_sides=multiplication_4,
    niche_prop=panel_3)
rotate_3d = Rotate3D(Geometry=arc_3.Arc, Angle=1.570796327, Center=Point(0, 0, 0), Axis=unit_x)  # -> Geometry, Transform
list_item_14 = ListItem(List=polar_array.Geometry, Index="1", Wrap=True)
list_item_15 = ListItem(List=polar_array.Geometry, Index="2", Wrap=True)
panel_4 = Panel("6")
region_union = RegionUnion(Curves=polar_array.Geometry)
aperture = Geometry(cluster_2)
niche = Geometry(cluster)
curve_curve = CurveCurve(CurveA=list_item_14, CurveB=list_item_15)  # -> Points, ParamsA, ParamsB
distance_6 = Distance(PointA=point, PointB=curve_curve.Points)
region_union_2 = RegionUnion(Curves=flatten([aperture, inner_rectangle.Rectangle]), Plane=point_2)
region_union_3 = RegionUnion(Curves=flatten([niche, inner_rectangle.Rectangle]), Plane=point_2)
center_of_drawing = Plane(point_2)
center_of_drawing_2 = Plane(point_2)
polygon = Polygon(Plane=PlaneXY(0, 0, 0), Radius=distance_6, Segments="24", FilletRadius=0)  # -> Polygon, Length
# C
# Views
circle_2 = Circle(Plane=PlaneXY(0, 0, 0), Radius=distance_6)
division = Division(A="8", B="2")
division_2 = Division(A="8", B="2")
region_union_4 = RegionUnion(Curves=region_union)
explode_6 = Explode(Curve=polygon.Polygon, Recursive=True)  # -> Segments, Vertices
region_difference = RegionDifference(CurvesA=[region_union, polygon.Polygon], CurvesB=circle_2)
list_item_16 = ListItem(List=explode_6.Segments, Index=0, Wrap=True)
point_on_curve_6 = PointOnCurve(list_item_16, parameter=0.5)
distance_7 = Distance(PointA=point_on_curve_6, PointB=point)
unit_x_2 = UnitX(Factor="-50")
unit_x_3 = UnitX(Factor="60")
distance_8 = Distance(PointA=curve_curve.Points, PointB=point)
arc_4 = Arc(Plane=PlaneXY(0, 0, 0), Radius=distance_8, Angle="3.14/2")  # -> Arc, Length
unit_z = UnitZ(Factor=1)
unit_x_4 = UnitX(Factor=1)
line_sdl_3 = LineSDL(Start=point, Direction=unit_z, Length=1)
rotate_3d_2 = Rotate3D(Geometry=arc_4.Arc, Angle=1.570796327, Center=Point(0, 0, 0), Axis=unit_x_4)  # -> Geometry, Transform
stream_filter = StreamFilter(Gate="0", Stream0=[region_union_3, region_union_2])  # -> flatten(Stream)
# D
# Line Type
region_difference_2 = RegionDifference(CurvesA=boundary_surfaces_2, CurvesB=boundary_surfaces, Plane=point)
rail_revolution = RailRevolution(Curve=rotate_3d_2.Geometry, Rail=region_union_4, Axis=line_sdl_3, Scale=False)
# E
region_difference_3 = RegionDifference(CurvesA=region_difference_2, CurvesB=stream_filter, Plane=point)
wall_outline = Geometry(region_difference_3)
wall_outline_2 = Geometry(region_difference_3)
brep = Brep(wall_outline_2)

# ---- group: Hatch Group
# Layers
boundary_surfaces_3 = BoundarySurfaces(Edges=brep)
vector_at_angle = PythonScript(angle="45")  # -> vector
# ---------- vector_at_angle: Python ----------
import rhinoscriptsyntax as rs
import math
if angle == None:
    Vector = None
else:
    c=rs.AddPoint(0,0,0)
    f=math.radians(float(angle))
    l=rs.AddPoint(math.cos(f),math.sin(f),0)
    d=rs.VectorCreate(l,c)
    vector =rs.VectorUnitize(d)
# ---------- end vector_at_angle ----------
# F
# Preview and Bake
contour = Contour(Shape=boundary_surfaces_3, Point=Point(0, 0, 0), Direction=vector_at_angle, Distance=".5")

# ----
loft_options = LoftOptions(Closed=False, Adjust=Toggle(True), Rebuild=0, Refit=0, Type="1")
loft_options_2 = LoftOptions(Closed=False, Adjust=Toggle(True), Rebuild=0, Refit=0, Type="1")
panel_5 = Panel("""1
.5
.5
.5""")
dash_pattern = DashPattern(Curve=line, Pattern=panel_5)  # -> Dashes, Gaps

wall_thickness = Relay([inner_rectangle.Rectangle, offset_curve])
get_name = GhPythonScript()  # -> Geometry, Name
# ---------- get_name: Python ----------
# Mark Ericson 1.17.19
   #take from forum discussion thread https://www.grasshopper3d.com/forum/topics/python-get-label-name-of-input-components
    #edited version of code  by Mostapha Sadeghipour Roudsari

def GetComponentName():
    Comp = ghenv.Component.Params.Input[0]
    sources = Comp.Sources

    if sources.Count == 0: 
        return components

    for source in sources:
        attr = source.Attributes
        if (attr is None) or (attr.GetTopLevel is None):
            pass
        else:

            component = attr.GetTopLevel.DocObject
            componentName = component.NickName

            return componentName

if Component == None:
    pass
else:
    Name = GetComponentName()
    Geometry = Component
# ---------- end get_name ----------
button = Button()
panel_6 = Panel(get_name.Name)
linear_gradient = GhPythonScript(R="0", G="0", B="0", Percent=".5")  # -> Color
# ---------- linear_gradient: Python ----------
__author__ = "ericsonm"
__version__ = "2019.01.15"

import rhinoscriptsyntax as rs

def LinearColorGradient(R,G,B,R2,G2,B2,ColorPercentage):
    
    if ColorPercentage > 1:
        R3 = None
        G3 = None
        B3 = None
    else:
        #This function defines linear color gradient by treating R,G,B as coordinates on a 3D line.
        #The base color that will be altered by the percentage should be entered in the second R2,G2,B2 valu
    
        Rdiff = float(R2) - float(R)
        Gdiff = float(G2) - float(G)
        Bdiff = float(B2) - float(B)


        t = float(ColorPercentage)


        R3 = float(R) + Rdiff*t
        G3 = float(G) + Gdiff*t
        B3 = float(B) + Bdiff*t



    return R3,G3,B3


if (R or G or B or Percent) is None:
    Color = None
else: 
    Color1 = LinearColorGradient(255,255,255,R,G,B,Percent)

    R3 = Color1[0]
    G3 = Color1[1]
    B3 = Color1[2]

    Color = rs.CreateColor(R3,G3,B3)
# ---------- end linear_gradient ----------
custom_preview = CustomPreview(Geometry=get_name.Geometry, Material=linear_gradient)
custom_preview_lineweights = CustomPreviewLineweights(Geometry=get_name.Geometry, Shader=linear_gradient, Thickness=".0025", Absolute=Toggle(True))

relay = Relay()

get_name_2 = GhPythonScript(Component=polar_array.Geometry)  # -> Geometry, Name; same code as get_name
button_2 = Button()
panel_7 = Panel(get_name_2.Name)
linear_gradient_2 = GhPythonScript(R="0", G="0", B="0", Percent=".5")  # -> Color; same code as linear_gradient
custom_preview_2 = CustomPreview(Geometry=get_name_2.Geometry, Material=linear_gradient_2)
custom_preview_lineweights_2 = CustomPreviewLineweights(Geometry=get_name_2.Geometry, Shader=linear_gradient_2, Thickness=".0025", Absolute=Toggle(True))

get_name_3 = GhPythonScript(Component=dash_pattern.Dashes)  # -> Geometry, Name; same code as get_name
button_3 = Button()
panel_8 = Panel(get_name_3.Name)
linear_gradient_3 = GhPythonScript(R="0", G="0", B="0", Percent=".5")  # -> Color; same code as linear_gradient
custom_preview_3 = CustomPreview(Geometry=get_name_3.Geometry, Material=linear_gradient_3)
custom_preview_lineweights_3 = CustomPreviewLineweights(Geometry=get_name_3.Geometry, Shader=linear_gradient_3, Thickness=".0025", Absolute=Toggle(True))

get_name_4 = GhPythonScript(Component=circle_a)  # -> Geometry, Name; same code as get_name
button_4 = Button()
panel_9 = Panel(get_name_4.Name)
linear_gradient_4 = GhPythonScript(R="0", G="0", B="0", Percent=".75")  # -> Color; same code as linear_gradient
custom_preview_4 = CustomPreview(Geometry=get_name_4.Geometry, Material=linear_gradient_4)
custom_preview_lineweights_4 = CustomPreviewLineweights(Geometry=get_name_4.Geometry, Shader=linear_gradient_4, Thickness=".0025", Absolute=Toggle(True))

get_name_5 = GhPythonScript(Component=contour)  # -> Geometry, Name; same code as get_name
button_5 = Button()
panel_10 = Panel(get_name_5.Name)
linear_gradient_5 = GhPythonScript(R="0", G="0", B="0", Percent=".5")  # -> Color; same code as linear_gradient
custom_preview_5 = CustomPreview(Geometry=get_name_5.Geometry, Material=linear_gradient_5)
custom_preview_lineweights_5 = CustomPreviewLineweights(Geometry=get_name_5.Geometry, Shader=linear_gradient_5, Thickness=".0025", Absolute=Toggle(True))

get_name_6 = GhPythonScript(Component=wall_outline)  # -> Geometry, Name; same code as get_name
button_6 = Button()
panel_11 = Panel(get_name_6.Name)
linear_gradient_6 = GhPythonScript(R="0", G="0", B="0", Percent="1")  # -> Color; same code as linear_gradient
custom_preview_6 = CustomPreview(Geometry=get_name_6.Geometry, Material=linear_gradient_6)
custom_preview_lineweights_6 = CustomPreviewLineweights(Geometry=get_name_6.Geometry, Shader=linear_gradient_6, Thickness=".0025", Absolute=Toggle(True))

get_name_7 = GhPythonScript(Component=rotate.Geometry)  # -> Geometry, Name; same code as get_name
button_7 = Button()
panel_12 = Panel(get_name_7.Name)
linear_gradient_7 = GhPythonScript(R="0", G="0", B="0", Percent="1")  # -> Color; same code as linear_gradient
custom_preview_7 = CustomPreview(Geometry=get_name_7.Geometry, Material=linear_gradient_7)
custom_preview_lineweights_7 = CustomPreviewLineweights(Geometry=get_name_7.Geometry, Shader=linear_gradient_7, Thickness=".0025", Absolute=Toggle(True))

scale_factor = Panel("1.025")

# ---- group: Section 3D
curve = Curve(join_curves)
point_on_curve_7 = PointOnCurve(line_3, parameter=1)
reverse_3 = Reverse(Vector=line_3)
rotate_3d_3 = Rotate3D(Geometry=curve, Angle=degrees("90"), Center=point_on_curve_7, Axis=reverse_3)  # -> Geometry, Transform

# ----
join_curves_3 = JoinCurves(Geometry=[line_3, rotate_3d_3.Geometry], Preserve=False)

# ---- group: Section 3D (continued)
polar_array_2 = PolarArray(Geometry=join_curves_3, Plane=center_of_drawing, Count=division, Angle=6.283185307)  # -> Geometry, Transform

# ----
boundary_surfaces_4 = BoundarySurfaces(Edges=join_curves_3)
extrude = Extrude(Base=boundary_surfaces_4, Direction=[unit_x_3, unit_x_2])
brep_join = BrepJoin(Breps=extrude)  # -> Breps, Closed

# ---- group: Surface
plane_3 = Plane(center_of_drawing)
point_on_curve_8 = PointOnCurve(rotate_3d_3.Geometry, parameter=0.5)
deconstruct = Deconstruct(Point=point_on_curve_8)  # -> XComponent, YComponent, ZComponent
division_3 = Division(A=deconstruct.ZComponent, B="10")
series = Series(Start="0", Step=division_3, Count="10")
unit_z_2 = UnitZ(Factor=series)
move_3 = Move(Geometry=plane_3, Motion=graft(unit_z_2))  # -> Geometry, Transform
curve_plane = CurvePlane(Curve=polar_array_2.Geometry, Plane=move_3.Geometry)  # -> flatten(Points), ParamsC, ParamsP
partition_list_2 = PartitionList(List=curve_plane.Points, Size="8")
convex_hull = ConvexHull(Points=partition_list_2, Plane=move_3.Geometry)  # -> Hull, HullZ, Indices
loft = Loft(Curves=flatten(convex_hull.Hull), Options=loft_options)

# ----
list_item_17 = ListItem(List=series, Index="3", Wrap=True)
unit_z_3 = UnitZ(Factor=list_item_17)
extrude_2 = Extrude(Base=cluster, Direction=unit_z_3)
cap_holes = CapHoles(Brep=extrude_2)
unit_z_4 = UnitZ(Factor=deconstruct.ZComponent)
move_4 = Move(Geometry=rail_revolution, Motion=unit_z_4)  # -> Geometry, Transform
panel_13 = Panel(curve_plane.Points)
line_sdl_4 = LineSDL(Start=point, Direction=unit_z_4, Length=1)
panel_14 = Panel(partition_list_2)
end_points_3 = EndPoints(Curve=line_sdl_4)  # -> Start, End
list_item_18 = ListItem(List=curve_plane.Points, Index="79", Wrap=True)
deconstruct_2 = Deconstruct(Point=end_points_3.End)  # -> XComponent, YComponent, ZComponent
deconstruct_3 = Deconstruct(Point=list_item_18)  # -> XComponent, YComponent, ZComponent
cap_holes_2 = CapHoles(Brep=loft)
solid_union = SolidUnion(Breps=[loft, cap_holes])

# ---- group: Section 3D
curve_2 = Curve(join_curves_2)
point_on_curve_9 = PointOnCurve(line_5, parameter=1)
reverse_4 = Reverse(Vector=line_5)
rotate_3d_4 = Rotate3D(Geometry=curve_2, Angle=degrees("90"), Center=point_on_curve_9, Axis=reverse_4)  # -> Geometry, Transform

# ----
join_curves_4 = JoinCurves(Geometry=[line_5, rotate_3d_4.Geometry], Preserve=False)

# ---- group: Section 3D (continued)
polar_array_3 = PolarArray(Geometry=join_curves_4, Plane=center_of_drawing_2, Count=division_2, Angle=6.283185307)  # -> Geometry, Transform

# ---- group: Surface
plane_4 = Plane(center_of_drawing_2)
point_on_curve_10 = PointOnCurve(rotate_3d_4.Geometry, parameter=0.5)
deconstruct_4 = Deconstruct(Point=point_on_curve_10)  # -> XComponent, YComponent, ZComponent
division_4 = Division(A=deconstruct_4.ZComponent, B="10")
series_2 = Series(Start="0", Step=division_4, Count="10")
unit_z_5 = UnitZ(Factor=series_2)
move_5 = Move(Geometry=plane_4, Motion=graft(unit_z_5))  # -> Geometry, Transform
curve_plane_2 = CurvePlane(Curve=polar_array_3.Geometry, Plane=move_5.Geometry)  # -> flatten(Points), ParamsC, ParamsP
partition_list_3 = PartitionList(List=curve_plane_2.Points, Size="8")
convex_hull_2 = ConvexHull(Points=partition_list_3, Plane=move_5.Geometry)  # -> flatten(Hull), HullZ, Indices
loft_2 = Loft(Curves=flatten(convex_hull_2.Hull), Options=loft_options_2)

# ----
panel_15 = Panel(curve_plane_2.Points)
panel_16 = Panel(partition_list_3)
list_item_19 = ListItem(List=convex_hull_2.Hull, Index="9", Wrap=True)
point_on_curve_11 = PointOnCurve(list_item_19, parameter=0.5)
cap_holes_3 = CapHoles(Brep=loft_2)
deconstruct_5 = Deconstruct(Point=point_on_curve_11)  # -> XComponent, YComponent, ZComponent
unit_z_6 = UnitZ(Factor=deconstruct_5.ZComponent)
move_6 = Move(Geometry=rotate_3d.Geometry, Motion=unit_z_6)  # -> Geometry, Transform
rail_revolution_2 = RailRevolution(Curve=move_6.Geometry, Rail=list_item_19, Axis=line_sdl_3, Scale=False)
solid_difference = SolidDifference(BrepsA=[cap_holes_2, cap_holes_3], BrepsB=[cap_holes, extrude])
trim_solid = TrimSolid(Shape=solid_difference, Cutters=[brep_join.Breps, cap_holes])
stream_filter_2 = StreamFilter(Gate=gate_control, Stream0=solid_difference)
hatch_lines = Relay([trim_solid, move_4.Geometry, rail_revolution_2])

get_name_8 = GhPythonScript(Component=hatch_lines)  # -> Geometry, Name; same code as get_name
button_8 = Button()
panel_17 = Panel(get_name_8.Name)
linear_gradient_8 = GhPythonScript(R="0", G="0", B="0", Percent=".5")  # -> Color; same code as linear_gradient
custom_preview_8 = CustomPreview(Geometry=get_name_8.Geometry, Material=linear_gradient_8)
custom_preview_lineweights_8 = CustomPreviewLineweights(Geometry=get_name_8.Geometry, Shader=linear_gradient_8, Thickness=".0025", Absolute=Toggle(True))

# ---- group: TEXT LABELS
text_size = Panel("1")
point_4 = Point(relay)
add_text = Panel("a")
linear_gradient_9 = GhPythonScript(R="0", G="0", B="0", Percent="1")  # -> Color; same code as linear_gradient

# ----
scale = Scale(Geometry=point_4, Center=Point(0, 0, 0), Factor=scale_factor)  # -> Geometry, Transform

# ---- group: TEXT LABELS (continued)
list_length_2 = ListLength(List=scale.Geometry)
series_3 = Series(Start=0, Step=1, Count=list_length_2)
integer = Integer(series_3)
concatenate = Concatenate(FragmentA=integer, FragmentB=add_text)
text_tag_3d = TextTag3D(Location=scale.Geometry, Text=concatenate, Size=text_size, Colour=linear_gradient_9, Justification=5)

# ==== cluster Cluster
niche_sides = ClusterInput()
niche_prop = ClusterInput()
niche_rotation = ClusterInput()
point_value = ClusterInput()
polygon_side = ClusterInput()
niche_sides_2 = Number(niche_sides)
niche_prop_2 = Number(niche_prop)
niche_rotation_2 = Number(niche_rotation)
point_value_2 = Number(point_value)
polygon_side_2 = Line(polygon_side)
point_on_line = PointOnLine(line=polygon_side_2, number=point_value_2)
point_on_line_2 = Point(point_on_line)
rotate = Rotate(Geometry=polygon_side_2, Angle=degrees("90"), Plane=point_on_line_2)  # -> Geometry, Transform
niche_sdies = Number(niche_sides_2)
construct_plane = ConstructPlane(Origin=point_on_line_2, XAxis=polygon_side_2, YAxis=rotate.Geometry)
length = Length(Curve=polygon_side_2)
rotate_2 = Rotate(Geometry=construct_plane, Angle=degrees(niche_rotation_2), Plane=point_on_line_2)  # -> Geometry, Transform
division = Division(A=length, B=niche_prop_2)
polygon = Polygon(Plane=rotate_2.Geometry, Radius=division, Segments=niche_sdies, FilletRadius=0)  # -> Polygon, Length
polygon_2 = ClusterOutput(polygon.Polygon)

# ==== cluster PointOnLine
line = ClusterInput()
number = ClusterInput()

line_2 = Line(line)
number_2 = Number(number)
end_points = EndPoints(Curve=line_2)  # -> Start, End
addition = Addition(A=end_points.Start, B=end_points.End)
multiplication = Multiplication(A=addition, B=number_2)
point = Point(multiplication)

point_2 = ClusterOutput(point)
