# Grasshopper definition GP_3D_P2V1_Roni_Hayroomian.gh (Grasshopper 1.0.7)
# plug-ins: Human

change_inner_shape = Text()
wall_scaler = Panel("1.5")
exterior_wall_rotation = Panel("1")
exterior_wall_subdivision = Panel("1")
interior_wall_options = Panel("2")
polygon_a_sides = Panel("4")
interior_wall_rotation = Panel("2")
total_degrees = Panel("360")
division = Panel("12")
interior_wall_subdivsion = Panel("2")
# Variables + Controls
drawing_center = Panel("0,0,0")
circle_a_radius = Panel("60")
start_point = Panel("0")
niche_sides_a = Panel("8")
nich_proportion_b = Panel("4")
niche_sides_b = Panel("4")
niche_proportion_divisor = Panel("1.8")
angle_of_niche_rotation = Panel("0")
division_2 = Division(A=total_degrees, B=division)
division_3 = Division(A=division, B=polygon_a_sides)
drawing_center_2 = Plane(drawing_center)
polygon_a_sides_2 = Panel("4")
total_degrees_2 = Panel("360")
division_4 = Panel("8")
drawing_center_3 = Panel("0,0,0")
circle_a_radius_2 = Panel("45")
start_point_2 = Panel("0")
division_5 = Division(A="360", B="12")
series = Series(Start=start_point, Step=division_2, Count=division_3)
xy_plane = XYPlane(Origin=Point(0, 0, 0))
series_2 = Series(Start=0, Step=division_5, Count="12")
number_of_polygons = Number("12")
division_6 = Division(A=total_degrees_2, B=division_4)
division_7 = Division(A=division_4, B=polygon_a_sides_2)
radians = Radians(Degrees=series)
drawing_center_4 = Plane(drawing_center_3)
circle = Circle(Plane=xy_plane, Radius="60")
rotate_plane = RotatePlane(Plane=xy_plane, Angle=degrees(series_2))
series_3 = Series(Start=start_point_2, Step=division_6, Count=division_7)
rotate_plane_2 = RotatePlane(Plane=drawing_center_2, Angle=radians)
polygon = Polygon(Plane=rotate_plane, Radius="60", Segments="4", FilletRadius=0)  # -> Polygon, Length
radians_2 = Radians(Degrees=series_3)
circle_2 = Circle(Plane=rotate_plane_2, Radius=circle_a_radius)

# ---- group: Polygon Sides
list_item = ListItem(List=polygon.Polygon, Index=0, Wrap=True)
explode = Explode(Curve=list_item, Recursive=True)  # -> Segments, Vertices
list_item_2 = ListItem(List=explode.Segments, Index=0, Wrap=True)

# ----
rotate_plane_3 = RotatePlane(Plane=drawing_center_4, Angle=radians_2)
circle_3 = Circle(Plane=rotate_plane_3, Radius=circle_a_radius_2)
line = Line(list_item_2)
# A
divide_curve = DivideCurve(Curve=circle_2, Count=polygon_a_sides, Kinks=False)  # -> Points, Tangents, Parameters
list_item_3 = ListItem(List=circle_2, Index=0, Wrap=True)
list_length = ListLength(List=flatten(divide_curve.Points))
polyline = PolyLine(Vertices=divide_curve.Points, Closed=Toggle(True))
reverse = Reverse(Vector=line)

# ---- group: Perpendicular to Section LIne
end_points = EndPoints(Curve=line)  # -> Start, End
perpendicular = GhPythonScript(line=line)  # -> Perp; inputs line: Line; same code as perpendicular
construct_plane = ConstructPlane(Origin=[end_points.Start, end_points.End], XAxis=[line, reverse], YAxis=perpendicular)

# ----
divide_curve_2 = DivideCurve(Curve=circle_3, Count=polygon_a_sides_2, Kinks=False)  # -> Points, Tangents, Parameters
number_of_points_on_inner_circle = Number(list_length)
scale = Scale(Geometry=list_item_3, Center=drawing_center_2, Factor=wall_scaler)  # -> Geometry, Transform
line_2 = Line(StartPoint=drawing_center_2, EndPoint=divide_curve.Points)

# ---- group: dome
# Operations
list_item_4 = ListItem(List=polyline, Index=0, Wrap=True)
explode_2 = Explode(Curve=list_item_4, Recursive=True)  # -> Segments, Vertices
list_item_5 = ListItem(List=explode_2.Segments, Index=0, Wrap=True)
point_on_curve = PointOnCurve(list_item_5, parameter=0.5)
distance = Distance(PointA=point_on_curve, PointB=drawing_center_2)
circle_4 = Circle(Plane=drawing_center_2, Radius=distance)

# ----
geometry = Geometry(circle_3)
number = Number(".5")
line_3 = Line(line)
plane = Plane(construct_plane)
vector = Vector(perpendicular)
divide_curve_3 = DivideCurve(Curve=scale.Geometry, Count=number_of_points_on_inner_circle, Kinks=False)  # -> Points, Tangents, Parameters
divide_curve_4 = DivideCurve(Curve=list_item_3, Count=number_of_points_on_inner_circle, Kinks=False)  # -> Points, Tangents, Parameters

# ---- group: 2D Section
length = Length(Curve=line_3)
multiplication = Multiplication(A=length, B=number)
line_sdl = LineSDL(Start=plane, Direction=vector, Length=multiplication)
point_on_curve_2 = PointOnCurve(line_sdl, parameter=0)
list_item_6 = ListItem(List=point_on_curve_2, Index=0, Wrap=True)
list_item_7 = ListItem(List=plane, Index="1", Wrap=True)
move = Move(Geometry=plane, Motion=line_sdl)  # -> Geometry, Transform
distance_2 = Distance(PointA=list_item_6, PointB=list_item_7)
radians_3 = Radians(Degrees="60")
arc = Arc(Plane=move.Geometry, Radius=distance_2, Angle=radians_3)  # -> Arc, Length
join_curves = JoinCurves(Curves=[arc.Arc, line_sdl], Preserve=False)

# ----
xy_plane_2 = XYPlane(Origin=Point(0, 0, 0))
list_item_8 = ListItem(List=divide_curve_2.Points, Index="0", Wrap=True)
line_4 = Line(StartPoint=drawing_center_3, EndPoint=list_item_8)
list_of_points_on_circle = Point(divide_curve_3.Points)
polygon_2 = Polygon(Plane=xy_plane_2, Radius="62", Segments="8", FilletRadius=0)  # -> Polygon, Length
list_of_points_on_circle_2 = Point(divide_curve_4.Points)

# ---- group: wall
partition_list = PartitionList(List=list_of_points_on_circle, Size=exterior_wall_subdivision)
panel = Panel(exterior_wall_rotation)
list_item_9 = ListItem(List=partition_list, Index=panel, Wrap=True)  # -> flatten(Item)
polyline_2 = PolyLine(Vertices=list_item_9, Closed=Toggle(True))

# ---- group: interior wall b
partition_list_2 = PartitionList(List=list_of_points_on_circle_2, Size=interior_wall_subdivsion)
panel_2 = Panel(interior_wall_rotation)
list_item_10 = ListItem(List=partition_list_2, Index=panel_2, Wrap=True)  # -> flatten(Item)
polyline_3 = PolyLine(Vertices=list_item_10, Closed=Toggle(True))

# ---- group: perpendecular to section line
end_points_2 = EndPoints(Curve=line_4)  # -> Start, End
perpendicular_2 = GhPythonScript(line=line_4)  # -> Perp; inputs line: Line; same code as perpendicular
reverse_2 = Reverse(Vector=line_4)
construct_plane_2 = ConstructPlane(Origin=[end_points_2.Start, end_points_2.End], XAxis=[line_4, reverse_2], YAxis=perpendicular_2)

# ----
line_5 = Line(line_4)
number_2 = Number("3")
wall_polyline = Geometry(polyline_2)
wall_polyline_2 = Geometry(polyline_3)

# ---- group: niches
explode_3 = Explode(Curve=wall_polyline_2, Recursive=True)  # -> Segments, Vertices
panel_3 = Panel("""0
1""")
sift_pattern = SiftPattern(List=explode_3.Segments, SiftPattern=panel_3)  # -> Output0, Output1
point_on_line = PointOnLine(curve=sift_pattern.Output0, point_value=".6")
point_on_line_2 = PointOnLine(curve=sift_pattern.Output1, point_value=".55")
niche = Niche(
    polygon_sides=niche_sides_a,
    divisor_of_niche_ratio=niche_proportion_divisor,
    angle_of_niche_rotation=angle_of_niche_rotation,
    polygon_side=sift_pattern.Output0,
    center_of_niche=point_on_line)
niche_2 = Niche(
    polygon_sides=niche_sides_b,
    divisor_of_niche_ratio=nich_proportion_b,
    angle_of_niche_rotation="45",
    polygon_side=sift_pattern.Output1,
    center_of_niche=point_on_line_2)

# ---- group: 2d Section
length_2 = Length(Curve=line_4)
plane_2 = Plane(construct_plane_2)
vector_2 = Vector(perpendicular_2)
multiplication_2 = Multiplication(A=length_2, B=number_2)
line_sdl_2 = LineSDL(Start=plane_2, Direction=vector_2, Length=multiplication_2)
move_2 = Move(Geometry=plane_2, Motion=line_sdl_2)  # -> Geometry, Transform
point_on_curve_3 = PointOnCurve(line_sdl_2, parameter=0)
list_item_11 = ListItem(List=plane_2, Index="1", Wrap=True)
list_item_12 = ListItem(List=point_on_curve_3, Index=0, Wrap=True)
radians_4 = Radians(Degrees="90")
distance_3 = Distance(PointA=list_item_12, PointB=list_item_11)
arc_2 = Arc(Plane=move_2.Geometry, Radius=distance_3, Angle=radians_4)  # -> Arc, Length
join_curves_2 = JoinCurves(Curves=[arc_2.Arc, line_sdl_2], Preserve=False)

# ----
boundary_surfaces = BoundarySurfaces(Edges=wall_polyline)
center_of_drawing = Plane(xy_plane)
curve = Curve(join_curves)
exterior_wall = Curve(boundary_surfaces)
division_8 = Division(A=number_of_polygons, B="2")

# ---- group: rotate 3D
base_line_of_section = Line(line_3)
reverse_3 = Reverse(Vector=base_line_of_section)
point_on_curve_4 = PointOnCurve(base_line_of_section, parameter=0.5)
rotate_3d = Rotate3D(Geometry=curve, Angle=degrees("90"), Center=point_on_curve_4, Axis=reverse_3)  # -> Geometry, Transform
polar_array = PolarArray(Geometry=rotate_3d.Geometry, Plane=center_of_drawing, Count=division_8, Angle=6.283185307)  # -> Geometry, Transform

# ----
list_item_13 = ListItem(List=line_sdl_2, Index="1", Wrap=True)
list_item_14 = ListItem(List=arc_2.Arc, Index=0, Wrap=True)
point_on_curve_5 = PointOnCurve(rotate_3d.Geometry, parameter=0.5)
join_curves_3 = JoinCurves(Curves=[list_item_13, list_item_14], Preserve=False)
niche_a_b = Relay([niche, niche_2])
region_union = RegionUnion(Curves=flatten([list_item_3, niche_a_b]))

# ---- group: Surface
deconstruct = Deconstruct(Point=point_on_curve_5)  # -> XComponent, YComponent, ZComponent
panel_4 = Panel(point_on_curve_5)
division_9 = Division(A=deconstruct.ZComponent, B="10")
arrayed_section = Geometry(polar_array.Geometry)
plane_3 = Plane(center_of_drawing)
series_4 = Series(Start="0", Step="10", Count=division_9)
unit_z = UnitZ(Factor=series_4)
move_3 = Move(Geometry=plane_3, Motion=graft(unit_z))  # -> Geometry, Transform
curve_plane = CurvePlane(Curve=arrayed_section, Plane=move_3.Geometry)  # -> flatten(Points), ParamsC, ParamsP
partition_list_3 = PartitionList(List=curve_plane.Points, Size=number_of_polygons)
convex_hull = ConvexHull(Points=partition_list_3, Plane=move_3.Geometry)  # -> Hull, HullZ, Indices
loft = Loft(
    Curves=flatten(convex_hull.Hull),
    Options={Adjust=False, Closed=False, LoftEnds=0, LoftSimp=0, LoftType=0, Rebuild=10, Refit=0.01})

# ----
region_union_2 = RegionUnion(Curves=flatten([niche_a_b, wall_polyline_2]))
stream_filter = StreamFilter(Gate=interior_wall_options, Stream0=list_item_3, Stream1=wall_polyline_2, Stream2=region_union_2, Stream3=region_union)
# B
# Output Geometry
region_difference = RegionDifference(CurvesA=exterior_wall, CurvesB=stream_filter)
unit_z_2 = UnitZ(Factor=1)
reverse_4 = Reverse(Vector=line_5)
point_on_curve_6 = PointOnCurve(line_5, parameter=0.5)
rotate_3d_2 = Rotate3D(Geometry=join_curves_3, Angle=degrees("90"), Center=point_on_curve_6, Axis=reverse_4)  # -> Geometry, Transform
line_sdl_3 = LineSDL(Start=geometry, Direction=unit_z_2, Length=1)
rail_revolution = RailRevolution(Curve=rotate_3d_2.Geometry, Rail=geometry, Axis=line_sdl_3, Scale=False)
dome_above = Geometry(circle_4)
# C
# Views
center_lines = Line(line_2)
panel_5 = Panel("""1
.5""")
panel_6 = Panel("""1
.5
.5
.5""")
dash_pattern = DashPattern(Curve=dome_above, Pattern=panel_5)  # -> Dashes, Gaps
# D
# Line Type
dash_pattern_2 = DashPattern(Curve=center_lines, Pattern=panel_6)  # -> Dashes, Gaps
stream_filter_2 = StreamFilter(Gate=Toggle(True), Stream1=region_difference)
brep = Brep(stream_filter_2)

# ---- group: Hatch Group
boundary_surfaces_2 = BoundarySurfaces(Edges=brep)
vector_at_angle = PythonScript(angle="45")  # -> vector
# ---------- vector_at_angle: Python ----------
import rhinoscriptsyntax as rs
import math
if angle == None:
    Vector = None
else:
    c=rs.AddPoint(0,0,0)
    f=math.radians(float(angle))
    l=rs.AddPoint(math.cos(f),math.sin(f),0)
    d=rs.VectorCreate(l,c)
    vector =rs.VectorUnitize(d)
# ---------- end vector_at_angle ----------
contour = Contour(Shape=boundary_surfaces_2, Point=Point(0, 0, 0), Direction=vector_at_angle, Distance="1")

# ----
geometry_2 = Geometry()
geometry_3 = Geometry()
geometry_4 = Geometry(polyline)
list_of_points_to_label = Point(flatten(divide_curve.Points))
geometry_5 = Geometry(region_difference)
hatch_lines = Geometry(contour)
geometry_6 = Geometry(dash_pattern.Dashes)
# E
# Layers
geometry_7 = Geometry(circle_2)
geometry_8 = Geometry(dash_pattern_2.Dashes)
point = Point(drawing_center_2)

# ---- group: Preview and Bake
button = Button()
get_name = GhPythonScript(Component=geometry_2)  # -> Geometry, Name
# ---------- get_name: Python ----------
# Mark Ericson 1.17.19
   #take from forum discussion thread https://www.grasshopper3d.com/forum/topics/python-get-label-name-of-input-components
    #edited version of code  by Mostapha Sadeghipour Roudsari

def GetComponentName():
    Comp = ghenv.Component.Params.Input[0]
    sources = Comp.Sources

    if sources.Count == 0: 
        return components

    for source in sources:
        attr = source.Attributes
        if (attr is None) or (attr.GetTopLevel is None):
            pass
        else:

            component = attr.GetTopLevel.DocObject
            componentName = component.NickName

            return componentName

if Component == None:
    pass
else:
    Name = GetComponentName()
    Geometry = Component
# ---------- end get_name ----------
linear_gradient = GhPythonScript(R="0", G="0", B="0", Percent="1")  # -> Color
# ---------- linear_gradient: Python ----------
__author__ = "ericsonm"
__version__ = "2019.01.15"

import rhinoscriptsyntax as rs

def LinearColorGradient(R,G,B,R2,G2,B2,ColorPercentage):
    
    if ColorPercentage > 1:
        R3 = None
        G3 = None
        B3 = None
    else:
        #This function defines linear color gradient by treating R,G,B as coordinates on a 3D line.
        #The base color that will be altered by the percentage should be entered in the second R2,G2,B2 valu
    
        Rdiff = float(R2) - float(R)
        Gdiff = float(G2) - float(G)
        Bdiff = float(B2) - float(B)


        t = float(ColorPercentage)


        R3 = float(R) + Rdiff*t
        G3 = float(G) + Gdiff*t
        B3 = float(B) + Bdiff*t



    return R3,G3,B3


if (R or G or B or Percent) is None:
    Color = None
else: 
    Color1 = LinearColorGradient(255,255,255,R,G,B,Percent)

    R3 = Color1[0]
    G3 = Color1[1]
    B3 = Color1[2]

    Color = rs.CreateColor(R3,G3,B3)
# ---------- end linear_gradient ----------
custom_preview = CustomPreview(Geometry=get_name.Geometry, Material=linear_gradient)

button_2 = Button()
get_name_2 = GhPythonScript(Component=geometry_3)  # -> Geometry, Name; same code as get_name
linear_gradient_2 = GhPythonScript(R="0", G="0", B="0", Percent="1")  # -> Color; same code as linear_gradient
custom_preview_2 = CustomPreview(Geometry=get_name_2.Geometry, Material=linear_gradient_2)

# F
button_3 = Button()
get_name_3 = GhPythonScript(Component=geometry_7)  # -> Geometry, Name; same code as get_name
linear_gradient_3 = GhPythonScript(R="0", G="0", B="0", Percent=".5")  # -> Color; same code as linear_gradient
custom_preview_3 = CustomPreview(Geometry=get_name_3.Geometry, Material=linear_gradient_3)

button_4 = Button()
get_name_4 = GhPythonScript(Component=geometry_4)  # -> Geometry, Name; same code as get_name
linear_gradient_4 = GhPythonScript(R="0", G="0", B="0", Percent="1")  # -> Color; same code as linear_gradient
custom_preview_4 = CustomPreview(Geometry=get_name_4.Geometry, Material=linear_gradient_4)

button_5 = Button()
get_name_5 = GhPythonScript(Component=hatch_lines)  # -> Geometry, Name; same code as get_name
linear_gradient_5 = GhPythonScript(R="0", G="0", B="0", Percent=".5")  # -> Color; same code as linear_gradient
custom_preview_5 = CustomPreview(Geometry=get_name_5.Geometry, Material=linear_gradient_5)

button_6 = Button()
get_name_6 = GhPythonScript(Component=geometry_5)  # -> Geometry, Name; same code as get_name
linear_gradient_6 = GhPythonScript(R="0", G="0", B="0", Percent=".5")  # -> Color; same code as linear_gradient
custom_preview_6 = CustomPreview(Geometry=get_name_6.Geometry, Material=linear_gradient_6)

button_7 = Button()
get_name_7 = GhPythonScript(Component=geometry_6)  # -> Geometry, Name; same code as get_name
linear_gradient_7 = GhPythonScript(R="0", G="0", B="0", Percent="1")  # -> Color; same code as linear_gradient
custom_preview_7 = CustomPreview(Geometry=get_name_7.Geometry, Material=linear_gradient_7)

button_8 = Button()
get_name_8 = GhPythonScript(Component=geometry_8)  # -> Geometry, Name; same code as get_name
linear_gradient_8 = GhPythonScript(R="0", G="0", B="0", Percent="1")  # -> Color; same code as linear_gradient
custom_preview_8 = CustomPreview(Geometry=get_name_8.Geometry, Material=linear_gradient_8)

# ----
panel_7 = Panel(get_name.Name)
panel_8 = Panel(get_name_2.Name)
# Preview and Bake
panel_9 = Panel(get_name_3.Name)
panel_10 = Panel(get_name_4.Name)
panel_11 = Panel(get_name_5.Name)
panel_12 = Panel(get_name_6.Name)
panel_13 = Panel(get_name_7.Name)
panel_14 = Panel(get_name_8.Name)
custom_preview_lineweights = CustomPreviewLineweights(Geometry=get_name.Geometry, Shader=linear_gradient, Thickness=".0025", Absolute=Toggle(True))
custom_preview_lineweights_2 = CustomPreviewLineweights(Geometry=get_name_2.Geometry, Shader=linear_gradient_2, Thickness=".0025", Absolute=Toggle(True))
custom_preview_lineweights_3 = CustomPreviewLineweights(Geometry=get_name_3.Geometry, Shader=linear_gradient_3, Thickness=".0025", Absolute=Toggle(True))
custom_preview_lineweights_4 = CustomPreviewLineweights(Geometry=get_name_4.Geometry, Shader=linear_gradient_4, Thickness=".0025", Absolute=Toggle(True))
custom_preview_lineweights_5 = CustomPreviewLineweights(Geometry=get_name_5.Geometry, Shader=linear_gradient_5, Thickness=".1", Absolute=Toggle(True))
custom_preview_lineweights_6 = CustomPreviewLineweights(Geometry=get_name_6.Geometry, Shader=linear_gradient_6, Thickness=".1", Absolute=Toggle(True))
custom_preview_lineweights_7 = CustomPreviewLineweights(Geometry=get_name_7.Geometry, Shader=linear_gradient_7, Thickness=".0025", Absolute=Toggle(True))
custom_preview_lineweights_8 = CustomPreviewLineweights(Geometry=get_name_8.Geometry, Shader=linear_gradient_8, Thickness=".0025", Absolute=Toggle(True))

# ---- group: TEXT LABELS
text_size = Panel("1")
point_2 = Point(list_of_points_to_label)
add_text = Panel("a")
linear_gradient_9 = GhPythonScript(R="0", G="0", B="0", Percent=".5")  # -> Color; same code as linear_gradient

# ----
scale_2 = Scale(Geometry=point_2, Center=point, Factor="1.025")  # -> Geometry, Transform

# ---- group: TEXT LABELS (continued)
list_length_2 = ListLength(List=scale_2.Geometry)
series_5 = Series(Start=0, Step=1, Count=list_length_2)
integer = Integer(series_5)
concatenate = Concatenate(FragmentA=integer, FragmentB=add_text)
text_tag_3d = TextTag3D(Location=scale_2.Geometry, Text=concatenate, Size=text_size, Colour=linear_gradient_9, Justification=5)

# ==== cluster Niche
angle_of_niche_rotation = ClusterInput()
divisor_of_niche_ratio = ClusterInput()
polygon_sides = ClusterInput()
polygon_side = ClusterInput()
center_of_niche = ClusterInput()

perpendicular = GhPythonScript(line=polygon_side)  # -> Perp; inputs line: Line
# ---------- perpendicular: Python ----------
__author__ = "mericson"
__version__ = "2019.01.11"

import rhinoscriptsyntax as rs
import math
import Rhino as rh

if line == None:
    line = None
else:
    a = 0,0,0
    b = 0,0,1
    Z = rs.VectorCreate(a,b)
    c = rh.Geometry.Line.PointAt(line,1)
    d = rh.Geometry.Line.PointAt(line,0)
    vector2 = rs.VectorCreate(c,d)
    Perp = rs.VectorRotate(vector2,90,Z)
# ---------- end perpendicular ----------
length = Length(Curve=polygon_side)
construct_plane = ConstructPlane(Origin=center_of_niche, XAxis=polygon_side, YAxis=perpendicular)
division = Division(A=length, B=divisor_of_niche_ratio)
rotate = Rotate(Geometry=construct_plane, Angle=degrees(angle_of_niche_rotation), Plane=center_of_niche)  # -> Geometry, Transform
polygon = Polygon(Plane=rotate.Geometry, Radius=division, Segments=polygon_sides, FilletRadius=0)  # -> Polygon, Length

polygon_2 = ClusterOutput(polygon.Polygon)

# ==== cluster PointOnLine
point_value = ClusterInput()
curve = ClusterInput()
point_value_2 = Number(point_value)

# ---- group: point on curv
end_points = EndPoints(Curve=curve)  # -> Start, End
panel = Panel(point_value_2)
point = Point(end_points.Start)
point_2 = Point(end_points.End)
addition = Addition(A=point, B=point_2)
multiplication = Multiplication(A=addition, B=panel)

# ----
result = ClusterOutput(multiplication)
