# Grasshopper definition GP_3D_P3V1_Roni_Hayroomian.gh (Grasshopper 1.0.7)
# plug-ins: Human

niche = NICHE()
change_inner_shape = Text()
polygon_a_sides = Panel("4")
total_degrees = Panel("360")
division = Panel("8")
drawing_center = Panel("0,0,0")
circle_a_radius = Panel("45")
start_point = Panel("0")
polygon_a_sides_2 = Panel("4")
total_degrees_2 = Panel("360")
division_2 = Panel("16")
drawing_center_2 = Panel("0,0,0")
circle_a_radius_2 = Panel("60")
start_point_2 = Panel("0")
wall_scaler = Panel("1.4")
exterior_wall_rotation = Panel("1")
exterior_wall_subdivision = Panel("2")
interior_wall_options = Panel("2")
polygon_a_sides_3 = Panel("4")
interior_wall_rotation = Panel("1")
total_degrees_3 = Panel("360")
division_3 = Panel("16")
interior_wall_subdivsion = Panel("2")
# Variables + Controls
drawing_center_3 = Panel("0,0,0")
circle_a_radius_3 = Panel("60")
start_point_3 = Panel("0")
niche_sides_a = Panel("6")
nich_proportion_b = Panel("1.7")
niche_sides_b = Panel("4")
niche_proportion_divisor = Panel("2")
angle_of_niche_rotation = Panel("0")
division_4 = Division(A=total_degrees, B=division)
division_5 = Division(A=division, B=polygon_a_sides)
division_6 = Division(A=total_degrees_2, B=division_2)
division_7 = Division(A=division_2, B=polygon_a_sides_2)
drawing_center_4 = Plane(drawing_center)
drawing_center_5 = Plane(drawing_center_2)
division_8 = Division(A=total_degrees_3, B=division_3)
division_9 = Division(A=division_3, B=polygon_a_sides_3)
drawing_center_6 = Plane(drawing_center_3)
series = Series(Start=start_point, Step=division_4, Count=division_5)
series_2 = Series(Start=start_point_2, Step=division_6, Count=division_7)
series_3 = Series(Start=start_point_3, Step=division_8, Count=division_9)
radians = Radians(Degrees=series)
radians_2 = Radians(Degrees=series_2)
radians_3 = Radians(Degrees=series_3)
rotate_plane = RotatePlane(Plane=drawing_center_4, Angle=radians)
rotate_plane_2 = RotatePlane(Plane=drawing_center_5, Angle=radians_2)
rotate_plane_3 = RotatePlane(Plane=drawing_center_6, Angle=radians_3)
circle = Circle(Plane=rotate_plane, Radius=circle_a_radius)
circle_2 = Circle(Plane=rotate_plane_2, Radius=circle_a_radius_2)
circle_3 = Circle(Plane=rotate_plane_3, Radius=circle_a_radius_3)
divide_curve = DivideCurve(Curve=circle, Count=polygon_a_sides, Kinks=False)  # -> Points, Tangents, Parameters
divide_curve_2 = DivideCurve(Curve=circle_2, Count=polygon_a_sides_2, Kinks=False)  # -> Points, Tangents, Parameters
# A
divide_curve_3 = DivideCurve(Curve=circle_3, Count=polygon_a_sides_3, Kinks=False)  # -> Points, Tangents, Parameters
list_item = ListItem(List=circle_3, Index=0, Wrap=True)
geometry = Geometry(circle)
geometry_2 = Geometry(circle_2)
list_length = ListLength(List=flatten(divide_curve_3.Points))
polyline = PolyLine(Vertices=divide_curve_3.Points, Closed=Toggle(True))
list_item_2 = ListItem(List=divide_curve.Points, Index="0", Wrap=True)
list_item_3 = ListItem(List=divide_curve_2.Points, Index="0", Wrap=True)
line = Line(StartPoint=drawing_center, EndPoint=list_item_2)
number_of_points_on_inner_circle = Number(list_length)
line_2 = Line(StartPoint=drawing_center_2, EndPoint=list_item_3)
scale = Scale(Geometry=list_item, Center=drawing_center_6, Factor=wall_scaler)  # -> Geometry, Transform
line_3 = Line(StartPoint=drawing_center_6, EndPoint=divide_curve_3.Points)

# ---- group: dome
# Operations
list_item_4 = ListItem(List=polyline, Index=0, Wrap=True)
explode = Explode(Curve=list_item_4, Recursive=True)  # -> Segments, Vertices
list_item_5 = ListItem(List=explode.Segments, Index=0, Wrap=True)
point_on_curve = PointOnCurve(list_item_5, parameter=0.5)
distance = Distance(PointA=point_on_curve, PointB=drawing_center_6)
circle_4 = Circle(Plane=drawing_center_6, Radius=distance)

# ----
divide_curve_4 = DivideCurve(Curve=scale.Geometry, Count=number_of_points_on_inner_circle, Kinks=False)  # -> Points, Tangents, Parameters
divide_curve_5 = DivideCurve(Curve=list_item, Count=number_of_points_on_inner_circle, Kinks=False)  # -> Points, Tangents, Parameters
xy_plane = XYPlane(Origin=Point(0, 0, 0))

# ---- group: perpendecular to section line
end_points = EndPoints(Curve=line)  # -> Start, End
perpendicular = GhPythonScript(line=line)  # -> Perp; inputs line: Line; same code as perpendicular
reverse = Reverse(Vector=line)
construct_plane = ConstructPlane(Origin=[end_points.Start, end_points.End], XAxis=[line, reverse], YAxis=perpendicular)

end_points_2 = EndPoints(Curve=line_2)  # -> Start, End
perpendicular_2 = GhPythonScript(line=line_2)  # -> Perp; inputs line: Line; same code as perpendicular
reverse_2 = Reverse(Vector=line_2)
construct_plane_2 = ConstructPlane(Origin=[end_points_2.Start, end_points_2.End], XAxis=[line_2, reverse_2], YAxis=perpendicular_2)

# ----
line_4 = Line(line)
line_5 = Line(line_2)
list_of_points_on_circle = Point(divide_curve_4.Points)
list_of_points_on_circle_2 = Point(divide_curve_5.Points)
polygon = Polygon(Plane=xy_plane, Radius="50", Segments="6", FilletRadius=0)  # -> Polygon, Length

# ---- group: wall
partition_list = PartitionList(List=list_of_points_on_circle, Size=exterior_wall_subdivision)
panel = Panel(exterior_wall_rotation)
list_item_6 = ListItem(List=partition_list, Index=panel, Wrap=True)  # -> flatten(Item)
polyline_2 = PolyLine(Vertices=list_item_6, Closed=Toggle(True))

# ---- group: interior wall b
partition_list_2 = PartitionList(List=list_of_points_on_circle_2, Size=interior_wall_subdivsion)
panel_2 = Panel(interior_wall_rotation)
list_item_7 = ListItem(List=partition_list_2, Index=panel_2, Wrap=True)  # -> flatten(Item)
polyline_3 = PolyLine(Vertices=list_item_7, Closed=Toggle(True))

# ----
number = Number("3")
number_2 = Number("1")

# ---- group: 2d Section
length = Length(Curve=line)
plane = Plane(construct_plane)
vector = Vector(perpendicular)
multiplication = Multiplication(A=length, B=number)
line_sdl = LineSDL(Start=plane, Direction=vector, Length=multiplication)
move = Move(Geometry=plane, Motion=line_sdl)  # -> Geometry, Transform
point_on_curve_2 = PointOnCurve(line_sdl, parameter=0)
list_item_8 = ListItem(List=plane, Index="1", Wrap=True)
list_item_9 = ListItem(List=point_on_curve_2, Index=0, Wrap=True)
radians_4 = Radians(Degrees="90")
distance_2 = Distance(PointA=list_item_9, PointB=list_item_8)
arc = Arc(Plane=move.Geometry, Radius=distance_2, Angle=radians_4)  # -> Arc, Length
join_curves = JoinCurves(Curves=[arc.Arc, line_sdl], Preserve=False)

length_2 = Length(Curve=line_2)
plane_2 = Plane(construct_plane_2)
vector_2 = Vector(perpendicular_2)
multiplication_2 = Multiplication(A=length_2, B=number_2)
line_sdl_2 = LineSDL(Start=plane_2, Direction=vector_2, Length=multiplication_2)
move_2 = Move(Geometry=plane_2, Motion=line_sdl_2)  # -> Geometry, Transform
point_on_curve_3 = PointOnCurve(line_sdl_2, parameter=0)
list_item_10 = ListItem(List=plane_2, Index="1", Wrap=True)
list_item_11 = ListItem(List=point_on_curve_3, Index=0, Wrap=True)
radians_5 = Radians(Degrees="90")
distance_3 = Distance(PointA=list_item_11, PointB=list_item_10)
arc_2 = Arc(Plane=move_2.Geometry, Radius=distance_3, Angle=radians_5)  # -> Arc, Length
join_curves_2 = JoinCurves(Curves=[arc_2.Arc, line_sdl_2], Preserve=False)

# ---- group: niches
explode_2 = Explode(Curve=polygon.Polygon, Recursive=True)  # -> Segments, Vertices
panel_3 = Panel("""0
1""")
sift_pattern = SiftPattern(List=explode_2.Segments, SiftPattern=panel_3)  # -> Output0, Output1
point_on_line = PointOnLine(curve=sift_pattern.Output0, point_value=".5")
point_on_line_2 = PointOnLine(curve=sift_pattern.Output1, point_value=".8")
niche_2 = Niche(
    polygon_sides=niche_sides_a,
    divisor_of_niche_ratio=niche_proportion_divisor,
    angle_of_niche_rotation=angle_of_niche_rotation,
    polygon_side=sift_pattern.Output0,
    center_of_niche=point_on_line)
niche_3 = Niche(
    polygon_sides=niche_sides_b,
    divisor_of_niche_ratio=nich_proportion_b,
    angle_of_niche_rotation="45",
    polygon_side=sift_pattern.Output1,
    center_of_niche=point_on_line_2)

# ----
wall_polyline = Geometry(polyline_2)
wall_polyline_2 = Geometry(polyline_3)
boundary_surfaces = BoundarySurfaces(Edges=wall_polyline)
list_item_12 = ListItem(List=line_sdl, Index="1", Wrap=True)
list_item_13 = ListItem(List=arc.Arc, Index=0, Wrap=True)
list_item_14 = ListItem(List=line_sdl_2, Index="1", Wrap=True)
list_item_15 = ListItem(List=arc_2.Arc, Index=0, Wrap=True)
exterior_wall = Curve(boundary_surfaces)
join_curves_3 = JoinCurves(Curves=[list_item_12, list_item_13], Preserve=False)
join_curves_4 = JoinCurves(Curves=[list_item_14, list_item_15], Preserve=False)
unit_z = UnitZ(Factor=1)
unit_z_2 = UnitZ(Factor=1)
reverse_3 = Reverse(Vector=line_4)
reverse_4 = Reverse(Vector=line_5)
point_on_curve_4 = PointOnCurve(line_4, parameter=0.5)
point_on_curve_5 = PointOnCurve(line_5, parameter=0.5)
niche_a_b = Relay([niche_2, niche_3])
region_union = RegionUnion(Curves=flatten([list_item, niche_a_b]))
rotate_3d = Rotate3D(Geometry=join_curves_3, Angle=degrees("90"), Center=point_on_curve_4, Axis=reverse_3)  # -> Geometry, Transform
line_sdl_3 = LineSDL(Start=geometry, Direction=unit_z, Length=1)
rotate_3d_2 = Rotate3D(Geometry=join_curves_4, Angle=degrees("90"), Center=point_on_curve_5, Axis=reverse_4)  # -> Geometry, Transform
line_sdl_4 = LineSDL(Start=geometry_2, Direction=unit_z_2, Length=1)
region_union_2 = RegionUnion(Curves=flatten([niche_a_b, wall_polyline_2]))
stream_filter = StreamFilter(Gate=interior_wall_options, Stream0=list_item, Stream1=wall_polyline_2, Stream2=region_union_2, Stream3=region_union)
# B
# Output Geometry
region_difference = RegionDifference(CurvesA=exterior_wall, CurvesB=stream_filter)
rail_revolution = RailRevolution(Curve=rotate_3d.Geometry, Rail=geometry, Axis=line_sdl_3, Scale=False)
rail_revolution_2 = RailRevolution(Curve=rotate_3d_2.Geometry, Rail=geometry_2, Axis=line_sdl_4, Scale=False)
dome_above = Geometry(circle_4)
# C
# Views
center_lines = Line(line_3)
panel_4 = Panel("""1
.5""")
panel_5 = Panel("""1
.5
.5
.5""")
dash_pattern = DashPattern(Curve=dome_above, Pattern=panel_4)  # -> Dashes, Gaps
# D
# Line Type
dash_pattern_2 = DashPattern(Curve=center_lines, Pattern=panel_5)  # -> Dashes, Gaps
stream_filter_2 = StreamFilter(Gate=Toggle(True), Stream1=region_difference)
brep = Brep(stream_filter_2)

# ---- group: Hatch Group
boundary_surfaces_2 = BoundarySurfaces(Edges=brep)
vector_at_angle = PythonScript(angle="45")  # -> vector
# ---------- vector_at_angle: Python ----------
import rhinoscriptsyntax as rs
import math
if angle == None:
    Vector = None
else:
    c=rs.AddPoint(0,0,0)
    f=math.radians(float(angle))
    l=rs.AddPoint(math.cos(f),math.sin(f),0)
    d=rs.VectorCreate(l,c)
    vector =rs.VectorUnitize(d)
# ---------- end vector_at_angle ----------
contour = Contour(Shape=boundary_surfaces_2, Point=Point(0, 0, 0), Direction=vector_at_angle, Distance="1")

# ----
geometry_3 = Geometry()
geometry_4 = Geometry()
geometry_5 = Geometry(polyline)
list_of_points_to_label = Point(flatten(divide_curve_3.Points))
geometry_6 = Geometry(region_difference)
hatch_lines = Geometry(contour)
geometry_7 = Geometry(dash_pattern.Dashes)
# E
# Layers
geometry_8 = Geometry(circle_3)
geometry_9 = Geometry(dash_pattern_2.Dashes)
point = Point(drawing_center_6)

# ---- group: Preview and Bake
button = Button()
get_name = GhPythonScript(Component=geometry_3)  # -> Geometry, Name
# ---------- get_name: Python ----------
# Mark Ericson 1.17.19
   #take from forum discussion thread https://www.grasshopper3d.com/forum/topics/python-get-label-name-of-input-components
    #edited version of code  by Mostapha Sadeghipour Roudsari

def GetComponentName():
    Comp = ghenv.Component.Params.Input[0]
    sources = Comp.Sources

    if sources.Count == 0: 
        return components

    for source in sources:
        attr = source.Attributes
        if (attr is None) or (attr.GetTopLevel is None):
            pass
        else:

            component = attr.GetTopLevel.DocObject
            componentName = component.NickName

            return componentName

if Component == None:
    pass
else:
    Name = GetComponentName()
    Geometry = Component
# ---------- end get_name ----------
linear_gradient = GhPythonScript(R="0", G="0", B="0", Percent="1")  # -> Color
# ---------- linear_gradient: Python ----------
__author__ = "ericsonm"
__version__ = "2019.01.15"

import rhinoscriptsyntax as rs

def LinearColorGradient(R,G,B,R2,G2,B2,ColorPercentage):
    
    if ColorPercentage > 1:
        R3 = None
        G3 = None
        B3 = None
    else:
        #This function defines linear color gradient by treating R,G,B as coordinates on a 3D line.
        #The base color that will be altered by the percentage should be entered in the second R2,G2,B2 valu
    
        Rdiff = float(R2) - float(R)
        Gdiff = float(G2) - float(G)
        Bdiff = float(B2) - float(B)


        t = float(ColorPercentage)


        R3 = float(R) + Rdiff*t
        G3 = float(G) + Gdiff*t
        B3 = float(B) + Bdiff*t



    return R3,G3,B3


if (R or G or B or Percent) is None:
    Color = None
else: 
    Color1 = LinearColorGradient(255,255,255,R,G,B,Percent)

    R3 = Color1[0]
    G3 = Color1[1]
    B3 = Color1[2]

    Color = rs.CreateColor(R3,G3,B3)
# ---------- end linear_gradient ----------
custom_preview = CustomPreview(Geometry=get_name.Geometry, Material=linear_gradient)

button_2 = Button()
get_name_2 = GhPythonScript(Component=geometry_4)  # -> Geometry, Name; same code as get_name
linear_gradient_2 = GhPythonScript(R="0", G="0", B="0", Percent="1")  # -> Color; same code as linear_gradient
custom_preview_2 = CustomPreview(Geometry=get_name_2.Geometry, Material=linear_gradient_2)

# F
button_3 = Button()
get_name_3 = GhPythonScript(Component=geometry_8)  # -> Geometry, Name; same code as get_name
linear_gradient_3 = GhPythonScript(R="0", G="0", B="0", Percent=".5")  # -> Color; same code as linear_gradient
custom_preview_3 = CustomPreview(Geometry=get_name_3.Geometry, Material=linear_gradient_3)

button_4 = Button()
get_name_4 = GhPythonScript(Component=geometry_5)  # -> Geometry, Name; same code as get_name
linear_gradient_4 = GhPythonScript(R="0", G="0", B="0", Percent="1")  # -> Color; same code as linear_gradient
custom_preview_4 = CustomPreview(Geometry=get_name_4.Geometry, Material=linear_gradient_4)

button_5 = Button()
get_name_5 = GhPythonScript(Component=hatch_lines)  # -> Geometry, Name; same code as get_name
linear_gradient_5 = GhPythonScript(R="0", G="0", B="0", Percent=".5")  # -> Color; same code as linear_gradient
custom_preview_5 = CustomPreview(Geometry=get_name_5.Geometry, Material=linear_gradient_5)

button_6 = Button()
get_name_6 = GhPythonScript(Component=geometry_6)  # -> Geometry, Name; same code as get_name
linear_gradient_6 = GhPythonScript(R="0", G="0", B="0", Percent=".5")  # -> Color; same code as linear_gradient
custom_preview_6 = CustomPreview(Geometry=get_name_6.Geometry, Material=linear_gradient_6)

button_7 = Button()
get_name_7 = GhPythonScript(Component=geometry_7)  # -> Geometry, Name; same code as get_name
linear_gradient_7 = GhPythonScript(R="0", G="0", B="0", Percent="1")  # -> Color; same code as linear_gradient
custom_preview_7 = CustomPreview(Geometry=get_name_7.Geometry, Material=linear_gradient_7)

button_8 = Button()
get_name_8 = GhPythonScript(Component=geometry_9)  # -> Geometry, Name; same code as get_name
linear_gradient_8 = GhPythonScript(R="0", G="0", B="0", Percent="1")  # -> Color; same code as linear_gradient
custom_preview_8 = CustomPreview(Geometry=get_name_8.Geometry, Material=linear_gradient_8)

# ----
panel_6 = Panel(get_name.Name)
panel_7 = Panel(get_name_2.Name)
# Preview and Bake
panel_8 = Panel(get_name_3.Name)
panel_9 = Panel(get_name_4.Name)
panel_10 = Panel(get_name_5.Name)
panel_11 = Panel(get_name_6.Name)
panel_12 = Panel(get_name_7.Name)
panel_13 = Panel(get_name_8.Name)
custom_preview_lineweights = CustomPreviewLineweights(Geometry=get_name.Geometry, Shader=linear_gradient, Thickness=".0025", Absolute=Toggle(True))
custom_preview_lineweights_2 = CustomPreviewLineweights(Geometry=get_name_2.Geometry, Shader=linear_gradient_2, Thickness=".0025", Absolute=Toggle(True))
custom_preview_lineweights_3 = CustomPreviewLineweights(Geometry=get_name_3.Geometry, Shader=linear_gradient_3, Thickness=".0025", Absolute=Toggle(True))
custom_preview_lineweights_4 = CustomPreviewLineweights(Geometry=get_name_4.Geometry, Shader=linear_gradient_4, Thickness=".0025", Absolute=Toggle(True))
custom_preview_lineweights_5 = CustomPreviewLineweights(Geometry=get_name_5.Geometry, Shader=linear_gradient_5, Thickness=".1", Absolute=Toggle(True))
custom_preview_lineweights_6 = CustomPreviewLineweights(Geometry=get_name_6.Geometry, Shader=linear_gradient_6, Thickness=".1", Absolute=Toggle(True))
custom_preview_lineweights_7 = CustomPreviewLineweights(Geometry=get_name_7.Geometry, Shader=linear_gradient_7, Thickness=".0025", Absolute=Toggle(True))
custom_preview_lineweights_8 = CustomPreviewLineweights(Geometry=get_name_8.Geometry, Shader=linear_gradient_8, Thickness=".0025", Absolute=Toggle(True))

# ---- group: TEXT LABELS
text_size = Panel("1")
point_2 = Point(list_of_points_to_label)
add_text = Panel("a")
linear_gradient_9 = GhPythonScript(R="0", G="0", B="0", Percent=".5")  # -> Color; same code as linear_gradient

# ----
scale_2 = Scale(Geometry=point_2, Center=point, Factor="1.025")  # -> Geometry, Transform

# ---- group: TEXT LABELS (continued)
list_length_2 = ListLength(List=scale_2.Geometry)
series_4 = Series(Start=0, Step=1, Count=list_length_2)
integer = Integer(series_4)
concatenate = Concatenate(FragmentA=integer, FragmentB=add_text)
text_tag_3d = TextTag3D(Location=scale_2.Geometry, Text=concatenate, Size=text_size, Colour=linear_gradient_9, Justification=5)

# ==== cluster Niche
angle_of_niche_rotation = ClusterInput()
divisor_of_niche_ratio = ClusterInput()
polygon_sides = ClusterInput()
polygon_side = ClusterInput()
center_of_niche = ClusterInput()

perpendicular = GhPythonScript(line=polygon_side)  # -> Perp; inputs line: Line
# ---------- perpendicular: Python ----------
__author__ = "mericson"
__version__ = "2019.01.11"

import rhinoscriptsyntax as rs
import math
import Rhino as rh

if line == None:
    line = None
else:
    a = 0,0,0
    b = 0,0,1
    Z = rs.VectorCreate(a,b)
    c = rh.Geometry.Line.PointAt(line,1)
    d = rh.Geometry.Line.PointAt(line,0)
    vector2 = rs.VectorCreate(c,d)
    Perp = rs.VectorRotate(vector2,90,Z)
# ---------- end perpendicular ----------
length = Length(Curve=polygon_side)
construct_plane = ConstructPlane(Origin=center_of_niche, XAxis=polygon_side, YAxis=perpendicular)
division = Division(A=length, B=divisor_of_niche_ratio)
rotate = Rotate(Geometry=construct_plane, Angle=degrees(angle_of_niche_rotation), Plane=center_of_niche)  # -> Geometry, Transform
polygon = Polygon(Plane=rotate.Geometry, Radius=division, Segments=polygon_sides, FilletRadius=0)  # -> Polygon, Length

polygon_2 = ClusterOutput(polygon.Polygon)

# ==== cluster PointOnLine
point_value = ClusterInput()
curve = ClusterInput()
point_value_2 = Number(point_value)

# ---- group: point on curv
end_points = EndPoints(Curve=curve)  # -> Start, End
panel = Panel(point_value_2)
point = Point(end_points.Start)
point_2 = Point(end_points.End)
addition = Addition(A=point, B=point_2)
multiplication = Multiplication(A=addition, B=panel)

# ----
result = ClusterOutput(multiplication)

# ==== cluster NICHE
niche_prop = ClusterInput()
niche_rotation = ClusterInput()
point_value = ClusterInput()
polygon_side = ClusterInput()
niche_sides = ClusterInput()

niche_prop_2 = Number(niche_prop)
niche_sides_2 = Number(niche_sides)
niche_rotation_2 = Number(niche_rotation)
point_value_2 = Number(point_value)
polygon_side_2 = Line(polygon_side)
point_on = PointOn(line=polygon_side_2, number=point_value_2)
rotate = Rotate(Geometry=polygon_side_2, Angle=degrees("90"), Plane=point_on)  # -> Geometry, Transform
construct_plane = ConstructPlane(Origin=point_on, XAxis=polygon_side_2, YAxis=rotate.Geometry)
length = Length(Curve=polygon_side_2)
rotate_2 = Rotate(Geometry=construct_plane, Angle=degrees(niche_rotation_2), Plane=point_on)  # -> Geometry, Transform
division = Division(A=length, B=niche_prop_2)
polygon = Polygon(Plane=rotate_2.Geometry, Radius=division, Segments=niche_sides_2, FilletRadius=0)  # -> Polygon, Length
niche = Geometry(polygon.Polygon)

niche_2 = ClusterOutput(niche)

# ==== cluster PointOn
line = ClusterInput()
number = ClusterInput()

line_2 = Line(line)
number_2 = Number(number)
end_points = EndPoints(Curve=line_2)  # -> Start, End
addition = Addition(A=end_points.Start, B=end_points.End)
multiplication = Multiplication(A=addition, B=number_2)

result = ClusterOutput(multiplication)
