# Grasshopper definition SHEAR GROUP.gh (Grasshopper 1.0.7)

boolean = Boolean()
geometry = Geometry()
center_of_object_at_base = Point()
center_of_object_at_top = Point()
radius_of_base_circle = Number()
point = Point(center_of_object_at_top)
radius_of_base_circle_2 = Number(radius_of_base_circle)
shear_rotation = Number("180")
negative = Negative(Value=radius_of_base_circle_2)
unit_y = UnitY(Factor=negative)
rotate = Rotate(Geometry=unit_y, Angle=degrees(shear_rotation), Plane=PlaneXY(0, 0, 0))  # -> Geometry, Transform
move = Move(Geometry=point, Motion=rotate.Geometry)  # -> Geometry, Transform
center_of_roof_displaced = Point(move.Geometry)
center_of_roof_original = Point(point)
center_of_object = Point(center_of_object_at_base)
shear = Shear(Geometry=geometry, Base=center_of_object, Grip=center_of_roof_original, Target=center_of_roof_displaced)  # -> Geometry, Transform
xy_plane = XYPlane(Origin=center_of_object)
mirror = Mirror(Geometry=shear.Geometry, Plane=xy_plane)  # -> Geometry, Transform
stream_filter = StreamFilter(Gate=boolean, Stream0=geometry, Stream1=mirror.Geometry)
sheared_object = Geometry(stream_filter)
