# Grasshopper definition Room Cluster.gh (Grasshopper 1.0.7)

polygon_sides = Number()
niche_radius = Number()
point = Point()
radius = Number()
multiplication = Multiplication(A="10", B=".25")
polygon_sides_2 = Number(polygon_sides)
niche_radius_2 = Number(niche_radius)
point_2 = Point(point)
radius_2 = Number(radius)
circle = Circle(Plane=point_2, Radius=radius_2)
divide_curve = DivideCurve(Curve=circle, Count=polygon_sides_2, Kinks=False)  # -> Points, Tangents, Parameters
polyline = PolyLine(Vertices=divide_curve.Points, Closed=Toggle(True))
explode = Explode(Curve=polyline, Recursive=True)  # -> Segments, Vertices
circle_2 = Circle(Plane=explode.Vertices, Radius=niche_radius_2)
polygon = Geometry(polyline)
circles = Geometry(circle_2)
cluster = Cluster(point="0,0,0", radius="10", polygon_sides="5", niche_radius=multiplication)
region_union = RegionUnion(Curves=flatten([polygon, circles]))
plan = Geometry(region_union)
plan_2 = Geometry(plan)

# ==== cluster Cluster
polygon_sides = ClusterInput()
niche_radius = ClusterInput()
point = ClusterInput()
radius = ClusterInput()
polygon_sides_2 = Number(polygon_sides)
niche_radius_2 = Number(niche_radius)
point_2 = Point(point)
radius_2 = Number(radius)
circle = Circle(Plane=point_2, Radius=radius_2)
divide_curve = DivideCurve(Curve=circle, Count=polygon_sides_2, Kinks=False)  # -> Points, Tangents, Parameters
polyline = PolyLine(Vertices=divide_curve.Points, Closed=Toggle(True))
explode = Explode(Curve=polyline, Recursive=True)  # -> Segments, Vertices
circle_2 = Circle(Plane=explode.Vertices, Radius=niche_radius_2)
polygon = Geometry(polyline)
circles = Geometry(circle_2)
region_union = RegionUnion(Curves=flatten([polygon, circles]))
plan = Geometry(region_union)
plan_2 = ClusterOutput(plan)
