# Grasshopper definition Mock-up of massing model.gh (Grasshopper 1.0.7)

site = Panel("120")
panel = Panel("""10
15
20
20
15""")
# This cirlce is place holder for your part
centered_rectangle = GhPythonScript(width=site, height=site, centerX="0", centerY="0", centerZ="0")  # -> rectangle, center
# ---------- centered_rectangle: Python ----------
__author__ = "ericsonm"
__version__ = "2019.01.15"

import rhinoscriptsyntax as rs

if (width or height) == None:
    rectangle = None

else:

    x1 = float(width)
    y1 = float(height)
    xc = x1/-2 + float(centerX)
    yc = y1/-2 + float(centerY)
    center = rs.AddPoint(float(centerX),float(centerY),float(centerZ))

    rectangle = rs.AddRectangle((xc,yc,0),x1,y1)
# ---------- end centered_rectangle ----------
circle = Circle(Plane=centered_rectangle.center, Radius="30")
divide_curve = DivideCurve(Curve=circle, Count="5", Kinks=False)  # -> Points, Tangents, Parameters
radians = Radians(Degrees="90")
# This is a place holder for your smaller programs
circle_2 = Circle(Plane=divide_curve.Points, Radius=panel)
xz_plane = XZPlane(Origin=divide_curve.Points)
xz_plane_2 = XZPlane(Origin=circle)
arc = Arc(Plane=xz_plane_2, Radius="30", Angle=radians)  # -> Arc, Length
arc_2 = Arc(Plane=xz_plane, Radius=panel, Angle=radians)  # -> Arc, Length
unit_z = UnitZ(Factor=1)
unit_z_2 = UnitZ(Factor=1)
line_sdl = LineSDL(Start=arc.Arc, Direction=unit_z, Length=1)
line_sdl_2 = LineSDL(Start=arc_2.Arc, Direction=unit_z_2, Length=1)
rail_revolution = RailRevolution(Curve=arc.Arc, Rail=circle, Axis=line_sdl, Scale=False)
rail_revolution_2 = RailRevolution(Curve=arc_2.Arc, Rail=circle_2, Axis=line_sdl_2, Scale=False)
# One possibility is to move your programs up and subtract again to generat a second level
unit_z_3 = UnitZ(Factor="10")
cap_holes = CapHoles(Brep=rail_revolution)
cap_holes_2 = CapHoles(Brep=rail_revolution_2)
solid_union = SolidUnion(Breps=flatten([cap_holes, cap_holes_2]))
move = Move(Geometry=cap_holes_2, Motion=unit_z_3)  # -> Geometry, Transform
scale = Scale(Geometry=solid_union, Center=Point(0, 0, 0), Factor=".8")  # -> Geometry, Transform
scale_2 = Scale(Geometry=move.Geometry, Center=Point(0, 0, 0), Factor=".75")  # -> Geometry, Transform
solid_difference = SolidDifference(BrepsA=solid_union, BrepsB=scale.Geometry)
solid_difference_2 = SolidDifference(BrepsA=solid_difference, BrepsB=scale_2.Geometry)
