# Grasshopper definition Print Volume.gh (Grasshopper 1.0.7)

brep = Brep()
xz_plane = XZPlane(Origin=Point(0, 0, 0))
list_item = ListItem(List=brep, Index=0, Wrap=True)
brep_plane = BrepPlane(Brep=brep, Plane=xz_plane)  # -> Curves, Points
brep_2 = Brep(list_item)
cost_per_cubic_inch = Panel("5")
volume = Volume(Geometry=brep_2)  # -> Volume, Centroid
multiplication = Multiplication(A=volume.Volume, B=cost_per_cubic_inch)
panel = Panel(multiplication)
brep_to_bake = Geometry(brep_2)
section = Geometry(brep_plane.Curves)
