# Grasshopper definition point on line.gh (Grasshopper 1.0.7)

point_on_line = GhPythonScript()  # -> points
# ---------- point_on_line: Python ----------
__author__ = "ericsonm"
__version__ = "2019.10.18"

import rhinoscriptsyntax as rs
import Rhino as rh

if lines == None:
    pass
    
else:

    points = rh.Geometry.Line.PointAt(rs.coerceline(lines),float(value))
# ---------- end point_on_line ----------
