# Grasshopper definition room plan.gh (Grasshopper 1.0.7)

room_height_proportion = Number("1")
number = Number(".5")
number_2 = Number("2")
plane = Plane("0,0,0")
number_3 = Number("10")
number_4 = Number("8")
multiplication = Multiplication(A="10", B="1.5")
number_5 = Number("3")

# ---- group: plan
nichelocation = Number(number)
polygonsides = Number(number_4)
niche_filter = Number(number_2)
nicheradius = Number(number_5)
radius = Number(number_3)
plane_2 = Plane(plane)
polygon = Polygon(Plane=plane_2, Radius=radius, Segments=polygonsides, FilletRadius=0)  # -> Polygon, Length
polygon_2 = Polygon(Plane=plane_2, Radius=multiplication, Segments="7", FilletRadius=0)  # -> Polygon, Length
explode = Explode(Curve=polygon.Polygon, Recursive=True)  # -> Segments, Vertices
geometry = Geometry(polygon.Polygon)
point_on_line = GhPythonScript(lines=explode.Segments, value=nichelocation)  # -> points
# ---------- point_on_line: Python ----------
__author__ = "ericsonm"
__version__ = "2019.10.18"

import rhinoscriptsyntax as rs
import Rhino as rh

points = rh.Geometry.Line.PointAt(rs.coerceline(lines),float(value))
# ---------- end point_on_line ----------
partition_list = PartitionList(List=point_on_line, Size=niche_filter)
explode_2 = Explode(Curve=polygon_2.Polygon, Recursive=True)  # -> Segments, Vertices
list_item = ListItem(List=partition_list, Index=0, Wrap=True)
list_item_2 = ListItem(List=explode.Vertices, Index=0, Wrap=True)
list_item_3 = ListItem(List=explode_2.Vertices, Index=0, Wrap=True)
polygon_3 = Polygon(Plane=list_item, Radius=nicheradius, Segments=6, FilletRadius=0)  # -> Polygon, Length
line = Line(StartPoint=plane_2, EndPoint=list_item_2)
line_2 = Line(StartPoint=plane_2, EndPoint=list_item_3)
region_union = RegionUnion(Curves=flatten([geometry, polygon_3.Polygon]))
room_plan = Geometry(region_union)
outerwall = Geometry(polygon_2.Polygon)
outer_radius = Geometry(line_2)
inner_radius = Geometry(line)

# ----
room_height_proportion_2 = Number(room_height_proportion)

# ---- group: section
outer_radius_2 = Geometry(outer_radius)
room_plan_2 = Geometry(room_plan)
outerwall_2 = Geometry(outerwall)
inner_radius_2 = Geometry(inner_radius)
end_points = EndPoints(Curve=[inner_radius_2, outer_radius_2])  # -> Start, End
panel = Panel(room_height_proportion_2)
unit_z = UnitZ(Factor=1)
length = Length(Curve=inner_radius_2)
multiplication_2 = Multiplication(A=length, B=panel)
line_sdl = LineSDL(Start=end_points.End, Direction=unit_z, Length=multiplication_2)
move = Move(Geometry=end_points.Start, Motion=line_sdl)  # -> Geometry, Transform
line_3 = Line(line_sdl)
end_points_2 = EndPoints(Curve=line_3)  # -> Start, End
vector_2pt = Vector2Pt(PointA=move.Geometry, PointB=end_points_2.End, Unitize=False)  # -> Vector, Length
unit_z_2 = UnitZ(Factor=1)
construct_plane = ConstructPlane(Origin=move.Geometry, XAxis=vector_2pt.Vector, YAxis=unit_z_2)
arc = Arc(Plane=construct_plane, Radius=vector_2pt.Vector, Angle=Domain(0, 1.570796327))  # -> Arc, Length
join_curves = JoinCurves(Curves=[line_3, arc.Arc], Preserve=False)  # -> reverse(Curves)
center_of_dome = Geometry(move.Geometry)
section = Geometry(join_curves)

# ----
merge = Merge(Data1=outerwall_2, Data2=room_plan_2)

# ---- group: solid
section_2 = Geometry(section)
center_of_dome_2 = Geometry(center_of_dome)
unit_z_3 = UnitZ(Factor=1)
line_sdl_2 = LineSDL(Start=center_of_dome_2, Direction=unit_z_3, Length=1)
list_item_4 = ListItem(List=line_sdl_2, Index=0, Wrap=True)
rail_revolution = RailRevolution(Curve=section_2, Rail=flatten(merge), Axis=list_item_4, Scale=False)
cap_holes = CapHoles(Brep=rail_revolution)

# ----
volume = Volume(Geometry=cap_holes)  # -> Volume, Centroid
index_of_max = PythonScript(values=volume.Volume)  # -> IMin, IMax; inputs values: list
# ---------- index_of_max: Python ----------
q=[values]
for i in values:
    IMax=list.index(values,max(values))
    IMin=list.index(values,min(values))
# ---------- end index_of_max ----------

# ---- group: solid (continued)
list_item_5 = ListItem(List=flatten(cap_holes), Index=index_of_max.IMax, Wrap=True)
list_item_6 = ListItem(List=flatten(cap_holes), Index=index_of_max.IMin, Wrap=True)
solid_difference = SolidDifference(BrepsA=list_item_5, BrepsB=list_item_6)

# ----
room = Geometry(solid_difference)
