# Grasshopper definition 01_Example.gh (Grasshopper 1.0.7)
# plug-ins: Human, LunchBox

# Variables + Controls
panel = Panel("0,0,0")
room_height_proportion = Number("1")
number = Number(".5")
number_2 = Number("2")
# A
plane = Plane(panel)
number_3 = Number("50")
number_4 = Number("8")
multiplication = Multiplication(A="50", B="1.5")
number_5 = Number("4")

# ---- group: plan
nichelocation = Number(number)
polygonsides = Number(number_4)
niche_filter = Number(number_2)
nicheradius = Number(number_5)
radius = Number(number_3)
plane_2 = Plane(plane)
polygon = Polygon(Plane=plane_2, Radius=radius, Segments=polygonsides, FilletRadius=0)  # -> Polygon, Length
polygon_2 = Polygon(Plane=plane_2, Radius=multiplication, Segments="7", FilletRadius=0)  # -> Polygon, Length
explode = Explode(Curve=polygon.Polygon, Recursive=True)  # -> Segments, Vertices
# Operations
geometry = Geometry(polygon.Polygon)
point_on_line = GhPythonScript(lines=explode.Segments, value=nichelocation)  # -> points
# ---------- point_on_line: Python ----------
__author__ = "ericsonm"
__version__ = "2019.10.18"

import rhinoscriptsyntax as rs
import Rhino as rh

points = rh.Geometry.Line.PointAt(rs.coerceline(lines),float(value))
# ---------- end point_on_line ----------
partition_list = PartitionList(List=point_on_line, Size=niche_filter)
explode_2 = Explode(Curve=polygon_2.Polygon, Recursive=True)  # -> Segments, Vertices
list_item = ListItem(List=partition_list, Index=0, Wrap=True)
list_item_2 = ListItem(List=explode.Vertices, Index=0, Wrap=True)
list_item_3 = ListItem(List=explode_2.Vertices, Index=0, Wrap=True)
polygon_3 = Polygon(Plane=list_item, Radius=nicheradius, Segments=6, FilletRadius=0)  # -> Polygon, Length
line = Line(StartPoint=plane_2, EndPoint=list_item_2)
line_2 = Line(StartPoint=plane_2, EndPoint=list_item_3)
region_union = RegionUnion(Curves=flatten([geometry, polygon_3.Polygon]))
room_plan = Geometry(region_union)
outerwall = Geometry(polygon_2.Polygon)
outer_radius = Geometry(line_2)
inner_radius = Geometry(line)

# ----
room_height_proportion_2 = Number(room_height_proportion)

# ---- group: section
outer_radius_2 = Geometry(outer_radius)
room_plan_2 = Geometry(room_plan)
outerwall_2 = Geometry(outerwall)
inner_radius_2 = Geometry(inner_radius)
end_points = EndPoints(Curve=[inner_radius_2, outer_radius_2])  # -> Start, End
panel_2 = Panel(room_height_proportion_2)
unit_z = UnitZ(Factor=1)
length = Length(Curve=inner_radius_2)
multiplication_2 = Multiplication(A=length, B=panel_2)
line_sdl = LineSDL(Start=end_points.End, Direction=unit_z, Length=multiplication_2)
move = Move(Geometry=end_points.Start, Motion=line_sdl)  # -> Geometry, Transform
line_3 = Line(line_sdl)
end_points_2 = EndPoints(Curve=line_3)  # -> Start, End
vector_2pt = Vector2Pt(PointA=move.Geometry, PointB=end_points_2.End, Unitize=False)  # -> Vector, Length
unit_z_2 = UnitZ(Factor=1)
construct_plane = ConstructPlane(Origin=move.Geometry, XAxis=vector_2pt.Vector, YAxis=unit_z_2)
arc = Arc(Plane=construct_plane, Radius=vector_2pt.Vector, Angle=Domain(0, 1.570796327))  # -> Arc, Length
join_curves = JoinCurves(Curves=[line_3, arc.Arc], Preserve=False)  # -> reverse(Curves)
center_of_dome = Geometry(move.Geometry)
section = Geometry(join_curves)

# ----
merge = Merge(Data1=outerwall_2, Data2=room_plan_2)
inner_polygon = Geometry(polygon.Polygon)
point = Point(plane)
explode_3 = Explode(Curve=inner_polygon, Recursive=True)  # -> Segments, Vertices

# ---- group: cull last item
list_length = ListLength(List=explode_3.Vertices)
subtraction = Subtraction(A=list_length, B="1")
cull_index = CullIndex(List=explode_3.Vertices, Indices=subtraction, Wrap=True)

# ----
vector_2pt_2 = Vector2Pt(PointA=plane, PointB=cull_index, Unitize=False)  # -> Vector, Length
list_of_points_to_label = Point()

# ---- group: TEXT LABELS
text_size = Panel(".02")
point_2 = Point(list_of_points_to_label)
add_text = Panel("a")
list_length_2 = ListLength(List=point_2)
linear_gradient = GhPythonScript(R="0", G="0", B="0", Percent=".5")  # -> Color
# ---------- linear_gradient: Python ----------
__author__ = "ericsonm"
__version__ = "2019.01.15"

import rhinoscriptsyntax as rs

def LinearColorGradient(R,G,B,R2,G2,B2,ColorPercentage):
    
    if ColorPercentage > 1:
        R3 = None
        G3 = None
        B3 = None
    else:
        #This function defines linear color gradient by treating R,G,B as coordinates on a 3D line.
        #The base color that will be altered by the percentage should be entered in the second R2,G2,B2 valu
    
        Rdiff = float(R2) - float(R)
        Gdiff = float(G2) - float(G)
        Bdiff = float(B2) - float(B)


        t = float(ColorPercentage)


        R3 = float(R) + Rdiff*t
        G3 = float(G) + Gdiff*t
        B3 = float(B) + Bdiff*t



    return R3,G3,B3


if (R or G or B or Percent) is None:
    Color = None
else: 
    Color1 = LinearColorGradient(255,255,255,R,G,B,Percent)

    R3 = Color1[0]
    G3 = Color1[1]
    B3 = Color1[2]

    Color = rs.CreateColor(R3,G3,B3)
# ---------- end linear_gradient ----------
series = Series(Start=0, Step=1, Count=list_length_2)
integer = Integer(series)
concatenate = Concatenate(FragmentA=integer, FragmentB=add_text)
text_tag_3d = TextTag3D(Location=point_2, Text=concatenate, Size=text_size, Colour=linear_gradient, Justification=5)

# ---- group: solid
section_2 = Geometry(section)
center_of_dome_2 = Geometry(center_of_dome)
unit_z_3 = UnitZ(Factor=1)
line_sdl_2 = LineSDL(Start=center_of_dome_2, Direction=unit_z_3, Length=1)
list_item_4 = ListItem(List=line_sdl_2, Index=0, Wrap=True)
rail_revolution = RailRevolution(Curve=section_2, Rail=flatten(merge), Axis=list_item_4, Scale=False)
cap_holes = CapHoles(Brep=rail_revolution)

# ----
volume = Volume(Geometry=cap_holes)  # -> Volume, Centroid
index_of_max = PythonScript(values=volume.Volume)  # -> IMin, IMax; inputs values: list
# ---------- index_of_max: Python ----------
q=[values]
for i in values:
    IMax=list.index(values,max(values))
    IMin=list.index(values,min(values))
# ---------- end index_of_max ----------

# ---- group: solid (continued)
list_item_5 = ListItem(List=flatten(cap_holes), Index=index_of_max.IMin, Wrap=True)
list_item_6 = ListItem(List=flatten(cap_holes), Index=index_of_max.IMax, Wrap=True)
solid_difference = SolidDifference(BrepsA=list_item_6, BrepsB=list_item_5)

# ----
outer_building = Geometry(solid_difference)
scale = Scale(Geometry=outer_building, Center=point, Factor=".4")  # -> Geometry, Transform
move_2 = Move(Geometry=scale.Geometry, Motion=vector_2pt_2.Vector)  # -> Geometry, Transform
inner_buildings = Geometry(move_2.Geometry)
# B
# Output Geometry
solid_difference_2 = SolidDifference(BrepsA=outer_building, BrepsB=inner_buildings)
solid_union = SolidUnion(Breps=[inner_buildings, outer_building])
scale_2 = Scale(Geometry=solid_union, Center=Point(0, 0, 0), Factor=".8")  # -> Geometry, Transform
# C
# Views
solid_difference_3 = SolidDifference(BrepsA=solid_union, BrepsB=flatten(solid_difference_2))
# D
# E
# F
# Line Type
# Layers
geometry_2 = Geometry(solid_difference_3)

# ---- group: Preview and Bake
# Preview and Bake
button = Button()
get_name = GhPythonScript(Component=geometry_2)  # -> Geometry, Name
# ---------- get_name: Python ----------
# Mark Ericson 1.17.19
   #take from forum discussion thread https://www.grasshopper3d.com/forum/topics/python-get-label-name-of-input-components
    #edited version of code  by Mostapha Sadeghipour Roudsari

def GetComponentName():
    Comp = ghenv.Component.Params.Input[0]
    sources = Comp.Sources

    if sources.Count == 0: 
        return components

    for source in sources:
        attr = source.Attributes
        if (attr is None) or (attr.GetTopLevel is None):
            pass
        else:

            component = attr.GetTopLevel.DocObject
            componentName = component.NickName

            return componentName

if Component == None:
    pass
else:
    Name = GetComponentName()
    Geometry = Component
# ---------- end get_name ----------
linear_gradient_2 = GhPythonScript(R="0", G="0", B="0", Percent=".5")  # -> Color; same code as linear_gradient
custom_preview = CustomPreview(Geometry=get_name.Geometry, Material=linear_gradient_2)

# ----
panel_3 = Panel(get_name.Name)

# ---- group: Preview and Bake (continued)
object_bake = ObjectBake(
    BakeToggle=button,
    GeometryObjects=get_name.Geometry,
    Layer=panel_3,
    ObjectName=panel_3,
    ObjectColor=linear_gradient_2,
    LayerColor=linear_gradient_2)

# ----
custom_preview_lineweights = CustomPreviewLineweights(Geometry=get_name.Geometry, Shader=linear_gradient_2, Thickness=".0025", Absolute=Toggle(True))
