# Grasshopper definition 01_Ericson_1_4b_with views.gh (Grasshopper 1.0.7)
# plug-ins: Human, LunchBox

angle_of_niche_rotation = Panel("""0
30
10
45""")
niche_proportion_divisor = Panel("""4
2
2
4
1""")
polygon_a_sides = Panel("5")
wall_scalar = Panel("1.4")
# Variables + Controls
drawing_cetner = Panel("0,0,0")
circle_a_radius = Panel("60")
start = Panel("0")
exterior_wall_subdivision = Panel("2")
exterior_wall_rotation = Panel("0")
interior_wall_options = Panel("2")
interior_wall_subdivision = Panel("2")
interior_wall_rotation = Panel("2")
total_degrees = Panel("360")
division = Panel("10")
niche_sides = Panel("""5
4
4
4""")
division_2 = Division(A=total_degrees, B=division)
division_3 = Division(A=division, B=polygon_a_sides)
drawing_center = Plane(drawing_cetner)
division_4 = Division(A=circle_a_radius, B=wall_scalar)
series = Series(Start=start, Step=division_2, Count=division_3)
radians = Radians(Degrees=series)
rotate_plane = RotatePlane(Plane=drawing_center, Angle=radians)
circle = Circle(Plane=rotate_plane, Radius=division_4)
list_item = ListItem(List=circle, Index=0, Wrap=True)
# A
divide_curve = DivideCurve(Curve=circle, Count=polygon_a_sides, Kinks=False)  # -> Points, Tangents, Parameters
polyline = PolyLine(Vertices=divide_curve.Points, Closed=Toggle(True))
# Operations
list_length = ListLength(List=flatten(divide_curve.Points))
number_of_points_on_inner_circle = Number(list_length)
scale = Scale(Geometry=list_item, Center=drawing_center, Factor=wall_scalar)  # -> Geometry, Transform
line = Line(StartPoint=drawing_center, EndPoint=divide_curve.Points)
divide_curve_2 = DivideCurve(Curve=scale.Geometry, Count=number_of_points_on_inner_circle, Kinks=False)  # -> Points, Tangents, Parameters
divide_curve_3 = DivideCurve(Curve=list_item, Count=number_of_points_on_inner_circle, Kinks=False)  # -> Points, Tangents, Parameters

# ---- group: dome
list_item_2 = ListItem(List=polyline, Index=0, Wrap=True)
explode = Explode(Curve=list_item_2, Recursive=True)  # -> Segments, Vertices
list_item_3 = ListItem(List=explode.Segments, Index=0, Wrap=True)
point_on_curve = PointOnCurve(list_item_3, parameter=0.5)
distance = Distance(PointA=point_on_curve, PointB=drawing_center)
circle_2 = Circle(Plane=drawing_center, Radius=distance)

# ----
list_of_points_on_circle = Point(divide_curve_2.Points)
list_of_points_on_circle_2 = Point(divide_curve_3.Points)

# ---- group: wall
partition_list = PartitionList(List=list_of_points_on_circle, Size=exterior_wall_subdivision)
panel = Panel(exterior_wall_rotation)
list_item_4 = ListItem(List=partition_list, Index=panel, Wrap=True)  # -> flatten(Item)
polyline_2 = PolyLine(Vertices=list_item_4, Closed=Toggle(True))

# ---- group: interior wall b
partition_list_2 = PartitionList(List=list_of_points_on_circle_2, Size=interior_wall_subdivision)
panel_2 = Panel(interior_wall_rotation)
list_item_5 = ListItem(List=partition_list_2, Index=panel_2, Wrap=True)  # -> flatten(Item)
polyline_3 = PolyLine(Vertices=list_item_5, Closed=Toggle(True))

# ----
deconstruct_arc = DeconstructArc(Arc=list_item)  # -> BasePlane, Radius, Angle

list_item_6 = ListItem(List=list_of_points_on_circle, Index=0, Wrap=True)
list_item_7 = ListItem(List=flatten(list_item), Index=0, Wrap=True)
line_2 = Line(StartPoint=list_item_7, EndPoint=list_item_6)
line_3 = Line(line_2)

list_item_8 = ListItem(List=circle, Index=0, Wrap=True)
list_item_9 = ListItem(List=flatten(divide_curve.Points), Index=0, Wrap=True)
line_4 = Line(StartPoint=list_item_8, EndPoint=list_item_9)
line_5 = Line(line_4)

wall_polyline = Geometry(polyline_3)

# ---- group: niche
explode_2 = Explode(Curve=wall_polyline, Recursive=True)  # -> Segments, Vertices
point_on_line = PointOnLine(curve=explode_2.Segments, point_value=".5")
niche = Niche(
    polygon_sides=niche_sides,
    divisor_of_niche_ratio=niche_proportion_divisor,
    angle_of_niche_rotation=angle_of_niche_rotation,
    polygon_side=explode_2.Segments,
    center_of_niche=point_on_line)

# ----
wall_polyline_2 = Geometry(polyline_2)
region_union = RegionUnion(Curves=flatten([wall_polyline, niche]))
exterior_wall = Curve(wall_polyline_2)
stream_filter = StreamFilter(Gate=interior_wall_options, Stream0=list_item, Stream1=wall_polyline, Stream2=region_union)
region_difference = RegionDifference(CurvesA=exterior_wall, CurvesB=stream_filter)
center_of_drawing = Point(drawing_center)
section_line_inner = Line(line_5)
section_line_outer = Line(line_3)
interior_rail = Geometry(stream_filter)
geometry = Geometry(exterior_wall)

# ---- group: section interior
line_6 = Line(section_line_inner)
end_points = EndPoints(Curve=line_6)  # -> Start, End
cluster = Cluster(eccentricity="1", center_value=".5", line=line_6, height_factor=".5", arc_degrees="60")
section = Geometry(cluster)
end_points_2 = EndPoints(Curve=section)  # -> Start, End
perpendicular = GhPythonScript(line=line_6)  # -> Perp; inputs line: Line; same code as perpendicular
project_point = ProjectPoint(Point=end_points_2.End, Direction=perpendicular, Geometry=line_6)  # -> Point, Index
vector_2pt = Vector2Pt(PointA=project_point.Point, PointB=end_points_2.End, Unitize=False)  # -> Vector, Length
line_7 = Line(StartPoint=end_points.Start, EndPoint=project_point.Point)
cluster_2 = Cluster(eccentricity=".5", center_value="0", line=line_7, height_factor=".5", arc_degrees="90")
move = Move(Geometry=cluster_2, Motion=vector_2pt.Vector)  # -> Geometry, Transform
join_curves = JoinCurves(Curves=flatten([cluster, move.Geometry]), Preserve=False)

# ---- group: section exterior
line_8 = Line(section_line_outer)
end_points_3 = EndPoints(Curve=line_8)  # -> Start, End
cluster_3 = Cluster(eccentricity="2", center_value=".5", line=line_8, height_factor=".5", arc_degrees="60")
section_2 = Geometry(cluster_3)
end_points_4 = EndPoints(Curve=section_2)  # -> Start, End
perpendicular_2 = GhPythonScript(line=line_8)  # -> Perp; inputs line: Line; same code as perpendicular
project_point_2 = ProjectPoint(Point=end_points_4.End, Direction=perpendicular_2, Geometry=line_8)  # -> Point, Index
vector_2pt_2 = Vector2Pt(PointA=project_point_2.Point, PointB=end_points_4.End, Unitize=False)  # -> Vector, Length
line_9 = Line(StartPoint=end_points_3.Start, EndPoint=project_point_2.Point)
cluster_4 = Cluster(eccentricity="-.2", center_value="0", line=line_9, height_factor=".5", arc_degrees="90")
move_2 = Move(Geometry=cluster_4, Motion=vector_2pt_2.Vector)  # -> Geometry, Transform
join_curves_2 = JoinCurves(Curves=flatten([cluster_3, move_2.Geometry]), Preserve=False)
section_3 = Geometry(join_curves_2)

# ----
section_4 = Geometry(join_curves)

# ---- group: rail revolve
section_5 = Geometry(section_3)
rail = Geometry(geometry)
point = Point(center_of_drawing)
line_10 = Line(line_8)
point_on_curve_2 = PointOnCurve(line_10, parameter=0.5)
rotate_3d = Rotate3D(Geometry=section_5, Angle=degrees("90"), Center=point_on_curve_2, Axis=line_10)  # -> Geometry, Transform
unit_z = UnitZ(Factor=1)
line_sdl = LineSDL(Start=point, Direction=unit_z, Length=1)
point_on_curve_3 = PointOnCurve(rotate_3d.Geometry, parameter=1)
rail_revolution = RailRevolution(Curve=rotate_3d.Geometry, Rail=rail, Axis=line_sdl, Scale=False)

section_6 = Geometry(section_4)
line_11 = Line(section_line_inner)
rail_2 = Geometry(interior_rail)
point_2 = Point(drawing_center)
point_on_curve_4 = PointOnCurve(line_11, parameter=0.5)
rotate_3d_2 = Rotate3D(Geometry=section_6, Angle=degrees("90"), Center=point_on_curve_4, Axis=line_11)  # -> Geometry, Transform
unit_z_2 = UnitZ(Factor=1)
line_sdl_2 = LineSDL(Start=point_2, Direction=unit_z_2, Length=1)
# B
# Output Geometry
rail_revolution_2 = RailRevolution(Curve=rotate_3d_2.Geometry, Rail=rail_2, Axis=line_sdl_2, Scale=False)

# ----
brep = Brep(rail_revolution_2)
brep_2 = Brep(rail_revolution)
cap_holes = CapHoles(Brep=brep)
cap_holes_2 = CapHoles(Brep=brep_2)
solid_difference = SolidDifference(BrepsA=cap_holes_2, BrepsB=cap_holes)
unit_z_3 = UnitZ(Factor=1)
contour = Contour(Shape=solid_difference, Point=Point(0, 0, 0), Direction=unit_z_3, Distance="4")
merge = Merge(Data1=solid_difference, Data2=contour)

center_of_object_at_top = Point(point_on_curve_3)
center_of_object_at_base = Point(center_of_drawing)
radius_of_base_circle = Number(deconstruct_arc.Radius)
geometry_2 = Geometry(merge)
# C
# Views
boolean = Boolean(Toggle(True))
radius_of_base_circle_2 = Number(radius_of_base_circle)
point_3 = Point(center_of_object_at_top)
shear_rotation = Number("180")
negative = Negative(Value=radius_of_base_circle_2)
unit_y = UnitY(Factor=negative)
rotate = Rotate(Geometry=unit_y, Angle=degrees(shear_rotation), Plane=PlaneXY(0, 0, 0))  # -> Geometry, Transform
move_3 = Move(Geometry=point_3, Motion=rotate.Geometry)  # -> Geometry, Transform
center_of_roof_displaced = Point(move_3.Geometry)
center_of_roof_original = Point(point_3)
center_of_object = Point(center_of_object_at_base)
shear = Shear(Geometry=geometry_2, Base=center_of_object, Grip=center_of_roof_original, Target=center_of_roof_displaced)  # -> Geometry, Transform
xy_plane = XYPlane(Origin=center_of_object)
mirror = Mirror(Geometry=shear.Geometry, Plane=xy_plane)  # -> Geometry, Transform
stream_filter_2 = StreamFilter(Gate=boolean, Stream0=geometry_2, Stream1=mirror.Geometry)
sheared_object = Geometry(stream_filter_2)

unsheared_model = Geometry(cap_holes)
unsheared_model_2 = Geometry(solid_difference)
boolean_toggle = BooleanToggle(True)

# ---- group: Plan Section Group
unsheared_model_3 = Geometry(unsheared_model_2)
xy_plane_2 = XYPlane(Origin=Point(0, 0, 0))
cutting_surface = Geometry(xy_plane_2)
level_2_cut_height = Panel("30")
level_3_cut_height = Panel("60")
level_1_cut_height = Panel("3")
multiplication = Multiplication(A=level_2_cut_height, B="1")
multiplication_2 = Multiplication(A="1", B=level_3_cut_height)
multiplication_3 = Multiplication(A=level_1_cut_height, B="1")
unit_z_4 = UnitZ(Factor=multiplication_3)
unit_z_5 = UnitZ(Factor=multiplication)
unit_z_6 = UnitZ(Factor=multiplication_2)
move_4 = Move(Geometry=cutting_surface, Motion=unit_z_4)  # -> Geometry, Transform
move_5 = Move(Geometry=cutting_surface, Motion=unit_z_6)  # -> Geometry, Transform
move_6 = Move(Geometry=cutting_surface, Motion=unit_z_5)  # -> Geometry, Transform
xz_plane = XZPlane(Origin=Point(0, 0, 0))
level_3_cutter = Geometry(move_5.Geometry)
level_1_cutter = Geometry(move_4.Geometry)
level_2_cutter = Geometry(move_6.Geometry)
unit_x = UnitX(Factor=1)
brep_plane = BrepPlane(Brep=unsheared_model_3, Plane=level_1_cutter)  # -> Curves, Points
brep_plane_2 = BrepPlane(Brep=unsheared_model_3, Plane=level_2_cutter)  # -> Curves, Points
brep_plane_3 = BrepPlane(Brep=unsheared_model_3, Plane=level_3_cutter)  # -> Curves, Points
brep_plane_4 = BrepPlane(Brep=unsheared_model_3, Plane=xz_plane)  # -> Curves, Points
line_sdl_3 = LineSDL(Start=xz_plane, Direction=unit_x, Length=1)
panel_3 = Panel("-90")
geometry_3 = Geometry(brep_plane.Curves)
geometry_4 = Geometry(brep_plane_2.Curves)
geometry_5 = Geometry(brep_plane_4.Curves)
geometry_6 = Geometry(brep_plane_3.Curves)
rotate_3d_3 = Rotate3D(Geometry=geometry_5, Angle=degrees(panel_3), Center=Point(0, 0, 0), Axis=line_sdl_3)  # -> Geometry, Transform
offset_of_pages = Panel("500")
multiplication_4 = Multiplication(A=offset_of_pages, B="2")
multiplication_5 = Multiplication(A=offset_of_pages, B="4")
multiplication_6 = Multiplication(A=offset_of_pages, B="3")
unit_x_2 = UnitX(Factor=offset_of_pages)
unit_x_3 = UnitX(Factor=multiplication_4)
unit_x_4 = UnitX(Factor=multiplication_6)
unit_x_5 = UnitX(Factor=multiplication_5)
move_7 = Move(Geometry=geometry_3, Motion=unit_x_2)  # -> Geometry, Transform
move_8 = Move(Geometry=geometry_4, Motion=unit_x_3)  # -> Geometry, Transform
move_9 = Move(Geometry=geometry_6, Motion=unit_x_4)  # -> Geometry, Transform
move_10 = Move(Geometry=rotate_3d_3.Geometry, Motion=unit_x_5)  # -> Geometry, Transform
center_point_of_plan_03 = Point(unit_x_4)
center_point_of_plan_01 = Point(unit_x_2)
center_point_fo_plan_02 = Point(unit_x_3)
center_of_section = Point(unit_x_5)
level_2_plan = Geometry(move_8.Geometry)
level_3_plan = Geometry(move_9.Geometry)
level_1_plan = Geometry(move_7.Geometry)
section_7 = Geometry(move_10.Geometry)

# ---- group: Plan and Section Contour
relay = Relay()
inner_surface = Geometry(unsheared_model)
outer_surface = Geometry(unsheared_model_2)
stream_filter_3 = StreamFilter(Gate=boolean_toggle, Stream1=outer_surface)
stream_filter_4 = StreamFilter(Gate=boolean_toggle, Stream1=inner_surface)
bounding_box = BoundingBox(Content=stream_filter_3, Plane=PlaneXY(0, 0, 0))  # -> Box, Box_2
unit_y_2 = UnitY(Factor="-60")
move_11 = Move(Geometry=bounding_box.Box, Motion=unit_z_4)  # -> Geometry, Transform
move_12 = Move(Geometry=bounding_box.Box, Motion=unit_z_5)  # -> Geometry, Transform
move_13 = Move(Geometry=bounding_box.Box, Motion=unit_z_6)  # -> Geometry, Transform
move_14 = Move(Geometry=bounding_box.Box, Motion=unit_y_2)  # -> Geometry, Transform
solid_difference_2 = SolidDifference(BrepsA=stream_filter_3, BrepsB=move_11.Geometry)
solid_difference_3 = SolidDifference(BrepsA=stream_filter_3, BrepsB=move_12.Geometry)
solid_difference_4 = SolidDifference(BrepsA=stream_filter_3, BrepsB=move_13.Geometry)
solid_difference_5 = SolidDifference(BrepsA=stream_filter_4, BrepsB=move_14.Geometry)
rotate_3d_4 = Rotate3D(Geometry=solid_difference_5, Angle=degrees(panel_3), Center=Point(0, 0, 0), Axis=line_sdl_3)  # -> Geometry, Transform
move_15 = Move(Geometry=solid_difference_2, Motion=unit_x_2)  # -> Geometry, Transform
move_16 = Move(Geometry=solid_difference_3, Motion=unit_x_3)  # -> Geometry, Transform
move_17 = Move(Geometry=solid_difference_4, Motion=unit_x_4)  # -> Geometry, Transform
move_18 = Move(Geometry=rotate_3d_4.Geometry, Motion=unit_x_5)  # -> Geometry, Transform
geometry_7 = Geometry(move_15.Geometry)
geometry_8 = Geometry(move_16.Geometry)
geometry_9 = Geometry(move_17.Geometry)
geometry_10 = Geometry(move_18.Geometry)
unit_z_7 = UnitZ(Factor=1)
contour_2 = Contour(Shape=[geometry_7, geometry_8, geometry_9, geometry_10], Point=Point(0, 0, 0), Direction=unit_z_7, Distance="1")
plan_and_section_contours = Geometry(contour_2)

# ----
dome_above = Geometry(circle_2)
xy_plane_3 = XYPlane(Origin=Point(0, 0, 0))
brep_plane_5 = BrepPlane(Brep=solid_difference, Plane=xy_plane_3)  # -> Curves, Points
move_19 = Move(Geometry=brep_plane_5.Curves, Motion=unit_x_5)  # -> Geometry, Transform
centers = Relay([center_point_of_plan_01, center_point_fo_plan_02, center_point_of_plan_03, center_of_section])

# ---- group: sheet
sheet_size = Panel("11.7")
feet_per_inch = Panel("20")
sheet_size_2 = Panel("8")
multiplication_7 = Multiplication(A=feet_per_inch, B=sheet_size)
multiplication_8 = Multiplication(A=feet_per_inch, B=sheet_size_2)
centered_rectangle = GhPythonScript(width=multiplication_8, height=multiplication_7, point=centers)  # -> rectangle, center
# ---------- centered_rectangle: Python ----------
__author__ = "ericsonm"
__version__ = "2019.01.15"

import rhinoscriptsyntax as rs
import Rhino as rh

if (width or height) == None:
    rectangle = None

else:
    point1 = rs.coerce3dpoint(point)
    centerX = rh.Geometry.Point3d.X.GetValue(point1)
    centerY = rh.Geometry.Point3d.Y.GetValue(point1)
    centerZ = rh.Geometry.Point3d.Z.GetValue(point1)
    x1 = float(width)
    y1 = float(height)
    xc = x1/-2 + float(centerX)
    yc = y1/-2 + float(centerY)
    center = rs.AddPoint(float(centerX),float(centerY),float(centerZ))

    rectangle = rs.AddRectangle((xc,yc,0),x1,y1)
# ---------- end centered_rectangle ----------

# ----
bounding_box_2 = BoundingBox(Content=move_10.Geometry, Plane=PlaneXY(0, 0, 0))  # -> Box, Box_2
trim_with_brep = TrimWithBrep(Curve=move_19.Geometry, Brep=bounding_box_2.Box)  # -> Inside, flatten(Outside)
relay_2 = Relay([level_1_plan, level_2_plan, level_3_plan, section_7])

# ---- group: Hatch Group
boundary_surfaces = BoundarySurfaces(Edges=relay_2)
vector_at_angle = PythonScript(angle="45")  # -> vector
# ---------- vector_at_angle: Python ----------
import rhinoscriptsyntax as rs
import math
if angle == None:
    Vector = None
else:
    c=rs.AddPoint(0,0,0)
    f=math.radians(float(angle))
    l=rs.AddPoint(math.cos(f),math.sin(f),0)
    d=rs.VectorCreate(l,c)
    vector =rs.VectorUnitize(d)
# ---------- end vector_at_angle ----------
contour_3 = Contour(Shape=boundary_surfaces, Point=Point(0, 0, 0), Direction=vector_at_angle, Distance=".76")

# ----
footprint = Geometry(trim_with_brep.Outside)
vector_2pt_3 = Vector2Pt(PointA=xy_plane_2, PointB=centers, Unitize=False)  # -> Vector, Length
group = Group(Objects=[circle, line, polyline])
geometry_11 = Geometry(contour_3)
# D
center_lines = Line(line)
move_20 = Move(Geometry=group, Motion=vector_2pt_3.Vector)  # -> Geometry, Transform
panel_4 = Panel("""1
.5
.5
.5""")
panel_5 = Panel("""1
.5""")
# Line Type
dash_pattern = DashPattern(Curve=center_lines, Pattern=panel_4)  # -> Dashes, Gaps
dash_pattern_2 = DashPattern(Curve=dome_above, Pattern=panel_5)  # -> Dashes, Gaps
stream_filter_5 = StreamFilter(Gate=Toggle(True), Stream1=brep_plane_5.Curves)
brep_3 = Brep(stream_filter_5)

# ---- group: Hatch Group
boundary_surfaces_2 = BoundarySurfaces(Edges=brep_3)
vector_at_angle_2 = PythonScript(angle="45")  # -> vector; same code as vector_at_angle
contour_4 = Contour(Shape=boundary_surfaces_2, Point=Point(0, 0, 0), Direction=vector_at_angle_2, Distance=".76")

# ----
dome_above_2 = Geometry(dash_pattern_2.Dashes)
centerlines_a = Geometry(dash_pattern.Dashes)
hatch_lines = Geometry(contour_4)
point_4 = Point(flatten(divide_curve.Points))
# E
# F
# Layers
circle_a = Geometry(circle)
point_5 = Point(drawing_center)
geometry_12 = Geometry(brep_plane_5.Curves)
curve = Curve(sheared_object)
polygon = Geometry(polyline)

# ---- group: Preview and Bake
# Preview and Bake
button = Button()
get_name = GhPythonScript(Component=circle_a)  # -> Geometry, Name
# ---------- get_name: Python ----------
# Mark Ericson 1.17.19
   #take from forum discussion thread https://www.grasshopper3d.com/forum/topics/python-get-label-name-of-input-components
    #edited version of code  by Mostapha Sadeghipour Roudsari

def GetComponentName():
    Comp = ghenv.Component.Params.Input[0]
    sources = Comp.Sources

    if sources.Count == 0: 
        return components

    for source in sources:
        attr = source.Attributes
        if (attr is None) or (attr.GetTopLevel is None):
            pass
        else:

            component = attr.GetTopLevel.DocObject
            componentName = component.NickName

            return componentName

if Component == None:
    pass
else:
    Name = GetComponentName()
    Geometry = Component
# ---------- end get_name ----------
linear_gradient = GhPythonScript(R="0", G="0", B="0", Percent=".5")  # -> Color
# ---------- linear_gradient: Python ----------
__author__ = "ericsonm"
__version__ = "2019.01.15"

import rhinoscriptsyntax as rs

def LinearColorGradient(R,G,B,R2,G2,B2,ColorPercentage):
    
    if ColorPercentage > 1:
        R3 = None
        G3 = None
        B3 = None
    else:
        #This function defines linear color gradient by treating R,G,B as coordinates on a 3D line.
        #The base color that will be altered by the percentage should be entered in the second R2,G2,B2 valu
    
        Rdiff = float(R2) - float(R)
        Gdiff = float(G2) - float(G)
        Bdiff = float(B2) - float(B)


        t = float(ColorPercentage)


        R3 = float(R) + Rdiff*t
        G3 = float(G) + Gdiff*t
        B3 = float(B) + Bdiff*t



    return R3,G3,B3


if (R or G or B or Percent) is None:
    Color = None
else: 
    Color1 = LinearColorGradient(255,255,255,R,G,B,Percent)

    R3 = Color1[0]
    G3 = Color1[1]
    B3 = Color1[2]

    Color = rs.CreateColor(R3,G3,B3)
# ---------- end linear_gradient ----------
custom_preview = CustomPreview(Geometry=get_name.Geometry, Material=linear_gradient)

# ----
panel_6 = Panel(get_name.Name)

# ---- group: Preview and Bake (continued)
object_bake = ObjectBake(
    BakeToggle=button,
    GeometryObjects=get_name.Geometry,
    Layer=panel_6,
    ObjectName=panel_6,
    ObjectColor=linear_gradient,
    LayerColor=linear_gradient)

# ----
custom_preview_lineweights = CustomPreviewLineweights(Geometry=get_name.Geometry, Shader=linear_gradient, Thickness=".0025", Absolute=Toggle(True))

# ---- group: Preview and Bake
get_name_2 = GhPythonScript(Component=polygon)  # -> Geometry, Name; same code as get_name
linear_gradient_2 = GhPythonScript(R="0", G="0", B="0", Percent=".4")  # -> Color; same code as linear_gradient
custom_preview_2 = CustomPreview(Geometry=get_name_2.Geometry, Material=linear_gradient_2)

# ----
panel_7 = Panel(get_name_2.Name)

# ---- group: Preview and Bake (continued)
object_bake_2 = ObjectBake(
    BakeToggle=Button(),
    GeometryObjects=get_name_2.Geometry,
    Layer=panel_7,
    ObjectName=panel_7,
    ObjectColor=linear_gradient_2,
    LayerColor=linear_gradient_2)

# ----
custom_preview_lineweights_2 = CustomPreviewLineweights(Geometry=get_name_2.Geometry, Shader=linear_gradient_2, Thickness=".0025", Absolute=Toggle(True))

# ---- group: Preview and Bake
get_name_3 = GhPythonScript(Component=centerlines_a)  # -> Geometry, Name; same code as get_name
button_2 = Button()
linear_gradient_3 = GhPythonScript(R="0", G="0", B="0", Percent="1")  # -> Color; same code as linear_gradient
custom_preview_3 = CustomPreview(Geometry=get_name_3.Geometry, Material=linear_gradient_3)

# ----
panel_8 = Panel(get_name_3.Name)

# ---- group: Preview and Bake (continued)
object_bake_3 = ObjectBake(
    BakeToggle=button_2,
    GeometryObjects=get_name_3.Geometry,
    Layer=panel_8,
    ObjectName=panel_8,
    ObjectColor=linear_gradient_3,
    LayerColor=linear_gradient_3)

# ----
custom_preview_lineweights_3 = CustomPreviewLineweights(Geometry=get_name_3.Geometry, Shader=linear_gradient_3, Thickness=".0025", Absolute=Toggle(True))

# ---- group: Preview and Bake
get_name_4 = GhPythonScript(Component=sheared_object)  # -> Geometry, Name; same code as get_name
linear_gradient_4 = GhPythonScript(R="0", G="0", B="0", Percent=".4")  # -> Color; same code as linear_gradient
custom_preview_4 = CustomPreview(Geometry=get_name_4.Geometry, Material=linear_gradient_4)

# ----
panel_9 = Panel(get_name_4.Name)

# ---- group: Preview and Bake (continued)
object_bake_4 = ObjectBake(
    BakeToggle=button_2,
    GeometryObjects=get_name_4.Geometry,
    Layer=panel_9,
    ObjectName=panel_9,
    ObjectColor=linear_gradient_4,
    LayerColor=linear_gradient_4)

# ----
custom_preview_lineweights_4 = CustomPreviewLineweights(Geometry=get_name_4.Geometry, Shader=linear_gradient_4, Thickness=".0025", Absolute=Toggle(True))

# ---- group: Preview and Bake
get_name_5 = GhPythonScript(Component=curve)  # -> Geometry, Name; same code as get_name
linear_gradient_5 = GhPythonScript(R="0", G="0", B="0", Percent="0")  # -> Color; same code as linear_gradient
custom_preview_5 = CustomPreview(Geometry=get_name_5.Geometry, Material=linear_gradient_5)

# ----
panel_10 = Panel(get_name_5.Name)

# ---- group: Preview and Bake (continued)
object_bake_5 = ObjectBake(
    BakeToggle=button_2,
    GeometryObjects=get_name_5.Geometry,
    Layer=panel_10,
    ObjectName=panel_10,
    ObjectColor=linear_gradient_5,
    LayerColor=linear_gradient_5)

# ----
custom_preview_lineweights_5 = CustomPreviewLineweights(Geometry=get_name_5.Geometry, Shader=linear_gradient_5, Thickness=".0025", Absolute=Toggle(True))

# ---- group: Preview and Bake
get_name_6 = GhPythonScript(Component=dome_above_2)  # -> Geometry, Name; same code as get_name
linear_gradient_6 = GhPythonScript(R="0", G="0", B="0", Percent="1")  # -> Color; same code as linear_gradient
custom_preview_6 = CustomPreview(Geometry=get_name_6.Geometry, Material=linear_gradient_6)

# ----
panel_11 = Panel(get_name_6.Name)

# ---- group: Preview and Bake (continued)
object_bake_6 = ObjectBake(
    BakeToggle=Button(),
    GeometryObjects=get_name_6.Geometry,
    Layer=panel_11,
    ObjectName=panel_11,
    ObjectColor=linear_gradient_6,
    LayerColor=linear_gradient_6)

# ----
custom_preview_lineweights_6 = CustomPreviewLineweights(Geometry=get_name_6.Geometry, Shader=linear_gradient_6, Thickness=".1", Absolute=Toggle(True))

# ---- group: Preview and Bake
get_name_7 = GhPythonScript(Component=[hatch_lines, geometry_11])  # -> Geometry, Name; same code as get_name
linear_gradient_7 = GhPythonScript(R="0", G="0", B="0", Percent=".4")  # -> Color; same code as linear_gradient
custom_preview_7 = CustomPreview(Geometry=get_name_7.Geometry, Material=linear_gradient_7)

# ----
panel_12 = Panel(get_name_7.Name)

# ---- group: Preview and Bake (continued)
object_bake_7 = ObjectBake(
    BakeToggle=Button(),
    GeometryObjects=get_name_7.Geometry,
    Layer=panel_12,
    ObjectName=panel_12,
    ObjectColor=linear_gradient_7,
    LayerColor=linear_gradient_7)

# ----
custom_preview_lineweights_7 = CustomPreviewLineweights(Geometry=get_name_7.Geometry, Shader=linear_gradient_7, Thickness=".1", Absolute=Toggle(True))

# ---- group: Preview and Bake
get_name_8 = GhPythonScript(Component=move_20.Geometry)  # -> Geometry, Name; same code as get_name
linear_gradient_8 = GhPythonScript(R="0", G="0", B="0", Percent=".3")  # -> Color; same code as linear_gradient
custom_preview_8 = CustomPreview(Geometry=get_name_8.Geometry, Material=linear_gradient_8)

# ----
panel_13 = Panel(get_name_8.Name)

# ---- group: Preview and Bake (continued)
object_bake_8 = ObjectBake(
    BakeToggle=Button(),
    GeometryObjects=get_name_8.Geometry,
    Layer=panel_13,
    ObjectName=panel_13,
    ObjectColor=linear_gradient_8,
    LayerColor=linear_gradient_8)

# ----
custom_preview_lineweights_8 = CustomPreviewLineweights(Geometry=get_name_8.Geometry, Shader=linear_gradient_8, Thickness=".05", Absolute=Toggle(True))

# ---- group: Preview and Bake
get_name_9 = GhPythonScript(Component=footprint)  # -> Geometry, Name; same code as get_name
linear_gradient_9 = GhPythonScript(R="0", G="0", B="0", Percent="1")  # -> Color; same code as linear_gradient
custom_preview_9 = CustomPreview(Geometry=get_name_9.Geometry, Material=linear_gradient_9)

# ----
panel_14 = Panel(get_name_9.Name)

# ---- group: Preview and Bake (continued)
object_bake_9 = ObjectBake(
    BakeToggle=Button(),
    GeometryObjects=get_name_9.Geometry,
    Layer=panel_14,
    ObjectName=panel_14,
    ObjectColor=linear_gradient_9,
    LayerColor=linear_gradient_9)

# ----
custom_preview_lineweights_9 = CustomPreviewLineweights(Geometry=get_name_9.Geometry, Shader=linear_gradient_9, Thickness=".1", Absolute=Toggle(True))

# ---- group: Preview and Bake
get_name_10 = GhPythonScript(Component=[geometry_12, relay_2])  # -> Geometry, Name; same code as get_name
linear_gradient_10 = GhPythonScript(R="0", G="0", B="0", Percent="1")  # -> Color; same code as linear_gradient
custom_preview_10 = CustomPreview(Geometry=get_name_10.Geometry, Material=linear_gradient_10)

# ----
panel_15 = Panel(get_name_10.Name)

# ---- group: Preview and Bake (continued)
object_bake_10 = ObjectBake(
    BakeToggle=Button(),
    GeometryObjects=get_name_10.Geometry,
    Layer=panel_15,
    ObjectName=panel_15,
    ObjectColor=linear_gradient_10,
    LayerColor=linear_gradient_10)

# ----
custom_preview_lineweights_10 = CustomPreviewLineweights(Geometry=get_name_10.Geometry, Shader=linear_gradient_10, Thickness=".1", Absolute=Toggle(True))

# ---- group: Preview and Bake
get_name_11 = GhPythonScript(Component=plan_and_section_contours)  # -> Geometry, Name; same code as get_name
linear_gradient_11 = GhPythonScript(R="0", G="0", B="0", Percent=".75")  # -> Color; same code as linear_gradient
custom_preview_11 = CustomPreview(Geometry=get_name_11.Geometry, Material=linear_gradient_11)

# ----
panel_16 = Panel(get_name_11.Name)

# ---- group: Preview and Bake (continued)
object_bake_11 = ObjectBake(
    BakeToggle=Button(),
    GeometryObjects=get_name_11.Geometry,
    Layer=panel_16,
    ObjectName=panel_16,
    ObjectColor=linear_gradient_11,
    LayerColor=linear_gradient_11)

# ----
custom_preview_lineweights_11 = CustomPreviewLineweights(Geometry=get_name_11.Geometry, Shader=linear_gradient_11, Thickness=".1", Absolute=Toggle(True))

# ---- group: TEXT LABELS
text_size = Panel("1")
point_6 = Point(point_4)
add_text = Panel("a")
linear_gradient_12 = GhPythonScript(R="0", G="0", B="0", Percent=".5")  # -> Color; same code as linear_gradient

# ----
scale_2 = Scale(Geometry=point_6, Center=point_5, Factor="1.025")  # -> Geometry, Transform

# ---- group: TEXT LABELS (continued)
list_length_2 = ListLength(List=scale_2.Geometry)
series_2 = Series(Start=0, Step=1, Count=list_length_2)
integer = Integer(series_2)
concatenate = Concatenate(FragmentA=integer, FragmentB=add_text)
text_tag_3d = TextTag3D(Location=scale_2.Geometry, Text=concatenate, Size=text_size, Colour=linear_gradient_12, Justification=5)

# ==== cluster Niche
angle_of_niche_rotation = ClusterInput()
divisor_of_niche_ratio = ClusterInput()
polygon_sides = ClusterInput()
polygon_side = ClusterInput()
center_of_niche = ClusterInput()

perpendicular = GhPythonScript(line=polygon_side)  # -> Perp; inputs line: Line
# ---------- perpendicular: Python ----------
__author__ = "mericson"
__version__ = "2019.01.11"

import rhinoscriptsyntax as rs
import math
import Rhino as rh

if line == None:
    line = None
else:
    a = 0,0,0
    b = 0,0,1
    Z = rs.VectorCreate(a,b)
    c = rh.Geometry.Line.PointAt(line,1)
    d = rh.Geometry.Line.PointAt(line,0)
    vector2 = rs.VectorCreate(c,d)
    Perp = rs.VectorRotate(vector2,90,Z)
# ---------- end perpendicular ----------
length = Length(Curve=polygon_side)
construct_plane = ConstructPlane(Origin=center_of_niche, XAxis=polygon_side, YAxis=perpendicular)
division = Division(A=length, B=divisor_of_niche_ratio)
rotate = Rotate(Geometry=construct_plane, Angle=degrees(angle_of_niche_rotation), Plane=center_of_niche)  # -> Geometry, Transform
polygon = Polygon(Plane=rotate.Geometry, Radius=division, Segments=polygon_sides, FilletRadius=0)  # -> Polygon, Length

polygon_2 = ClusterOutput(polygon.Polygon)

# ==== cluster PointOnLine
point_value = ClusterInput()
curve = ClusterInput()
point_value_2 = Number(point_value)

# ---- group: point on curv
end_points = EndPoints(Curve=curve)  # -> Start, End
panel = Panel(point_value_2)
point = Point(end_points.Start)
point_2 = Point(end_points.End)
addition = Addition(A=point, B=point_2)
multiplication = Multiplication(A=addition, B=panel)

# ----
result = ClusterOutput(multiplication)

# ==== cluster Cluster
height_factor = ClusterInput()
center_value = ClusterInput()
arc_degrees = ClusterInput()
eccentricity = ClusterInput()
line = ClusterInput()

height_factor_2 = Number(height_factor)
center_value_2 = Number(center_value)
arc_degrees_2 = Number(arc_degrees)
eccentricity_2 = Number(eccentricity)
line_2 = Line(line)
line_3 = Line(line_2)
point_on_line = GhPythonScript(lines=line_2, value=center_value_2)  # -> points
# ---------- point_on_line: Python ----------
__author__ = "ericsonm"
__version__ = "2019.10.18"

import rhinoscriptsyntax as rs
import Rhino as rh

if lines == None:
    pass
    
else:

    points = rh.Geometry.Line.PointAt(rs.coerceline(lines),float(value))
# ---------- end point_on_line ----------
point_on_line_2 = GhPythonScript(lines=line_2, value="1")  # -> points; same code as point_on_line
length = Length(Curve=line_2)
multiplication = Multiplication(A=length, B=height_factor_2)
distance = Distance(PointA=point_on_line, PointB=point_on_line_2)
radians = Radians(Degrees=arc_degrees_2)

# ---- group: perpendicular plane
perpendicular = GhPythonScript(line=line_3)  # -> Perp; inputs line: Line; same code as perpendicular
point_on_curve = PointOnCurve(line_3, parameter=0)

# ----
reverse = Reverse(Vector=perpendicular)
line_sdl = LineSDL(Start=point_on_line_2, Direction=reverse, Length=multiplication)
move = Move(Geometry=point_on_line, Motion=line_sdl)  # -> Geometry, Transform
construct_plane = ConstructPlane(Origin=move.Geometry, XAxis=line_2, YAxis=line_sdl)
arc = Arc(Plane=construct_plane, Radius=distance, Angle=radians)  # -> Arc, Length
scale_nu = ScaleNU(Geometry=arc.Arc, Plane=construct_plane, ScaleX="1", ScaleY=eccentricity_2, ScaleZ="1")  # -> Geometry, Transform
join_curves = JoinCurves(Curves=flatten([line_sdl, scale_nu.Geometry]), Preserve=False)
section = Geometry(join_curves)

# ---- group: perpendicular plane (continued)
construct_plane_2 = ConstructPlane(Origin=point_on_curve, XAxis=line_3, YAxis=reverse)

# ----
section_2 = ClusterOutput(section)
