# Grasshopper definition Centered Rectangle.gh (Grasshopper 1.0.7)

centered_rectangle = GhPythonScript()  # -> rectangle, center
# ---------- centered_rectangle: Python ----------
__author__ = "ericsonm"
__version__ = "2019.01.15"

import rhinoscriptsyntax as rs
import Rhino as rh

if (width or height) == None:
    rectangle = None

else:
    point1 = rs.coerce3dpoint(point)
    centerX = rh.Geometry.Point3d.X.GetValue(point1)
    centerY = rh.Geometry.Point3d.Y.GetValue(point1)
    centerZ = rh.Geometry.Point3d.Z.GetValue(point1)
    x1 = float(width)
    y1 = float(height)
    xc = x1/-2 + float(centerX)
    yc = y1/-2 + float(centerY)
    center = rs.AddPoint(float(centerX),float(centerY),float(centerZ))

    rectangle = rs.AddRectangle((xc,yc,0),x1,y1)
# ---------- end centered_rectangle ----------
