# Grasshopper definition Layered Section_rapha.gh (Grasshopper 1.0.7)

unit_x = UnitX(Factor=1)
unit_x_2 = UnitX(Factor=1)
unit_x_3 = UnitX(Factor=1)
unit_x_4 = UnitX(Factor=1)
center_value = Number("0")
line_sdl = LineSDL(Start="0,0,0", Direction=unit_x, Length="60")
line_sdl_2 = LineSDL(Start="0,0,0", Direction=unit_x_2, Length="70")
line_sdl_3 = LineSDL(Start="0,0,0", Direction=unit_x_3, Length="60")
line_sdl_4 = LineSDL(Start="0,0,0", Direction=unit_x_4, Length="60")
eccentricity = Number(".2")
height_factor = Number(".5")
line = Line(line_sdl)
arc_degrees = Number("90")
line_2 = Line(line_sdl_2)
line_3 = Line(line_sdl_4)
end_points = EndPoints(Curve=line)  # -> Start, End
end_points_2 = EndPoints(Curve=line_2)  # -> Start, End
cluster = Cluster(eccentricity="1", center_value=".5", line=line, height_factor=".5", arc_degrees="90")
cluster_2 = Cluster(eccentricity=".1", center_value=".5", line=line_2, height_factor="1.5", arc_degrees="90")
section = Geometry(cluster)
section_2 = Geometry(cluster_2)

line_4 = Line(line_sdl_3)
cluster_3 = Cluster(eccentricity="1", center_value=".5", line=line_4, height_factor=".5", arc_degrees="60")
section_3 = Geometry(cluster_3)
end_points_3 = EndPoints(Curve=section_3)  # -> Start, End
perpendicular = GhPythonScript(line=line_4)  # -> Perp; inputs line: Line; same code as perpendicular
project_point = ProjectPoint(Point=end_points_3.End, Direction=perpendicular, Geometry=line_4)  # -> Point, Index
vector_2pt = Vector2Pt(PointA=project_point.Point, PointB=end_points_3.End, Unitize=False)  # -> Vector, Length

end_points_4 = EndPoints(Curve=line_4)  # -> Start, End

line_5 = Line(StartPoint=end_points_4.Start, EndPoint=project_point.Point)
cluster_4 = Cluster(eccentricity=".5", center_value="0", line=line_5, height_factor=".5", arc_degrees="90")
move = Move(Geometry=cluster_4, Motion=vector_2pt.Vector)  # -> Geometry, Transform
join_curves = JoinCurves(Curves=flatten([cluster_3, move.Geometry]), Preserve=False)

section_4 = Geometry(join_curves)

height_factor_2 = Number(height_factor)
center_value_2 = Number(center_value)
arc_degrees_2 = Number(arc_degrees)
eccentricity_2 = Number(eccentricity)
line_6 = Line(line_3)
line_7 = Line(line_6)
point_on_line = GhPythonScript(lines=line_6, value=center_value_2)  # -> points; same code as point_on_line
point_on_line_2 = GhPythonScript(lines=line_6, value="1")  # -> points; same code as point_on_line
length = Length(Curve=line_6)
multiplication = Multiplication(A=length, B=height_factor_2)
distance = Distance(PointA=point_on_line, PointB=point_on_line_2)
radians = Radians(Degrees=arc_degrees_2)

# ---- group: perpendicular plane
perpendicular_2 = GhPythonScript(line=line_7)  # -> Perp; inputs line: Line; same code as perpendicular
point_on_curve = PointOnCurve(line_7, parameter=0)

# ----
reverse = Reverse(Vector=perpendicular_2)
line_sdl_5 = LineSDL(Start=point_on_line_2, Direction=reverse, Length=multiplication)
move_2 = Move(Geometry=point_on_line, Motion=line_sdl_5)  # -> Geometry, Transform
construct_plane = ConstructPlane(Origin=move_2.Geometry, XAxis=line_6, YAxis=line_sdl_5)
arc = Arc(Plane=construct_plane, Radius=distance, Angle=radians)  # -> Arc, Length
scale_nu = ScaleNU(Geometry=arc.Arc, Plane=construct_plane, ScaleX="1", ScaleY=eccentricity_2, ScaleZ="1")  # -> Geometry, Transform
join_curves_2 = JoinCurves(Curves=flatten([line_sdl_5, scale_nu.Geometry]), Preserve=False)
section_5 = Geometry(join_curves_2)

# ---- group: perpendicular plane (continued)
construct_plane_2 = ConstructPlane(Origin=point_on_curve, XAxis=line_7, YAxis=reverse)

# ----
section_6 = Geometry(section_5)

# ==== cluster Cluster
height_factor = ClusterInput()
center_value = ClusterInput()
arc_degrees = ClusterInput()
eccentricity = ClusterInput()
line = ClusterInput()

height_factor_2 = Number(height_factor)
center_value_2 = Number(center_value)
arc_degrees_2 = Number(arc_degrees)
eccentricity_2 = Number(eccentricity)
line_2 = Line(line)
line_3 = Line(line_2)
point_on_line = GhPythonScript(lines=line_2, value=center_value_2)  # -> points
# ---------- point_on_line: Python ----------
__author__ = "ericsonm"
__version__ = "2019.10.18"

import rhinoscriptsyntax as rs
import Rhino as rh

if lines == None:
    pass
    
else:

    points = rh.Geometry.Line.PointAt(rs.coerceline(lines),float(value))
# ---------- end point_on_line ----------
point_on_line_2 = GhPythonScript(lines=line_2, value="1")  # -> points; same code as point_on_line
length = Length(Curve=line_2)
multiplication = Multiplication(A=length, B=height_factor_2)
distance = Distance(PointA=point_on_line, PointB=point_on_line_2)
radians = Radians(Degrees=arc_degrees_2)

# ---- group: perpendicular plane
perpendicular = GhPythonScript(line=line_3)  # -> Perp; inputs line: Line
# ---------- perpendicular: Python ----------
__author__ = "mericson"
__version__ = "2019.01.11"

import rhinoscriptsyntax as rs
import math
import Rhino as rh

if line == None:
    line = None
else:
    a = 0,0,0
    b = 0,0,1
    Z = rs.VectorCreate(a,b)
    c = rh.Geometry.Line.PointAt(line,1)
    d = rh.Geometry.Line.PointAt(line,0)
    vector2 = rs.VectorCreate(c,d)
    Perp = rs.VectorRotate(vector2,90,Z)
# ---------- end perpendicular ----------
point_on_curve = PointOnCurve(line_3, parameter=0)

# ----
reverse = Reverse(Vector=perpendicular)
line_sdl = LineSDL(Start=point_on_line_2, Direction=reverse, Length=multiplication)
move = Move(Geometry=point_on_line, Motion=line_sdl)  # -> Geometry, Transform
construct_plane = ConstructPlane(Origin=move.Geometry, XAxis=line_2, YAxis=line_sdl)
arc = Arc(Plane=construct_plane, Radius=distance, Angle=radians)  # -> Arc, Length
scale_nu = ScaleNU(Geometry=arc.Arc, Plane=construct_plane, ScaleX="1", ScaleY=eccentricity_2, ScaleZ="1")  # -> Geometry, Transform
join_curves = JoinCurves(Curves=flatten([line_sdl, scale_nu.Geometry]), Preserve=False)
section = Geometry(join_curves)

# ---- group: perpendicular plane (continued)
construct_plane_2 = ConstructPlane(Origin=point_on_curve, XAxis=line_3, YAxis=reverse)

# ----
section_2 = ClusterOutput(section)
