# Grasshopper definition Plan_Section_Group.gh (Grasshopper 1.0.7)

cone = Cone(Base=PlaneXY(0, 0, 0), Radius="40", Length="50")  # -> Cone, Tip
cone_2 = Cone(Base=PlaneXY(0, 0, 0), Radius="60", Length="80")  # -> Cone, Tip
boolean_toggle = BooleanToggle(True)
cap_holes = CapHoles(Brep=cone_2.Cone)
cap_holes_2 = CapHoles(Brep=cone.Cone)
solid_difference = SolidDifference(BrepsA=cap_holes, BrepsB=cap_holes_2)

# ---- group: Plan Section Group
unsheared_model = Geometry(solid_difference)
xy_plane = XYPlane(Origin=Point(0, 0, 0))
cutting_surface = Geometry(xy_plane)
level_2_cut_height = Panel("30")
level_3_cut_height = Panel("60")
level_1_cut_height = Panel("3")
multiplication = Multiplication(A=level_2_cut_height, B="1")
multiplication_2 = Multiplication(A="1", B=level_3_cut_height)
multiplication_3 = Multiplication(A=level_1_cut_height, B="1")
unit_z = UnitZ(Factor=multiplication_3)
unit_z_2 = UnitZ(Factor=multiplication)
unit_z_3 = UnitZ(Factor=multiplication_2)
move = Move(Geometry=cutting_surface, Motion=unit_z_3)  # -> Geometry, Transform
move_2 = Move(Geometry=cutting_surface, Motion=unit_z)  # -> Geometry, Transform
move_3 = Move(Geometry=cutting_surface, Motion=unit_z_2)  # -> Geometry, Transform
xz_plane = XZPlane(Origin=Point(0, 0, 0))
level_3_cutter = Geometry(move.Geometry)
level_1_cutter = Geometry(move_2.Geometry)
level_2_cutter = Geometry(move_3.Geometry)
unit_x = UnitX(Factor=1)
brep_plane = BrepPlane(Brep=unsheared_model, Plane=level_1_cutter)  # -> Curves, Points
brep_plane_2 = BrepPlane(Brep=unsheared_model, Plane=level_2_cutter)  # -> Curves, Points
brep_plane_3 = BrepPlane(Brep=unsheared_model, Plane=level_3_cutter)  # -> Curves, Points
brep_plane_4 = BrepPlane(Brep=unsheared_model, Plane=xz_plane)  # -> Curves, Points
line_sdl = LineSDL(Start=xz_plane, Direction=unit_x, Length=1)
panel = Panel("-90")
geometry = Geometry(brep_plane.Curves)
geometry_2 = Geometry(brep_plane_2.Curves)
geometry_3 = Geometry(brep_plane_3.Curves)
geometry_4 = Geometry(brep_plane_4.Curves)
rotate_3d = Rotate3D(Geometry=geometry_4, Angle=degrees(panel), Center=Point(0, 0, 0), Axis=line_sdl)  # -> Geometry, Transform
offset_of_pages = Panel("500")
multiplication_4 = Multiplication(A=offset_of_pages, B="2")
multiplication_5 = Multiplication(A=offset_of_pages, B="4")
multiplication_6 = Multiplication(A=offset_of_pages, B="3")
unit_x_2 = UnitX(Factor=offset_of_pages)
unit_x_3 = UnitX(Factor=multiplication_4)
unit_x_4 = UnitX(Factor=multiplication_6)
unit_x_5 = UnitX(Factor=multiplication_5)
move_4 = Move(Geometry=geometry, Motion=unit_x_2)  # -> Geometry, Transform
move_5 = Move(Geometry=geometry_2, Motion=unit_x_3)  # -> Geometry, Transform
move_6 = Move(Geometry=geometry_3, Motion=unit_x_4)  # -> Geometry, Transform
move_7 = Move(Geometry=rotate_3d.Geometry, Motion=unit_x_5)  # -> Geometry, Transform
center_point_of_plan_01 = Point(unit_x_2)
center_point_fo_plan_02 = Point(unit_x_3)
center_point_of_plan_03 = Point(unit_x_4)
center_of_section = Point(unit_x_5)
level_1_plan = Geometry(move_4.Geometry)
level_2_plan = Geometry(move_5.Geometry)
level_3_plan = Geometry(move_6.Geometry)
section = Geometry(move_7.Geometry)

# ---- group: Plan and Section Contour
inner_surface = Geometry(cap_holes_2)
outer_surface = Geometry(cap_holes)
stream_filter = StreamFilter(Gate=boolean_toggle, Stream1=outer_surface)
stream_filter_2 = StreamFilter(Gate=boolean_toggle, Stream1=inner_surface)
bounding_box = BoundingBox(Content=stream_filter, Plane=PlaneXY(0, 0, 0))  # -> Box, Box_2
unit_y = UnitY(Factor="-60")
move_8 = Move(Geometry=bounding_box.Box, Motion=unit_z)  # -> Geometry, Transform
move_9 = Move(Geometry=bounding_box.Box, Motion=unit_z_2)  # -> Geometry, Transform
move_10 = Move(Geometry=bounding_box.Box, Motion=unit_z_3)  # -> Geometry, Transform
move_11 = Move(Geometry=bounding_box.Box, Motion=unit_y)  # -> Geometry, Transform
solid_difference_2 = SolidDifference(BrepsA=stream_filter, BrepsB=move_8.Geometry)
solid_difference_3 = SolidDifference(BrepsA=stream_filter, BrepsB=move_9.Geometry)
solid_difference_4 = SolidDifference(BrepsA=stream_filter, BrepsB=move_10.Geometry)
solid_difference_5 = SolidDifference(BrepsA=stream_filter_2, BrepsB=move_11.Geometry)
rotate_3d_2 = Rotate3D(Geometry=solid_difference_5, Angle=degrees(panel), Center=Point(0, 0, 0), Axis=line_sdl)  # -> Geometry, Transform
move_12 = Move(Geometry=solid_difference_2, Motion=unit_x_2)  # -> Geometry, Transform
move_13 = Move(Geometry=solid_difference_3, Motion=unit_x_3)  # -> Geometry, Transform
move_14 = Move(Geometry=solid_difference_4, Motion=unit_x_4)  # -> Geometry, Transform
move_15 = Move(Geometry=rotate_3d_2.Geometry, Motion=unit_x_5)  # -> Geometry, Transform
geometry_5 = Geometry(move_12.Geometry)
geometry_6 = Geometry(move_13.Geometry)
geometry_7 = Geometry(move_14.Geometry)
geometry_8 = Geometry(move_15.Geometry)
unit_z_4 = UnitZ(Factor=1)
contour = Contour(Shape=[geometry_5, geometry_6, geometry_7, geometry_8], Point=Point(0, 0, 0), Direction=unit_z_4, Distance="1")
plan_and_section_contours = Geometry(contour)

# ----
centers = Relay([center_point_of_plan_01, center_point_fo_plan_02, center_point_of_plan_03, center_of_section])

# ---- group: sheet
sheet_size = Panel("11.7")
feet_per_inch = Panel("20")
sheet_size_2 = Panel("8")
multiplication_7 = Multiplication(A=feet_per_inch, B=sheet_size)
multiplication_8 = Multiplication(A=feet_per_inch, B=sheet_size_2)
centered_rectangle = GhPythonScript(width=multiplication_8, height=multiplication_7, point=centers)  # -> rectangle, center
# ---------- centered_rectangle: Python ----------
__author__ = "ericsonm"
__version__ = "2019.01.15"

import rhinoscriptsyntax as rs
import Rhino as rh

if (width or height) == None:
    rectangle = None

else:
    point1 = rs.coerce3dpoint(point)
    centerX = rh.Geometry.Point3d.X.GetValue(point1)
    centerY = rh.Geometry.Point3d.Y.GetValue(point1)
    centerZ = rh.Geometry.Point3d.Z.GetValue(point1)
    x1 = float(width)
    y1 = float(height)
    xc = x1/-2 + float(centerX)
    yc = y1/-2 + float(centerY)
    center = rs.AddPoint(float(centerX),float(centerY),float(centerZ))

    rectangle = rs.AddRectangle((xc,yc,0),x1,y1)
# ---------- end centered_rectangle ----------

# ---- group: Hatch Group
boundary_surfaces = BoundarySurfaces(Edges=[level_1_plan, level_2_plan, level_3_plan, section])
vector_at_angle = PythonScript(angle="45")  # -> vector
# ---------- vector_at_angle: Python ----------
import rhinoscriptsyntax as rs
import math
if angle == None:
    Vector = None
else:
    c=rs.AddPoint(0,0,0)
    f=math.radians(float(angle))
    l=rs.AddPoint(math.cos(f),math.sin(f),0)
    d=rs.VectorCreate(l,c)
    vector =rs.VectorUnitize(d)
# ---------- end vector_at_angle ----------
contour_2 = Contour(Shape=boundary_surfaces, Point=Point(0, 0, 0), Direction=vector_at_angle, Distance=".76")

# ----
geometry_9 = Geometry(contour_2)
