# Grasshopper definition plan group.gh (Grasshopper 1.0.7)

cutting_surface = Geometry()
unsheared_model = Geometry()

# ---- group: Plan Group
# This group intersects the
# unsheared model with planes at each fo the plan heights.  It provide live plans so that as you model you can  see the result in plan
# 
# It also moves them and roughly centers them on a sheet.
# 
# It requires a single cutting surface and the unsheared surface model
level_1_cut_height = Panel("3")
level_2_cut_height = Panel("15")
level_3_cut_height = Panel("30")
panel = Panel("12")
multiplication = Multiplication(A=level_1_cut_height, B=panel)
unit_z = UnitZ(Factor=multiplication)
move = Move(Geometry=cutting_surface, Motion=unit_z)  # -> Geometry, Transform
offset_of_pages = Panel("3000")
panel_2 = Panel("3")
panel_3 = Panel("2")
unit_x = UnitX(Factor=offset_of_pages)
center_point_of_plan_01 = Point(unit_x)

# ----
multiplication_2 = Multiplication(A=level_2_cut_height, B=panel)
multiplication_3 = Multiplication(A=panel, B=level_3_cut_height)
level_1_cutter = Geometry(move.Geometry)
brep_brep = BrepBrep(BrepA=unsheared_model, BrepB=level_1_cutter)  # -> Curves, Points
multiplication_4 = Multiplication(A=offset_of_pages, B=panel_3)
multiplication_5 = Multiplication(A=offset_of_pages, B=panel_2)

# ---- group: Plan Group (continued)
unit_z_2 = UnitZ(Factor=multiplication_2)
unit_z_3 = UnitZ(Factor=multiplication_3)
move_2 = Move(Geometry=cutting_surface, Motion=unit_z_2)  # -> Geometry, Transform
move_3 = Move(Geometry=cutting_surface, Motion=unit_z_3)  # -> Geometry, Transform
geometry = Geometry(brep_brep.Curves)
unit_x_2 = UnitX(Factor=multiplication_5)
unit_x_3 = UnitX(Factor=multiplication_4)
move_4 = Move(Geometry=geometry, Motion=unit_x)  # -> Geometry, Transform
center_point_fo_plan_02 = Point(unit_x_3)
center_point_of_plan_03 = Point(unit_x_2)

# ----
level_2_cutter = Geometry(move_2.Geometry)
level_3_cutter = Geometry(move_3.Geometry)
brep_brep_2 = BrepBrep(BrepA=unsheared_model, BrepB=level_2_cutter)  # -> Curves, Points
brep_brep_3 = BrepBrep(BrepA=unsheared_model, BrepB=level_3_cutter)  # -> Curves, Points

# ---- group: Plan Group (continued)
geometry_2 = Geometry(brep_brep_2.Curves)
geometry_3 = Geometry(brep_brep_3.Curves)
move_5 = Move(Geometry=geometry_2, Motion=unit_x_3)  # -> Geometry, Transform
move_6 = Move(Geometry=geometry_3, Motion=unit_x_2)  # -> Geometry, Transform

# ----
level_1_plan = Geometry(move_4.Geometry)
level_2_plan = Geometry(move_5.Geometry)
level_3_plan = Geometry(move_6.Geometry)
plans = Curve([level_1_plan, level_2_plan, level_3_plan])
