# Grasshopper definition plan section in class.gh (Grasshopper 1.0.7)

cone = Cone(Base=PlaneXY(0, 0, 0), Radius="60", Length="80")  # -> Cone, Tip
cone_2 = Cone(Base=PlaneXY(0, 0, 0), Radius="40", Length="60")  # -> Cone, Tip
cap_holes = CapHoles(Brep=cone.Cone)
cap_holes_2 = CapHoles(Brep=cone_2.Cone)
outer_surface = Geometry(cap_holes)
inner_surface = Geometry(cap_holes_2)
solid_difference = SolidDifference(BrepsA=outer_surface, BrepsB=inner_surface)
object_to_cut = Geometry(solid_difference)
# PLAN 1
# PLAN 2
object_to_cut_2 = Geometry(object_to_cut)

xy_plane = XYPlane(Origin=Point(0, 0, 0))
unit_z = UnitZ(Factor="4")
move = Move(Geometry=xy_plane, Motion=unit_z)  # -> Geometry, Transform
brep_plane = BrepPlane(Brep=object_to_cut_2, Plane=move.Geometry)  # -> Curves, Points
offset_between_sheets = Panel("500")
multiplication = Multiplication(A="1", B=offset_between_sheets)
unit_x = UnitX(Factor=multiplication)
move_2 = Move(Geometry=brep_plane.Curves, Motion=unit_x)  # -> Geometry, Transform
plan_center_1 = Point(unit_x)

# ----
# PLAN3
xy_plane_2 = XYPlane(Origin=Point(0, 0, 0))
unit_z_2 = UnitZ(Factor="50")
move_3 = Move(Geometry=xy_plane_2, Motion=unit_z_2)  # -> Geometry, Transform
brep_plane_2 = BrepPlane(Brep=object_to_cut_2, Plane=move_3.Geometry)  # -> Curves, Points
offset_between_sheets_2 = Panel("500")
multiplication_2 = Multiplication(A="3", B=offset_between_sheets_2)
unit_x_2 = UnitX(Factor=multiplication_2)
move_4 = Move(Geometry=brep_plane_2.Curves, Motion=unit_x_2)  # -> Geometry, Transform
plan_center_3 = Point(unit_x_2)

xy_plane_3 = XYPlane(Origin=Point(0, 0, 0))
unit_z_3 = UnitZ(Factor="30")
move_5 = Move(Geometry=xy_plane_3, Motion=unit_z_3)  # -> Geometry, Transform
brep_plane_3 = BrepPlane(Brep=object_to_cut_2, Plane=move_5.Geometry)  # -> Curves, Points
offset_between_sheets_3 = Panel("500")
multiplication_3 = Multiplication(A="2", B=offset_between_sheets_3)
unit_x_3 = UnitX(Factor=multiplication_3)
move_6 = Move(Geometry=brep_plane_3.Curves, Motion=unit_x_3)  # -> Geometry, Transform
plan_center_2 = Point(unit_x_3)
plan_cuts = Geometry([move_6.Geometry, move_2.Geometry, move_4.Geometry])

# ----
# SECTION
xz_plane = XZPlane(Origin=Point(0, 0, 0))
unit_y = UnitY(Factor="0")
move_7 = Move(Geometry=xz_plane, Motion=unit_y)  # -> Geometry, Transform
brep_plane_4 = BrepPlane(Brep=object_to_cut_2, Plane=move_7.Geometry)  # -> Curves, Points
unit_x_4 = UnitX(Factor=1)
rotate_3d = Rotate3D(Geometry=brep_plane_4.Curves, Angle=degrees("-90"), Center=Point(0, 0, 0), Axis=unit_x_4)  # -> Geometry, Transform
offset_between_sheets_4 = Panel("500")
multiplication_4 = Multiplication(A="4", B=offset_between_sheets_4)
unit_x_5 = UnitX(Factor=multiplication_4)
move_8 = Move(Geometry=rotate_3d.Geometry, Motion=unit_x_5)  # -> Geometry, Transform
section_center = Point(unit_x_5)
section = Geometry(move_8.Geometry)

# ----
# PLAN 1
bounding_box = BoundingBox(Content=outer_surface, Plane=PlaneXY(0, 0, 0))  # -> Box, Box_2
move_9 = Move(Geometry=bounding_box.Box, Motion=unit_z)  # -> Geometry, Transform
solid_difference_2 = SolidDifference(BrepsA=outer_surface, BrepsB=move_9.Geometry)
move_10 = Move(Geometry=solid_difference_2, Motion=unit_x)  # -> Geometry, Transform
unit_z_4 = UnitZ(Factor=1)
contour = Contour(Shape=move_10.Geometry, Point=Point(0, 0, 0), Direction=unit_z_4, Distance="1")

# ----
# PLAN 2
bounding_box_2 = BoundingBox(Content=outer_surface, Plane=PlaneXY(0, 0, 0))  # -> Box, Box_2
move_11 = Move(Geometry=bounding_box_2.Box, Motion=unit_z_3)  # -> Geometry, Transform
solid_difference_3 = SolidDifference(BrepsA=outer_surface, BrepsB=move_11.Geometry)
move_12 = Move(Geometry=solid_difference_3, Motion=unit_x_3)  # -> Geometry, Transform
unit_z_5 = UnitZ(Factor=1)
contour_2 = Contour(Shape=move_12.Geometry, Point=Point(0, 0, 0), Direction=unit_z_5, Distance="1")

# ----
# PLAN3
bounding_box_3 = BoundingBox(Content=outer_surface, Plane=PlaneXY(0, 0, 0))  # -> Box, Box_2
move_13 = Move(Geometry=bounding_box_3.Box, Motion=unit_z_2)  # -> Geometry, Transform
solid_difference_4 = SolidDifference(BrepsA=outer_surface, BrepsB=move_13.Geometry)
move_14 = Move(Geometry=solid_difference_4, Motion=unit_x_2)  # -> Geometry, Transform
unit_z_6 = UnitZ(Factor=1)
contour_3 = Contour(Shape=move_14.Geometry, Point=Point(0, 0, 0), Direction=unit_z_6, Distance="1")

unit_y_2 = UnitY(Factor="-60")
multiplication_5 = Multiplication(A="8", B="20")
multiplication_6 = Multiplication(A="11.7", B="20")
centered_rectangle = GhPythonScript(width=multiplication_5, height=multiplication_6, point=[plan_center_1, plan_center_3, plan_center_2, section_center])  # -> rectangle, center
# ---------- centered_rectangle: Python ----------
__author__ = "ericsonm"
__version__ = "2019.01.15"

import rhinoscriptsyntax as rs
import Rhino as rh

if (width or height) == None:
    rectangle = None

else:
    point1 = rs.coerce3dpoint(point)
    centerX = rh.Geometry.Point3d.X.GetValue(point1)
    centerY = rh.Geometry.Point3d.Y.GetValue(point1)
    centerZ = rh.Geometry.Point3d.Z.GetValue(point1)
    x1 = float(width)
    y1 = float(height)
    xc = x1/-2 + float(centerX)
    yc = y1/-2 + float(centerY)
    center = rs.AddPoint(float(centerX),float(centerY),float(centerZ))

    rectangle = rs.AddRectangle((xc,yc,0),x1,y1)
# ---------- end centered_rectangle ----------

# ---- group: Hatch Group
boundary_surfaces = BoundarySurfaces(Edges=[plan_cuts, section])
vector_at_angle = PythonScript(angle="45")  # -> vector
# ---------- vector_at_angle: Python ----------
import rhinoscriptsyntax as rs
import math
if angle == None:
    Vector = None
else:
    c=rs.AddPoint(0,0,0)
    f=math.radians(float(angle))
    l=rs.AddPoint(math.cos(f),math.sin(f),0)
    d=rs.VectorCreate(l,c)
    vector =rs.VectorUnitize(d)
# ---------- end vector_at_angle ----------
contour_4 = Contour(Shape=boundary_surfaces, Point=Point(0, 0, 0), Direction=vector_at_angle, Distance=".76")

# ----
sheet = Geometry(centered_rectangle.rectangle)
geometry = Geometry(contour_4)

# ----
# SECTION
bounding_box_4 = BoundingBox(Content=inner_surface, Plane=PlaneXY(0, 0, 0))  # -> Box, Box_2
move_15 = Move(Geometry=bounding_box_4.Box, Motion=unit_y_2)  # -> Geometry, Transform
solid_difference_5 = SolidDifference(BrepsA=outer_surface, BrepsB=move_15.Geometry)
unit_z_7 = UnitZ(Factor=1)

rotate_3d_2 = Rotate3D(Geometry=solid_difference_5, Angle=degrees("-90"), Center=Point(0, 0, 0), Axis=unit_x_4)  # -> Geometry, Transform

move_16 = Move(Geometry=rotate_3d_2.Geometry, Motion=unit_x_5)  # -> Geometry, Transform
contour_5 = Contour(Shape=move_16.Geometry, Point=Point(0, 0, 0), Direction=unit_z_7, Distance="1")

plan_and_section_contours = Geometry([contour, contour_2, contour_3, contour_5])
