# Grasshopper definition Site Model.gh (Grasshopper 1.0.7)
# plug-ins: Human

# Use this gh definition to build your site model. Add buildings, roads, curbs.  Once the basics of the model have been established in GH, copy and paste this definition into the "operations" section of your GH project file.
# 
# Produce a "baked" Rhino version of the model at 1" = 20' and modify it as necessary in rhino to produce the physical model
# 
# Only 2 parameter need to be changed to use this script. Do not change any of the other values:
# 
# 
# 1. FILE PATH PANEL:  Copy and paste the file path associated with site image into the file path panel.
# 
# 2. BOOLEAN TOGGLE:  Toggle Boolean for Scale:
# 
#       False = 1:1
#       True = 1" = 20'  (the scale of the model)
file_path_for_site_image = Panel("C:\Users\ericsonm\Dropbox\Woodbury\2019_sep\Arch_281\05_Workshops\191106\Alameda_4th_scaled.jpg")
scaled = BooleanToggle(True)

# ---- group: MODEL DIMENSIONS: DO NOT CHANGE
panel = Panel("1")
feet_per_inch = Panel("20")
multiplication = Multiplication(A=feet_per_inch, B="12")
panel_2 = Panel("240")
panel_3 = Panel("360")
panel_4 = Panel("""0
0""")
panel_5 = Panel("""2
2""")
panel_6 = Panel("""1
1""")
panel_7 = Panel("""3
3""")
panel_8 = Panel(""".8
.225""")
panel_9 = Panel(""".82
.2""")
panel_10 = Panel(""".125
.775""")
panel_11 = Panel(""".18
.6""")

# ----
stream_filter = StreamFilter(Gate=scaled, Stream0=panel, Stream1=multiplication)
division = Division(A=panel_2, B=stream_filter)
division_2 = Division(A=panel_3, B=stream_filter)

# ---- group: MODEL DIMENSIONS: DO NOT CHANGE (continued)
centered_rectangle = GhPythonScript(width=division, height=division_2, point="0,0,0")  # -> rectangle, center
# ---------- centered_rectangle: Python ----------
__author__ = "ericsonm"
__version__ = "2019.01.15"

import rhinoscriptsyntax as rs
import Rhino as rh

if (width or height) == None:
    rectangle = None

else:
    point1 = rs.coerce3dpoint(point)
    centerX = rh.Geometry.Point3d.X.GetValue(point1)
    centerY = rh.Geometry.Point3d.Y.GetValue(point1)
    centerZ = rh.Geometry.Point3d.Z.GetValue(point1)
    x1 = float(width)
    y1 = float(height)
    xc = x1/-2 + float(centerX)
    yc = y1/-2 + float(centerY)
    center = rs.AddPoint(float(centerX),float(centerY),float(centerZ))

    rectangle = rs.AddRectangle((xc,yc,0),x1,y1)
# ---------- end centered_rectangle ----------
explode = Explode(Curve=centered_rectangle.rectangle, Recursive=True)  # -> Segments, Vertices
explode_2 = Explode(Curve=centered_rectangle.rectangle, Recursive=True)  # -> Segments, Vertices
list_item = ListItem(List=explode.Segments, Index=panel_5, Wrap=True)
list_item_2 = ListItem(List=explode.Segments, Index=panel_4, Wrap=True)
list_item_3 = ListItem(List=explode_2.Segments, Index=panel_6, Wrap=True)
list_item_4 = ListItem(List=explode_2.Segments, Index=panel_7, Wrap=True)
point_on_line = GhPythonScript(lines=list_item_2, value=panel_8)  # -> points
# ---------- point_on_line: Python ----------
__author__ = "ericsonm"
__version__ = "2019.10.18"

import rhinoscriptsyntax as rs
import Rhino as rh

if lines == None:
    pass
    
else:

    points = rh.Geometry.Line.PointAt(rs.coerceline(lines),float(value))
# ---------- end point_on_line ----------
point_on_line_2 = GhPythonScript(lines=list_item, value=panel_10)  # -> points; same code as point_on_line
point_on_line_3 = GhPythonScript(lines=list_item_3, value=panel_9)  # -> points; same code as point_on_line
point_on_line_4 = GhPythonScript(lines=list_item_4, value=panel_11)  # -> points; same code as point_on_line
point = Point(point_on_line_4)
point_2 = Point(point_on_line)
point_3 = Point(point_on_line_2)
point_4 = Point(point_on_line_3)
line = Line(StartPoint=point_2, EndPoint=point_3)
line_2 = Line(StartPoint=point_4, EndPoint=point)
curve_curve = CurveCurve(CurveA=graft(line), CurveB=line_2)  # -> Points, ParamsA, ParamsB
dimensions = Dimensions(Surface=centered_rectangle.rectangle)  # -> UDimension, VDimension
convex_hull = ConvexHull(Points=flatten(curve_curve.Points), Plane=PlaneXY(0, 0, 0))  # -> Hull, HullZ, Indices

# ---- group: Background Image : DO NOT CHANGE
division_3 = Division(A=" 758.473", B=stream_filter)
division_4 = Division(A="981.553", B=stream_filter)
division_5 = Division(A="-359.682948", B=stream_filter)
division_6 = Division(A=" -438.470322", B=stream_filter)
construct_point = ConstructPoint(XCoordinate=division_5, YCoordinate=division_6, ZCoordinate=0)
rectangle = Rectangle(Plane=construct_point, XSize=division_4, YSize=division_3, Radius=0)  # -> Rectangle, Length
surface_on_which_to_map_image = Surface(rectangle.Rectangle)
file_path = FilePath(file_path_for_site_image)
custom_preview_materials = CustomPreviewMaterials(Geometry=surface_on_which_to_map_image, DiffuseColor=RGB(255, 255, 255), DiffuseBitmap=file_path)

# ----
model_x_in_feet = Panel(dimensions.UDimension)
model_y_in_feet = Panel(dimensions.VDimension)
site_boundary = Geometry(convex_hull.Hull)
model_boundary = Geometry(centered_rectangle.rectangle)
