# Grasshopper definition Helicoid in class.gh (Grasshopper 1.0.7)

deconstruct = Deconstruct(Point="30,30,30")  # -> XComponent, YComponent, ZComponent
panel = Panel(deconstruct.ZComponent)
division = Division(A="360", B="32")
addition = Addition(A="32", B="1")
series = Series(Start="0", Step=division, Count=addition)
series_2 = Series(Start=panel, Step="7", Count=addition)

radians = Radians(Degrees=series)
panel_2 = Panel("100")
sine = Sine(Value=radians)
cosine = Cosine(Value=radians)
multiplication = Multiplication(A="100", B=cosine)
multiplication_2 = Multiplication(A=sine, B="100")
panel_3 = Panel(deconstruct.YComponent)
panel_4 = Panel(deconstruct.XComponent)
addition_2 = Addition(A=panel_4, B=multiplication)
addition_3 = Addition(A=multiplication_2, B=panel_3)
construct_point = ConstructPoint(XCoordinate=addition_2, YCoordinate=addition_3, ZCoordinate=series_2)
polyline = PolyLine(Vertices=construct_point, Closed=False)

radians_2 = Radians(Degrees=series)
sine_2 = Sine(Value=radians_2)
cosine_2 = Cosine(Value=radians_2)
multiplication_3 = Multiplication(A="30", B=cosine_2)
multiplication_4 = Multiplication(A=sine_2, B="30")
addition_4 = Addition(A="0", B=multiplication_3)
addition_5 = Addition(A=multiplication_4, B="0")
construct_point_2 = ConstructPoint(XCoordinate=addition_4, YCoordinate=addition_5, ZCoordinate=series_2)
polyline_2 = PolyLine(Vertices=construct_point_2, Closed=False)

line = Line(StartPoint=construct_point, EndPoint=construct_point_2)
unit_z = UnitZ(Factor="7")
move = Move(Geometry=line, Motion=unit_z)  # -> Geometry, Transform
list_length = ListLength(List=move.Geometry)
series_3 = Series(Start="0", Step="1", Count=list_length)
insert_items = InsertItems(List=move.Geometry, Item=line, Indices=series_3, Wrap=True)
loft_options = LoftOptions(Closed=False, Adjust=False, Rebuild=0, Refit=0, Type="3")
loft = Loft(Curves=insert_items, Options=loft_options)
