# Grasshopper definition Helicoidal Stair.gh (Grasshopper 1.0.7)

radius_x = Panel("200")
radius_y = Panel("200")
starting_degree = Panel("0")
degrees_between_points = Panel("12")
number_of_points = Panel("74")
rise = Panel("7")
scale_of_inner_helix = Panel("2")
stair_or_ramp = BooleanToggle(True)
rise_2 = Number(rise)
colour_rgb = ColourRGB(Alpha="100", Red="0", Green="40", Blue="85")
colour_rgb_2 = ColourRGB(Alpha=255, Red="0", Green="40", Blue="85")
colour_rgb_3 = ColourRGB(Alpha=255, Red="150", Green="150", Blue="150")

scale_of_inner_helix_2 = Number(scale_of_inner_helix)
helix = Helix(
    radius_x=radius_x,
    radius_y=radius_y,
    starting_degree=starting_degree,
    degrees_between_points=degrees_between_points,
    number_of_points=number_of_points,
    z_step=rise_2)  # -> points_on_helix_2, helix_2, slope_3
negative = Negative(Value=rise_2)
division = Division(A=radius_y, B=scale_of_inner_helix_2)
division_2 = Division(A=radius_x, B=scale_of_inner_helix_2)
helix_2 = Helix(
    radius_x=division_2,
    radius_y=division,
    starting_degree=starting_degree,
    degrees_between_points=degrees_between_points,
    number_of_points=number_of_points,
    z_step=rise_2)  # -> points_on_helix_2, helix_2, slope_3
unit_z = UnitZ(Factor=helix.points_on_helix_2)
number = Number(negative)
point = Point(helix.points_on_helix_2)
point_2 = Point(helix_2.points_on_helix_2)
arc_sed = ArcSED(Start=point, End=point_2, Direction=unit_z)  # -> Arc, Plane, Radius
line = Line(StartPoint=point, EndPoint=point_2)
unit_z_2 = UnitZ(Factor=number)
list_length = ListLength(List=line)
top_edge = Line(line)
move = Move(Geometry=top_edge, Motion=unit_z_2)  # -> Geometry, Transform
series = Series(Start="0", Step="1", Count=list_length)
loft = Loft(Curves=line, Options={Adjust=False, Closed=False, LoftEnds=0, LoftSimp=0, LoftType=0, Rebuild=10, Refit=0.01})
bottom_edge = Line(move.Geometry)
stair_or_ramp_2 = Boolean(stair_or_ramp)
top_edge_2 = Line(top_edge)
loft_options = LoftOptions(Closed=False, Adjust=False, Rebuild=0, Refit=0, Type="3")
insert_items = InsertItems(List=top_edge_2, Item=bottom_edge, Indices=series, Wrap=True)
boolean = Boolean(stair_or_ramp_2)
loft_2 = Loft(Curves=insert_items, Options=loft_options)
stair = Brep(loft_2)
stream_filter = StreamFilter(Gate=boolean, Stream0=loft, Stream1=stair)
walking_surface = Geometry(stream_filter)

geometry = Geometry(arc_sed.Arc)

loft_3 = Loft(Curves=geometry, Options={Adjust=False, Closed=False, LoftEnds=0, LoftSimp=0, LoftType=0, Rebuild=10, Refit=0.01})

geometry_2 = Geometry(geometry)
sectional_arcs = Geometry(geometry_2)
vault = Surface(loft_3)
walking_surface_2 = Geometry(walking_surface)
sectional_arcs_2 = Geometry(sectional_arcs)
vault_2 = Surface(vault)
custom_preview = CustomPreview(Geometry=vault_2, Shader=colour_rgb)
custom_preview_2 = CustomPreview(Geometry=walking_surface_2, Shader=colour_rgb_2)
custom_preview_3 = CustomPreview(Geometry=sectional_arcs_2, Shader=colour_rgb_3)

# ==== cluster Helix
degrees_between_points = ClusterInput()
number_of_points = ClusterInput()
starting_degree = ClusterInput()
radius_x = ClusterInput()
radius_y = ClusterInput()
z_step = ClusterInput()

# ---- group: Helix
degrees_between_points_2 = Number(degrees_between_points)
number_of_points_2 = Number(number_of_points)
starting_degree_2 = Number(starting_degree)
radius_x_2 = Number(radius_x)
radius_y_2 = Number(radius_y)
z_step_2 = Number(z_step)
series = Series(Start=starting_degree_2, Step=degrees_between_points_2, Count=number_of_points_2)
series_2 = Series(Start=starting_degree_2, Step=z_step_2, Count=number_of_points_2)
radians = Radians(Degrees=series)
radius_y_3 = Number(radius_y_2)
radius_y_4 = Number(radius_y_3)
cosine = Cosine(Value=radians)
sine = Sine(Value=radians)
multiplication = Multiplication(A=sine, B=radius_y_4)
number = Number(series_2)
multiplication_2 = Multiplication(A=radius_x_2, B=cosine)
number_2 = Number(number)
construct_point = ConstructPoint(XCoordinate=multiplication_2, YCoordinate=multiplication, ZCoordinate=number)
addition = Addition(A="0", B="1")
number_3 = Number("1")
list_item = ListItem(List=construct_point, Index="0", Wrap=True)
polyline = PolyLine(Vertices=construct_point, Closed=False)
list_item_2 = ListItem(List=construct_point, Index=addition, Wrap=True)
xy_plane = XYPlane(Origin=Point(0, 0, 0))
points_on_helix = Point(construct_point)
helix = Curve(polyline)
project = Project(Geometry=list_item, Plane=xy_plane)  # -> Geometry, Transform
project_2 = Project(Geometry=list_item_2, Plane=xy_plane)  # -> Geometry, Transform
number_4 = Number(number_2)
distance = Distance(PointA=project.Geometry, PointB=project_2.Geometry)
list_item_3 = ListItem(List=number_4, Index=number_3, Wrap=True)
division = Division(A=list_item_3, B=distance)
slope = Number(division)

# ----
helix_2 = ClusterOutput(helix)
points_on_helix_2 = ClusterOutput(points_on_helix)
slope_2 = Number(slope)
slope_3 = ClusterOutput(slope_2)
