# Grasshopper definition Part Drawing_in class.gh (Grasshopper 1.0.7)
# plug-ins: Human, LunchBox

point = Point("0,0,0")
cone = Cone(Base=point, Radius="60", Length="80")  # -> Cone, Tip
cone_2 = Cone(Base=point, Radius="40", Length="60")  # -> Cone, Tip
circle = Circle(Plane=point, Radius="60")
cap_holes = CapHoles(Brep=cone.Cone)
cap_holes_2 = CapHoles(Brep=cone_2.Cone)
solid_difference = SolidDifference(BrepsA=cap_holes, BrepsB=cap_holes_2)
circle_2 = Circle(circle)
geometry = Geometry(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)
drawing_center = Point(point)
deconstruct_arc = DeconstructArc(Arc=circle_2)  # -> BasePlane, Radius, Angle
multiplication = Multiplication(A=deconstruct_arc.Radius, B="2")
vector_at_angle = PythonScript(angle="0")  # -> vector
# ---------- vector_at_angle: Python ----------
import rhinoscriptsyntax as rs
import math
if angle == None:
    Vector = None
else:
    c=rs.AddPoint(0,0,0)
    f=math.radians(float(angle))
    l=rs.AddPoint(math.cos(f),math.sin(f),0)
    d=rs.VectorCreate(l,c)
    vector =rs.VectorUnitize(d)
# ---------- end vector_at_angle ----------

# ---- group: cutter
unit_y = UnitY(Factor=1)
unit_x = UnitX(Factor=1)
line_sdl = LineSDL(Start=drawing_center, Direction=unit_y, Length=multiplication)
line_sdl_2 = LineSDL(Start=drawing_center, Direction=vector_at_angle, Length=multiplication)
end_points = EndPoints(Curve=line_sdl)  # -> Start, End
end_points_2 = EndPoints(Curve=line_sdl_2)  # -> Start, End
line = Line(StartPoint=end_points.End, EndPoint=end_points_2.End)
join_curves = JoinCurves(Curves=[line_sdl_2, line, line_sdl], Preserve=False)

# ----
region_difference = RegionDifference(CurvesA=circle_2, CurvesB=join_curves)
geometry_2 = Geometry(region_difference)
unit_z = UnitZ(Factor=multiplication)
unit_x_2 = UnitX(Factor=1)
unit_y_2 = UnitY(Factor=1)
point_on_curve = PointOnCurve(circle_2, parameter=0.25)
extrude = Extrude(Base=geometry_2, Direction=unit_z)
cap_holes_3 = CapHoles(Brep=extrude)
line_sdl_3 = LineSDL(Start=point_on_curve, Direction=[unit_x_2, unit_y_2], Length=1)
point_on_curve_2 = PointOnCurve(line_sdl_3, parameter=0.5)
solid_difference_2 = SolidDifference(BrepsA=geometry, BrepsB=cap_holes_3)
unit_z_2 = UnitZ(Factor="80")
move = Move(Geometry=drawing_center, Motion=unit_z_2)  # -> Geometry, Transform
rotate_3d = Rotate3D(Geometry=solid_difference_2, Angle=degrees("-90"), Center=point_on_curve_2, Axis=line_sdl_3)  # -> Geometry, Transform

center_of_object_at_top = Point(move.Geometry)
center_of_object_at_base = Point(drawing_center)
radius_of_base_circle = Number(deconstruct_arc.Radius)
geometry_3 = Geometry(solid_difference_2)
boolean = Boolean(Toggle(True))
radius_of_base_circle_2 = Number(radius_of_base_circle)
point_2 = Point(center_of_object_at_top)
shear_rotation = Number("0")
negative = Negative(Value=radius_of_base_circle_2)
unit_y_3 = UnitY(Factor=negative)
rotate = Rotate(Geometry=unit_y_3, Angle=degrees(shear_rotation), Plane=PlaneXY(0, 0, 0))  # -> Geometry, Transform
move_2 = Move(Geometry=point_2, Motion=rotate.Geometry)  # -> Geometry, Transform
center_of_roof_displaced = Point(move_2.Geometry)
center_of_roof_original = Point(point_2)
center_of_object = Point(center_of_object_at_base)
shear = Shear(Geometry=geometry_3, Base=center_of_object, Grip=center_of_roof_original, Target=center_of_roof_displaced)  # -> Geometry, Transform
xy_plane = XYPlane(Origin=center_of_object)
mirror = Mirror(Geometry=shear.Geometry, Plane=xy_plane)  # -> Geometry, Transform
stream_filter = StreamFilter(Gate=boolean, Stream0=geometry_3, Stream1=mirror.Geometry)
sheared_object = Geometry(stream_filter)

xy_plane_2 = XYPlane(Origin=Point(0, 0, 0))
unit_z_3 = UnitZ(Factor=1)
brep_plane = BrepPlane(Brep=sheared_object, Plane=xy_plane_2)  # -> Curves, Points
contour = Contour(Shape=[sheared_object, rotate_3d.Geometry], Point=Point(0, 0, 0), Direction=unit_z_3, Distance="3")  # -> flatten(Contours)
brep = Brep(brep_plane.Curves)
boundary_surfaces = BoundarySurfaces(Edges=contour)

# ---- group: Hatch Group
boundary_surfaces_2 = BoundarySurfaces(Edges=brep)
vector_at_angle_2 = PythonScript(angle="45")  # -> vector; same code as vector_at_angle
contour_2 = Contour(Shape=boundary_surfaces_2, Point=Point(0, 0, 0), Direction=vector_at_angle_2, Distance="1")

# ----
make2d_rhino_view = Make2DRhinoView(Name="view 1", Clip=True)
make2d = Make2D(Geometry=boundary_surfaces, View=make2d_rhino_view, TangentEdges=False, TangentSeams=False, AutoComputeMake2D=False)  # -> VisibleCurves, VisibleIndex, VisibleType, HiddenCurves, HiddenIndex, HiddenType
make2d_2 = Make2D(
    Geometry=[sheared_object, rotate_3d.Geometry],
    View=make2d_rhino_view,
    TangentEdges=False,
    TangentSeams=False,
    AutoComputeMake2D=False)  # -> VisibleCurves, VisibleIndex, VisibleType, HiddenCurves, HiddenIndex, HiddenType
hatch_lines = Geometry(contour_2)
geometry_4 = Geometry(make2d.VisibleCurves)
geometry_5 = Geometry(make2d_2.VisibleCurves)

# ---- group: Preview and Bake
get_name = GhPythonScript(Component=hatch_lines)  # -> Geometry, Name
# ---------- get_name: Python ----------
# Mark Ericson 1.17.19
   #take from forum discussion thread https://www.grasshopper3d.com/forum/topics/python-get-label-name-of-input-components
    #edited version of code  by Mostapha Sadeghipour Roudsari

def GetComponentName():
    Comp = ghenv.Component.Params.Input[0]
    sources = Comp.Sources

    if sources.Count == 0: 
        return components

    for source in sources:
        attr = source.Attributes
        if (attr is None) or (attr.GetTopLevel is None):
            pass
        else:

            component = attr.GetTopLevel.DocObject
            componentName = component.NickName

            return componentName

if Component == None:
    pass
else:
    Name = GetComponentName()
    Geometry = Component
# ---------- end get_name ----------
linear_gradient = GhPythonScript(R="0", G="0", B="0", Percent="1")  # -> Color
# ---------- linear_gradient: Python ----------
__author__ = "ericsonm"
__version__ = "2019.01.15"

import rhinoscriptsyntax as rs

def LinearColorGradient(R,G,B,R2,G2,B2,ColorPercentage):
    
    if ColorPercentage > 1:
        R3 = None
        G3 = None
        B3 = None
    else:
        #This function defines linear color gradient by treating R,G,B as coordinates on a 3D line.
        #The base color that will be altered by the percentage should be entered in the second R2,G2,B2 valu
    
        Rdiff = float(R2) - float(R)
        Gdiff = float(G2) - float(G)
        Bdiff = float(B2) - float(B)


        t = float(ColorPercentage)


        R3 = float(R) + Rdiff*t
        G3 = float(G) + Gdiff*t
        B3 = float(B) + Bdiff*t



    return R3,G3,B3


if (R or G or B or Percent) is None:
    Color = None
else: 
    Color1 = LinearColorGradient(255,255,255,R,G,B,Percent)

    R3 = Color1[0]
    G3 = Color1[1]
    B3 = Color1[2]

    Color = rs.CreateColor(R3,G3,B3)
# ---------- end linear_gradient ----------
custom_preview = CustomPreview(Geometry=get_name.Geometry, Material=linear_gradient)

# ----
panel = Panel(get_name.Name)

# ---- group: Preview and Bake (continued)
object_bake = ObjectBake(
    BakeToggle=Button(),
    GeometryObjects=get_name.Geometry,
    Layer=panel,
    ObjectName=panel,
    ObjectColor=linear_gradient,
    LayerColor=linear_gradient)

# ----
custom_preview_lineweights = CustomPreviewLineweights(Geometry=get_name.Geometry, Shader=linear_gradient, Thickness=".0025", Absolute=Toggle(True))

# ---- group: Preview and Bake
get_name_2 = GhPythonScript(Component=circle_2)  # -> Geometry, Name; same code as get_name
linear_gradient_2 = GhPythonScript(R="0", G="0", B="0", Percent=".5")  # -> Color; same code as linear_gradient
custom_preview_2 = CustomPreview(Geometry=get_name_2.Geometry, Material=linear_gradient_2)

# ----
panel_2 = Panel(get_name_2.Name)

# ---- group: Preview and Bake (continued)
object_bake_2 = ObjectBake(
    BakeToggle=Button(),
    GeometryObjects=get_name_2.Geometry,
    Layer=panel_2,
    ObjectName=panel_2,
    ObjectColor=linear_gradient_2,
    LayerColor=linear_gradient_2)

# ----
custom_preview_lineweights_2 = CustomPreviewLineweights(Geometry=get_name_2.Geometry, Shader=linear_gradient_2, Thickness=".0025", Absolute=Toggle(True))

# ---- group: Preview and Bake
get_name_3 = GhPythonScript(Component=geometry_4)  # -> Geometry, Name; same code as get_name
linear_gradient_3 = GhPythonScript(R="0", G="0", B="0", Percent="1")  # -> Color; same code as linear_gradient
custom_preview_3 = CustomPreview(Geometry=get_name_3.Geometry, Material=linear_gradient_3)

# ----
panel_3 = Panel(get_name_3.Name)

# ---- group: Preview and Bake (continued)
object_bake_3 = ObjectBake(
    BakeToggle=Button(),
    GeometryObjects=get_name_3.Geometry,
    Layer=panel_3,
    ObjectName=panel_3,
    ObjectColor=linear_gradient_3,
    LayerColor=linear_gradient_3)

# ----
custom_preview_lineweights_3 = CustomPreviewLineweights(Geometry=get_name_3.Geometry, Shader=linear_gradient_3, Thickness=".0025", Absolute=Toggle(True))

# ---- group: Preview and Bake
get_name_4 = GhPythonScript(Component=geometry_5)  # -> Geometry, Name; same code as get_name
linear_gradient_4 = GhPythonScript(R="0", G="0", B="0", Percent="1")  # -> Color; same code as linear_gradient
custom_preview_4 = CustomPreview(Geometry=get_name_4.Geometry, Material=linear_gradient_4)

# ----
panel_4 = Panel(get_name_4.Name)

# ---- group: Preview and Bake (continued)
object_bake_4 = ObjectBake(
    BakeToggle=Button(),
    GeometryObjects=get_name_4.Geometry,
    Layer=panel_4,
    ObjectName=panel_4,
    ObjectColor=linear_gradient_4,
    LayerColor=linear_gradient_4)

# ----
custom_preview_lineweights_4 = CustomPreviewLineweights(Geometry=get_name_4.Geometry, Shader=linear_gradient_4, Thickness=".0025", Absolute=Toggle(True))
