# Grasshopper definition Part Fabrication.gh (Grasshopper 1.0.7)
# plug-ins: Bowerbird

point = Point("0,0,0")

# ---- group: scale
scaled = BooleanToggle(True)
feet_per_inch = Panel("20")
stream_filter = StreamFilter(Gate=scaled, Stream0="1", Stream1=feet_per_inch)

# ----
cone = Cone(Base=point, Radius="60", Length="80")  # -> Cone, Tip
cone_2 = Cone(Base=point, Radius="40", Length="60")  # -> Cone, Tip
circle = Circle(Plane=point, Radius="60")
cap_holes = CapHoles(Brep=cone.Cone)
cap_holes_2 = CapHoles(Brep=cone_2.Cone)
solid_difference = SolidDifference(BrepsA=cap_holes, BrepsB=cap_holes_2)
division = Division(A="1", B=stream_filter)
circle_2 = Circle(circle)
geometry = Geometry(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)

# ---- group: CUT
scale = Scale(Geometry=circle_2, Center=circle, Factor=division)  # -> Geometry, Transform
scale_2 = Scale(Geometry=geometry, Center=circle, Factor=division)  # -> Geometry, Transform
drawing_center = Point(point)
deconstruct_arc = DeconstructArc(Arc=scale.Geometry)  # -> BasePlane, Radius, Angle
multiplication = Multiplication(A=deconstruct_arc.Radius, B="2")
unit_z = UnitZ(Factor=multiplication)

# ---- group: CUT / cutter
unit_y = UnitY(Factor=1)
vector_at_angle = PythonScript(angle="0")  # -> vector
# ---------- vector_at_angle: Python ----------
import rhinoscriptsyntax as rs
import math
if angle == None:
    Vector = None
else:
    c=rs.AddPoint(0,0,0)
    f=math.radians(float(angle))
    l=rs.AddPoint(math.cos(f),math.sin(f),0)
    d=rs.VectorCreate(l,c)
    vector =rs.VectorUnitize(d)
# ---------- end vector_at_angle ----------
line_sdl = LineSDL(Start=drawing_center, Direction=unit_y, Length=multiplication)
line_sdl_2 = LineSDL(Start=drawing_center, Direction=vector_at_angle, Length=multiplication)
end_points = EndPoints(Curve=line_sdl)  # -> Start, End
end_points_2 = EndPoints(Curve=line_sdl_2)  # -> Start, End
line = Line(StartPoint=end_points.End, EndPoint=end_points_2.End)
join_curves = JoinCurves(Curves=[line_sdl_2, line, line_sdl], Preserve=False)

# ---- group: CUT (continued)
region_difference = RegionDifference(CurvesA=scale.Geometry, CurvesB=join_curves)
geometry_2 = Geometry(region_difference)

# ---- group: CUT / Cutting
extrude = Extrude(Base=join_curves, Direction=unit_z)
cap_holes_3 = CapHoles(Brep=extrude)
solid_difference_2 = SolidDifference(BrepsA=scale_2.Geometry, BrepsB=cap_holes_3)

extrude_2 = Extrude(Base=geometry_2, Direction=unit_z)
cap_holes_4 = CapHoles(Brep=extrude_2)
solid_difference_3 = SolidDifference(BrepsA=scale_2.Geometry, BrepsB=cap_holes_4)

# ----
_3d_print_part = Geometry(solid_difference_3)
laser_cut_part = Geometry(solid_difference_2)

# ---- group: Contour / Height of Object
bounding_box = BoundingBox(Content=laser_cut_part, Plane=PlaneXY(0, 0, 0))  # -> Box, Box_2
deconstruct_brep = DeconstructBrep(Brep=bounding_box.Box)  # -> Faces, Edges, Vertices
deconstruct = Deconstruct(Point=deconstruct_brep.Vertices)  # -> XComponent, YComponent, ZComponent
index_of_max = PythonScript(values=deconstruct.ZComponent)  # -> IMin, IMax; inputs values: list
# ---------- index_of_max: Python ----------
q=[values]
for i in values:
    IMax=list.index(values,max(values))
    IMin=list.index(values,min(values))
# ---------- end index_of_max ----------
list_item = ListItem(List=deconstruct.ZComponent, Index=index_of_max.IMax, Wrap=True)
list_item_2 = ListItem(List=deconstruct.ZComponent, Index=list_item, Wrap=True)

# ---- group: Contour
max_height_of_object = Number(list_item_2)

# ---- group: Contour / Create Planes
division_2 = Division(A=max_height_of_object, B=".0625")
series = Series(Start=0, Step=".0625", Count=division_2)
construct_point = ConstructPoint(XCoordinate=0, YCoordinate=0, ZCoordinate=series)
xy_plane = XYPlane(Origin=construct_point)

# ---- group: Contour (continued)
brep_plane = BrepPlane(Brep=laser_cut_part, Plane=xy_plane)  # -> Curves, Points

# ---- group: Move to plane / Locate points to move to
area = Area(Geometry=brep_plane.Curves)  # -> Area, flatten(Centroid)
list_length = ListLength(List=flatten(brep_plane.Curves))
point_2 = Point("0,0,0")
series_2 = Series(Start=0, Step="8", Count=list_length)  # -> flatten(Series)
unit_x = UnitX(Factor=series_2)
move = Move(Geometry=point_2, Motion=unit_x)  # -> Geometry, Transform
vector_2pt = Vector2Pt(PointA=area.Centroid, PointB=move.Geometry, Unitize=False)  # -> Vector, Length

# ---- group: Move to plane / Move and project
xy_plane_2 = XYPlane(Origin=Point(0, 0, 0))
move_2 = Move(Geometry=brep_plane.Curves, Motion=graft(vector_2pt.Vector))  # -> Geometry, Transform
project = Project(Geometry=move_2.Geometry, Plane=xy_plane_2)  # -> Geometry, Transform

# ----
geometry_3 = Geometry(flatten(project.Geometry))

# ---- group: locate point for text
point_on_curve = PointOnCurve(geometry_3, parameter=0.583)
unit_x_2 = UnitX(Factor="0")
move_3 = Move(Geometry=point_on_curve, Motion=unit_x_2)  # -> Geometry, Transform

# ----
area_2 = Area(Geometry=flatten(project.Geometry))  # -> Area, Centroid

# ---- group: text values
list_length_2 = ListLength(List=flatten(project.Geometry))
series_3 = Series(Start="1", Step="1", Count=list_length_2)
integer = Integer(series_3)

# ----
bb_text = BBText(Location=area_2.Centroid, Text=integer, Size=".125", Bold=False, HorizontalAlignment=0, VerticalAlignment=0)  # -> graft(Curves)
geometry_to_laser_cut = Geometry(project.Geometry)
text_curves_to_laser_cut = Geometry(bb_text)
group = Group(Objects=geometry_to_laser_cut)
