# Grasshopper definition Part fabrication_start.gh (Grasshopper 1.0.7)
# plug-ins: Bowerbird2

point = Point("0,0,0")

scale_object = BooleanToggle(True)
stream_filter = StreamFilter(Gate=scale_object, Stream0="1", Stream1="20")
division = Division(A="1", B=stream_filter)

cone = Cone(Base=point, Radius="60", Length="80")  # -> Cone, Tip
cone_2 = Cone(Base=point, Radius="40", Length="60")  # -> Cone, Tip
circle = Circle(Plane=point, Radius="60")
cap_holes = CapHoles(Brep=cone.Cone)
cap_holes_2 = CapHoles(Brep=cone_2.Cone)
solid_difference = SolidDifference(BrepsA=cap_holes, BrepsB=cap_holes_2)
geometry = Geometry(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)
scale = Scale(Geometry=circle, Center=Point(0, 0, 0), Factor=division)  # -> Geometry, Transform
scale_2 = Scale(Geometry=geometry, Center=Point(0, 0, 0), Factor=division)  # -> Geometry, Transform
drawing_center = Point(point)
circle_2 = Circle(scale.Geometry)
deconstruct_arc = DeconstructArc(Arc=circle_2)  # -> BasePlane, Radius, Angle
multiplication = Multiplication(A=deconstruct_arc.Radius, B="2")
vector_at_angle = PythonScript(angle="0")  # -> vector
# ---------- vector_at_angle: Python ----------
import rhinoscriptsyntax as rs
import math
if angle == None:
    Vector = None
else:
    c=rs.AddPoint(0,0,0)
    f=math.radians(float(angle))
    l=rs.AddPoint(math.cos(f),math.sin(f),0)
    d=rs.VectorCreate(l,c)
    vector =rs.VectorUnitize(d)
# ---------- end vector_at_angle ----------

# ---- group: cutter
unit_y = UnitY(Factor=1)
unit_x = UnitX(Factor=1)
line_sdl = LineSDL(Start=drawing_center, Direction=unit_y, Length=multiplication)
line_sdl_2 = LineSDL(Start=drawing_center, Direction=vector_at_angle, Length=multiplication)
end_points = EndPoints(Curve=line_sdl)  # -> Start, End
end_points_2 = EndPoints(Curve=line_sdl_2)  # -> Start, End
line = Line(StartPoint=end_points.End, EndPoint=end_points_2.End)
join_curves = JoinCurves(Curves=[line_sdl_2, line, line_sdl], Preserve=False)

# ---- group: cutting
region_difference = RegionDifference(CurvesA=circle_2, CurvesB=join_curves)
geometry_2 = Geometry(join_curves)
geometry_3 = Geometry(region_difference)
unit_z = UnitZ(Factor=multiplication)
extrude = Extrude(Base=geometry_2, Direction=unit_z)
extrude_2 = Extrude(Base=geometry_3, Direction=unit_z)
cap_holes_3 = CapHoles(Brep=extrude)
cap_holes_4 = CapHoles(Brep=extrude_2)
solid_difference_2 = SolidDifference(BrepsA=scale_2.Geometry, BrepsB=cap_holes_4)
solid_difference_3 = SolidDifference(BrepsA=scale_2.Geometry, BrepsB=cap_holes_3)

# ----
object_ot_print = Geometry(solid_difference_2)
object_to_cut = Geometry(solid_difference_3)

# ---- group: contouring
bounding_box = BoundingBox(Content=object_to_cut, Plane=PlaneXY(0, 0, 0))  # -> Box, Box_2
deconstruct_brep = DeconstructBrep(Brep=bounding_box.Box)  # -> Faces, Edges, Vertices
deconstruct = Deconstruct(Point=deconstruct_brep.Vertices)  # -> XComponent, YComponent, ZComponent
index_of_max = PythonScript(values=deconstruct.ZComponent)  # -> IMin, IMax; inputs values: list
# ---------- index_of_max: Python ----------
q=[values]
for i in values:
    IMax=list.index(values,max(values))
    IMin=list.index(values,min(values))
# ---------- end index_of_max ----------
list_item = ListItem(List=deconstruct.ZComponent, Index=index_of_max.IMax, Wrap=True)
division_2 = Division(A=list_item, B=".0625")
series = Series(Start="0", Step=".0625", Count=division_2)
construct_point = ConstructPoint(XCoordinate=0, YCoordinate=0, ZCoordinate=series)
xy_plane = XYPlane(Origin=construct_point)
brep_plane = BrepPlane(Brep=object_to_cut, Plane=xy_plane)  # -> Curves, Points

# ----
geometry_4 = Geometry(brep_plane.Curves)

# ---- group: move objects to xy plane
list_length = ListLength(List=flatten(geometry_4))
series_2 = Series(Start=0, Step="8", Count=list_length)  # -> flatten(Series)
point_2 = Point("0,0,0")
area = Area(Geometry=geometry_4)  # -> Area, flatten(Centroid)
unit_x_2 = UnitX(Factor=series_2)
move = Move(Geometry=point_2, Motion=unit_x_2)  # -> Geometry, Transform
vector_2pt = Vector2Pt(PointA=area.Centroid, PointB=move.Geometry, Unitize=False)  # -> Vector, Length
move_2 = Move(Geometry=geometry_4, Motion=graft(vector_2pt.Vector))  # -> Geometry, Transform
xy_plane_2 = XYPlane(Origin=Point(0, 0, 0))
project = Project(Geometry=move_2.Geometry, Plane=xy_plane_2)  # -> Geometry, Transform

# ---- group: label contours
area_2 = Area(Geometry=project.Geometry)  # -> Area, Centroid
list_length_2 = ListLength(List=flatten(area_2.Centroid))
panel = Panel(area_2.Centroid)
series_3 = Series(Start="1", Step="1", Count=list_length_2)
integer = Integer(series_3)
bb_text = BBText(Location=flatten(area_2.Centroid), Text=integer, Size=".125", Bold=False, HorizontalAlignment=0, VerticalAlignment=0)

# ----
group = Group(Objects=project.Geometry)
text_to_engrave = Geometry(bb_text)
profiles = Geometry(group)
