# Grasshopper definition Ericson_inclass.gh (Grasshopper 1.0.7)

python = GhPythonScript(
    radiusX="20",
    radiusY="20",
    centerX="0",
    centerY="0",
    centerZ="0",
    start="0",
    stop="360",
    sides="3",
    centerline=Toggle(False))  # -> points, polyline
# ---------- python: Python ----------
__author__ = "ericsonm"
__version__ = "2020.01.13"

import rhinoscriptsyntax as rs
import math

#creates a circle based on trigonmetric funtions.
#returns (points, polyline, center, start, end, lines)

def TrigCircle(radiusX,radiusY,centerX,centerY,centerZ,start,stop,sides,centerline):
    
    sa = float(start)
    so = float(stop) + sa
    se = float(stop)/float(sides)
    
    rx = float(radiusX)
    ry = float(radiusY)
    
    cx = float(centerX)
    cy = float(centerY)
    cz = float(centerZ)
    
    #add center point
    rs.AddPoint(cx,cy,cz)
    
    #create an empty list in which to collect the points
    points =[]
    for i in rs.frange(math.radians(sa), math.radians(so), math.radians(se)):
        p = rs.AddPoint(math.cos(i)*rx + cx, math.sin(i)*ry + cy, cz)
        points.append(p)
        
    #Add polyline to the points

    polyline = rs.AddPolyline(points)
    
    return (points, polyline)
    
Circle = TrigCircle(radiusX,radiusY,centerX,centerY,centerZ,start,stop,sides,centerline)

points  =  Circle[0]
polyline = Circle[1]
# ---------- end python ----------
