# Grasshopper definition Python_Trig Circle.gh (Grasshopper 1.0.7)

trig_circle = GhPythonScript(
    radiusX="50",
    radiusY="50",
    centerX="0",
    centerZ="0",
    centerY="0",
    start="0",
    stop="180",
    step="10",
    centerline=Toggle(False))  # -> points, polyline, center, start, lines, end
# ---------- trig_circle: Python ----------
__author__ = "mericson"
__version__ = "2019.01.07"

import rhinoscriptsyntax as rs
import math

#convert values to float

sa = float(start) 
so = float(stop)
se = float(step)

rx = float(radiusX)
ry = float(radiusY)

cx = float(centerX)
cy = float(centerY)
cz = float(centerZ)

#add center point
center = rs.AddPoint(cx,cy,cz)

#create an empty list in which to collect the points
points = []
#create points using sine, cosine and range
for i in rs.frange(math.radians(sa), math.radians(so),math.radians(se)):
    p = rs.AddPoint(math.cos(i)*rx + cx, math.sin(i)*ry + cy, cz)
    points.append(p)

#Add polyline to the points
polyline = rs.AddPolyline(points)


#Add optional centerline
if centerline:
    lines = []
    for i in points:
        l = rs.AddLine(center,i)
        lines.append(l)
        rs.ObjectColor(polyline,255,200,0)
#select the first point on the circle
start = points[0]
#get the index of the last point in the circle
m = len(points) - 1
#select the last point in the circle with the index
end = points[m]
# ---------- end trig_circle ----------
trig_circle_2 = GhPythonScript(
    radiusX="50",
    radiusY="50",
    centerX="0",
    centerZ="0",
    centerY="0",
    start="0",
    stop="180",
    sides="18",
    centerline=Toggle(False))  # -> points, polyline, center, start, lines, end
# ---------- trig_circle_2: Python ----------
                
                
__author__ = "mericson"
__version__ = "2019.01.07"
                
import rhinoscriptsyntax as rs
import math
#creates a circle based on trigonmetric functions
#returns (points,polyline,center,start,end,lines)
def TrigCircle(radiusX,radiusY,centerX,centerY,centerZ,start,stop,sides,centerline):
                    
    sa = float(start) 
    so = float(stop) + sa
    se = float(stop)/float(sides)
                
    rx = float(radiusX)
    ry = float(radiusY)
                
    cx = float(centerX)
    cy = float(centerY)
    cz = float(centerZ)
                
    #add center point
    center = rs.AddPoint(cx,cy,cz)
                
    #create an empty list in which to collect the points
    points = []
    #create points using sine, cosine and range
    for i in rs.frange(math.radians(sa), math.radians(so),math.radians(se)):
        p = rs.AddPoint(math.cos(i)*rx + cx, math.sin(i)*ry + cy, cz)
        points.append(p)
                
                
                
    #Add polyline to the points
    polyline = rs.AddPolyline(points)
                
                
                
    #select the first point on the circle
    start = points[0]
    
    #get the index of the last point in the circle
    m = len(points) - 1
    
    #select the last point in the circle with the index
    end = points[m]
    
    #adds centerlines to the circle
    lines = []
    if centerline:
        for i in points:
            l = rs.AddLine(center,i)
            lines.append(l)
    else:
        lines = None

    return(points,polyline,center,start,end,lines)
                
                
                
#calls the function
circle = TrigCircle(radiusX,radiusY,centerX,centerY,centerZ,start,stop,sides,centerline)
                
#retrieves each item returned from the function and assigns it to an output
points   = circle[0]
polyline = circle[1]
center   = circle[2]
start    = circle[3]
end      = circle[4]
lines    = circle[5]
# ---------- end trig_circle_2 ----------
geometry = Geometry(trig_circle_2.center)
geometry_2 = Geometry(trig_circle_2.points)
geometry_3 = Geometry(trig_circle_2.lines)
geometry_4 = Geometry(trig_circle_2.polyline)
