# Grasshopper definition Anet.gh (Grasshopper 1.0.7)
# plug-ins: Human, LunchBox

panel = Panel("""0
180""")
series = BooleanToggle(True)
panel_2 = Panel("36")
panel_3 = Panel("36")
trig_circle = GhPythonScript(
    radiusX="50",
    radiusY="50",
    centerX="0",
    centerZ="0",
    centerY="0",
    start=panel,
    stop="180",
    sides="36",
    centerline=Toggle(False))  # -> points, graft(polyline), center, start, lines, end
# ---------- trig_circle: Python ----------
                
                
__author__ = "mericson"
__version__ = "2019.01.07"
                
import rhinoscriptsyntax as rs
import math
#creates a circle based on trigonmetric functions
#returns (points,polyline,center,start,end,lines)
def TrigCircle(radiusX,radiusY,centerX,centerY,centerZ,start,stop,sides,centerline):
                    
    sa = float(start) 
    so = float(stop) + sa
    se = float(stop)/float(sides)
                
    rx = float(radiusX)
    ry = float(radiusY)
                
    cx = float(centerX)
    cy = float(centerY)
    cz = float(centerZ)
                
    #add center point
    center = rs.AddPoint(cx,cy,cz)
                
    #create an empty list in which to collect the points
    points = []
    #create points using sine, cosine and range
    for i in rs.frange(math.radians(sa), math.radians(so),math.radians(se)):
        p = rs.AddPoint(math.cos(i)*rx + cx, math.sin(i)*ry + cy, cz)
        points.append(p)
                
                
                
    #Add polyline to the points
    polyline = rs.AddPolyline(points)
                
                
                
    #select the first point on the circle
    start = points[0]
    
    #get the index of the last point in the circle
    m = len(points) - 1
    
    #select the last point in the circle with the index
    end = points[m]
    
    #adds centerlines to the circle
    lines = []
    if centerline:
        for i in points:
            l = rs.AddLine(center,i)
            lines.append(l)
    else:
        lines = None

    return(points,polyline,center,start,end,lines)
                
                
                
#calls the function
circle = TrigCircle(radiusX,radiusY,centerX,centerY,centerZ,start,stop,sides,centerline)
                
#retrieves each item returned from the function and assigns it to an output
points   = circle[0]
polyline = circle[1]
center   = circle[2]
start    = circle[3]
end      = circle[4]
lines    = circle[5]
# ---------- end trig_circle ----------
multiplication = Multiplication(A="50", B=".75")
linear_loop = PythonScript(reset=Toggle(False), Interval="100", Inc=Slider(1, range=0..10), Max=panel_2, Min="0", Iterations=panel_3)  # -> Val
# ---------- linear_loop: Python ----------
#this timer loop stops when either the number of iterations are reached or the boolean condition is set true.
#The update also stops preventing the last element in the list from being duplicated indefinitely.
import time
import Grasshopper as gh


def updateComponent():
    
    """ Updates this component, similar to using a grasshopper timer """
    
    # Define callback action
    def callBack(e):
        ghenv.Component.ExpireSolution(False)
        
    # Get grasshopper document
    ghDoc = ghenv.Component.OnPingDocument()
    
    # Schedule this component to expire
    ghDoc.ScheduleSolution(int(Interval),gh.Kernel.GH_Document.GH_ScheduleDelegate(callBack))

#sets the starting point of the counter
if reset:
    counter = float(Min)
    it = 0
#adds the increment to counter
else:
    counter += float(Inc)
    it += float(Inc)
    
#reverses the count in the negative direction
if counter > float(Max):
    counter = float(-Max)
    
#reverses the count in the positive direction
if abs (counter) <  float(Min):
    counter = float(Min)
    
#provides an output
Val = abs(counter)

print it
#stops and start the update
if it< float(Iterations) and not reset:
    updateComponent()
# ---------- end linear_loop ----------
geometry = Geometry(trig_circle.center)
panel_4 = Panel(linear_loop)
list_item = ListItem(List=geometry, Index=0, Wrap=True)
explode_tree = ExplodeTree(Data=trig_circle.polyline)  # -> Branch0, Branch1
explode_tree_2 = ExplodeTree(Data=trig_circle.points)  # -> Branch0, Branch1
section_points = Point(explode_tree_2.Branch0)
plan_points = Point(explode_tree_2.Branch1)
section = Curve(explode_tree.Branch0)
plan = Curve(explode_tree.Branch1)

# ---- group: List mid point
list_length = ListLength(List=plan_points)
subtraction = Subtraction(A=list_length, B="1")
division = Division(A=subtraction, B="2")

# ----
geometry_2 = Geometry([section, plan])
stream_filter = StreamFilter(Gate=series, Stream0=division, Stream1=panel_4)
list_item_2 = ListItem(List=plan_points, Index=stream_filter, Wrap=True)
vector_2pt = Vector2Pt(PointA=list_item_2, PointB=list_item, Unitize=False)  # -> Vector, Length
line_sdl = LineSDL(Start=list_item_2, Direction=vector_2pt.Vector, Length=multiplication)
point_on_curve = PointOnCurve(line_sdl, parameter=0.5)
distance = Distance(PointA=list_item_2, PointB=point_on_curve)
subtraction_2 = Subtraction(A=list_length, B="1")
circle = Circle(Plane=point_on_curve, Radius=distance)
divide_curve = DivideCurve(Curve=circle, Count=subtraction_2, Kinks=False)  # -> Points, Tangents, Parameters
distance_2 = Distance(PointA=list_item, PointB=divide_curve.Points)
radians = Radians(Degrees="-180")
arc = Arc(Plane=list_item, Radius=distance_2, Angle=radians)  # -> Arc, Length
end_points = EndPoints(Curve=arc.Arc)  # -> Start, End
unit_y = UnitY(Factor=1)
projection = PythonScript(points=end_points.Start, geometry=section, vector=unit_y)  # -> lines
# ---------- projection: Python ----------
import rhinoscriptsyntax as rs
import math
if (points or geometry or vector) == None:
    lines = None
else:

    d= vector
    n=rs.VectorUnitize(d)
    e=rs.ExtrudeCurveStraight(geometry,(0,0,0),(0,0,1))
    q=rs.ProjectPointToSurface(points,e,n)
    p2=rs.AddPoints(q)
    for i in p2:
        lines=rs.AddLine(points,i)
    if p2:
        del p2
# ---------- end projection ----------
projection_2 = PythonScript(points=end_points.End, geometry=section, vector=unit_y)  # -> lines; same code as projection
end_points_2 = EndPoints(Curve=projection)  # -> Start, End
end_points_3 = EndPoints(Curve=projection_2)  # -> Start, End
geometry_3 = Geometry([projection_2, projection, arc.Arc])
line = Line(StartPoint=end_points_2.End, EndPoint=end_points_3.End)
unit_y_2 = UnitY(Factor=1)
projection_3 = PythonScript(points=graft(divide_curve.Points), geometry=graft(line), vector=unit_y_2)  # -> lines; same code as projection
end_points_4 = EndPoints(Curve=projection_3)  # -> Start, End
get_y = PythonScript(point=end_points_4.End)  # -> Y; inputs point: Point3d
# ---------- get_y: Python ----------
import Rhino as rh




Y = (rh.Geometry.Point3d.Y.GetValue(point))
# ---------- end get_y ----------
move_point = PythonScript(point=divide_curve.Points, Z1=flatten(get_y))  # -> NPoint; inputs point: Point3d
# ---------- move_point: Python ----------
#moves point by adding to x, y, and z values. 
import rhinoscriptsyntax as rs
import Rhino as rh
if point == None:
    point = rh.Geometry.Point3d(0,0,0)
if X1 == None:
    X1 = 0
if Y1 == None:
    Y1 = 0
if Z1 == None:
    Z1 = 0


x = (rh.Geometry.Point3d.X.GetValue(point)) + float(X1)
y = (rh.Geometry.Point3d.Y.GetValue(point)) + float(Y1)
z = (rh.Geometry.Point3d.Z.GetValue(point)) + float(Z1)

NPoint = rs.AddPoint(x,y,z)
# ---------- end move_point ----------
polyline = PolyLine(Vertices=move_point, Closed=Toggle(True))
polyline_2 = PolyLine(Vertices=flatten(end_points_4.End), Closed=Toggle(True))

# ---- group: Preview and Bake
get_name = GhPythonScript(Component=polyline)  # -> Geometry, Name
# ---------- get_name: Python ----------
# Mark Ericson 1.17.19
   #take from forum discussion thread https://www.grasshopper3d.com/forum/topics/python-get-label-name-of-input-components
    #edited version of code  by Mostapha Sadeghipour Roudsari

def GetComponentName():
    Comp = ghenv.Component.Params.Input[0]
    sources = Comp.Sources

    if sources.Count == 0: 
        return components

    for source in sources:
        attr = source.Attributes
        if (attr is None) or (attr.GetTopLevel is None):
            pass
        else:

            component = attr.GetTopLevel.DocObject
            componentName = component.NickName

            return componentName

if Component == None:
    pass
else:
    Name = GetComponentName()
    Geometry = Component
# ---------- end get_name ----------
linear_gradient = GhPythonScript(R="0", G="0", B="0", Percent="1")  # -> Color
# ---------- linear_gradient: Python ----------
__author__ = "ericsonm"
__version__ = "2019.01.15"

import rhinoscriptsyntax as rs

def LinearColorGradient(R,G,B,R2,G2,B2,ColorPercentage):
    
    if ColorPercentage > 1:
        R3 = None
        G3 = None
        B3 = None
    else:
        #This function defines linear color gradient by treating R,G,B as coordinates on a 3D line.
        #The base color that will be altered by the percentage should be entered in the second R2,G2,B2 valu
    
        Rdiff = float(R2) - float(R)
        Gdiff = float(G2) - float(G)
        Bdiff = float(B2) - float(B)


        t = float(ColorPercentage)


        R3 = float(R) + Rdiff*t
        G3 = float(G) + Gdiff*t
        B3 = float(B) + Bdiff*t



    return R3,G3,B3


if (R or G or B or Percent) is None:
    Color = None
else: 
    Color1 = LinearColorGradient(255,255,255,R,G,B,Percent)

    R3 = Color1[0]
    G3 = Color1[1]
    B3 = Color1[2]

    Color = rs.CreateColor(R3,G3,B3)
# ---------- end linear_gradient ----------
custom_preview = CustomPreview(Geometry=get_name.Geometry, Material=linear_gradient)

# ----
panel_5 = Panel(get_name.Name)

# ---- group: Preview and Bake (continued)
object_bake = ObjectBake(
    BakeToggle=Button(),
    GeometryObjects=get_name.Geometry,
    Layer=panel_5,
    ObjectName=panel_5,
    ObjectColor=linear_gradient,
    LayerColor=linear_gradient)

# ----
custom_preview_lineweights = CustomPreviewLineweights(Geometry=get_name.Geometry, Shader=linear_gradient, Thickness=".1", Absolute=Toggle(True))

# ---- group: Preview and Bake
get_name_2 = GhPythonScript(Component=polyline_2)  # -> Geometry, Name; same code as get_name
linear_gradient_2 = GhPythonScript(R="0", G="0", B="0", Percent="1")  # -> Color; same code as linear_gradient
custom_preview_2 = CustomPreview(Geometry=get_name_2.Geometry, Material=linear_gradient_2)

# ----
panel_6 = Panel(get_name_2.Name)

# ---- group: Preview and Bake (continued)
object_bake_2 = ObjectBake(
    BakeToggle=Button(),
    GeometryObjects=get_name_2.Geometry,
    Layer=panel_6,
    ObjectName=panel_6,
    ObjectColor=linear_gradient_2,
    LayerColor=linear_gradient_2)

# ----
custom_preview_lineweights_2 = CustomPreviewLineweights(Geometry=get_name_2.Geometry, Shader=linear_gradient_2, Thickness=".1", Absolute=Toggle(True))

# ---- group: Preview and Bake
get_name_3 = GhPythonScript(Component=line)  # -> Geometry, Name; same code as get_name
linear_gradient_3 = GhPythonScript(R="0", G="0", B="0", Percent=".5")  # -> Color; same code as linear_gradient
custom_preview_3 = CustomPreview(Geometry=get_name_3.Geometry, Material=linear_gradient_3)

# ----
panel_7 = Panel(get_name_3.Name)

# ---- group: Preview and Bake (continued)
object_bake_3 = ObjectBake(
    BakeToggle=Button(),
    GeometryObjects=get_name_3.Geometry,
    Layer=panel_7,
    ObjectName=panel_7,
    ObjectColor=linear_gradient_3,
    LayerColor=linear_gradient_3)

# ----
custom_preview_lineweights_3 = CustomPreviewLineweights(Geometry=get_name_3.Geometry, Shader=linear_gradient_3, Thickness=".0025", Absolute=Toggle(True))

# ---- group: Preview and Bake
get_name_4 = GhPythonScript(Component=circle)  # -> Geometry, Name; same code as get_name
linear_gradient_4 = GhPythonScript(R="0", G="0", B="0", Percent=".5")  # -> Color; same code as linear_gradient
custom_preview_4 = CustomPreview(Geometry=get_name_4.Geometry, Material=linear_gradient_4)

# ----
panel_8 = Panel(get_name_4.Name)

# ---- group: Preview and Bake (continued)
object_bake_4 = ObjectBake(
    BakeToggle=Button(),
    GeometryObjects=get_name_4.Geometry,
    Layer=panel_8,
    ObjectName=panel_8,
    ObjectColor=linear_gradient_4,
    LayerColor=linear_gradient_4)

# ----
custom_preview_lineweights_4 = CustomPreviewLineweights(Geometry=get_name_4.Geometry, Shader=linear_gradient_4, Thickness=".0025", Absolute=Toggle(True))

# ---- group: Preview and Bake
get_name_5 = GhPythonScript(Component=geometry_3)  # -> Geometry, Name; same code as get_name
linear_gradient_5 = GhPythonScript(R="0", G="0", B="0", Percent=".5")  # -> Color; same code as linear_gradient
custom_preview_5 = CustomPreview(Geometry=get_name_5.Geometry, Material=linear_gradient_5)

# ----
panel_9 = Panel(get_name_5.Name)

# ---- group: Preview and Bake (continued)
object_bake_5 = ObjectBake(
    BakeToggle=Button(),
    GeometryObjects=get_name_5.Geometry,
    Layer=panel_9,
    ObjectName=panel_9,
    ObjectColor=linear_gradient_5,
    LayerColor=linear_gradient_5)

# ----
custom_preview_lineweights_5 = CustomPreviewLineweights(Geometry=get_name_5.Geometry, Shader=linear_gradient_5, Thickness=".0025", Absolute=Toggle(True))

# ---- group: Preview and Bake
get_name_6 = GhPythonScript(Component=geometry_2)  # -> Geometry, Name; same code as get_name
linear_gradient_6 = GhPythonScript(R="0", G="0", B="0", Percent="1")  # -> Color; same code as linear_gradient
custom_preview_6 = CustomPreview(Geometry=get_name_6.Geometry, Material=linear_gradient_6)

# ----
panel_10 = Panel(get_name_6.Name)

# ---- group: Preview and Bake (continued)
object_bake_6 = ObjectBake(
    BakeToggle=Button(),
    GeometryObjects=get_name_6.Geometry,
    Layer=panel_10,
    ObjectName=panel_10,
    ObjectColor=linear_gradient_6,
    LayerColor=linear_gradient_6)

# ----
custom_preview_lineweights_6 = CustomPreviewLineweights(Geometry=get_name_6.Geometry, Shader=linear_gradient_6, Thickness=".0025", Absolute=Toggle(True))
