# Grasshopper definition Ericson_Circle_150119.gh (Grasshopper 1.0.7)

panel = Panel("""5
3""")
trig_circle = GhPythonScript(
    radiusX=panel,
    radiusY=panel,
    centerX="0",
    centerY="0",
    centerZ="0",
    start="0",
    stop="180",
    sides="18",
    centerline=Toggle(True))  # -> simplify(points), start, center, end, lines, graft(polyline)
# ---------- trig_circle: Python ----------
__author__ = "ericsonm"
__version__ = "2020.01.13"

import rhinoscriptsyntax as rs
import math

#creates a circle based on trigonmetric funtions.
#returns (points, polyline, center, start, end, lines)

def TrigCircle(radiusX,radiusY,centerX,centerY,centerZ,start,stop,sides,centerline):
    
    sa = float(start)
    so = float(stop) + sa
    se = float(stop)/float(sides)
    
    rx = float(radiusX)
    ry = float(radiusY)
    
    cx = float(centerX)
    cy = float(centerY)
    cz = float(centerZ)
    
    #add center point
    center = rs.AddPoint(cx,cy,cz)
    
    #create an empty list in which to collect the points
    points =[]
    for i in rs.frange(math.radians(sa), math.radians(so), math.radians(se)):
        p = rs.AddPoint(math.cos(i)*rx + cx, math.sin(i)*ry + cy, cz)
        points.append(p)
        
    #Add polyline to the points

    polyline = rs.AddPolyline(points)
    
    #select first point in the circle:
    start = points[0]
    #get the index of the last point in the circle:
    m = len(points) - 1
        
    #select the last point in the circel with index
    end = points[m]
    
    #add the centerlines to the circle
    lines = [] 
    if centerline:
        for i in points:
            l = rs.AddLine(center,i)
            lines.append(l)
    else:
        lines = None
    return (points, polyline,start,center,end,lines)

#do nothing when no radius is provided
if radiusX == None:
    pass
else: 

#call the function 
    Circle = TrigCircle(radiusX,radiusY,centerX,centerY,centerZ,start,stop,sides,centerline)

#assign the outputs
    points   =   Circle[0]
    polyline =   Circle[1]
    start    =   Circle[2]
    center   =   Circle[3]
    end      =   Circle[4]
    lines    =   Circle[5]
# ---------- end trig_circle ----------
