# Grasshopper definition List Explanation in class.gh (Grasshopper 1.0.7)

series = Series(Start="0", Step="200", Count="8")
panel = Panel(series)
number = Number(graft(panel))
number_2 = Number(panel)
panel_2 = Panel(number)
multiplication = Multiplication(A=panel_2, B=panel)
multiplication_2 = Multiplication(A=panel, B=number_2)
panel_3 = Panel(multiplication_2)
panel_4 = Panel(multiplication)
list_item = ListItem(List=panel_3, Index="2", Wrap=True)
list_item_2 = ListItem(List=panel_4, Index="2", Wrap=True)  # -> flatten(Item)
panel_5 = Panel(list_item)
panel_6 = Panel(list_item_2)
