# Grasshopper definition Trig_Circle_GHVersion.gh (Grasshopper 1.0.7)

start = Panel("0")
point_coordinates = Panel("0,0,0")
radius_x = Panel("10")
radius_y = Panel("10")
stop = Panel("180")
sides = Panel("18")
start_2 = Panel("0")
point_coordinates_2 = Panel("0,0,0")
radius_x_2 = Panel("10")
radius_y_2 = Panel("10")
stop_2 = Panel("180")
sides_2 = Panel("18")
# Define the inputs
centerline = Boolean(Toggle(True))
centerline_2 = Boolean(Toggle(True))
point = Point(point_coordinates)
radiusx = Number(radius_x)
radiusy = Number(radius_y)
start_3 = Number(start)
stop_3 = Number(stop)
sides_3 = Number(sides)
point_2 = Point(point_coordinates_2)
radiusx_2 = Number(radius_x_2)
radiusy_2 = Number(radius_y_2)
start_4 = Number(start_2)
stop_4 = Number(stop_2)
sides_4 = Number(sides_2)
centerline_3 = Boolean(centerline)
point_3 = Point(point)
radiusx_3 = Number(radiusx)
radiusy_3 = Number(radiusy)
start_5 = Number(start_3)
stop_5 = Number(stop_3)
sides_5 = Number(sides_3)
# add one additional step to complete the revolution
panel = Panel("1")
trig_circle = TrigCircle(centerline=centerline_2, point=point_2, radiusx=radiusx_2, radiusy=radiusy_2, start=start_4, stop=stop_4, sides=sides_4)  # -> lines_2, start_4, center_2, end_2, polyline_3
division = Division(A=stop_5, B=sides_5)
# extract the coordinates from center point
deconstruct = Deconstruct(Point=point_3)  # -> XComponent, YComponent, ZComponent
panel_2 = Panel(division)
addition = Addition(A=sides_5, B=panel)
# generate a list of values and convert radians
series = Series(Start=start_5, Step=panel_2, Count=addition)
radians = Radians(Degrees=series)
cosine = Cosine(Value=radians)
# find the sine and cosine of the values and
# multiply by the radius to find the x and y coordinates
sine = Sine(Value=radians)
multiplication = Multiplication(A=radiusx_3, B=cosine)
multiplication_2 = Multiplication(A=radiusy_3, B=sine)
addition_2 = Addition(A=deconstruct.XComponent, B=multiplication)
addition_3 = Addition(A=deconstruct.YComponent, B=multiplication_2)
# generate a list of points around the circle
construct_point = ConstructPoint(XCoordinate=addition_2, YCoordinate=addition_3, ZCoordinate=0)
# create a boolean gate for controlling the centerlines
stream_filter = StreamFilter(Gate=centerline_3, Stream1=point_3)
# construct a polyline through the list of points
polyline = PolyLine(Vertices=construct_point, Closed=False)
line = Line(StartPoint=stream_filter, EndPoint=construct_point)
# Find the length of the list and subtract 1 to obtain the index of the last item in the list
list_length = ListLength(List=construct_point)
subtraction = Subtraction(A=list_length, B="1")
list_item = ListItem(List=construct_point, Index=0, Wrap=True)
list_item_2 = ListItem(List=construct_point, Index=subtraction, Wrap=True)
polyline_2 = Curve(polyline)
# Define the outputs
lines = Line(line)
start_6 = Point(list_item)
center = Point(point_3)
end = Point(list_item_2)
polyline_3 = Curve(polyline_2)
lines_2 = Line(lines)
start_7 = Point(start_6)
center_2 = Point(center)
end_2 = Point(end)

# ==== cluster TrigCircle
# Define the inputs
centerline = ClusterInput()
point = ClusterInput()
radiusx = ClusterInput()
radiusy = ClusterInput()
start = ClusterInput()
stop = ClusterInput()
sides = ClusterInput()
centerline_2 = Boolean(centerline)
point_2 = Point(point)
radiusx_2 = Number(radiusx)
radiusy_2 = Number(radiusy)
start_2 = Number(start)
stop_2 = Number(stop)
sides_2 = Number(sides)
# add one additional step to complete the revolution
panel = Panel("1")
division = Division(A=stop_2, B=sides_2)
# extract the coordinates from center point
deconstruct = Deconstruct(Point=point_2)  # -> XComponent, YComponent, ZComponent
panel_2 = Panel(division)
addition = Addition(A=sides_2, B=panel)
# generate a list of values and convert radians
series = Series(Start=start_2, Step=panel_2, Count=addition)
radians = Radians(Degrees=series)
cosine = Cosine(Value=radians)
# find the sine and cosine of the values and
# multiply by the radius to find the x and y coordinates
sine = Sine(Value=radians)
multiplication = Multiplication(A=radiusx_2, B=cosine)
multiplication_2 = Multiplication(A=radiusy_2, B=sine)
addition_2 = Addition(A=deconstruct.XComponent, B=multiplication)
addition_3 = Addition(A=deconstruct.YComponent, B=multiplication_2)
# generate a list of points around the circle
construct_point = ConstructPoint(XCoordinate=addition_2, YCoordinate=addition_3, ZCoordinate=0)
# create a boolean gate for controlling the centerlines
stream_filter = StreamFilter(Gate=centerline_2, Stream1=point_2)
# construct a polyline through the list of points
polyline = PolyLine(Vertices=construct_point, Closed=False)
line = Line(StartPoint=stream_filter, EndPoint=construct_point)
# Find the length of the list and subtract 1 to obtain the index of the last item in the list
list_length = ListLength(List=construct_point)
subtraction = Subtraction(A=list_length, B="1")
list_item = ListItem(List=construct_point, Index=0, Wrap=True)
list_item_2 = ListItem(List=construct_point, Index=subtraction, Wrap=True)
polyline_2 = Curve(polyline)
# Define the outputs
lines = Line(line)
start_3 = Point(list_item)
center = Point(point_2)
end = Point(list_item_2)
polyline_3 = ClusterOutput(polyline_2)
lines_2 = ClusterOutput(lines)
start_4 = ClusterOutput(start_3)
center_2 = ClusterOutput(center)
end_2 = ClusterOutput(end)
