# Grasshopper definition Python_split list to center.gh (Grasshopper 0.9.76)
# plug-ins: Python Interpreter

split_list_to_center = PythonScript()  # -> p1, p2; inputs points: list
# ---------- split_list_to_center: Python ----------
import math
import rhinoscriptsyntax as rs
q=points
x=len(q)
r=int(x/2)
p1=q[:x-r]
p2=q[x-r-1:]
# ---------- end split_list_to_center ----------
