# Grasshopper definition python_recorder.gh (Grasshopper 1.0.7)

recorder = GhPythonScript(record=Toggle(False))  # -> Data; inputs geometry: GeometryBase
# ---------- recorder: Python ----------
__author__ = "mericson"
__version__ = "2019.01.25"

import rhinoscriptsyntax as rs
import ghpythonlib as ghp


if record == True:
    Data = []
    Data.append(geometry)
else:
    Data = geometry
# ---------- end recorder ----------
