# Grasshopper definition 01_1_Projection_Arch 563_3742.gh (Grasshopper 1.0.7)
# plug-ins: Human, LunchBox

linear_loop = PythonScript(
    reset=Toggle(True),
    Interval="100",
    Inc=Slider(1, range=0..10),
    Max=Slider(50, range=0..360),
    Min=Slider(0, range=0..360),
    Iterations="50")  # -> Val
# ---------- linear_loop: Python ----------
#this timer loop stops when either the number of iterations are reached or the boolean condition is set true.
#The update also stops preventing the last element in the list from being duplicated indefinitely.
import time
import Grasshopper as gh


def updateComponent():
    
    """ Updates this component, similar to using a grasshopper timer """
    
    # Define callback action
    def callBack(e):
        ghenv.Component.ExpireSolution(False)
        
    # Get grasshopper document
    ghDoc = ghenv.Component.OnPingDocument()
    
    # Schedule this component to expire
    ghDoc.ScheduleSolution(int(Interval),gh.Kernel.GH_Document.GH_ScheduleDelegate(callBack))

#sets the starting point of the counter
if reset:
    counter = float(Min)
    it = 0
#adds the increment to counter
else:
    counter += float(Inc)
    it += float(Inc)
    
#reverses the count in the negative direction
if counter > float(Max):
    counter = float(-Max)
    
#reverses the count in the positive direction
if abs (counter) <  float(Min):
    counter = float(Min)
    
#provides an output
Val = abs(counter)

print it
#stops and start the update
if it< float(Iterations) and not reset:
    updateComponent()
# ---------- end linear_loop ----------
# Variables + Controls
panel = Panel(linear_loop)
section_angle = Panel("70")
panel_2 = Panel("""10
15""")
series = Series(Start=section_angle, Step="2", Count="4")  # -> graft(Series)
centered_page = GhPythonScript(width="10", height="10", centerX="0", centerY="0")  # -> rectangle
# ---------- centered_page: Python ----------
__author__ = "ericsonm"
__version__ = "2019.01.15"

import rhinoscriptsyntax as rs

if (width or height) == None:
    rectangle = None

else:

    x1 = float(width)
    y1 = float(height)
    xc = x1/-2 + float(centerX)
    yc = y1/-2 + float(centerY)

    rectangle = rs.AddRectangle((xc,yc,0),x1,y1)
# ---------- end centered_page ----------
division = Division(A="10", B=panel_2)
panel_3 = Panel(division)
list_length = ListLength(List=panel_2)
trig_circle = GhPythonScript(
    radiusX=panel_3,
    radiusY=panel_3,
    centerX="0",
    centerZ="0",
    centerY="0",
    start="0",
    stop="180",
    sides="18",
    centerline=Toggle(True))  # -> points, graft(polyline), center, graft(start), lines, graft(end)
# ---------- trig_circle: Python ----------
                
                
__author__ = "mericson"
__version__ = "2019.01.07"
                
import rhinoscriptsyntax as rs
import math
#creates a circle based on trigonmetric functions
#returns (points,polyline,center,start,end,lines)
def TrigCircle(radiusX,radiusY,centerX,centerY,centerZ,start,stop,sides,centerline):
                    
    sa = float(start) 
    so = float(stop) + sa
    se = float(stop)/float(sides)
                
    rx = float(radiusX)
    ry = float(radiusY)
                
    cx = float(centerX)
    cy = float(centerY)
    cz = float(centerZ)
                
    #add center point
    center = rs.AddPoint(cx,cy,cz)
                
    #create an empty list in which to collect the points
    points = []
    #create points using sine, cosine and range
    for i in rs.frange(math.radians(sa), math.radians(so),math.radians(se)):
        p = rs.AddPoint(math.cos(i)*rx + cx, math.sin(i)*ry + cy, cz)
        points.append(p)
                
                
                
    #Add polyline to the points
    polyline = rs.AddPolyline(points)
                
                
                
    #select the first point on the circle
    start = points[0]
    
    #get the index of the last point in the circle
    m = len(points) - 1
    
    #select the last point in the circle with the index
    end = points[m]
    
    #adds centerlines to the circle
    lines = []
    if centerline:
        for i in points:
            l = rs.AddLine(center,i)
            lines.append(l)
    else:
        lines = None

    return(points,polyline,center,start,end,lines)
                
                
                
#calls the function
circle = TrigCircle(radiusX,radiusY,centerX,centerY,centerZ,start,stop,sides,centerline)
                
#retrieves each item returned from the function and assigns it to an output
points   = circle[0]
polyline = circle[1]
center   = circle[2]
start    = circle[3]
end      = circle[4]
lines    = circle[5]
# ---------- end trig_circle ----------
number = Number(graft(panel_3))

# ---- group: section line
list_item = ListItem(List=flatten(trig_circle.start), Index=0, Wrap=True)
sine = Sine(Value=degrees(series))
vector_at_angle = PythonScript(angle=series)  # -> vector
# ---------- vector_at_angle: Python ----------
import rhinoscriptsyntax as rs
import math
if angle == None:
    Vector = None
else:
    c=rs.AddPoint(0,0,0)
    f=math.radians(float(angle))
    l=rs.AddPoint(math.cos(f),math.sin(f),0)
    d=rs.VectorCreate(l,c)
    vector =rs.VectorUnitize(d)
# ---------- end vector_at_angle ----------
# A
# reference lines and objects
list_item_2 = ListItem(List=flatten(number), Index=0, Wrap=True)
division_2 = Division(A=list_item_2, B=sine)
line_sdl = LineSDL(Start=graft(list_item), Direction=vector_at_angle, Length=division_2)

# ---- group: longest section line
length = Length(Curve=line_sdl)  # -> flatten(Length)
index_of_max = PythonScript(values=length)  # -> IMin, IMax; inputs values: list
# ---------- index_of_max: Python ----------
q=[values]
for i in values:
    IMax=list.index(values,max(values))
    IMin=list.index(values,min(values))
# ---------- end index_of_max ----------
list_item_3 = ListItem(List=flatten(line_sdl), Index=index_of_max.IMax, Wrap=True)

# ---- group: vertical reference line
unit_y = UnitY(Factor="-1")
line_sdl_2 = LineSDL(Start=list_item, Direction=unit_y, Length=list_item_3)

# ---- group: project to section
unit_x = UnitX(Factor=1)
# B
# projection
projection = PythonScript(points=flatten(trig_circle.points), geometry=line_sdl, vector=unit_x)  # -> lines
# ---------- projection: Python ----------
import rhinoscriptsyntax as rs
import math
if (points or geometry or vector) == None:
    lines = None
else:

    d= vector
    n=rs.VectorUnitize(d)
    e=rs.ExtrudeCurveStraight(geometry,(0,0,0),(0,0,1))
    q=rs.ProjectPointToSurface(points,e,n)
    p2=rs.AddPoints(q)
    for i in p2:
        lines=rs.AddLine(points,i)
    if p2:
        del p2
# ---------- end projection ----------

# ---- group: Project to horizontal
xz_plane = XZPlane(Origin=Point(0, 0, 0))
point_on_curve = PointOnCurve(projection, parameter=1)
project = Project(Geometry=point_on_curve, Plane=xz_plane)  # -> Geometry, Transform
line = Line(StartPoint=point_on_curve, EndPoint=project.Geometry)

# ---- group: rotate
unit_x_2 = UnitX(Factor=1)
angle = Angle(VectorA=unit_x_2, VectorB=line_sdl_2, Plane=list_item)  # -> Angle, Reflex
rotate = Rotate(Geometry=project.Geometry, Angle=angle.Angle, Plane=list_item)  # -> Geometry, Transform
point = Point(rotate.Geometry)

# ---- group: get diameter of large arc
list_item_4 = ListItem(List=flatten(trig_circle.end), Index=0, Wrap=True)
distance = Distance(PointA=list_item, PointB=list_item_4)

# ---- group: arc to to view
distance_2 = Distance(PointA=list_item, PointB=point)
negative = Negative(Value=angle.Reflex)
arc = Arc(Plane=list_item, Radius=distance_2, Angle=negative)  # -> Arc, Length

# ----
unit_x_3 = UnitX(Factor="-1")

# ---- group: projection to top view
xz_plane_2 = XZPlane(Origin=Point(0, 0, 0))
line_sdl_3 = LineSDL(Start=point, Direction=unit_x_3, Length=distance)
project_2 = Project(Geometry=trig_circle.points, Plane=xz_plane_2)  # -> Geometry, Transform
unit_y_2 = UnitY(Factor=1)
# C
projection_2 = PythonScript(points=flatten(project_2.Geometry), geometry=line_sdl_3, vector=unit_y_2)  # -> lines; same code as projection

# ---- group: sort proection
list_length_2 = ListLength(List=projection_2)
division_3 = Division(A=list_length_2, B=list_length)
partition_list = PartitionList(List=projection_2, Size=division_3)

# ---- group: curves in top view
# projected curves
point_on_curve_2 = PointOnCurve(partition_list, parameter=1)
# D
# E
# Views
# Recording
polyline = PolyLine(Vertices=point_on_curve_2, Closed=False)

# ----
# G
# F
# Line Type
# Layers
explode_tree = ExplodeTree(Data=trig_circle.points)  # -> Branch0, Branch1
# H
list_of_points_to_label = Point(explode_tree.Branch0)
list_of_points_to_label_2 = Point(explode_tree.Branch1)
page_border = Geometry(centered_page)
semicircle = Geometry([trig_circle.polyline, polyline])
projection_3 = Geometry([projection, line, arc.Arc, line_sdl_3, partition_list])
sections = Geometry(line_sdl)

# ---- group: TEXT LABELS
add_text = Panel("b")
text_size = Panel(".02")
point_2 = Point(list_of_points_to_label_2)
list_length_3 = ListLength(List=point_2)
linear_gradient = GhPythonScript(R="0", G="0", B="0", Percent=".5")  # -> Color
# ---------- linear_gradient: Python ----------
__author__ = "ericsonm"
__version__ = "2019.01.15"

import rhinoscriptsyntax as rs

def LinearColorGradient(R,G,B,R2,G2,B2,ColorPercentage):
    
    if ColorPercentage > 1:
        R3 = None
        G3 = None
        B3 = None
    else:
        #This function defines linear color gradient by treating R,G,B as coordinates on a 3D line.
        #The base color that will be altered by the percentage should be entered in the second R2,G2,B2 valu
    
        Rdiff = float(R2) - float(R)
        Gdiff = float(G2) - float(G)
        Bdiff = float(B2) - float(B)


        t = float(ColorPercentage)


        R3 = float(R) + Rdiff*t
        G3 = float(G) + Gdiff*t
        B3 = float(B) + Bdiff*t



    return R3,G3,B3


if (R or G or B or Percent) is None:
    Color = None
else: 
    Color1 = LinearColorGradient(255,255,255,R,G,B,Percent)

    R3 = Color1[0]
    G3 = Color1[1]
    B3 = Color1[2]

    Color = rs.CreateColor(R3,G3,B3)
# ---------- end linear_gradient ----------
series_2 = Series(Start=0, Step=1, Count=list_length_3)
integer = Integer(series_2)
concatenate = Concatenate(FragmentA=integer, FragmentB=add_text)
text_tag_3d = TextTag3D(Location=point_2, Text=concatenate, Size=text_size, Colour=linear_gradient, Justification=5)

add_text_2 = Panel("a")
# Preview and Bake
text_size_2 = Panel(".02")
point_3 = Point(list_of_points_to_label)
list_length_4 = ListLength(List=point_3)
linear_gradient_2 = GhPythonScript(R="0", G="0", B="0", Percent=".5")  # -> Color; same code as linear_gradient
series_3 = Series(Start=0, Step=1, Count=list_length_4)
integer_2 = Integer(series_3)
concatenate_2 = Concatenate(FragmentA=integer_2, FragmentB=add_text_2)
text_tag_3d_2 = TextTag3D(Location=point_3, Text=concatenate_2, Size=text_size_2, Colour=linear_gradient_2, Justification=5)

# ----
panel_4 = Panel(".001")
points_to_inches = GhPythonScript(points=".1")  # -> inches
# ---------- points_to_inches: Python ----------
__author__ = "marke"
__version__ = "2020.01.24"

import rhinoscriptsyntax as rs
if points == None:
    pass
else:
    
    p = float(points)

    inches = p/72
# ---------- end points_to_inches ----------

# ---- group: Preview and Bake
get_name = GhPythonScript(Component=page_border)  # -> Geometry, Name
# ---------- get_name: Python ----------
# Mark Ericson 1.17.19
   #take from forum discussion thread https://www.grasshopper3d.com/forum/topics/python-get-label-name-of-input-components
    #edited version of code  by Mostapha Sadeghipour Roudsari

def GetComponentName():
    Comp = ghenv.Component.Params.Input[0]
    sources = Comp.Sources

    if sources.Count == 0: 
        return components

    for source in sources:
        attr = source.Attributes
        if (attr is None) or (attr.GetTopLevel is None):
            pass
        else:

            component = attr.GetTopLevel.DocObject
            componentName = component.NickName

            return componentName

if Component == None:
    pass
else:
    Name = GetComponentName()
    Geometry = Component
# ---------- end get_name ----------
linear_gradient_3 = GhPythonScript(R="0", G="0", B="0", Percent="1")  # -> Color; same code as linear_gradient
custom_preview = CustomPreview(Geometry=get_name.Geometry, Material=linear_gradient_3)

# ----
panel_5 = Panel(get_name.Name)

# ---- group: Preview and Bake (continued)
object_bake = ObjectBake(
    BakeToggle=Button(),
    GeometryObjects=get_name.Geometry,
    Layer=panel_5,
    ObjectName=panel_5,
    ObjectColor=linear_gradient_3,
    LayerColor=linear_gradient_3)

# ----
custom_preview_lineweights = CustomPreviewLineweights(Geometry=get_name.Geometry, Shader=linear_gradient_3, Thickness=".0025", Absolute=Toggle(True))

# ---- group: Preview and Bake
get_name_2 = GhPythonScript(Component=projection_3)  # -> Geometry, Name; same code as get_name
linear_gradient_4 = GhPythonScript(R="0", G="0", B="0", Percent=".4")  # -> Color; same code as linear_gradient
custom_preview_2 = CustomPreview(Geometry=get_name_2.Geometry, Material=linear_gradient_4)

# ----
panel_6 = Panel(get_name_2.Name)

# ---- group: Preview and Bake (continued)
object_bake_2 = ObjectBake(
    BakeToggle=Button(),
    GeometryObjects=get_name_2.Geometry,
    Layer=panel_6,
    ObjectName=panel_6,
    ObjectColor=linear_gradient_4,
    LayerColor=linear_gradient_4)

# ----
custom_preview_lineweights_2 = CustomPreviewLineweights(Geometry=get_name_2.Geometry, Shader=linear_gradient_4, Thickness=points_to_inches, Absolute=Toggle(True))

# ---- group: Preview and Bake
get_name_3 = GhPythonScript(Component=semicircle)  # -> Geometry, Name; same code as get_name
linear_gradient_5 = GhPythonScript(R="0", G="0", B="0", Percent="1")  # -> Color; same code as linear_gradient
custom_preview_3 = CustomPreview(Geometry=get_name_3.Geometry, Material=linear_gradient_5)

# ----
panel_7 = Panel(get_name_3.Name)

# ---- group: Preview and Bake (continued)
object_bake_3 = ObjectBake(
    BakeToggle=Button(),
    GeometryObjects=get_name_3.Geometry,
    Layer=panel_7,
    ObjectName=panel_7,
    ObjectColor=linear_gradient_5,
    LayerColor=linear_gradient_5)

# ----
custom_preview_lineweights_3 = CustomPreviewLineweights(Geometry=get_name_3.Geometry, Shader=linear_gradient_5, Thickness=".0025", Absolute=Toggle(True))

# ---- group: Preview and Bake
get_name_4 = GhPythonScript(Component=sections)  # -> Geometry, Name; same code as get_name
linear_gradient_6 = GhPythonScript(R="0", G="0", B="0", Percent="1")  # -> Color; same code as linear_gradient
custom_preview_4 = CustomPreview(Geometry=get_name_4.Geometry, Material=linear_gradient_6)

# ----
panel_8 = Panel(get_name_4.Name)

# ---- group: Preview and Bake (continued)
object_bake_4 = ObjectBake(
    BakeToggle=Button(),
    GeometryObjects=get_name_4.Geometry,
    Layer=panel_8,
    ObjectName=panel_8,
    ObjectColor=linear_gradient_6,
    LayerColor=linear_gradient_6)

# ----
custom_preview_lineweights_4 = CustomPreviewLineweights(Geometry=get_name_4.Geometry, Shader=linear_gradient_6, Thickness=".0025", Absolute=Toggle(True))
