# Grasshopper definition 01_3_Projection_Arch 563_3742.gh (Grasshopper 1.0.7)
# plug-ins: Human, LunchBox

# Variables + Controls
panel = Panel("10")
panel_2 = Panel("""10
15""")
section_angle = Panel("20")
projection_type = Panel("2")
series = Series(Start=section_angle, Step="1", Count="20")  # -> graft(Series)
centered_page = GhPythonScript(width=panel, height=panel, centerX="0", centerY="0")  # -> rectangle
# ---------- centered_page: Python ----------
__author__ = "ericsonm"
__version__ = "2019.01.15"

import rhinoscriptsyntax as rs

if (width or height) == None:
    rectangle = None

else:

    x1 = float(width)
    y1 = float(height)
    xc = x1/-2 + float(centerX)
    yc = y1/-2 + float(centerY)

    rectangle = rs.AddRectangle((xc,yc,0),x1,y1)
# ---------- end centered_page ----------
division = Division(A=panel, B=panel_2)
panel_3 = Panel(division)
list_length = ListLength(List=panel_2)
trig_circle = GhPythonScript(
    radiusX=panel_3,
    radiusY=panel_3,
    centerX="0",
    centerZ="0",
    centerY="0",
    start="0",
    stop="180",
    sides="18",
    centerline=Toggle(True))  # -> points, graft(polyline), center, graft(start), lines, graft(end)
# ---------- trig_circle: Python ----------
                
                
__author__ = "mericson"
__version__ = "2019.01.07"
                
import rhinoscriptsyntax as rs
import math
#creates a circle based on trigonmetric functions
#returns (points,polyline,center,start,end,lines)
def TrigCircle(radiusX,radiusY,centerX,centerY,centerZ,start,stop,sides,centerline):
                    
    sa = float(start) 
    so = float(stop) + sa
    se = float(stop)/float(sides)
                
    rx = float(radiusX)
    ry = float(radiusY)
                
    cx = float(centerX)
    cy = float(centerY)
    cz = float(centerZ)
                
    #add center point
    center = rs.AddPoint(cx,cy,cz)
                
    #create an empty list in which to collect the points
    points = []
    #create points using sine, cosine and range
    for i in rs.frange(math.radians(sa), math.radians(so),math.radians(se)):
        p = rs.AddPoint(math.cos(i)*rx + cx, math.sin(i)*ry + cy, cz)
        points.append(p)
                
                
                
    #Add polyline to the points
    polyline = rs.AddPolyline(points)
                
                
                
    #select the first point on the circle
    start = points[0]
    
    #get the index of the last point in the circle
    m = len(points) - 1
    
    #select the last point in the circle with the index
    end = points[m]
    
    #adds centerlines to the circle
    lines = []
    if centerline:
        for i in points:
            l = rs.AddLine(center,i)
            lines.append(l)
    else:
        lines = None

    return(points,polyline,center,start,end,lines)
                
                
                
#calls the function
circle = TrigCircle(radiusX,radiusY,centerX,centerY,centerZ,start,stop,sides,centerline)
                
#retrieves each item returned from the function and assigns it to an output
points   = circle[0]
polyline = circle[1]
center   = circle[2]
start    = circle[3]
end      = circle[4]
lines    = circle[5]
# ---------- end trig_circle ----------
unit_x = UnitX(Factor="2")
# A
number = Number(graft(panel_3))

# ---- group: section line
# reference lines and objects
list_item = ListItem(List=flatten(number), Index=0, Wrap=True)
list_item_2 = ListItem(List=flatten(trig_circle.start), Index=0, Wrap=True)
vector_at_angle = PythonScript(angle=series)  # -> vector
# ---------- vector_at_angle: Python ----------
import rhinoscriptsyntax as rs
import math
if angle == None:
    Vector = None
else:
    c=rs.AddPoint(0,0,0)
    f=math.radians(float(angle))
    l=rs.AddPoint(math.cos(f),math.sin(f),0)
    d=rs.VectorCreate(l,c)
    vector =rs.VectorUnitize(d)
# ---------- end vector_at_angle ----------
sine = Sine(Value=degrees(series))
division_2 = Division(A=list_item, B=sine)
line_sdl = LineSDL(Start=list_item_2, Direction=vector_at_angle, Length=division_2)

# ---- group: Projection Types
folded_line = FoldedLine(line=line_sdl, fold_proportion=".2")
arc_section = ArcSection(line=line_sdl, arc_proportion=flatten(".2"))

# ----
# Projection Filter
stream_filter = StreamFilter(Gate=projection_type, Stream0=line_sdl, Stream1=arc_section, Stream2=folded_line)
unit_vector = UnitVector(Vector=line_sdl)

# ---- group: longest section line
length = Length(Curve=stream_filter)  # -> flatten(Length)
index_of_max = PythonScript(values=length)  # -> IMin, IMax; inputs values: list
# ---------- index_of_max: Python ----------
q=[values]
for i in values:
    IMax=list.index(values,max(values))
    IMin=list.index(values,min(values))
# ---------- end index_of_max ----------
list_item_3 = ListItem(List=flatten(stream_filter), Index=index_of_max.IMax, Wrap=True)

# ----
unit_y = UnitY(Factor="-1")

# ---- group: vertical reference line
line_sdl_2 = LineSDL(Start=list_item_2, Direction=unit_y, Length=list_item_3)

# ---- group: project to section
unit_x_2 = UnitX(Factor=1)
# B
# projection
projection = PythonScript(points=flatten(trig_circle.points), geometry=graft(stream_filter), vector=unit_x_2)  # -> lines
# ---------- projection: Python ----------
import rhinoscriptsyntax as rs
import math
if (points or geometry or vector) == None:
    lines = None
else:

    d= vector
    n=rs.VectorUnitize(d)
    e=rs.ExtrudeCurveStraight(geometry,(0,0,0),(0,0,1))
    q=rs.ProjectPointToSurface(points,e,n)
    
    p2=rs.AddPoints(q)
    for i in p2:
        lines=rs.AddLine(points,i)
        

    if p2:
        del p2
# ---------- end projection ----------

# ---- group: Project to horizontal
xz_plane = XZPlane(Origin=Point(0, 0, 0))
point_on_curve = PointOnCurve(projection, parameter=1)
project = Project(Geometry=point_on_curve, Plane=xz_plane)  # -> Geometry, Transform
line = Line(StartPoint=point_on_curve, EndPoint=project.Geometry)

# ---- group: rotate
unit_x_3 = UnitX(Factor=1)
angle = Angle(VectorA=unit_x_3, VectorB=line_sdl_2, Plane=list_item_2)  # -> Angle, Reflex
rotate = Rotate(Geometry=project.Geometry, Angle=angle.Angle, Plane=list_item_2)  # -> Geometry, Transform
point = Point(rotate.Geometry)

# ----
vector_at_angle_2 = PythonScript(angle="-90")  # -> vector; same code as vector_at_angle
line_sdl_3 = LineSDL(Start=trig_circle.center, Direction=vector_at_angle_2, Length=list_item_3)
unit_x_4 = UnitX(Factor=1)
projection_2 = PythonScript(points=flatten(rotate.Geometry), geometry=line_sdl_3, vector=unit_x_4)  # -> lines
# ---------- projection_2: Python ----------
import rhinoscriptsyntax as rs
import math
if (points or geometry or vector) == None:
    lines = None
else:

    d= vector
    n=rs.VectorUnitize(d)
    e=rs.ExtrudeCurveStraight(geometry,(0,0,0),(0,0,1))
    q=rs.ProjectPointToSurface(points,e,n)
    
    p2=rs.AddPoints(q)
    for i in p2:
        lines=rs.AddLine(points,i)

    if p2:
        del p2
# ---------- end projection_2 ----------

# ---- group: get diameter of large arc
list_item_4 = ListItem(List=flatten(trig_circle.end), Index=0, Wrap=True)
distance = Distance(PointA=list_item_2, PointB=list_item_4)

# ----
multiplication = Multiplication(A=list_item_3, B="10")

# ---- group: arc to to view
distance_2 = Distance(PointA=list_item_2, PointB=point)

# ----
unit_x_5 = UnitX(Factor="-1")
circle = Circle(Plane=list_item_2, Radius=distance_2)
point_on_curve_2 = PointOnCurve(projection_2, parameter=1)
relay = Relay()
series_2 = Series(Start=0, Step="1", Count="30")
panel_4 = Panel("-10")
end_points = EndPoints()  # -> Start, End
# G
# F
# Line Type
# Layers
explode_tree = ExplodeTree(Data=trig_circle.points)  # -> Branch0, Branch1
list_of_points_to_label = Point(explode_tree.Branch1)
list_of_points_to_label_2 = Point(explode_tree.Branch0)
page_border = Geometry(centered_page)
sections = Geometry(stream_filter)

# ---- group: TEXT LABELS
add_text = Panel("b")
text_size = Panel(".02")
point_2 = Point(list_of_points_to_label)
list_length_2 = ListLength(List=point_2)
linear_gradient = GhPythonScript(R="0", G="0", B="0", Percent=".5")  # -> Color
# ---------- linear_gradient: Python ----------
__author__ = "ericsonm"
__version__ = "2019.01.15"

import rhinoscriptsyntax as rs

def LinearColorGradient(R,G,B,R2,G2,B2,ColorPercentage):
    
    if ColorPercentage > 1:
        R3 = None
        G3 = None
        B3 = None
    else:
        #This function defines linear color gradient by treating R,G,B as coordinates on a 3D line.
        #The base color that will be altered by the percentage should be entered in the second R2,G2,B2 valu
    
        Rdiff = float(R2) - float(R)
        Gdiff = float(G2) - float(G)
        Bdiff = float(B2) - float(B)


        t = float(ColorPercentage)


        R3 = float(R) + Rdiff*t
        G3 = float(G) + Gdiff*t
        B3 = float(B) + Bdiff*t



    return R3,G3,B3


if (R or G or B or Percent) is None:
    Color = None
else: 
    Color1 = LinearColorGradient(255,255,255,R,G,B,Percent)

    R3 = Color1[0]
    G3 = Color1[1]
    B3 = Color1[2]

    Color = rs.CreateColor(R3,G3,B3)
# ---------- end linear_gradient ----------
series_3 = Series(Start=0, Step=1, Count=list_length_2)
integer = Integer(series_3)
concatenate = Concatenate(FragmentA=integer, FragmentB=add_text)
text_tag_3d = TextTag3D(Location=point_2, Text=concatenate, Size=text_size, Colour=linear_gradient, Justification=5)

add_text_2 = Panel("b")
text_size_2 = Panel(".02")
point_3 = Point(list_of_points_to_label)
list_length_3 = ListLength(List=point_3)
linear_gradient_2 = GhPythonScript(R="0", G="0", B="0", Percent=".5")  # -> Color; same code as linear_gradient
series_4 = Series(Start=0, Step=1, Count=list_length_3)
integer_2 = Integer(series_4)
concatenate_2 = Concatenate(FragmentA=integer_2, FragmentB=add_text_2)
text_tag_3d_2 = TextTag3D(Location=point_3, Text=concatenate_2, Size=text_size_2, Colour=linear_gradient_2, Justification=5)

add_text_3 = Panel("a")
# H
# Preview and Bake
text_size_3 = Panel(".02")
point_4 = Point(list_of_points_to_label_2)
list_length_4 = ListLength(List=point_4)
linear_gradient_3 = GhPythonScript(R="0", G="0", B="0", Percent=".5")  # -> Color; same code as linear_gradient
series_5 = Series(Start=0, Step=1, Count=list_length_4)
integer_3 = Integer(series_5)
concatenate_3 = Concatenate(FragmentA=integer_3, FragmentB=add_text_3)
text_tag_3d_3 = TextTag3D(Location=point_4, Text=concatenate_3, Size=text_size_3, Colour=linear_gradient_3, Justification=5)

# ---- group: horizontal reference line
end_points_2 = EndPoints(Curve=line_sdl)  # -> Start, flatten(End)
get_x = PythonScript(point=end_points_2.End)  # -> X; inputs point: Point3d
# ---------- get_x: Python ----------
import Rhino as rh




X = (rh.Geometry.Point3d.X.GetValue(point))
# ---------- end get_x ----------
index_of_max_2 = PythonScript(values=get_x)  # -> IMin, IMax; inputs values: list; same code as index_of_max
list_item_5 = ListItem(List=get_x, Index=index_of_max_2.IMax, Wrap=True)
construct_point = ConstructPoint(XCoordinate=list_item_5, YCoordinate=0, ZCoordinate=0)

# ----
# draw horizontal reference line
list_item_6 = ListItem(List=get_x, Index=index_of_max_2.IMin, Wrap=True)

# ---- group: horizontal reference line (continued)
construct_point_2 = ConstructPoint(XCoordinate=list_item_6, YCoordinate=0, ZCoordinate=0)
line_2 = Line(StartPoint=construct_point_2, EndPoint=construct_point)

# ----
reference_lines = Geometry(line_2)

end_points_3 = EndPoints(Curve=line_sdl)  # -> Start, End
xz_plane_2 = XZPlane(Origin=Point(0, 0, 0))

move = Move(Geometry=end_points_3.End, Motion=unit_vector)  # -> Geometry, Transform

project_2 = Project(Geometry=move.Geometry, Plane=xz_plane_2)  # -> Geometry, Transform

# ---- group: rotate
unit_x_6 = UnitX(Factor=1)
angle_2 = Angle(VectorA=unit_x_6, VectorB=line_sdl_2, Plane=list_item_2)  # -> Angle, Reflex
rotate_2 = Rotate(Geometry=project_2.Geometry, Angle=angle_2.Angle, Plane=list_item_2)  # -> Geometry, Transform
point_5 = Point(rotate_2.Geometry)

# ----
vector_at_angle_3 = PythonScript(angle=graft("-90"))  # -> vector; same code as vector_at_angle
line_sdl_4 = LineSDL(Start=trig_circle.center, Direction=vector_at_angle_3, Length=multiplication)
unit_x_7 = UnitX(Factor=1)
projection_3 = PythonScript(points=flatten(point_5), geometry=line_sdl_4, vector=unit_x_7)  # -> lines; same code as projection_2

point_on_curve_3 = PointOnCurve(projection_3, parameter=1)
panel_5 = Panel(projection_3)
list_item_7 = ListItem(List=point_on_curve_3, Index=0, Wrap=True)
xy_plane = XYPlane(Origin=point_on_curve_3)
# break list of into chunks (tree branches) equal in length the original  number of points on the curve.
distance_3 = Distance(PointA=list_item_7, PointB=point_on_curve_2)
circle_2 = Circle(Plane=list_item_7, Radius=distance_3)

# ---- group: sort proection
list_length_5 = ListLength(List=circle_2)
division_3 = Division(A=list_length_5, B="20")
partition_list = PartitionList(List=circle_2, Size=division_3)

# ----
rotate_3 = Rotate(Geometry=partition_list, Angle=graft(degrees(series_2)), Plane=trig_circle.center)  # -> Geometry, Transform
geometry = Geometry(rotate_3.Geometry)
panel_6 = Panel(partition_list)

# ---- group: projection to top view
xz_plane_3 = XZPlane(Origin=Point(0, 0, 0))
line_sdl_5 = LineSDL(Start=point, Direction=unit_x_5, Length=distance)
project_3 = Project(Geometry=trig_circle.points, Plane=xz_plane_3)  # -> Geometry, Transform
unit_y_2 = UnitY(Factor=1)

# ----
stream_filter_2 = StreamFilter(Gate="1", Stream0=line_sdl_5, Stream1=rotate_3.Geometry)

# ---- group: projection to top view (continued)
# C
projection_4 = PythonScript(points=flatten(project_3.Geometry), geometry=stream_filter_2, vector=unit_y_2)  # -> lines
# ---------- projection_4: Python ----------
import rhinoscriptsyntax as rs
import math
if (points or geometry or vector) == None:
    lines = None
else:

    d= vector
    n=rs.VectorUnitize(d)
    e=rs.ExtrudeCurveStraight(geometry,(0,0,0),(0,0,1))
    q=rs.ProjectPointToSurface(points,e,n)
    p2=rs.AddPoints(q)
    for i in p2:
        lines=rs.AddLine(points,i)
    if p2:
        del p2

print e
# ---------- end projection_4 ----------

# ---- group: sort proection
list_length_6 = ListLength(List=projection_4)
division_4 = Division(A=list_length_6, B=list_length)
partition_list_2 = PartitionList(List=projection_4, Size=division_4)

# ---- group: curves in top view
# projected curves
point_on_curve_4 = PointOnCurve(partition_list_2, parameter=1)
# D
polyline = PolyLine(Vertices=point_on_curve_4, Closed=False)

# ---- group: joint lines
panel_7 = Panel("""0
1""")
sift_pattern = SiftPattern(List=flatten(polyline), SiftPattern=panel_7)  # -> Output0, Output1
geometry_2 = Geometry(sift_pattern.Output0)
geometry_3 = Geometry(sift_pattern.Output1)
explode = Explode(Curve=geometry_2, Recursive=True)  # -> Segments, Vertices
explode_2 = Explode(Curve=geometry_3, Recursive=True)  # -> Segments, Vertices
# E
# Views
# Recording
line_3 = Line(StartPoint=flatten(explode.Vertices), EndPoint=flatten(explode_2.Vertices))

# ----
face_joints = Geometry(line_3)
semicircle = Geometry([trig_circle.polyline, polyline])
projection_5 = Geometry([projection, line, circle, stream_filter_2, partition_list_2])

# ---- group: Preview and Bake
get_name = GhPythonScript(Component=face_joints)  # -> Geometry, Name
# ---------- get_name: Python ----------
# Mark Ericson 1.17.19
   #take from forum discussion thread https://www.grasshopper3d.com/forum/topics/python-get-label-name-of-input-components
    #edited version of code  by Mostapha Sadeghipour Roudsari

def GetComponentName():
    Comp = ghenv.Component.Params.Input[0]
    sources = Comp.Sources

    if sources.Count == 0: 
        return components

    for source in sources:
        attr = source.Attributes
        if (attr is None) or (attr.GetTopLevel is None):
            pass
        else:

            component = attr.GetTopLevel.DocObject
            componentName = component.NickName

            return componentName

if Component == None:
    pass
else:
    Name = GetComponentName()
    Geometry = Component
# ---------- end get_name ----------
linear_gradient_4 = GhPythonScript(R="0", G="0", B="0", Percent=".75")  # -> Color; same code as linear_gradient
custom_preview = CustomPreview(Geometry=get_name.Geometry, Material=linear_gradient_4)

# ----
panel_8 = Panel(get_name.Name)

# ---- group: Preview and Bake (continued)
object_bake = ObjectBake(
    BakeToggle=Button(),
    GeometryObjects=get_name.Geometry,
    Layer=panel_8,
    ObjectName=panel_8,
    ObjectColor=linear_gradient_4,
    LayerColor=linear_gradient_4)

# ----
points_to_inches = GhPythonScript(points=".15")  # -> inches
# ---------- points_to_inches: Python ----------
__author__ = "marke"
__version__ = "2020.01.24"

import rhinoscriptsyntax as rs
if points == None:
    pass
else:
    
    p = float(points)

    inches = p/72
# ---------- end points_to_inches ----------
custom_preview_lineweights = CustomPreviewLineweights(Geometry=get_name.Geometry, Shader=linear_gradient_4, Thickness=points_to_inches, Absolute=Toggle(True))

# ---- group: Preview and Bake
get_name_2 = GhPythonScript(Component=reference_lines)  # -> Geometry, Name; same code as get_name
linear_gradient_5 = GhPythonScript(R="0", G="0", B="0", Percent=".75")  # -> Color; same code as linear_gradient
custom_preview_2 = CustomPreview(Geometry=get_name_2.Geometry, Material=linear_gradient_5)

# ----
panel_9 = Panel(get_name_2.Name)

# ---- group: Preview and Bake (continued)
object_bake_2 = ObjectBake(
    BakeToggle=Button(),
    GeometryObjects=get_name_2.Geometry,
    Layer=panel_9,
    ObjectName=panel_9,
    ObjectColor=linear_gradient_5,
    LayerColor=linear_gradient_5)

# ----
# convert inches to points
panel_10 = Panel(".15")
points_to_inches_2 = GhPythonScript(points=panel_10)  # -> inches; same code as points_to_inches
custom_preview_lineweights_2 = CustomPreviewLineweights(Geometry=get_name_2.Geometry, Shader=linear_gradient_5, Thickness=points_to_inches_2, Absolute=Toggle(True))

# ---- group: Preview and Bake
get_name_3 = GhPythonScript(Component=reference_lines)  # -> Geometry, Name; same code as get_name
linear_gradient_6 = GhPythonScript(R="0", G="0", B="0", Percent=".75")  # -> Color; same code as linear_gradient
custom_preview_3 = CustomPreview(Geometry=get_name_3.Geometry, Material=linear_gradient_6)

# ----
panel_11 = Panel(get_name_3.Name)

# ---- group: Preview and Bake (continued)
object_bake_3 = ObjectBake(
    BakeToggle=Button(),
    GeometryObjects=get_name_3.Geometry,
    Layer=panel_11,
    ObjectName=panel_11,
    ObjectColor=linear_gradient_6,
    LayerColor=linear_gradient_6)

# ----
points_to_inches_3 = GhPythonScript(points=".15")  # -> inches; same code as points_to_inches
custom_preview_lineweights_3 = CustomPreviewLineweights(Geometry=get_name_3.Geometry, Shader=linear_gradient_6, Thickness=points_to_inches_3, Absolute=Toggle(True))

# ---- group: Preview and Bake
get_name_4 = GhPythonScript(Component=projection_5)  # -> Geometry, Name; same code as get_name
linear_gradient_7 = GhPythonScript(R="0", G="0", B="0", Percent=".4")  # -> Color; same code as linear_gradient
custom_preview_4 = CustomPreview(Geometry=get_name_4.Geometry, Material=linear_gradient_7)

# ----
panel_12 = Panel(get_name_4.Name)

# ---- group: Preview and Bake (continued)
object_bake_4 = ObjectBake(
    BakeToggle=Button(),
    GeometryObjects=get_name_4.Geometry,
    Layer=panel_12,
    ObjectName=panel_12,
    ObjectColor=linear_gradient_7,
    LayerColor=linear_gradient_7)

# ----
points_to_inches_4 = GhPythonScript(points=".1")  # -> inches; same code as points_to_inches
custom_preview_lineweights_4 = CustomPreviewLineweights(Geometry=get_name_4.Geometry, Shader=linear_gradient_7, Thickness=points_to_inches_4, Absolute=Toggle(True))

# ---- group: Preview and Bake
get_name_5 = GhPythonScript(Component=page_border)  # -> Geometry, Name; same code as get_name
linear_gradient_8 = GhPythonScript(R="0", G="0", B="0", Percent=".75")  # -> Color; same code as linear_gradient
custom_preview_5 = CustomPreview(Geometry=get_name_5.Geometry, Material=linear_gradient_8)

# ----
panel_13 = Panel(get_name_5.Name)

# ---- group: Preview and Bake (continued)
object_bake_5 = ObjectBake(
    BakeToggle=Button(),
    GeometryObjects=get_name_5.Geometry,
    Layer=panel_13,
    ObjectName=panel_13,
    ObjectColor=linear_gradient_8,
    LayerColor=linear_gradient_8)

# ----
points_to_inches_5 = GhPythonScript(points=".15")  # -> inches; same code as points_to_inches
custom_preview_lineweights_5 = CustomPreviewLineweights(Geometry=get_name_5.Geometry, Shader=linear_gradient_8, Thickness=points_to_inches_5, Absolute=Toggle(True))

# ---- group: Preview and Bake
get_name_6 = GhPythonScript(Component=sections)  # -> Geometry, Name; same code as get_name
linear_gradient_9 = GhPythonScript(R="0", G="0", B="0", Percent="1")  # -> Color; same code as linear_gradient
custom_preview_6 = CustomPreview(Geometry=get_name_6.Geometry, Material=linear_gradient_9)

# ----
panel_14 = Panel(get_name_6.Name)

# ---- group: Preview and Bake (continued)
object_bake_6 = ObjectBake(
    BakeToggle=Button(),
    GeometryObjects=get_name_6.Geometry,
    Layer=panel_14,
    ObjectName=panel_14,
    ObjectColor=linear_gradient_9,
    LayerColor=linear_gradient_9)

# ----
points_to_inches_6 = GhPythonScript(points=".15")  # -> inches; same code as points_to_inches
custom_preview_lineweights_6 = CustomPreviewLineweights(Geometry=get_name_6.Geometry, Shader=linear_gradient_9, Thickness=points_to_inches_6, Absolute=Toggle(True))

# ---- group: Preview and Bake
get_name_7 = GhPythonScript(Component=semicircle)  # -> Geometry, Name; same code as get_name
linear_gradient_10 = GhPythonScript(R="0", G="0", B="0", Percent="1")  # -> Color; same code as linear_gradient
custom_preview_7 = CustomPreview(Geometry=get_name_7.Geometry, Material=linear_gradient_10)

# ----
panel_15 = Panel(get_name_7.Name)

# ---- group: Preview and Bake (continued)
object_bake_7 = ObjectBake(
    BakeToggle=Button(),
    GeometryObjects=get_name_7.Geometry,
    Layer=panel_15,
    ObjectName=panel_15,
    ObjectColor=linear_gradient_10,
    LayerColor=linear_gradient_10)

# ----
points_to_inches_7 = GhPythonScript(points=".3")  # -> inches; same code as points_to_inches
custom_preview_lineweights_7 = CustomPreviewLineweights(Geometry=get_name_7.Geometry, Shader=linear_gradient_10, Thickness=points_to_inches_7, Absolute=Toggle(True))

# ==== cluster ArcSection
line = ClusterInput()
arc_proportion = ClusterInput()
line_2 = Line(line)
arc_proportion_2 = Number(arc_proportion)
length = Length(Curve=line_2)
point_on_curve = PointOnCurve(line_2, parameter=0.5)
end_points = EndPoints(Curve=line_2)  # -> Start, End
line_3 = Line(StartPoint=end_points.Start, EndPoint=point_on_curve)
multiplication = Multiplication(A=length, B=arc_proportion_2)
perpendicular = GhPythonScript(line=line_3)  # -> Perp; inputs line: Line
# ---------- perpendicular: Python ----------
__author__ = "mericson"
__version__ = "2019.01.11"

import rhinoscriptsyntax as rs
import math
import Rhino as rh

if line == None:
    line = None
else:
    a = 0,0,0
    b = 0,0,1
    Z = rs.VectorCreate(a,b)
    c = rh.Geometry.Line.PointAt(line,1)
    d = rh.Geometry.Line.PointAt(line,0)
    vector2 = rs.VectorCreate(c,d)
    Perp = rs.VectorRotate(vector2,90,Z)
# ---------- end perpendicular ----------
amplitude = Amplitude(Vector=perpendicular, Amplitude=multiplication)
move = Move(Geometry=point_on_curve, Motion=amplitude)  # -> Geometry, Transform
arc_3pt = Arc3Pt(PointA=end_points.Start, PointB=move.Geometry, PointC=end_points.End)  # -> Arc, Plane, Radius
arc = Geometry(arc_3pt.Arc)
arc_2 = ClusterOutput(arc)

# ==== cluster FoldedLine
line = ClusterInput()
fold_proportion = ClusterInput()
line_2 = Line(line)
fold_proportion_2 = Number(fold_proportion)
length = Length(Curve=line_2)
point_on_curve = PointOnCurve(line_2, parameter=0.5)
end_points = EndPoints(Curve=line_2)  # -> Start, End
line_3 = Line(StartPoint=end_points.Start, EndPoint=point_on_curve)
multiplication = Multiplication(A=length, B=fold_proportion_2)
perpendicular = GhPythonScript(line=line_3)  # -> Perp; inputs line: Line; same code as perpendicular
amplitude = Amplitude(Vector=perpendicular, Amplitude=multiplication)
move = Move(Geometry=point_on_curve, Motion=amplitude)  # -> Geometry, Transform
merge = Merge(Data1=end_points.Start, Data2=move.Geometry, Data3=end_points.End)
polyline = PolyLine(Vertices=merge, Closed=False)
polyline_2 = Geometry(polyline)
polyline_3 = ClusterOutput(polyline_2)
