# Grasshopper definition DrawHypotenuse_alternate.gh (Grasshopper 1.0.7)

vector_at_angle = PythonScript(angle="160")  # -> vector
# ---------- vector_at_angle: Python ----------
import rhinoscriptsyntax as rs
import math
if angle == None:
    Vector = None
else:
    c=rs.AddPoint(0,0,0)
    f=math.radians(float(angle))
    l=rs.AddPoint(math.cos(f),math.sin(f),0)
    d=rs.VectorCreate(l,c)
    vector =rs.VectorUnitize(d)
# ---------- end vector_at_angle ----------
line_sdl = LineSDL(Start="0,0,0,", Direction=vector_at_angle, Length="2.03")
point_on_curve = PointOnCurve(line_sdl, parameter=0)
hypotenuse = GhPythonScript(point=point_on_curve, baseline=line_sdl, rotation="30")  # -> Line; inputs point: Point3d, baseline: Line
# ---------- hypotenuse: Python ----------
__author__ = "ericsonm"
__version__ = "2019.01.31"

import rhinoscriptsyntax as rs
import math
import Rhino as rh
import ghpythonlib as gh


def Perpendicular(line):
    if line == None:
        line = None
    else:
        a = 0,0,0
        b = 0,0,1
        Z = rs.VectorCreate(a,b)
        c = rh.Geometry.Line.PointAt(line,1)
        d = rh.Geometry.Line.PointAt(line,0)
        vector2 = rs.VectorCreate(c,d)
        Perp1 = rs.VectorRotate(vector2,90,Z)
        Perp2 = rs.VectorUnitize(Perp1)
        return(Perp2)


def vectoratAngle(angle):
    if angle == None:
        vector = None
    else:
        c=rs.AddPoint(0,0,0)
        f=math.radians(float(angle))
        l=rs.AddPoint(math.cos(f),math.sin(f),0)
        d=rs.VectorCreate(l,c)
        vector =rs.VectorUnitize(d)
        return(vector)



def drawhypotenuse(point,baseline,rotation):

    if (point or baseline or rotation) == None:
        pass
    else:
        factor = (gh.components.Length(baseline)*1000)
        Int = rh.Geometry.Line.PointAt(baseline,1)
        Dir = Perpendicular(baseline)
        Adj =  gh.components.LineSDL(Int,Dir,factor)
        Vector1 = vectoratAngle(rotation)
        Hyp1 = gh.components.LineSDL(point,Vector1,factor)
        Vertex = rs.LineLineIntersection(Adj,Hyp1)[0]
        Hyp2 = rs.AddLine(point, Vertex)
        return(Hyp2)


Line = drawhypotenuse(point,baseline,rotation)
# ---------- end hypotenuse ----------
