# Grasshopper definition Linear Gradient.gh (Grasshopper 1.0.7)

linear_gradient = GhPythonScript()  # -> Color
# ---------- linear_gradient: Python ----------
__author__ = "ericsonm"
__version__ = "2019.01.15"

import rhinoscriptsyntax as rs

def LinearColorGradient(R,G,B,R2,G2,B2,ColorPercentage):
    
    if ColorPercentage > 1:
        R3 = None
        G3 = None
        B3 = None
    else:
        #This function defines linear color gradient by treating R,G,B as coordinates on a 3D line.
        #The base color that will be altered by the percentage should be entered in the second R2,G2,B2 valu
    
        Rdiff = float(R2) - float(R)
        Gdiff = float(G2) - float(G)
        Bdiff = float(B2) - float(B)


        t = float(ColorPercentage)


        R3 = float(R) + Rdiff*t
        G3 = float(G) + Gdiff*t
        B3 = float(B) + Bdiff*t



    return R3,G3,B3


if (R or G or B or Percent) is None:
    Color = None
else: 
    Color1 = LinearColorGradient(255,255,255,R,G,B,Percent)

    R3 = Color1[0]
    G3 = Color1[1]
    B3 = Color1[2]

    Color = rs.CreateColor(R3,G3,B3)
# ---------- end linear_gradient ----------
