# Grasshopper definition name getter.gh (Grasshopper 1.0.7)

line_sdl = LineSDL(Start="0,0,0", Direction=Vector(0, 0, 1), Length=1)
line_sdl_2 = LineSDL(Start="0,0,0", Direction=Vector(0, 0, 1), Length=1)
test_line = Curve(line_sdl_2)
get_name = GhPythonScript(Component=test_line)  # -> Name
# ---------- get_name: Python ----------
# Mark Ericson 1.17.19
   #take from forum discussion thread https://www.grasshopper3d.com/forum/topics/python-get-label-name-of-input-components
    #edited version of code  by Mostapha Sadeghipour Roudsari

def GetComponentName():
    Comp = ghenv.Component.Params.Input[0]
    sources = Comp.Sources

    if sources.Count == 0: 
        return components

    for source in sources:
        attr = source.Attributes
        if (attr is None) or (attr.GetTopLevel is None):
            pass
        else:

            component = attr.GetTopLevel.DocObject
            componentName = component.NickName

            return componentName
Name = GetComponentName()
# ---------- end get_name ----------
panel = Panel(get_name)
