# Grasshopper definition folded plane_cluster.gh (Grasshopper 1.0.7)

vector_at_angle = PythonScript(angle="30")  # -> vector
# ---------- vector_at_angle: Python ----------
import rhinoscriptsyntax as rs
import math
if angle == None:
    Vector = None
else:
    c=rs.AddPoint(0,0,0)
    f=math.radians(float(angle))
    l=rs.AddPoint(math.cos(f),math.sin(f),0)
    d=rs.VectorCreate(l,c)
    vector =rs.VectorUnitize(d)
# ---------- end vector_at_angle ----------
line_sdl = LineSDL(Start="0,0,0", Direction=vector_at_angle, Length="1")
line = Line(line_sdl)
fold_proportion = Number("-.5")
length = Length(Curve=line)
point_on_curve = PointOnCurve(line, parameter=0.5)
end_points = EndPoints(Curve=line)  # -> Start, End
line_2 = Line(StartPoint=end_points.Start, EndPoint=point_on_curve)
multiplication = Multiplication(A=length, B=fold_proportion)
perpendicular = GhPythonScript(line=line_2)  # -> Perp; inputs line: Line
# ---------- perpendicular: Python ----------
__author__ = "mericson"
__version__ = "2019.01.11"

import rhinoscriptsyntax as rs
import math
import Rhino as rh

if line == None:
    line = None
else:
    a = 0,0,0
    b = 0,0,1
    Z = rs.VectorCreate(a,b)
    c = rh.Geometry.Line.PointAt(line,1)
    d = rh.Geometry.Line.PointAt(line,0)
    vector2 = rs.VectorCreate(c,d)
    Perp = rs.VectorRotate(vector2,90,Z)
# ---------- end perpendicular ----------
amplitude = Amplitude(Vector=perpendicular, Amplitude=multiplication)
move = Move(Geometry=point_on_curve, Motion=amplitude)  # -> Geometry, Transform
merge = Merge(Data1=end_points.Start, Data2=move.Geometry, Data3=end_points.End)
polyline = PolyLine(Vertices=merge, Closed=False)
polyline_2 = Geometry(polyline)
