# Grasshopper definition 01_2_Projection_In Class_take.gh (Grasshopper 1.0.7)
# plug-ins: Human, LunchBox

panel = Panel("""10
15""")
projection_options = Panel("0")
centered_page = GhPythonScript(width="10", height="10", centerX="0", centerY="0")  # -> rectangle
# ---------- centered_page: Python ----------
__author__ = "ericsonm"
__version__ = "2019.01.15"

import rhinoscriptsyntax as rs

if (width or height) == None:
    rectangle = None

else:

    x1 = float(width)
    y1 = float(height)
    xc = x1/-2 + float(centerX)
    yc = y1/-2 + float(centerY)

    rectangle = rs.AddRectangle((xc,yc,0),x1,y1)
# ---------- end centered_page ----------
series = Series(Start="30", Step="2", Count="2")  # -> graft(Series)
series_2 = Series(Start=0, Step=1, Count=10)
# A
# Variables + Controls
vector_at_angle = PythonScript()  # -> vector
# ---------- vector_at_angle: Python ----------
import rhinoscriptsyntax as rs
import math
if angle == None:
    Vector = None
else:
    c=rs.AddPoint(0,0,0)
    f=math.radians(float(angle))
    l=rs.AddPoint(math.cos(f),math.sin(f),0)
    d=rs.VectorCreate(l,c)
    vector =rs.VectorUnitize(d)
# ---------- end vector_at_angle ----------
division = Division(A="10", B=panel)
panel_2 = Panel(series)
panel_3 = Panel(division)
trig_circle = GhPythonScript(
    radiusX=panel_3,
    radiusY=panel_3,
    centerX="0",
    centerZ="0",
    centerY="0",
    start="0",
    stop="180",
    sides="18",
    centerline=Toggle(True))  # -> points, graft(polyline), center, graft(start), lines, graft(end)
# ---------- trig_circle: Python ----------
                
                
__author__ = "mericson"
__version__ = "2019.01.07"
                
import rhinoscriptsyntax as rs
import math
#creates a circle based on trigonmetric functions
#returns (points,polyline,center,start,end,lines)
def TrigCircle(radiusX,radiusY,centerX,centerY,centerZ,start,stop,sides,centerline):
                    
    sa = float(start) 
    so = float(stop) + sa
    se = float(stop)/float(sides)
                
    rx = float(radiusX)
    ry = float(radiusY)
                
    cx = float(centerX)
    cy = float(centerY)
    cz = float(centerZ)
                
    #add center point
    center = rs.AddPoint(cx,cy,cz)
                
    #create an empty list in which to collect the points
    points = []
    #create points using sine, cosine and range
    for i in rs.frange(math.radians(sa), math.radians(so),math.radians(se)):
        p = rs.AddPoint(math.cos(i)*rx + cx, math.sin(i)*ry + cy, cz)
        points.append(p)
                
                
                
    #Add polyline to the points
    polyline = rs.AddPolyline(points)
                
                
                
    #select the first point on the circle
    start = points[0]
    
    #get the index of the last point in the circle
    m = len(points) - 1
    
    #select the last point in the circle with the index
    end = points[m]
    
    #adds centerlines to the circle
    lines = []
    if centerline:
        for i in points:
            l = rs.AddLine(center,i)
            lines.append(l)
    else:
        lines = None

    return(points,polyline,center,start,end,lines)
                
                
                
#calls the function
circle = TrigCircle(radiusX,radiusY,centerX,centerY,centerZ,start,stop,sides,centerline)
                
#retrieves each item returned from the function and assigns it to an output
points   = circle[0]
polyline = circle[1]
center   = circle[2]
start    = circle[3]
end      = circle[4]
lines    = circle[5]
# ---------- end trig_circle ----------
number = Number(graft(panel_3))
point = Point(flatten(trig_circle.points))
tree_statistics = TreeStatistics(Tree=trig_circle.points)  # -> Paths, Length, Count
# reference lines and objects
list_item = ListItem(List=flatten(trig_circle.center), Index=0, Wrap=True)
relay = Relay()
list_item_2 = ListItem(List=tree_statistics.Length, Index=0, Wrap=True)
list_item_3 = ListItem(List=flatten(number), Index="0", Wrap=True)
list_item_4 = ListItem(List=flatten(trig_circle.start), Index="0", Wrap=True)
unit_y = UnitY(Factor=1)
merge = Merge(Data1="1", Data2="-1")  # -> graft(Result)
unit_y_2 = UnitY(Factor="-1")
# G
# H
# Line Type
# Layers
page_border = Geometry(centered_page)
list_of_points_to_label = Point(trig_circle.points)

# ---- group: TEXT LABELS
add_text = Panel("""a
b""")
text_size = Panel(".02")
point_2 = Point(list_of_points_to_label)
list_length = ListLength(List=point_2)
linear_gradient = GhPythonScript(R="0", G="0", B="0", Percent=".5")  # -> Color
# ---------- linear_gradient: Python ----------
__author__ = "ericsonm"
__version__ = "2019.01.15"

import rhinoscriptsyntax as rs

def LinearColorGradient(R,G,B,R2,G2,B2,ColorPercentage):
    
    if ColorPercentage > 1:
        R3 = None
        G3 = None
        B3 = None
    else:
        #This function defines linear color gradient by treating R,G,B as coordinates on a 3D line.
        #The base color that will be altered by the percentage should be entered in the second R2,G2,B2 valu
    
        Rdiff = float(R2) - float(R)
        Gdiff = float(G2) - float(G)
        Bdiff = float(B2) - float(B)


        t = float(ColorPercentage)


        R3 = float(R) + Rdiff*t
        G3 = float(G) + Gdiff*t
        B3 = float(B) + Bdiff*t



    return R3,G3,B3


if (R or G or B or Percent) is None:
    Color = None
else: 
    Color1 = LinearColorGradient(255,255,255,R,G,B,Percent)

    R3 = Color1[0]
    G3 = Color1[1]
    B3 = Color1[2]

    Color = rs.CreateColor(R3,G3,B3)
# ---------- end linear_gradient ----------
series_3 = Series(Start=0, Step=1, Count=list_length)
integer = Integer(series_3)
concatenate = Concatenate(FragmentA=integer, FragmentB=graft(add_text))
text_tag_3d = TextTag3D(Location=point_2, Text=concatenate, Size=text_size, Colour=linear_gradient, Justification=5)

# ---- group: section line
radians = Radians(Degrees=panel_2)
radius = Number(list_item_3)
sine = Sine(Value=radians)
vector_at_angle_2 = PythonScript(angle=panel_2)  # -> vector; same code as vector_at_angle
division_2 = Division(A=radius, B=sine)
point_3 = Point(list_item_4)
vector = Vector(vector_at_angle_2)

# ----
multiplication = Multiplication(A=division_2, B="1.5")

# ---- group: section line (continued)
length = Number(multiplication)
line_sdl = LineSDL(Start=point_3, Direction=vector, Length=length)

# ---- group: reference line 1
radians_2 = Radians(Degrees=panel_2)
cosine = Cosine(Value=radians_2)
unit_x = UnitX(Factor=1)
multiplication_2 = Multiplication(A=cosine, B=length)
line_sdl_2 = LineSDL(Start=list_item_4, Direction=unit_x, Length=multiplication_2)

# ----
unit_y_3 = UnitY(Factor="-1")
line_sdl_3 = LineSDL(Start=list_item_4, Direction=unit_y_3, Length=multiplication_2)

# ---- group: section 1
unit_y_4 = UnitY(Factor=1)
line_sdl_4 = LineSDL(Start=point_3, Direction=unit_y_4, Length=list_item_3)

# ----
triangle = Triangle(line=line_sdl, height_ratio="-.1")
arc_section = ArcSection(line=line_sdl, height_ratio="-.1")
stream_filter = StreamFilter(Gate=projection_options, Stream0=line_sdl, Stream1=arc_section, Stream2=triangle)
# B
reference_lines = Relay([line_sdl_3, line_sdl_2])

# ---- group: PROJECTION TO SECTION
unit_x_2 = UnitX(Factor=1)
projection = PythonScript(points=point, geometry=stream_filter, vector=unit_x_2)  # -> lines
# ---------- projection: Python ----------
import rhinoscriptsyntax as rs
import math
if (points or geometry or vector) == None:
    lines = None
else:

    d= vector
    n=rs.VectorUnitize(d)
    e=rs.ExtrudeCurveStraight(geometry,(0,0,0),(0,0,1))
    q=rs.ProjectPointToSurface(points,e,n)

    p2=rs.AddPoints(q)
    for i in p2:
        lines=rs.AddLine(points,i)
    if p2:
        del p2
# ---------- end projection ----------
point_on_curve = PointOnCurve(projection, parameter=1)

# ---- group: ALLOWS PROJECTION TO MOVE PAST 90
# projection
point_on_curve_2 = PointOnCurve(line_sdl, parameter=1)
xz_plane = XZPlane(Origin=Point(0, 0, 0))
project = Project(Geometry=point_on_curve_2, Plane=xz_plane)  # -> Geometry, Transform

xz_plane_2 = XZPlane(Origin=Point(0, 0, 0))
project_2 = Project(Geometry=point_on_curve, Plane=xz_plane_2)  # -> Geometry, Transform

# ---- group: PROJECTION TO REFERENCE LINE 1
projection_2 = PythonScript(points=point_on_curve, geometry=line_sdl_2, vector=unit_y)  # -> lines
# ---------- projection_2: Python ----------
import rhinoscriptsyntax as rs
import math
if (points or geometry or vector) == None:
    lines = None
else:

    d= vector
    n=rs.VectorUnitize(d)
    e=rs.ExtrudeCurveStraight(geometry,(0,0,0),(0,0,1))
    q=rs.ProjectPointToSurface(points,e,n)
    p2=rs.AddPoints(q)
    for i in p2:
        lines=rs.AddLine(points,i)
    if p2:
        del p2
# ---------- end projection_2 ----------
point_on_curve_3 = PointOnCurve(projection_2, parameter=1)

# ---- group: ROTATE TO R2
radians_3 = Radians(Degrees="-90")
rotate = Rotate(Geometry=project_2.Geometry, Angle=radians_3, Plane=point_3)  # -> Geometry, Transform
rotation_to_r2 = Point(rotate.Geometry)

# ----
distance = Distance(PointA=list_item_4, PointB=project.Geometry)
distance_2 = Distance(PointA=project.Geometry, PointB=project_2.Geometry)
index_of_max = PythonScript(values=flatten(distance))  # -> IMin, IMax; inputs values: list
# ---------- index_of_max: Python ----------
q=[values]
for i in values:
    IMax=list.index(values,max(values))
    IMin=list.index(values,min(values))
# ---------- end index_of_max ----------

# ---- group: Rotation Arcs
distance_3 = Distance(PointA=point_3, PointB=project_2.Geometry)
arc = Arc(Plane=point_3, Radius=distance_3, Angle=radians_3)  # -> Arc, Length

# ----
list_item_5 = ListItem(List=flatten(distance), Index=index_of_max.IMax, Wrap=True)
# C
line_sdl_5 = LineSDL(Start=list_item, Direction=unit_y_2, Length=list_item_5)
point_on_curve_4 = PointOnCurve(line_sdl_5, parameter=1)
# projected curves
circle = Circle(Plane=point_on_curve_4, Radius=distance_2)

# ---- group: Project to Top View curve
multiplication_3 = Multiplication(A=list_item_3, B="2")
unit_x_3 = UnitX(Factor="-1.1")
unit_y_5 = UnitY(Factor=merge)
line_sdl_6 = LineSDL(Start=rotation_to_r2, Direction=unit_x_3, Length=multiplication_3)

# ----
stream_filter_2 = StreamFilter(Gate="1", Stream0=line_sdl_6, Stream1=circle)

# ---- group: Project to Top View curve (continued)
projection_3 = PythonScript(points=point, geometry=stream_filter_2, vector=unit_y_5)  # -> lines; same code as projection_2

# ----
projections = Relay([arc.Arc, projection, projection_3, projection_2, stream_filter_2])

point_on_curve_5 = PointOnCurve(projection_3, parameter=1)
partition_list = PartitionList(List=flatten(point_on_curve_5), Size=list_item_2)
polyline = PolyLine(Vertices=partition_list, Closed=False)

# ----
# D
# E
# F
# Views
# Recording
relay_2 = Relay([trig_circle.polyline, polyline, stream_filter])
semicircle = Geometry(relay_2)
list_of_points_to_label_2 = Point(partition_list)

# ---- group: TEXT LABELS
add_text_2 = Panel("""a
b
a
b""")
text_size_2 = Panel(".02")
point_4 = Point(list_of_points_to_label_2)
list_length_2 = ListLength(List=point_4)
linear_gradient_2 = GhPythonScript(R="0", G="0", B="0", Percent=".5")  # -> Color; same code as linear_gradient
series_4 = Series(Start=0, Step=1, Count=list_length_2)
integer_2 = Integer(series_4)
concatenate_2 = Concatenate(FragmentA=integer_2, FragmentB=graft(add_text_2))
text_tag_3d_2 = TextTag3D(Location=point_4, Text=concatenate_2, Size=text_size_2, Colour=linear_gradient_2, Justification=5)

# ---- group: Preview and Bake
# Preview and Bake
button = Button()
get_name = GhPythonScript(Component=page_border)  # -> Geometry, Name
# ---------- get_name: Python ----------
# Mark Ericson 1.17.19
   #take from forum discussion thread https://www.grasshopper3d.com/forum/topics/python-get-label-name-of-input-components
    #edited version of code  by Mostapha Sadeghipour Roudsari

def GetComponentName():
    Comp = ghenv.Component.Params.Input[0]
    sources = Comp.Sources

    if sources.Count == 0: 
        return components

    for source in sources:
        attr = source.Attributes
        if (attr is None) or (attr.GetTopLevel is None):
            pass
        else:

            component = attr.GetTopLevel.DocObject
            componentName = component.NickName

            return componentName

if Component == None:
    pass
else:
    Name = GetComponentName()
    Geometry = Component
# ---------- end get_name ----------
linear_gradient_3 = GhPythonScript(R="0", G="0", B="0", Percent="1")  # -> Color; same code as linear_gradient
custom_preview = CustomPreview(Geometry=get_name.Geometry, Material=linear_gradient_3)

# ----
panel_4 = Panel(get_name.Name)

# ---- group: Preview and Bake (continued)
object_bake = ObjectBake(
    BakeToggle=button,
    GeometryObjects=get_name.Geometry,
    Layer=panel_4,
    ObjectName=panel_4,
    ObjectColor=linear_gradient_3,
    LayerColor=linear_gradient_3)

# ----
points_to_inches = GhPythonScript(points=".15")  # -> inches
# ---------- points_to_inches: Python ----------
__author__ = "marke"
__version__ = "2020.01.24"

import rhinoscriptsyntax as rs
if points == None:
    pass
else:
    
    p = float(points)

    inches = p/72
# ---------- end points_to_inches ----------
custom_preview_lineweights = CustomPreviewLineweights(Geometry=get_name.Geometry, Shader=linear_gradient_3, Thickness=points_to_inches, Absolute=Toggle(True))

# ---- group: Preview and Bake
get_name_2 = GhPythonScript(Component=semicircle)  # -> Geometry, Name; same code as get_name
linear_gradient_4 = GhPythonScript(R="0", G="47", B="95", Percent="1")  # -> Color; same code as linear_gradient
custom_preview_2 = CustomPreview(Geometry=get_name_2.Geometry, Material=linear_gradient_4)

# ----
panel_5 = Panel(get_name_2.Name)

# ---- group: Preview and Bake (continued)
object_bake_2 = ObjectBake(
    BakeToggle=Button(),
    GeometryObjects=get_name_2.Geometry,
    Layer=panel_5,
    ObjectName=panel_5,
    ObjectColor=linear_gradient_4,
    LayerColor=linear_gradient_4)

# ----
points_to_inches_2 = GhPythonScript(points=".375")  # -> inches; same code as points_to_inches
custom_preview_lineweights_2 = CustomPreviewLineweights(Geometry=get_name_2.Geometry, Shader=linear_gradient_4, Thickness=points_to_inches_2, Absolute=Toggle(True))

# ---- group: Preview and Bake
get_name_3 = GhPythonScript(Component=reference_lines)  # -> Geometry, Name; same code as get_name
linear_gradient_5 = GhPythonScript(R="0", G="0", B="0", Percent=".75")  # -> Color; same code as linear_gradient
custom_preview_3 = CustomPreview(Geometry=get_name_3.Geometry, Material=linear_gradient_5)

# ----
panel_6 = Panel(get_name_3.Name)

# ---- group: Preview and Bake (continued)
object_bake_3 = ObjectBake(
    BakeToggle=Button(),
    GeometryObjects=get_name_3.Geometry,
    Layer=panel_6,
    ObjectName=panel_6,
    ObjectColor=linear_gradient_5,
    LayerColor=linear_gradient_5)

# ----
points_to_inches_3 = GhPythonScript(points=".1")  # -> inches; same code as points_to_inches
custom_preview_lineweights_3 = CustomPreviewLineweights(Geometry=get_name_3.Geometry, Shader=linear_gradient_5, Thickness=points_to_inches_3, Absolute=Toggle(True))

# ---- group: Preview and Bake
get_name_4 = GhPythonScript(Component=projections)  # -> Geometry, Name; same code as get_name
linear_gradient_6 = GhPythonScript(R="0", G="0", B="0", Percent=".4")  # -> Color; same code as linear_gradient
custom_preview_4 = CustomPreview(Geometry=get_name_4.Geometry, Material=linear_gradient_6)

# ----
panel_7 = Panel(get_name_4.Name)

# ---- group: Preview and Bake (continued)
object_bake_4 = ObjectBake(
    BakeToggle=Button(),
    GeometryObjects=get_name_4.Geometry,
    Layer=panel_7,
    ObjectName=panel_7,
    ObjectColor=linear_gradient_6,
    LayerColor=linear_gradient_6)

# ----
points_to_inches_4 = GhPythonScript(points=".15")  # -> inches; same code as points_to_inches
custom_preview_lineweights_4 = CustomPreviewLineweights(Geometry=get_name_4.Geometry, Shader=linear_gradient_6, Thickness=points_to_inches_4, Absolute=Toggle(True))

# ==== cluster ArcSection
height_ratio = ClusterInput()
line = ClusterInput()
height_ratio_2 = Number(height_ratio)
line_2 = Line(line)
point_on_curve = PointOnCurve(line_2, parameter=0.5)
length = Length(Curve=line_2)
perpendicular = GhPythonScript(line=line_2)  # -> Perp; inputs line: Line
# ---------- perpendicular: Python ----------
__author__ = "mericson"
__version__ = "2019.01.11"

import rhinoscriptsyntax as rs
import math
import Rhino as rh

if line == None:
    line = None
else:
    a = 0,0,0
    b = 0,0,1
    Z = rs.VectorCreate(a,b)
    c = rh.Geometry.Line.PointAt(line,1)
    d = rh.Geometry.Line.PointAt(line,0)
    vector2 = rs.VectorCreate(c,d)
    Perp = rs.VectorRotate(vector2,90,Z)
# ---------- end perpendicular ----------
end_points = EndPoints(Curve=line_2)  # -> Start, End
multiplication = Multiplication(A=length, B=height_ratio_2)
amplitude = Amplitude(Vector=perpendicular, Amplitude=multiplication)
move = Move(Geometry=point_on_curve, Motion=amplitude)  # -> Geometry, Transform
arc_3pt = Arc3Pt(PointA=end_points.Start, PointB=move.Geometry, PointC=end_points.End)  # -> Arc, Plane, Radius
arc = Geometry(arc_3pt.Arc)
arc_2 = ClusterOutput(arc)

# ==== cluster Triangle
height_ratio = ClusterInput()
line = ClusterInput()
height_ratio_2 = Number(height_ratio)
line_2 = Line(line)
point_on_curve = PointOnCurve(line_2, parameter=0.5)
length = Length(Curve=line_2)
perpendicular = GhPythonScript(line=line_2)  # -> Perp; inputs line: Line; same code as perpendicular
end_points = EndPoints(Curve=line_2)  # -> Start, End
multiplication = Multiplication(A=length, B=height_ratio_2)
amplitude = Amplitude(Vector=perpendicular, Amplitude=multiplication)
move = Move(Geometry=point_on_curve, Motion=amplitude)  # -> Geometry, Transform
merge = Merge(Data1=end_points.Start, Data2=move.Geometry, Data3=end_points.End)
polyline = PolyLine(Vertices=merge, Closed=False)
triangle = Geometry(polyline)
triangle_2 = ClusterOutput(triangle)
