# Grasshopper definition Get XYZ and Move XYZ.gh (Grasshopper 1.0.7)

move_point = PythonScript()  # -> NPoint; inputs point: Point3d
# ---------- move_point: Python ----------
#moves point by adding to x, y, and z values. 
import rhinoscriptsyntax as rs
import Rhino as rh
if point == None:
    point = rh.Geometry.Point3d(0,0,0)
if X1 == None:
    X1 = 0
if Y1 == None:
    Y1 = 0
if Z1 == None:
    Z1 = 0


x = (rh.Geometry.Point3d.X.GetValue(point)) + float(X1)
y = (rh.Geometry.Point3d.Y.GetValue(point)) + float(Y1)
z = (rh.Geometry.Point3d.Z.GetValue(point)) + float(Z1)

NPoint = rs.AddPoint(x,y,z)
# ---------- end move_point ----------
get_z = PythonScript()  # -> Z; inputs point: Point3d
# ---------- get_z: Python ----------
import Rhino as rh




Z = (rh.Geometry.Point3d.Z.GetValue(point))
# ---------- end get_z ----------
get_x = PythonScript()  # -> X; inputs point: Point3d
# ---------- get_x: Python ----------
import Rhino as rh




X = (rh.Geometry.Point3d.X.GetValue(point))
# ---------- end get_x ----------
get_y = PythonScript()  # -> Y; inputs point: Point3d
# ---------- get_y: Python ----------
import Rhino as rh




Y = (rh.Geometry.Point3d.Y.GetValue(point))
# ---------- end get_y ----------
