# Grasshopper definition section line.gh (Grasshopper 1.0.7)

unit_y = UnitY(Factor=1)
line_sdl = LineSDL(Start="0,0,0", Direction=unit_y, Length="1")

# ---- group: section line
radians = Radians(Degrees="10")
radius = Number("1")
sine = Sine(Value=radians)
vector_at_angle = PythonScript(angle="10")  # -> vector
# ---------- vector_at_angle: Python ----------
import rhinoscriptsyntax as rs
import math
if angle == None:
    Vector = None
else:
    c=rs.AddPoint(0,0,0)
    f=math.radians(float(angle))
    l=rs.AddPoint(math.cos(f),math.sin(f),0)
    d=rs.VectorCreate(l,c)
    vector =rs.VectorUnitize(d)
# ---------- end vector_at_angle ----------
division = Division(A=radius, B=sine)
point = Point("0,0,0")
vector = Vector(vector_at_angle)
length = Number(division)
line_sdl_2 = LineSDL(Start=point, Direction=vector, Length=length)
