# Grasshopper definition arc_cluster inclass.gh (Grasshopper 1.0.7)

vector_at_angle = PythonScript(angle="30")  # -> vector
# ---------- vector_at_angle: Python ----------
import rhinoscriptsyntax as rs
import math
if angle == None:
    Vector = None
else:
    c=rs.AddPoint(0,0,0)
    f=math.radians(float(angle))
    l=rs.AddPoint(math.cos(f),math.sin(f),0)
    d=rs.VectorCreate(l,c)
    vector =rs.VectorUnitize(d)
# ---------- end vector_at_angle ----------
arc_section = ArcSection()
line_sdl = LineSDL(Start="0,0,0", Direction=vector_at_angle, Length="1")
height_ratio = Number(".4")
line = Line(line_sdl)
height_ratio_2 = Number(height_ratio)
line_2 = Line(line)
point_on_curve = PointOnCurve(line_2, parameter=0.5)
length = Length(Curve=line_2)
perpendicular = GhPythonScript(line=line_2)  # -> Perp; inputs line: Line; same code as perpendicular
end_points = EndPoints(Curve=line_2)  # -> Start, End
multiplication = Multiplication(A=length, B=height_ratio_2)
amplitude = Amplitude(Vector=perpendicular, Amplitude=multiplication)
move = Move(Geometry=point_on_curve, Motion=amplitude)  # -> Geometry, Transform
arc_3pt = Arc3Pt(PointA=end_points.Start, PointB=move.Geometry, PointC=end_points.End)  # -> Arc, Plane, Radius
arc = Geometry(arc_3pt.Arc)
arc_2 = Geometry(arc)

# ==== cluster ArcSection
line = ClusterInput()
height_ratio = ClusterInput()
height_ratio_2 = Number(height_ratio)
line_2 = Line(line)
point_on_curve = PointOnCurve(line_2, parameter=0.5)
length = Length(Curve=line_2)
perpendicular = GhPythonScript(line=line_2)  # -> Perp; inputs line: Line
# ---------- perpendicular: Python ----------
__author__ = "mericson"
__version__ = "2019.01.11"

import rhinoscriptsyntax as rs
import math
import Rhino as rh

if line == None:
    line = None
else:
    a = 0,0,0
    b = 0,0,1
    Z = rs.VectorCreate(a,b)
    c = rh.Geometry.Line.PointAt(line,1)
    d = rh.Geometry.Line.PointAt(line,0)
    vector2 = rs.VectorCreate(c,d)
    Perp = rs.VectorRotate(vector2,90,Z)
# ---------- end perpendicular ----------
end_points = EndPoints(Curve=line_2)  # -> Start, End
multiplication = Multiplication(A=length, B=height_ratio_2)
amplitude = Amplitude(Vector=perpendicular, Amplitude=multiplication)
move = Move(Geometry=point_on_curve, Motion=amplitude)  # -> Geometry, Transform
arc_3pt = Arc3Pt(PointA=end_points.Start, PointB=move.Geometry, PointC=end_points.End)  # -> Arc, Plane, Radius
arc = Geometry(arc_3pt.Arc)
arc_2 = ClusterOutput(arc)
