# Grasshopper definition line weight.gh (Grasshopper 1.0.7)
# plug-ins: Human

points_to_inches = GhPythonScript(points=".15")  # -> inches
# ---------- points_to_inches: Python ----------
__author__ = "marke"
__version__ = "2020.01.24"

import rhinoscriptsyntax as rs
if points == None:
    pass
else:
    
    p = float(points)

    inches = p/72
# ---------- end points_to_inches ----------
custom_preview_lineweights = CustomPreviewLineweights(
    Shader={diffuse=RGB(255, 105, 180), emission=RGB(76, 32, 54), shine=0.5, specular=RGB(255, 255, 255), transparency=0},
    Thickness=points_to_inches,
    Absolute=Toggle(True))
