# Grasshopper definition triangle_cluster inclass.gh (Grasshopper 1.0.7)

vector_at_angle = PythonScript(angle="30")  # -> vector
# ---------- vector_at_angle: Python ----------
import rhinoscriptsyntax as rs
import math
if angle == None:
    Vector = None
else:
    c=rs.AddPoint(0,0,0)
    f=math.radians(float(angle))
    l=rs.AddPoint(math.cos(f),math.sin(f),0)
    d=rs.VectorCreate(l,c)
    vector =rs.VectorUnitize(d)
# ---------- end vector_at_angle ----------
line_sdl = LineSDL(Start="0,0,0", Direction=vector_at_angle, Length="1")
cluster = Cluster(line=line_sdl, height_ratio=".3")
geometry = Geometry(cluster)

# ==== cluster Cluster
line = ClusterInput()
height_ratio = ClusterInput()
line_2 = Line(line)
height_ratio_2 = Number(height_ratio)
height_ratio_3 = Number(height_ratio_2)
divide_curve = DivideCurve(Curve=line_2, Count="2", Kinks=False)  # -> Points, Tangents, Parameters
list_item = ListItem(List=divide_curve.Points, Index=0, Wrap=True)
list_item_2 = ListItem(List=divide_curve.Points, Index="1", Wrap=True)
line_3 = Line(StartPoint=list_item, EndPoint=list_item_2)
perpendicular = GhPythonScript(line=line_2)  # -> Perp; inputs line: Line
# ---------- perpendicular: Python ----------
__author__ = "mericson"
__version__ = "2019.01.11"

import rhinoscriptsyntax as rs
import math
import Rhino as rh

if line == None:
    line = None
else:
    a = 0,0,0
    b = 0,0,1
    Z = rs.VectorCreate(a,b)
    c = rh.Geometry.Line.PointAt(line,1)
    d = rh.Geometry.Line.PointAt(line,0)
    vector2 = rs.VectorCreate(c,d)
    Perp = rs.VectorRotate(vector2,90,Z)
# ---------- end perpendicular ----------
line_4 = Line(line_3)
point_on_curve = PointOnCurve(line_4, parameter=0.5)
length = Length(Curve=line_4)
end_points = EndPoints(Curve=line_4)  # -> Start, End
point_on_curve_2 = PointOnCurve(line_2, parameter=0.5)
multiplication = Multiplication(A=length, B=height_ratio_3)
amplitude = Amplitude(Vector=perpendicular, Amplitude=multiplication)
reverse = Reverse(Vector=amplitude)
move = Move(Geometry=point_on_curve, Motion=amplitude)  # -> Geometry, Transform
move_2 = Move(Geometry=list_item_2, Motion=reverse)  # -> Geometry, Transform
line_5 = Line(StartPoint=point_on_curve_2, EndPoint=move_2.Geometry)
perpendicular_2 = GhPythonScript(line=line_5)  # -> Perp; inputs line: Line; same code as perpendicular
unit_z = UnitZ(Factor=1)
merge = Merge(Data1=end_points.Start, Data2=move.Geometry, Data3=move_2.Geometry)
polyline = PolyLine(Vertices=merge, Closed=False)
construct_plane = ConstructPlane(Origin=point_on_curve_2, XAxis=line_5, YAxis=unit_z)
triangle = Geometry(polyline)
triangle_2 = Geometry(triangle)
mirror = Mirror(Geometry=triangle, Plane=construct_plane)  # -> Geometry, Transform
join_curves = JoinCurves(Curves=[polyline, mirror.Geometry], Preserve=False)
explode = Explode(Curve=join_curves, Recursive=True)  # -> Segments, Vertices
nurbs_curve = NurbsCurve(Vertices=explode.Vertices, Degree="2", Periodic=False)  # -> Curve, Length, Domain
curve = ClusterOutput(nurbs_curve.Curve)
