# Grasshopper definition 01_3_Projection_In Class.gh (Grasshopper 1.0.7)
# plug-ins: Human, LunchBox

panel = Panel("1")
# Variables + Controls
panel_2 = Panel("10")
panel_3 = Panel("""10
15""")
projection_options = Panel("1")
centered_page = GhPythonScript(width=panel_2, height=panel_2, centerX="0", centerY="0")  # -> rectangle
# ---------- centered_page: Python ----------
__author__ = "ericsonm"
__version__ = "2019.01.15"

import rhinoscriptsyntax as rs

if (width or height) == None:
    rectangle = None

else:

    x1 = float(width)
    y1 = float(height)
    xc = x1/-2 + float(centerX)
    yc = y1/-2 + float(centerY)

    rectangle = rs.AddRectangle((xc,yc,0),x1,y1)
# ---------- end centered_page ----------
series = Series(Start="20", Step="2", Count="60")  # -> graft(Series)
series_2 = Series(Start="0", Step="2", Count="60")  # -> graft(Series)
division = Division(A=panel_2, B=panel_3)
panel_4 = Panel(series)
panel_5 = Panel(division)
trig_circle = GhPythonScript(
    radiusX=panel_5,
    radiusY=panel_5,
    centerX="0",
    centerZ="0",
    centerY="0",
    start="0",
    stop="180",
    sides="18",
    centerline=Toggle(True))  # -> flatten(points), graft(polyline), center, graft(start), lines, graft(end)
# ---------- trig_circle: Python ----------
                
                
__author__ = "mericson"
__version__ = "2019.01.07"
                
import rhinoscriptsyntax as rs
import math
#creates a circle based on trigonmetric functions
#returns (points,polyline,center,start,end,lines)
def TrigCircle(radiusX,radiusY,centerX,centerY,centerZ,start,stop,sides,centerline):
                    
    sa = float(start) 
    so = float(stop) + sa
    se = float(stop)/float(sides)
                
    rx = float(radiusX)
    ry = float(radiusY)
                
    cx = float(centerX)
    cy = float(centerY)
    cz = float(centerZ)
                
    #add center point
    center = rs.AddPoint(cx,cy,cz)
                
    #create an empty list in which to collect the points
    points = []
    #create points using sine, cosine and range
    for i in rs.frange(math.radians(sa), math.radians(so),math.radians(se)):
        p = rs.AddPoint(math.cos(i)*rx + cx, math.sin(i)*ry + cy, cz)
        points.append(p)
                
                
                
    #Add polyline to the points
    polyline = rs.AddPolyline(points)
                
                
                
    #select the first point on the circle
    start = points[0]
    
    #get the index of the last point in the circle
    m = len(points) - 1
    
    #select the last point in the circle with the index
    end = points[m]
    
    #adds centerlines to the circle
    lines = []
    if centerline:
        for i in points:
            l = rs.AddLine(center,i)
            lines.append(l)
    else:
        lines = None

    return(points,polyline,center,start,end,lines)
                
                
                
#calls the function
circle = TrigCircle(radiusX,radiusY,centerX,centerY,centerZ,start,stop,sides,centerline)
                
#retrieves each item returned from the function and assigns it to an output
points   = circle[0]
polyline = circle[1]
center   = circle[2]
start    = circle[3]
end      = circle[4]
lines    = circle[5]
# ---------- end trig_circle ----------
# A
number = Number(graft(panel_5))
list_item = ListItem(List=flatten(number), Index="0", Wrap=True)
list_item_2 = ListItem(List=flatten(trig_circle.start), Index="0", Wrap=True)
unit_y = UnitY(Factor=1)
list_length = ListLength(List=trig_circle.points)
division_2 = Division(A=list_length, B="2")
partition_list = PartitionList(List=trig_circle.points, Size=division_2)
# G
# H
# Layers
page_border = Geometry(centered_page)
list_of_points_to_label = Point(trig_circle.points)

# ---- group: TEXT LABELS
add_text = Panel("""a
b""")
text_size = Panel(".02")
point = Point(list_of_points_to_label)
list_length_2 = ListLength(List=point)
linear_gradient = GhPythonScript(R="0", G="0", B="0", Percent=".5")  # -> Color
# ---------- linear_gradient: Python ----------
__author__ = "ericsonm"
__version__ = "2019.01.15"

import rhinoscriptsyntax as rs

def LinearColorGradient(R,G,B,R2,G2,B2,ColorPercentage):
    
    if ColorPercentage > 1:
        R3 = None
        G3 = None
        B3 = None
    else:
        #This function defines linear color gradient by treating R,G,B as coordinates on a 3D line.
        #The base color that will be altered by the percentage should be entered in the second R2,G2,B2 valu
    
        Rdiff = float(R2) - float(R)
        Gdiff = float(G2) - float(G)
        Bdiff = float(B2) - float(B)


        t = float(ColorPercentage)


        R3 = float(R) + Rdiff*t
        G3 = float(G) + Gdiff*t
        B3 = float(B) + Bdiff*t



    return R3,G3,B3


if (R or G or B or Percent) is None:
    Color = None
else: 
    Color1 = LinearColorGradient(255,255,255,R,G,B,Percent)

    R3 = Color1[0]
    G3 = Color1[1]
    B3 = Color1[2]

    Color = rs.CreateColor(R3,G3,B3)
# ---------- end linear_gradient ----------
series_3 = Series(Start=0, Step=1, Count=list_length_2)
integer = Integer(series_3)
concatenate = Concatenate(FragmentA=integer, FragmentB=graft(add_text))
text_tag_3d = TextTag3D(Location=point, Text=concatenate, Size=text_size, Colour=linear_gradient, Justification=5)

# ---- group: section line
radians = Radians(Degrees=panel_4)
radius = Number(list_item)
sine = Sine(Value=radians)
vector_at_angle = PythonScript(angle=panel_4)  # -> vector
# ---------- vector_at_angle: Python ----------
import rhinoscriptsyntax as rs
import math
if angle == None:
    Vector = None
else:
    c=rs.AddPoint(0,0,0)
    f=math.radians(float(angle))
    l=rs.AddPoint(math.cos(f),math.sin(f),0)
    d=rs.VectorCreate(l,c)
    vector =rs.VectorUnitize(d)
# ---------- end vector_at_angle ----------
division_3 = Division(A=radius, B=sine)
point_2 = Point(list_item_2)
vector = Vector(vector_at_angle)

# ----
multiplication = Multiplication(A=division_3, B="1.01")

# ---- group: section line (continued)
length = Number(multiplication)
line_sdl = LineSDL(Start=point_2, Direction=vector, Length=length)

# ---- group: reference line 1
radians_2 = Radians(Degrees=panel_4)
cosine = Cosine(Value=radians_2)
unit_x = UnitX(Factor=1)
multiplication_2 = Multiplication(A=cosine, B=length)
line_sdl_2 = LineSDL(Start=list_item_2, Direction=unit_x, Length=multiplication_2)

# ----
# reference lines and objects
panel_7 = Panel("-1")
unit_y_2 = UnitY(Factor=panel_7)
line_sdl_3 = LineSDL(Start=list_item_2, Direction=unit_y_2, Length=multiplication_2)

# ---- group: section 1
unit_y_3 = UnitY(Factor=1)
line_sdl_4 = LineSDL(Start=point_2, Direction=unit_y_3, Length=list_item)

# ----
triangle = Triangle(line=line_sdl, height_ratio="-.2")
arc_section = ArcSection(line=line_sdl, height_ratio="-.2")
stream_filter = StreamFilter(Gate=projection_options, Stream0=line_sdl, Stream1=arc_section, Stream2=triangle)
# B
# projection
reference_lines = Relay([line_sdl_3, line_sdl_2])

# ---- group: PROJECTION TO SECTION
unit_x_2 = UnitX(Factor=1)
projection = PythonScript(points=trig_circle.points, geometry=stream_filter, vector=unit_x_2)  # -> lines
# ---------- projection: Python ----------
import rhinoscriptsyntax as rs
import math
if (points or geometry or vector) == None:
    lines = None
else:

    d= vector
    n=rs.VectorUnitize(d)
    e=rs.ExtrudeCurveStraight(geometry,(0,0,0),(0,0,1))
    q=rs.ProjectPointToSurface(points,e,n)

    p2=rs.AddPoints(q)
    for i in p2:
        lines=rs.AddLine(points,i)
    if p2:
        del p2
# ---------- end projection ----------
point_on_curve = PointOnCurve(projection, parameter=1)

# ---- group: project to section 1
curve_curve = CurveCurve(CurveA=projection, CurveB=line_sdl_4)  # -> Points, ParamsA, ParamsB

# ---- group: ALLOWS PROJECTION TO MOVE PAST 90
xz_plane = XZPlane(Origin=Point(0, 0, 0))
# C
project = Project(Geometry=point_on_curve, Plane=xz_plane)  # -> Geometry, Transform

# ---- group: PROJECTION TO REFERENCE LINE 1
projection_2 = PythonScript(points=point_on_curve, geometry=line_sdl_2, vector=unit_y)  # -> lines
# ---------- projection_2: Python ----------
import rhinoscriptsyntax as rs
import math
if (points or geometry or vector) == None:
    lines = None
else:

    d= vector
    n=rs.VectorUnitize(d)
    e=rs.ExtrudeCurveStraight(geometry,(0,0,0),(0,0,1))
    q=rs.ProjectPointToSurface(points,e,n)
    p2=rs.AddPoints(q)
    for i in p2:
        lines=rs.AddLine(points,i)
    if p2:
        del p2
# ---------- end projection_2 ----------
point_on_curve_2 = PointOnCurve(projection_2, parameter=1)

# ---- group: ROTATE TO R2
radians_3 = Radians(Degrees="-90")
rotate = Rotate(Geometry=project.Geometry, Angle=radians_3, Plane=point_2)  # -> Geometry, Transform
rotation_to_r2 = Point(rotate.Geometry)

# ---- group: Rotation Arcs
distance = Distance(PointA=point_2, PointB=project.Geometry)
arc = Arc(Plane=point_2, Radius=distance, Angle=radians_3)  # -> Arc, Length

# ----
distance_2 = Distance(PointA=rotation_to_r2, PointB=trig_circle.center)
list_item_3 = ListItem(List=flatten(trig_circle.center), Index=0, Wrap=True)
circle = Circle(Plane=list_item_3, Radius=distance_2)

list_item_4 = ListItem(List=distance_2, Index=0, Wrap=True)
unit_y_4 = UnitY(Factor=list_item_4)
move = Move(Geometry=circle, Motion=unit_y_4)  # -> Geometry, Transform
rotate_2 = Rotate(Geometry=move.Geometry, Angle=degrees(series_2), Plane=list_item_3)  # -> Geometry, Transform

move_2 = Move(Geometry=list_item_3, Motion=unit_y_4)  # -> Geometry, Transform

# ---- group: Project to Top View curve
multiplication_3 = Multiplication(A=list_item, B="2")
unit_x_3 = UnitX(Factor="-1.1")
line_sdl_5 = LineSDL(Start=rotation_to_r2, Direction=unit_x_3, Length=multiplication_3)
unit_y_5 = UnitY(Factor=1)

# ---- group: SURFACE FILTER
stream_filter_2 = StreamFilter(Gate=Toggle(True), Stream0=circle, Stream1=rotate_2.Geometry)
stream_filter_3 = StreamFilter(Gate="1", Stream0=line_sdl_5, Stream1=stream_filter_2)

# ---- group: Project to Top View curve (continued)
projection_3 = PythonScript(points=trig_circle.points, geometry=stream_filter_3, vector=unit_y_5)  # -> lines; same code as projection_2

# ----
# projected curves
projections = Relay([arc.Arc, projection, projection_3, stream_filter_3, projection_2])

# ---- group: SORT POINTS INTO CURVE SIZE
list_length_3 = ListLength(List=trig_circle.points)
division_4 = Division(A=list_length_3, B="2")

# ----
point_on_curve_3 = PointOnCurve(projection_3, parameter=1)

# ---- group: TRANSLATION TO 3D
deconstruct = Deconstruct(Point=point_on_curve_3)  # -> XComponent, YComponent, ZComponent
deconstruct_2 = Deconstruct(Point=trig_circle.points)  # -> XComponent, YComponent, ZComponent
construct_point = ConstructPoint(XCoordinate=deconstruct.XComponent, YCoordinate=deconstruct.YComponent, ZCoordinate=deconstruct_2.YComponent)  # -> flatten(Point)
partition_list_2 = PartitionList(List=construct_point, Size=division_4)
polyline = PolyLine(Vertices=partition_list_2, Closed=False)

# ---- group: SORT POINTS INTO CURVE SIZE (continued)
partition_list_3 = PartitionList(List=point_on_curve_3, Size=division_4)

# ----
polyline_2 = PolyLine(Vertices=partition_list_3, Closed=False)

# ----
# D
relay = Relay([trig_circle.polyline, polyline_2, stream_filter])
partition_list_4 = PartitionList(List=flatten(polyline), Size="30")
# E
# F
# Views
# Recording
# Line Type
relay_2 = Relay([relay, polyline])
semicircle = Geometry(relay_2)
list_of_points_to_label_2 = Point(partition_list_3)

# ---- group: TEXT LABELS
add_text_2 = Panel("""a
b""")
text_size_2 = Panel(".02")
point_3 = Point(list_of_points_to_label_2)
list_length_4 = ListLength(List=point_3)
linear_gradient_2 = GhPythonScript(R="0", G="0", B="0", Percent=".5")  # -> Color; same code as linear_gradient
series_4 = Series(Start=0, Step=1, Count=list_length_4)
integer_2 = Integer(series_4)
concatenate_2 = Concatenate(FragmentA=integer_2, FragmentB=graft(add_text_2))
text_tag_3d_2 = TextTag3D(Location=point_3, Text=concatenate_2, Size=text_size_2, Colour=linear_gradient_2, Justification=5)

# ---- group: Preview and Bake
# Preview and Bake
button = Button()
get_name = GhPythonScript(Component=page_border)  # -> Geometry, Name
# ---------- get_name: Python ----------
# Mark Ericson 1.17.19
   #take from forum discussion thread https://www.grasshopper3d.com/forum/topics/python-get-label-name-of-input-components
    #edited version of code  by Mostapha Sadeghipour Roudsari

def GetComponentName():
    Comp = ghenv.Component.Params.Input[0]
    sources = Comp.Sources

    if sources.Count == 0: 
        return components

    for source in sources:
        attr = source.Attributes
        if (attr is None) or (attr.GetTopLevel is None):
            pass
        else:

            component = attr.GetTopLevel.DocObject
            componentName = component.NickName

            return componentName

if Component == None:
    pass
else:
    Name = GetComponentName()
    Geometry = Component
# ---------- end get_name ----------
linear_gradient_3 = GhPythonScript(R="0", G="0", B="0", Percent="1")  # -> Color; same code as linear_gradient
custom_preview = CustomPreview(Geometry=get_name.Geometry, Material=linear_gradient_3)

# ----
panel_8 = Panel(get_name.Name)

# ---- group: Preview and Bake (continued)
object_bake = ObjectBake(
    BakeToggle=button,
    GeometryObjects=get_name.Geometry,
    Layer=panel_8,
    ObjectName=panel_8,
    ObjectColor=linear_gradient_3,
    LayerColor=linear_gradient_3)

# ----
points_to_inches = GhPythonScript(points=".15")  # -> inches
# ---------- points_to_inches: Python ----------
__author__ = "marke"
__version__ = "2020.01.24"

import rhinoscriptsyntax as rs
if points == None:
    pass
else:
    
    p = float(points)

    inches = p/72
# ---------- end points_to_inches ----------
custom_preview_lineweights = CustomPreviewLineweights(Geometry=get_name.Geometry, Shader=linear_gradient_3, Thickness=points_to_inches, Absolute=Toggle(True))

# ---- group: Preview and Bake
get_name_2 = GhPythonScript(Component=semicircle)  # -> Geometry, Name; same code as get_name
linear_gradient_4 = GhPythonScript(R="0", G="47", B="95", Percent="1")  # -> Color; same code as linear_gradient
custom_preview_2 = CustomPreview(Geometry=get_name_2.Geometry, Material=linear_gradient_4)

# ----
panel_9 = Panel(get_name_2.Name)

# ---- group: Preview and Bake (continued)
object_bake_2 = ObjectBake(
    BakeToggle=Button(),
    GeometryObjects=get_name_2.Geometry,
    Layer=panel_9,
    ObjectName=panel_9,
    ObjectColor=linear_gradient_4,
    LayerColor=linear_gradient_4)

# ----
points_to_inches_2 = GhPythonScript(points=".375")  # -> inches; same code as points_to_inches
custom_preview_lineweights_2 = CustomPreviewLineweights(Geometry=get_name_2.Geometry, Shader=linear_gradient_4, Thickness=points_to_inches_2, Absolute=Toggle(True))

# ---- group: Preview and Bake
get_name_3 = GhPythonScript(Component=reference_lines)  # -> Geometry, Name; same code as get_name
linear_gradient_5 = GhPythonScript(R="0", G="0", B="0", Percent=".75")  # -> Color; same code as linear_gradient
custom_preview_3 = CustomPreview(Geometry=get_name_3.Geometry, Material=linear_gradient_5)

# ----
panel_10 = Panel(get_name_3.Name)

# ---- group: Preview and Bake (continued)
object_bake_3 = ObjectBake(
    BakeToggle=Button(),
    GeometryObjects=get_name_3.Geometry,
    Layer=panel_10,
    ObjectName=panel_10,
    ObjectColor=linear_gradient_5,
    LayerColor=linear_gradient_5)

# ----
points_to_inches_3 = GhPythonScript(points=".1")  # -> inches; same code as points_to_inches
custom_preview_lineweights_3 = CustomPreviewLineweights(Geometry=get_name_3.Geometry, Shader=linear_gradient_5, Thickness=points_to_inches_3, Absolute=Toggle(True))

# ---- group: Preview and Bake
get_name_4 = GhPythonScript(Component=projections)  # -> Geometry, Name; same code as get_name
linear_gradient_6 = GhPythonScript(R="0", G="0", B="0", Percent=".2")  # -> Color; same code as linear_gradient
custom_preview_4 = CustomPreview(Geometry=get_name_4.Geometry, Material=linear_gradient_6)

# ----
panel_11 = Panel(get_name_4.Name)

# ---- group: Preview and Bake (continued)
object_bake_4 = ObjectBake(
    BakeToggle=Button(),
    GeometryObjects=get_name_4.Geometry,
    Layer=panel_11,
    ObjectName=panel_11,
    ObjectColor=linear_gradient_6,
    LayerColor=linear_gradient_6)

# ----
points_to_inches_4 = GhPythonScript(points=".05")  # -> inches; same code as points_to_inches
custom_preview_lineweights_4 = CustomPreviewLineweights(Geometry=get_name_4.Geometry, Shader=linear_gradient_6, Thickness=points_to_inches_4, Absolute=Toggle(True))

# ==== cluster ArcSection
height_ratio = ClusterInput()
line = ClusterInput()
height_ratio_2 = Number(height_ratio)
line_2 = Line(line)
point_on_curve = PointOnCurve(line_2, parameter=0.5)
length = Length(Curve=line_2)
perpendicular = GhPythonScript(line=line_2)  # -> Perp; inputs line: Line
# ---------- perpendicular: Python ----------
__author__ = "mericson"
__version__ = "2019.01.11"

import rhinoscriptsyntax as rs
import math
import Rhino as rh

if line == None:
    line = None
else:
    a = 0,0,0
    b = 0,0,1
    Z = rs.VectorCreate(a,b)
    c = rh.Geometry.Line.PointAt(line,1)
    d = rh.Geometry.Line.PointAt(line,0)
    vector2 = rs.VectorCreate(c,d)
    Perp = rs.VectorRotate(vector2,90,Z)
# ---------- end perpendicular ----------
end_points = EndPoints(Curve=line_2)  # -> Start, End
multiplication = Multiplication(A=length, B=height_ratio_2)
amplitude = Amplitude(Vector=perpendicular, Amplitude=multiplication)
move = Move(Geometry=point_on_curve, Motion=amplitude)  # -> Geometry, Transform
arc_3pt = Arc3Pt(PointA=end_points.Start, PointB=move.Geometry, PointC=end_points.End)  # -> Arc, Plane, Radius
arc = Geometry(arc_3pt.Arc)
arc_2 = ClusterOutput(arc)

# ==== cluster Triangle
height_ratio = ClusterInput()
line = ClusterInput()
height_ratio_2 = Number(height_ratio)
line_2 = Line(line)
point_on_curve = PointOnCurve(line_2, parameter=0.5)
length = Length(Curve=line_2)
perpendicular = GhPythonScript(line=line_2)  # -> Perp; inputs line: Line; same code as perpendicular
end_points = EndPoints(Curve=line_2)  # -> Start, End
multiplication = Multiplication(A=length, B=height_ratio_2)
amplitude = Amplitude(Vector=perpendicular, Amplitude=multiplication)
move = Move(Geometry=point_on_curve, Motion=amplitude)  # -> Geometry, Transform
merge = Merge(Data1=end_points.Start, Data2=move.Geometry, Data3=end_points.End)
polyline = PolyLine(Vertices=merge, Closed=False)
triangle = Geometry(polyline)
triangle_2 = ClusterOutput(triangle)
