# Grasshopper definition POINT GRAPHIC.gh (Grasshopper 1.0.7)

point_graphic = POINTGRAPHIC(plane=PlaneXY(0, 0, 0), radius=1)

# ==== cluster POINTGRAPHIC
radius = ClusterInput()
plane = ClusterInput()

# ---- group: point graphic
circle = Circle(Plane=plane, Radius=radius)
divide_curve = DivideCurve(Curve=circle, Count="2", Kinks=False)  # -> Points, Tangents, Parameters
list_item = ListItem(List=divide_curve.Points, Index=0, Wrap=True)
list_item_2 = ListItem(List=divide_curve.Points, Index="1", Wrap=True)
line = Line(StartPoint=list_item, EndPoint=list_item_2)
rotate = Rotate(Geometry=line, Angle=degrees("90"), Plane=graft(circle))  # -> Geometry, Transform

# ----
merge = Merge(Data1=line, Data2=rotate.Geometry)
point_graphic = ClusterOutput(merge)
