# Grasshopper definition Tree Item series.gh (Grasshopper 1.0.7)

tree = Relay()

# ---- group: Tree item series
tree_statistics = TreeStatistics(Tree=tree)  # -> Paths, Length, Count
list_item = ListItem(List=tree_statistics.Length, Index=0, Wrap=True)
series = Series(Start=0, Step=1, Count=tree_statistics.Count)
series_2 = Series(Start=0, Step=1, Count=list_item)  # -> graft(Series)
tree_item = TreeItem(Tree=tree, Path=series, Index=series_2, Wrap=True)
polyline = PolyLine(Vertices=tree_item, Closed=False)
