# Grasshopper definition vault lines cluster.gh (Grasshopper 1.0.7)

points_on_curves = Point()
points_on_curves_2 = Point(points_on_curves)
polyline = PolyLine(Vertices=points_on_curves_2, Closed=False)

# ---- group: joints
panel = Panel("""0
1""")
sift_pattern = SiftPattern(List=flatten(polyline), SiftPattern=panel)  # -> Output0, Output1
clean_tree = CleanTree(RemoveNulls=True, RemoveInvalid=True, RemoveEmpty=False, Tree=sift_pattern.Output0)
clean_tree_2 = CleanTree(RemoveNulls=True, RemoveInvalid=True, RemoveEmpty=False, Tree=sift_pattern.Output1)
explode = Explode(Curve=clean_tree, Recursive=True)  # -> Segments, simplify(Vertices)
explode_2 = Explode(Curve=clean_tree_2, Recursive=True)  # -> Segments, simplify(Vertices)
line = Line(StartPoint=explode.Vertices, EndPoint=explode_2.Vertices)

# ----
vault = Vault()  # -> extado_curve_2, extrado, joint_lines, intrado, intrado_curve_2
flip_matrix = FlipMatrix(Data=explode.Vertices)
flip_matrix_2 = FlipMatrix(Data=explode_2.Vertices)
polyline_2 = PolyLine(Vertices=flip_matrix, Closed=False)
polyline_3 = PolyLine(Vertices=flip_matrix_2, Closed=False)
extado_curve = Curve(sift_pattern.Output0)
intrado_curve = Curve(sift_pattern.Output1)
extado_curve_2 = Curve(extado_curve)
intrado_curve_2 = Curve(intrado_curve)

# ==== cluster Vault
points_on_curves = ClusterInput()
points_on_curves_2 = Point(points_on_curves)
polyline = PolyLine(Vertices=points_on_curves_2, Closed=False)

# ---- group: joints
panel = Panel("""0
1""")
sift_pattern = SiftPattern(List=flatten(polyline), SiftPattern=panel)  # -> Output0, Output1
clean_tree = CleanTree(RemoveNulls=True, RemoveInvalid=True, RemoveEmpty=False, Tree=sift_pattern.Output0)
clean_tree_2 = CleanTree(RemoveNulls=True, RemoveInvalid=True, RemoveEmpty=False, Tree=sift_pattern.Output1)
explode = Explode(Curve=clean_tree, Recursive=True)  # -> Segments, simplify(Vertices)
explode_2 = Explode(Curve=clean_tree_2, Recursive=True)  # -> Segments, simplify(Vertices)
line = Line(StartPoint=explode.Vertices, EndPoint=explode_2.Vertices)

# ----
flip_matrix = FlipMatrix(Data=explode.Vertices)
flip_matrix_2 = FlipMatrix(Data=explode_2.Vertices)
polyline_2 = PolyLine(Vertices=flip_matrix, Closed=False)
polyline_3 = PolyLine(Vertices=flip_matrix_2, Closed=False)
extado_curve = Curve(sift_pattern.Output0)
intrado_curve = Curve(sift_pattern.Output1)
extado_curve_2 = ClusterOutput(extado_curve)
joint_lines = ClusterOutput(line)
extrado = ClusterOutput(polyline_2)
intrado_curve_2 = ClusterOutput(intrado_curve)
intrado = ClusterOutput(polyline_3)
