# Grasshopper definition voussoir.gh (Grasshopper 1.0.7)

ruled_surface = RuledSurface()
curve = Curve(flatten(ruled_surface))
shift_list = ShiftList(List=curve, Shift="1", Wrap=True)
ruled_surface_2 = RuledSurface(CurveA=curve, CurveB=shift_list)
area = Area(Geometry=ruled_surface_2)  # -> Area, Centroid
index_of_max = PythonScript(values=area.Area)  # -> IMin, IMax; inputs values: list
# ---------- index_of_max: Python ----------
q=[values]
for i in values:
    IMax=list.index(values,max(values))
    IMin=list.index(values,min(values))
# ---------- end index_of_max ----------
cull_index = CullIndex(List=ruled_surface_2, Indices=index_of_max.IMax, Wrap=True)  # -> flatten(List)
cap_holes_ex = CapHolesEx(Brep=cull_index)  # -> Brep, Caps, Solid
