# Grasshopper definition 01_9_Projection_In Class_ericson.gh (Grasshopper 1.0.7)
# plug-ins: Human, LunchBox

toggle = BooleanToggle(False)
toggle_2 = BooleanToggle(True)
toggle_3 = BooleanToggle(True)
linear_loop = PythonScript(reset=toggle, Interval="1", Inc="1", Max="5", Min="1", Iterations="50")  # -> Val, Iteration
# ---------- linear_loop: Python ----------
#this timer loop stops when either the number of iterations are reached or the boolean condition is set true.
#The update also stops preventing the last element in the list from being duplicated indefinitely.
import time
import Grasshopper as gh


def updateComponent():
    
    """ Updates this component, similar to using a grasshopper timer """
    
    # Define callback action
    def callBack(e):
        ghenv.Component.ExpireSolution(False)
        
    # Get grasshopper document
    ghDoc = ghenv.Component.OnPingDocument()
    
    # Schedule this component to expire
    ghDoc.ScheduleSolution(int(Interval),gh.Kernel.GH_Document.GH_ScheduleDelegate(callBack))

#sets the starting point of the counter
count = 0
its = 0

if reset:
    counter = float(Min)
    it = 0
#adds the increment to counter
else:
    counter += float(Inc)
    it += float(Inc)
    
#reverses the count in the negative direction
if counter > float(Max):
    counter = -float(Max)
    
#reverses the count in the positive direction
if abs (counter) <  float(Min):
    counter = float(Min)
    
#provides an output
Val = abs(counter)

Iteration = it
print it
#stops and start the update
if it< float(Iterations) and not reset:
    updateComponent()
# ---------- end linear_loop ----------
linear_loop_2 = PythonScript(reset=toggle, Interval="1", Inc="1", Max="10", Min="3.1", Iterations="50")  # -> Val, Iteration; same code as linear_loop
linear_loop_3 = PythonScript(reset=toggle, Interval="1", Inc="1", Max="30", Min="1", Iterations="50")  # -> Val, Iteration; same code as linear_loop
panel = Panel(linear_loop.Val)
panel_2 = Panel(linear_loop_3.Val)
panel_3 = Panel(linear_loop_2.Val)
panel_4 = Panel(panel)
panel_5 = Panel("""10
15""")
projection_options = Panel("2")
recieving_surface = Panel("2")
# Variables + Controls
polygon_sides = Panel(panel_3)
division = Division(A=panel_4, B="2")
centered_page = GhPythonScript(width="21", height="21", centerX="0", centerY="-2")  # -> rectangle
# ---------- centered_page: Python ----------
__author__ = "ericsonm"
__version__ = "2019.01.15"

import rhinoscriptsyntax as rs

if (width or height) == None:
    rectangle = None

else:

    x1 = float(width)
    y1 = float(height)
    xc = x1/-2 + float(centerX)
    yc = y1/-2 + float(centerY)

    rectangle = rs.AddRectangle((xc,yc,0),x1,y1)
# ---------- end centered_page ----------
series = Series(Start="70", Step="3", Count=panel_2)  # -> graft(Series)
angle_of_cone_projection = Panel(series)
series_2 = Series(Start="20", Step="1", Count=panel_4)  # -> graft(Series)
division_2 = Division(A="21", B=panel_5)
panel_6 = Panel(series_2)
panel_7 = Panel(division_2)
trig_circle = GhPythonScript(
    radiusX=panel_7,
    radiusY=panel_7,
    centerX="0",
    centerZ="0",
    centerY="0",
    start="0",
    stop="180",
    sides="8",
    centerline=Toggle(True))  # -> points, graft(polyline), center, graft(start), lines, graft(end)
# ---------- trig_circle: Python ----------
                
                
__author__ = "mericson"
__version__ = "2019.01.07"
                
import rhinoscriptsyntax as rs
import math
#creates a circle based on trigonmetric functions
#returns (points,polyline,center,start,end,lines)
def TrigCircle(radiusX,radiusY,centerX,centerY,centerZ,start,stop,sides,centerline):
                    
    sa = float(start) 
    so = float(stop) + sa
    se = float(stop)/float(sides)
                
    rx = float(radiusX)
    ry = float(radiusY)
                
    cx = float(centerX)
    cy = float(centerY)
    cz = float(centerZ)
                
    #add center point
    center = rs.AddPoint(cx,cy,cz)
                
    #create an empty list in which to collect the points
    points = []
    #create points using sine, cosine and range
    for i in rs.frange(math.radians(sa), math.radians(so),math.radians(se)):
        p = rs.AddPoint(math.cos(i)*rx + cx, math.sin(i)*ry + cy, cz)
        points.append(p)
                
                
                
    #Add polyline to the points
    polyline = rs.AddPolyline(points)
                
                
                
    #select the first point on the circle
    start = points[0]
    
    #get the index of the last point in the circle
    m = len(points) - 1
    
    #select the last point in the circle with the index
    end = points[m]
    
    #adds centerlines to the circle
    lines = []
    if centerline:
        for i in points:
            l = rs.AddLine(center,i)
            lines.append(l)
    else:
        lines = None

    return(points,polyline,center,start,end,lines)
                
                
                
#calls the function
circle = TrigCircle(radiusX,radiusY,centerX,centerY,centerZ,start,stop,sides,centerline)
                
#retrieves each item returned from the function and assigns it to an output
points   = circle[0]
polyline = circle[1]
center   = circle[2]
start    = circle[3]
end      = circle[4]
lines    = circle[5]
# ---------- end trig_circle ----------
number = Number(graft(panel_7))
point = Point(flatten(trig_circle.points))
unflattened_points = Point(trig_circle.points)
# A
# reference lines and objects
index_of_max = PythonScript(values=flatten(number))  # -> IMin, IMax; inputs values: list
# ---------- index_of_max: Python ----------
q=[values]
for i in values:
    IMax=list.index(values,max(values))
    IMin=list.index(values,min(values))
# ---------- end index_of_max ----------
list_item = ListItem(List=flatten(number), Index=index_of_max.IMax, Wrap=True)
list_item_2 = ListItem(List=flatten(trig_circle.start), Index=index_of_max.IMax, Wrap=True)
unit_y = UnitY(Factor=1)
addition = Addition(A="90", B=angle_of_cone_projection)
vector_at_angle = PythonScript(angle=addition)  # -> vector
# ---------- vector_at_angle: Python ----------
import rhinoscriptsyntax as rs
import math
if angle == None:
    Vector = None
else:
    c=rs.AddPoint(0,0,0)
    f=math.radians(float(angle))
    l=rs.AddPoint(math.cos(f),math.sin(f),0)
    d=rs.VectorCreate(l,c)
    vector =rs.VectorUnitize(d)
# ---------- end vector_at_angle ----------

series_3 = Series(Start=0, Step="2", Count="8")
vector_at_angle_2 = PythonScript(angle="30")  # -> vector; same code as vector_at_angle
amplitude = Amplitude(Vector=vector_at_angle_2, Amplitude=series_3)

panel_8 = Panel("2")  # disabled
panel_9 = Panel("30")  # disabled
vector_at_angle_3 = PythonScript(angle=panel_9)  # -> vector; disabled; same code as vector_at_angle
xy_plane = XYPlane(Origin=Point(0, 0, 0))  # disabled
# G
# Layers
page_border = Geometry(centered_page)
list_of_points_to_label = Point(unflattened_points)
relay = Relay()

# ---- group: TEXT LABELS
add_text = Panel("""a
b""")
text_size = Panel(".02")
point_2 = Point(list_of_points_to_label)
list_length = ListLength(List=point_2)
linear_gradient = GhPythonScript(R="0", G="0", B="0", Percent=".5")  # -> Color
# ---------- linear_gradient: Python ----------
__author__ = "ericsonm"
__version__ = "2019.01.15"

import rhinoscriptsyntax as rs

def LinearColorGradient(R,G,B,R2,G2,B2,ColorPercentage):
    
    if ColorPercentage > 1:
        R3 = None
        G3 = None
        B3 = None
    else:
        #This function defines linear color gradient by treating R,G,B as coordinates on a 3D line.
        #The base color that will be altered by the percentage should be entered in the second R2,G2,B2 valu
    
        Rdiff = float(R2) - float(R)
        Gdiff = float(G2) - float(G)
        Bdiff = float(B2) - float(B)


        t = float(ColorPercentage)


        R3 = float(R) + Rdiff*t
        G3 = float(G) + Gdiff*t
        B3 = float(B) + Bdiff*t



    return R3,G3,B3


if (R or G or B or Percent) is None:
    Color = None
else: 
    Color1 = LinearColorGradient(255,255,255,R,G,B,Percent)

    R3 = Color1[0]
    G3 = Color1[1]
    B3 = Color1[2]

    Color = rs.CreateColor(R3,G3,B3)
# ---------- end linear_gradient ----------
series_4 = Series(Start=0, Step=1, Count=list_length)
integer = Integer(series_4)
concatenate = Concatenate(FragmentA=integer, FragmentB=graft(add_text))
text_tag_3d = TextTag3D(Location=point_2, Text=concatenate, Size=text_size, Colour=linear_gradient, Justification=5)

# ---- group: section line
radians = Radians(Degrees=panel_6)
radius = Number(list_item)
sine = Sine(Value=radians)
vector_at_angle_4 = PythonScript(angle=panel_6)  # -> vector; same code as vector_at_angle
division_3 = Division(A=radius, B=sine)
point_3 = Point(list_item_2)
vector = Vector(vector_at_angle_4)

# ----
multiplication = Multiplication(A=division_3, B="2")

# ---- group: section line (continued)
length = Number(multiplication)
line_sdl = LineSDL(Start=point_3, Direction=vector, Length=length)

# ---- group: reference line 1
radians_2 = Radians(Degrees=panel_6)
cosine = Cosine(Value=radians_2)
unit_x = UnitX(Factor=1)
multiplication_2 = Multiplication(A=cosine, B=length)
line_sdl_2 = LineSDL(Start=list_item_2, Direction=unit_x, Length=multiplication_2)

# ----
unit_y_2 = UnitY(Factor="-1")
line_sdl_3 = LineSDL(Start=list_item_2, Direction=unit_y_2, Length=multiplication_2)

# ---- group: section 1
unit_y_3 = UnitY(Factor=1)
line_sdl_4 = LineSDL(Start=point_3, Direction=unit_y_3, Length=list_item)

# ----
point_on_curve = PointOnCurve(line_sdl, parameter=1)
cluster = Cluster(line=line_sdl, height_proportion=".2")
triangle = Triangle(line=line_sdl, height_ratio=".2")
arc_section = ArcSection(line=line_sdl, height_ratio=".2")
stream_filter = StreamFilter(Gate=projection_options, Stream0=line_sdl, Stream1=arc_section, Stream2=triangle, Stream3=cluster)
# B
reference_lines = Relay([line_sdl_3, line_sdl_2])

# ---- group: PROJECTION TO SECTION
unit_x_2 = UnitX(Factor=1)
projection = PythonScript(points=point, geometry=stream_filter, vector=unit_x_2)  # -> lines
# ---------- projection: Python ----------
import rhinoscriptsyntax as rs
import math
if (points or geometry or vector) == None:
    lines = None
else:

    d= vector
    n=rs.VectorUnitize(d)
    e=rs.ExtrudeCurveStraight(geometry,(0,0,0),(0,0,1))
    q=rs.ProjectPointToSurface(points,e,n)

    p2=rs.AddPoints(q)
    for i in p2:
        lines=rs.AddLine(points,i)
    if p2:
        del p2
# ---------- end projection ----------
point_on_curve_2 = PointOnCurve(projection, parameter=1)

# ---- group: project to section 1
curve_curve = CurveCurve(CurveA=projection, CurveB=line_sdl_4)  # -> Points, ParamsA, ParamsB

# ---- group: PROJECTION TO REFERENCE LINE 1
projection_2 = PythonScript(points=point_on_curve_2, geometry=line_sdl_2, vector=unit_y)  # -> lines
# ---------- projection_2: Python ----------
import rhinoscriptsyntax as rs
import math
if (points or geometry or vector) == None:
    lines = None
else:

    d= vector
    n=rs.VectorUnitize(d)
    e=rs.ExtrudeCurveStraight(geometry,(0,0,0),(0,0,1))
    q=rs.ProjectPointToSurface(points,e,n)
    p2=rs.AddPoints(q)
    for i in p2:
        lines=rs.AddLine(points,i)
    if p2:
        del p2
# ---------- end projection_2 ----------
point_on_curve_3 = PointOnCurve(projection_2, parameter=1)

# ---- group: project vertex to plane
# projection
xz_plane = XZPlane(Origin=Point(0, 0, 0))
project = Project(Geometry=point_on_curve, Plane=xz_plane)  # -> Geometry, Transform

# ---- group: ALLOWS PROJECTION TO MOVE PAST 90
xz_plane_2 = XZPlane(Origin=Point(0, 0, 0))
project_2 = Project(Geometry=point_on_curve_2, Plane=xz_plane_2)  # -> Geometry, Transform

# ---- group: ROTATE TO R2
radians_3 = Radians(Degrees="-90")
rotate = Rotate(Geometry=project_2.Geometry, Angle=radians_3, Plane=point_3)  # -> Geometry, Transform
rotation_to_r2 = Point(rotate.Geometry)

# ----
point_4 = Point(project.Geometry)
point_5 = Point(project_2.Geometry)

# ---- group: distance to start from vertex of cone
distance = Distance(PointA=point_4, PointB=point_3)
index_of_max_2 = PythonScript(values=distance)  # -> IMin, IMax; inputs values: list; same code as index_of_max
list_item_3 = ListItem(List=distance, Index=index_of_max_2.IMax, Wrap=True)

# ---- group: Cone radii
distance_2 = Distance(PointA=point_4, PointB=point_5)

# ---- group: Rotation Arcs
distance_3 = Distance(PointA=point_3, PointB=project_2.Geometry)
arc = Arc(Plane=point_3, Radius=distance_3, Angle=radians_3)  # -> Arc, Length

# ---- group: Cone location in plan
vector_at_angle_5 = PythonScript(angle=angle_of_cone_projection)  # -> vector; same code as vector_at_angle
line_sdl_5 = LineSDL(Start=trig_circle.center, Direction=vector_at_angle_5, Length=list_item_3)

# ----
reverse = Reverse(Vector=vector_at_angle_5)

# ---- group: Project to Top View curve
multiplication_3 = Multiplication(A=list_item, B="2")
unit_x_3 = UnitX(Factor="-1.1")
line_sdl_6 = LineSDL(Start=rotation_to_r2, Direction=unit_x_3, Length=multiplication_3)
unit_y_4 = UnitY(Factor=1)

# ----
stream_filter_2 = StreamFilter(Gate=Toggle(True), Stream0=unit_y_4, Stream1=reverse)

# ---- group: Cone in top view
point_on_curve_4 = PointOnCurve(line_sdl_5, parameter=1)

# ----
# C
construct_plane = ConstructPlane(Origin=point_on_curve_4, XAxis=vector_at_angle, YAxis=line_sdl_5)

# ---- group: Cone in top view (continued)
circle = Circle(Plane=construct_plane, Radius=distance_2)

# ----
polygon = Polygon(Plane=construct_plane, Radius=distance_2, Segments=polygon_sides, FilletRadius=0)  # -> Polygon, Length
stream_filter_3 = StreamFilter(Gate=recieving_surface, Stream0=line_sdl_6, Stream1=circle, Stream2=polygon.Polygon)

# ---- group: Project to Top View curve (continued)
projection_3 = PythonScript(points=point, geometry=stream_filter_3, vector=stream_filter_2)  # -> lines; same code as projection_2

# ----
# D
# projected curves
# joints
projections = Relay([arc.Arc, projection, projection_3, stream_filter_3, projection_2])

# ---- group: chunk list into 2 matching sets
list_item_4 = ListItem(List=point_on_curve_4, Index=0, Wrap=True)  # -> flatten(Item)
list_of_points_to_label_2 = Point(point_on_curve)
merge = Merge(Data1=flatten(list_of_points_to_label_2), Data2=list_item_4)
list_length_2 = ListLength(List=list_item_4)
partition_list = PartitionList(List=merge, Size=list_length_2)

# ----
point_on_curve_5 = PointOnCurve(projection_3, parameter=1)

# ---- group: break list into curves
list_length_3 = ListLength(List=point)
division_4 = Division(A=list_length_3, B="2")
partition_list_2 = PartitionList(List=point_on_curve_5, Size=division_4)

# ---- group: side projection
xz_plane_3 = XZPlane(Origin=point)
yz_plane = YZPlane(Origin=point_3)
project_3 = Project(Geometry=point_on_curve_5, Plane=yz_plane)  # -> Geometry, Transform
rotate_2 = Rotate(Geometry=project_3.Geometry, Angle=degrees("90"), Plane=point_3)  # -> Geometry, Transform
project_4 = Project(Geometry=rotate_2.Geometry, Plane=xz_plane_3)  # -> Geometry, Transform

# ----
polyline = PolyLine(Vertices=partition_list_2, Closed=False)

# ---- group: 3D curves
deconstruct = Deconstruct(Point=point_on_curve_5)  # -> XComponent, YComponent, ZComponent
deconstruct_2 = Deconstruct(Point=point)  # -> XComponent, YComponent, ZComponent
construct_point = ConstructPoint(XCoordinate=deconstruct.XComponent, YCoordinate=deconstruct.YComponent, ZCoordinate=deconstruct_2.YComponent)  # -> flatten(Point)
partition_list_3 = PartitionList(List=construct_point, Size=division_4)

# ----
project_5 = Project(Geometry=point_on_curve_5, Plane=xz_plane_3)  # -> Geometry, Transform

# ---- group: break list into curves
list_length_4 = ListLength(List=point)
division_5 = Division(A=list_length_4, B="2")
partition_list_4 = PartitionList(List=project_4.Geometry, Size=division_5)

list_length_5 = ListLength(List=point)
division_6 = Division(A=list_length_5, B="2")
partition_list_5 = PartitionList(List=project_5.Geometry, Size=division_6)

# ---- group: 3D VAULT
vault = Vault(vertices=partition_list_3)  # -> extrado, extrado_curve, joints, intrado_curve, intrado

# ---- group: SIDE VIEW VAULT
vault_2 = Vault(vertices=partition_list_4)  # -> extrado, extrado_curve, joints, intrado_curve, intrado

# ---- group: Front View Vault
vault_3 = Vault(vertices=partition_list_5)  # -> extrado, extrado_curve, joints, intrado_curve, intrado

# ----
relay_2 = Relay([polyline, vault.extrado_curve, vault.intrado_curve, vault_2.extrado_curve, vault_2.intrado_curve, vault_3.extrado_curve, vault_3.intrado_curve])
relay_3 = Relay([vault.extrado, vault_2.extrado, vault_3.extrado])
relay_4 = Relay([vault.intrado, vault_2.intrado, vault_3.intrado])
relay_5 = Relay([vault.joints, vault_2.joints, vault_3.joints])

repeat_2_in_list = GhPythonScript(list=flatten(vault.extrado))  # -> newlist; inputs list: list
# ---------- repeat_2_in_list: Python ----------
__author__ = "ericsonm"
__version__ = "2020.02.24"

import rhinoscriptsyntax as rs



newlista = []

for i in range(len(list)):
    if i == len(list)-1:
        pass
    else:
        newlista.append(list[i])
        newlista.append(list[i+1])

newlist = newlista
# ---------- end repeat_2_in_list ----------
partition_list_6 = PartitionList(List=repeat_2_in_list, Size="2")

repeat_2_in_list_2 = GhPythonScript(list=flatten(vault.intrado))  # -> newlist; inputs list: list; same code as repeat_2_in_list
partition_list_7 = PartitionList(List=repeat_2_in_list_2, Size="2")

# ---- group: voussoir
ruled_surface = RuledSurface(CurveA=vault.extrado, CurveB=vault.intrado)  # disabled
curve = Curve(flatten(ruled_surface))  # disabled
panel_10 = Panel("1")  # disabled
shift_list = ShiftList(List=curve, Shift=panel_10, Wrap=True)  # disabled
repeat_2_in_list_3 = GhPythonScript(list=flatten(ruled_surface))  # -> newlist; inputs list: list; disabled; same code as repeat_2_in_list
list_length_6 = ListLength(List=curve)  # disabled
panel_11 = Panel("2")  # disabled
panel_12 = Panel("1")  # disabled
subtraction = Subtraction(A=list_length_6, B=panel_12)  # disabled
partition_list_8 = PartitionList(List=repeat_2_in_list_3, Size=panel_11)  # disabled
cull_index = CullIndex(List=shift_list, Indices=subtraction, Wrap=True)  # disabled
cull_index_2 = CullIndex(List=curve, Indices=subtraction, Wrap=True)  # disabled
panel_13 = Panel("0")  # disabled
ruled_surface_2 = RuledSurface(CurveA=cull_index_2, CurveB=cull_index)  # disabled
insert_items = InsertItems(List=partition_list_8, Item=graft(ruled_surface_2), Indices=graft(panel_13), Wrap=True)  # disabled
brep_join = BrepJoin(Breps=insert_items)  # -> Breps, Closed; disabled

# ----
list_length_7 = ListLength(List=flatten(brep_join.Breps))  # disabled

# ---- group: cost calculation
volume = Volume(Geometry=flatten(brep_join.Breps))  # -> Volume, Centroid; disabled
mass_addition = MassAddition(Input=volume.Volume)  # -> Result, PartialResults; disabled
panel_14 = Panel(volume.Volume)  # disabled
panel_15 = Panel("5")  # disabled
multiplication_4 = Multiplication(A=mass_addition.Result, B=panel_15)  # disabled
panel_16 = Panel(mass_addition.Result)  # disabled
panel_17 = Panel(multiplication_4)  # disabled

# ----
series_5 = Series(Start=0, Step=panel_8, Count=list_length_7)  # disabled
explode = Explode(Curve=flatten(vault.extrado_curve), Recursive=True)  # -> Segments, Vertices
explode_2 = Explode(Curve=flatten(vault.intrado_curve), Recursive=True)  # -> Segments, Vertices
amplitude_2 = Amplitude(Vector=vector_at_angle_3, Amplitude=series_5)  # disabled
move = Move(Geometry=flatten(brep_join.Breps), Motion=amplitude_2)  # -> Geometry, Transform; disabled
# E
# F
# Line Type
# BREPS
relay_6 = Relay([trig_circle.polyline, relay_2, stream_filter])
move_2 = Move(Geometry=partition_list_7, Motion=graft(amplitude))  # -> Geometry, Transform
move_3 = Move(Geometry=partition_list_6, Motion=graft(amplitude))  # -> Geometry, Transform
move_4 = Move(Geometry=explode.Segments, Motion=amplitude)  # -> Geometry, Transform
move_5 = Move(Geometry=explode_2.Segments, Motion=amplitude)  # -> Geometry, Transform
geometry = Geometry([move_3.Geometry, move_2.Geometry, move_4.Geometry, move_5.Geometry])
move_to_plane = MoveToPlane(Geometry=move.Geometry, Plane=xy_plane, Above=True, Below=True)  # -> Geometry, Transform; disabled

panel_18 = Panel("""2
1""")
points_to_inches = GhPythonScript(points=panel_18)  # -> inches
# ---------- points_to_inches: Python ----------
__author__ = "marke"
__version__ = "2020.01.24"

import rhinoscriptsyntax as rs
if points == None:
    pass
else:
    
    p = float(points)

    inches = p/72
# ---------- end points_to_inches ----------
dash_pattern = DashPattern(Curve=relay_4, Pattern=points_to_inches)  # -> Dashes, Gaps

semicircle = Geometry(relay_6)
voussoirs = Geometry(geometry)

points_to_inches_2 = GhPythonScript(points=".75")  # -> inches; same code as points_to_inches
multiplication_5 = Multiplication(A=points_to_inches_2, B="3")
unit_y_5 = UnitY(Factor=multiplication_5)
point_graphic = POINTGRAPHIC(plane=partition_list, radius=points_to_inches_2)

# ---- group: BASE LINES
vertex_of_cone_in_plan = Point(list_item_4)
list_item_5 = ListItem(List=stream_filter_3, Index=0, Wrap=True)

# ----
end_points = EndPoints(Curve=list_item_5)  # -> Start, End

# ---- group: BASE LINES (continued)
line = Line(StartPoint=flatten(end_points.End), EndPoint=flatten(vertex_of_cone_in_plan))

# ----
point_on_curve_6 = PointOnCurve(line, parameter=0)
point_graphic_2 = POINTGRAPHIC(plane=point_on_curve_6, radius=points_to_inches_2)

panel_19 = Panel("""2
1""")
points_to_inches_3 = GhPythonScript(points=panel_19)  # -> inches; same code as points_to_inches
move_6 = Move(Geometry=partition_list, Motion=unit_y_5)  # -> Geometry, Transform
dash_pattern_2 = DashPattern(Curve=line, Pattern=points_to_inches_3)  # -> Dashes, Gaps

graphic_points = Relay([point_graphic, point_graphic_2])

# ---- group: TEXT LABELS
point_6 = Point(move_6.Geometry)
add_text_2 = Panel("c")
text_size_2 = Panel(".02")
list_length_8 = ListLength(List=point_6)
linear_gradient_2 = GhPythonScript(R="0", G="0", B="0", Percent=".5")  # -> Color; same code as linear_gradient
series_6 = Series(Start=0, Step=1, Count=list_length_8)
integer_2 = Integer(series_6)
concatenate_2 = Concatenate(FragmentA=integer_2, FragmentB=add_text_2)
text_tag_3d_2 = TextTag3D(Location=point_6, Text=concatenate_2, Size=text_size_2, Colour=linear_gradient_2, Justification=5)

# ---- group: Preview and Bake
# H
# Preview and Bake
button = Button()
get_name = GhPythonScript(Component=page_border)  # -> Geometry, Name
# ---------- get_name: Python ----------
# Mark Ericson 1.17.19
   #take from forum discussion thread https://www.grasshopper3d.com/forum/topics/python-get-label-name-of-input-components
    #edited version of code  by Mostapha Sadeghipour Roudsari

def GetComponentName():
    Comp = ghenv.Component.Params.Input[0]
    sources = Comp.Sources

    if sources.Count == 0: 
        return components

    for source in sources:
        attr = source.Attributes
        if (attr is None) or (attr.GetTopLevel is None):
            pass
        else:

            component = attr.GetTopLevel.DocObject
            componentName = component.NickName

            return componentName

if Component == None:
    pass
else:
    Name = GetComponentName()
    Geometry = Component
# ---------- end get_name ----------
linear_gradient_3 = GhPythonScript(R="0", G="0", B="0", Percent="1")  # -> Color; same code as linear_gradient
custom_preview = CustomPreview(Geometry=get_name.Geometry, Material=linear_gradient_3)

# ----
panel_20 = Panel(get_name.Name)

# ---- group: Preview and Bake (continued)
object_bake = ObjectBake(
    BakeToggle=button,
    GeometryObjects=get_name.Geometry,
    Layer=panel_20,
    ObjectName=panel_20,
    ObjectColor=linear_gradient_3,
    LayerColor=linear_gradient_3)

# ----
points_to_inches_4 = GhPythonScript(points=".15")  # -> inches; same code as points_to_inches
custom_preview_lineweights = CustomPreviewLineweights(Geometry=get_name.Geometry, Shader=linear_gradient_3, Thickness=points_to_inches_4, Absolute=Toggle(True))

# ---- group: Preview and Bake
get_name_2 = GhPythonScript(Component=semicircle)  # -> Geometry, Name; same code as get_name
linear_gradient_4 = GhPythonScript(R="0", G="47", B="95", Percent="1")  # -> Color; same code as linear_gradient
custom_preview_2 = CustomPreview(Geometry=get_name_2.Geometry, Material=linear_gradient_4)

# ----
panel_21 = Panel(get_name_2.Name)

# ---- group: Preview and Bake (continued)
object_bake_2 = ObjectBake(
    BakeToggle=Button(),
    GeometryObjects=get_name_2.Geometry,
    Layer=panel_21,
    ObjectName=panel_21,
    ObjectColor=linear_gradient_4,
    LayerColor=linear_gradient_4)

# ----
points_to_inches_5 = GhPythonScript(points=".375")  # -> inches; same code as points_to_inches
custom_preview_lineweights_2 = CustomPreviewLineweights(Geometry=get_name_2.Geometry, Shader=linear_gradient_4, Thickness=points_to_inches_5, Absolute=Toggle(True))

# ---- group: Preview and Bake
get_name_3 = GhPythonScript(Component=reference_lines)  # -> Geometry, Name; same code as get_name
linear_gradient_5 = GhPythonScript(R="0", G="0", B="0", Percent=".75")  # -> Color; same code as linear_gradient
custom_preview_3 = CustomPreview(Geometry=get_name_3.Geometry, Material=linear_gradient_5)

# ----
panel_22 = Panel(get_name_3.Name)

# ---- group: Preview and Bake (continued)
object_bake_3 = ObjectBake(
    BakeToggle=Button(),
    GeometryObjects=get_name_3.Geometry,
    Layer=panel_22,
    ObjectName=panel_22,
    ObjectColor=linear_gradient_5,
    LayerColor=linear_gradient_5)

# ----
points_to_inches_6 = GhPythonScript(points=".1")  # -> inches; same code as points_to_inches
custom_preview_lineweights_3 = CustomPreviewLineweights(Geometry=get_name_3.Geometry, Shader=linear_gradient_5, Thickness=points_to_inches_6, Absolute=Toggle(True))

# ---- group: Preview and Bake
get_name_4 = GhPythonScript(Component=projections)  # -> Geometry, Name; same code as get_name
linear_gradient_6 = GhPythonScript(R="0", G="0", B="0", Percent=".2")  # -> Color; same code as linear_gradient
custom_preview_4 = CustomPreview(Geometry=get_name_4.Geometry, Material=linear_gradient_6)

# ----
panel_23 = Panel(get_name_4.Name)

# ---- group: Preview and Bake (continued)
object_bake_4 = ObjectBake(
    BakeToggle=Button(),
    GeometryObjects=get_name_4.Geometry,
    Layer=panel_23,
    ObjectName=panel_23,
    ObjectColor=linear_gradient_6,
    LayerColor=linear_gradient_6)

# ----
points_to_inches_7 = GhPythonScript(points=".05")  # -> inches; same code as points_to_inches
custom_preview_lineweights_4 = CustomPreviewLineweights(Geometry=get_name_4.Geometry, Shader=linear_gradient_6, Thickness=points_to_inches_7, Absolute=Toggle(True))

# ---- group: Preview and Bake
get_name_5 = GhPythonScript(Component=[relay_3, dash_pattern.Dashes])  # -> Geometry, Name; same code as get_name
linear_gradient_7 = GhPythonScript(R="0", G="47", B="95", Percent="1")  # -> Color; same code as linear_gradient
custom_preview_5 = CustomPreview(Geometry=get_name_5.Geometry, Material=linear_gradient_7)

# ----
panel_24 = Panel(get_name_5.Name)

# ---- group: Preview and Bake (continued)
object_bake_5 = ObjectBake(
    BakeToggle=Button(),
    GeometryObjects=get_name_5.Geometry,
    Layer=panel_24,
    ObjectName=panel_24,
    ObjectColor=linear_gradient_7,
    LayerColor=linear_gradient_7)

# ----
points_to_inches_8 = GhPythonScript(points=".1")  # -> inches; same code as points_to_inches
custom_preview_lineweights_5 = CustomPreviewLineweights(Geometry=get_name_5.Geometry, Shader=linear_gradient_7, Thickness=points_to_inches_8, Absolute=Toggle(True))

# ---- group: Preview and Bake
get_name_6 = GhPythonScript(Component=relay_5)  # -> Geometry, Name; same code as get_name
linear_gradient_8 = GhPythonScript(R="0", G="47", B="95", Percent=".6")  # -> Color; same code as linear_gradient
custom_preview_6 = CustomPreview(Geometry=get_name_6.Geometry, Material=linear_gradient_8)

# ----
panel_25 = Panel(get_name_6.Name)

# ---- group: Preview and Bake (continued)
object_bake_6 = ObjectBake(
    BakeToggle=Button(),
    GeometryObjects=get_name_6.Geometry,
    Layer=panel_25,
    ObjectName=panel_25,
    ObjectColor=linear_gradient_8,
    LayerColor=linear_gradient_8)

# ----
points_to_inches_9 = GhPythonScript(points=".05")  # -> inches; same code as points_to_inches
custom_preview_lineweights_6 = CustomPreviewLineweights(Geometry=get_name_6.Geometry, Shader=linear_gradient_8, Thickness=points_to_inches_9, Absolute=Toggle(True))

# ---- group: Preview and Bake
get_name_7 = GhPythonScript(Component=dash_pattern_2.Dashes)  # -> Geometry, Name; same code as get_name
linear_gradient_9 = GhPythonScript(R="0", G="0", B="0", Percent=".5")  # -> Color; same code as linear_gradient
custom_preview_7 = CustomPreview(Geometry=get_name_7.Geometry, Material=linear_gradient_9)

# ----
panel_26 = Panel(get_name_7.Name)

# ---- group: Preview and Bake (continued)
object_bake_7 = ObjectBake(
    BakeToggle=Button(),
    GeometryObjects=get_name_7.Geometry,
    Layer=panel_26,
    ObjectName=panel_26,
    ObjectColor=linear_gradient_9,
    LayerColor=linear_gradient_9)

# ----
points_to_inches_10 = GhPythonScript(points=".25")  # -> inches; same code as points_to_inches
custom_preview_lineweights_7 = CustomPreviewLineweights(Geometry=get_name_7.Geometry, Shader=linear_gradient_9, Thickness=points_to_inches_10, Absolute=Toggle(True))

# ---- group: Preview and Bake
get_name_8 = GhPythonScript(Component=relay)  # -> Geometry, Name; same code as get_name
linear_gradient_10 = GhPythonScript(R="0", G="47", B="95", Percent=".75")  # -> Color; same code as linear_gradient
custom_preview_8 = CustomPreview(Geometry=get_name_8.Geometry, Material=linear_gradient_10)

# ----
panel_27 = Panel(get_name_8.Name)

# ---- group: Preview and Bake (continued)
object_bake_8 = ObjectBake(
    BakeToggle=Button(),
    GeometryObjects=get_name_8.Geometry,
    Layer=panel_27,
    ObjectName=panel_27,
    ObjectColor=linear_gradient_10,
    LayerColor=linear_gradient_10)

# ----
points_to_inches_11 = GhPythonScript(points=".5")  # -> inches; same code as points_to_inches
custom_preview_lineweights_8 = CustomPreviewLineweights(Geometry=get_name_8.Geometry, Shader=linear_gradient_10, Thickness=points_to_inches_11, Absolute=Toggle(True))

# ---- group: Preview and Bake
get_name_9 = GhPythonScript(Component=voussoirs)  # -> Geometry, Name; same code as get_name
linear_gradient_11 = GhPythonScript(R="0", G="47", B="95", Percent=".5")  # -> Color; same code as linear_gradient
custom_preview_9 = CustomPreview(Geometry=get_name_9.Geometry, Material=linear_gradient_11)

# ----
panel_28 = Panel(get_name_9.Name)

# ---- group: Preview and Bake (continued)
object_bake_9 = ObjectBake(
    BakeToggle=Button(),
    GeometryObjects=get_name_9.Geometry,
    Layer=panel_28,
    ObjectName=panel_28,
    ObjectColor=linear_gradient_11,
    LayerColor=linear_gradient_11)

# ----
points_to_inches_12 = GhPythonScript(points="1")  # -> inches; same code as points_to_inches
custom_preview_lineweights_9 = CustomPreviewLineweights(Geometry=get_name_9.Geometry, Shader=linear_gradient_11, Thickness=points_to_inches_12, Absolute=Toggle(True))

# ---- group: Preview and Bake
get_name_10 = GhPythonScript(Component=graphic_points)  # -> Geometry, Name; same code as get_name
linear_gradient_12 = GhPythonScript(R="0", G="0", B="0", Percent=".75")  # -> Color; same code as linear_gradient
custom_preview_10 = CustomPreview(Geometry=get_name_10.Geometry, Material=linear_gradient_12)

# ----
panel_29 = Panel(get_name_10.Name)

# ---- group: Preview and Bake (continued)
object_bake_10 = ObjectBake(
    BakeToggle=Button(),
    GeometryObjects=get_name_10.Geometry,
    Layer=panel_29,
    ObjectName=panel_29,
    ObjectColor=linear_gradient_12,
    LayerColor=linear_gradient_12)

# ----
points_to_inches_13 = GhPythonScript(points=".5")  # -> inches; same code as points_to_inches
custom_preview_lineweights_10 = CustomPreviewLineweights(Geometry=get_name_10.Geometry, Shader=linear_gradient_12, Thickness=points_to_inches_13, Absolute=Toggle(True))

# ==== cluster ArcSection
height_ratio = ClusterInput()
line = ClusterInput()
height_ratio_2 = Number(height_ratio)
line_2 = Line(line)
point_on_curve = PointOnCurve(line_2, parameter=0.5)
length = Length(Curve=line_2)
perpendicular = GhPythonScript(line=line_2)  # -> Perp; inputs line: Line
# ---------- perpendicular: Python ----------
__author__ = "mericson"
__version__ = "2019.01.11"

import rhinoscriptsyntax as rs
import math
import Rhino as rh

if line == None:
    line = None
else:
    a = 0,0,0
    b = 0,0,1
    Z = rs.VectorCreate(a,b)
    c = rh.Geometry.Line.PointAt(line,1)
    d = rh.Geometry.Line.PointAt(line,0)
    vector2 = rs.VectorCreate(c,d)
    Perp = rs.VectorRotate(vector2,90,Z)
# ---------- end perpendicular ----------
end_points = EndPoints(Curve=line_2)  # -> Start, End
multiplication = Multiplication(A=length, B=height_ratio_2)
amplitude = Amplitude(Vector=perpendicular, Amplitude=multiplication)
move = Move(Geometry=point_on_curve, Motion=amplitude)  # -> Geometry, Transform
arc_3pt = Arc3Pt(PointA=end_points.Start, PointB=move.Geometry, PointC=end_points.End)  # -> Arc, Plane, Radius
arc = Geometry(arc_3pt.Arc)
arc_2 = ClusterOutput(arc)

# ==== cluster Triangle
height_ratio = ClusterInput()
line = ClusterInput()
height_ratio_2 = Number(height_ratio)
line_2 = Line(line)
point_on_curve = PointOnCurve(line_2, parameter=0.5)
length = Length(Curve=line_2)
perpendicular = GhPythonScript(line=line_2)  # -> Perp; inputs line: Line; same code as perpendicular
end_points = EndPoints(Curve=line_2)  # -> Start, End
multiplication = Multiplication(A=length, B=height_ratio_2)
amplitude = Amplitude(Vector=perpendicular, Amplitude=multiplication)
move = Move(Geometry=point_on_curve, Motion=amplitude)  # -> Geometry, Transform
merge = Merge(Data1=end_points.Start, Data2=move.Geometry, Data3=end_points.End)
polyline = PolyLine(Vertices=merge, Closed=False)
triangle = Geometry(polyline)
triangle_2 = ClusterOutput(triangle)

# ==== cluster Cluster
line = ClusterInput()
height_proportion = ClusterInput()

line_2 = Line(line)
height_proportion_2 = Number(height_proportion)
point_on_curve = PointOnCurve(line_2, parameter=0.5)
end_points = EndPoints(Curve=line_2)  # -> Start, End
line_3 = Line(StartPoint=point_on_curve, EndPoint=end_points.End)
line_4 = Line(StartPoint=end_points.Start, EndPoint=point_on_curve)
point_on_curve_2 = PointOnCurve([line_3, line_4], parameter=0.5)
length = Length(Curve=line_3)
perpendicular = GhPythonScript(line=line_4)  # -> Perp; inputs line: Line; same code as perpendicular
panel = Panel("""1
-1""")
multiplication = Multiplication(A=length, B=height_proportion_2)
multiplication_2 = Multiplication(A=multiplication, B=panel)
line_sdl = LineSDL(Start=point_on_curve_2, Direction=perpendicular, Length=multiplication_2)
point_on_curve_3 = PointOnCurve(line_sdl, parameter=1)
split_list = SplitList(List=point_on_curve_3, Index="1")  # -> ListA, ListB
point = Point(split_list.ListB)
point_2 = Point(end_points.Start)
point_3 = Point(point_on_curve)
point_4 = Point(point_on_curve)
point_5 = Point(split_list.ListA)
point_6 = Point(end_points.End)
arc_3pt = Arc3Pt(PointA=point_3, PointB=point, PointC=point_2)  # -> Arc, Plane, Radius
arc_3pt_2 = Arc3Pt(PointA=point_4, PointB=point_5, PointC=point_6)  # -> Arc, Plane, Radius
join_curves = JoinCurves(Curves=[arc_3pt_2.Arc, arc_3pt.Arc], Preserve=False)
section_curve = Geometry(join_curves)

section_curve_2 = ClusterOutput(section_curve)

# ==== cluster POINTGRAPHIC
radius = ClusterInput()
plane = ClusterInput()

# ---- group: point graphic
circle = Circle(Plane=plane, Radius=radius)
divide_curve = DivideCurve(Curve=circle, Count="2", Kinks=False)  # -> Points, Tangents, Parameters
list_item = ListItem(List=divide_curve.Points, Index=0, Wrap=True)
list_item_2 = ListItem(List=divide_curve.Points, Index="1", Wrap=True)
line = Line(StartPoint=list_item, EndPoint=list_item_2)
rotate = Rotate(Geometry=line, Angle=degrees("90"), Plane=graft(circle))  # -> Geometry, Transform

# ----
merge = Merge(Data1=line, Data2=rotate.Geometry)
point_graphic = ClusterOutput(merge)

# ==== cluster Vault
vertices = ClusterInput()

# ---- group: 3D curves
polyline = PolyLine(Vertices=vertices, Closed=False)  # -> flatten(Polyline)

# ---- group: joints
panel = Panel("""0
1""")
sift_pattern = SiftPattern(List=polyline, SiftPattern=panel)  # -> Output0, Output1
clean_tree = CleanTree(RemoveNulls=True, RemoveInvalid=True, RemoveEmpty=False, Tree=sift_pattern.Output0)
clean_tree_2 = CleanTree(RemoveNulls=True, RemoveInvalid=True, RemoveEmpty=False, Tree=sift_pattern.Output1)
explode = Explode(Curve=clean_tree, Recursive=True)  # -> Segments, simplify(Vertices)
explode_2 = Explode(Curve=clean_tree_2, Recursive=True)  # -> Segments, simplify(Vertices)
line = Line(StartPoint=explode.Vertices, EndPoint=explode_2.Vertices)

# ----
flip_matrix = FlipMatrix(Data=explode.Vertices)
flip_matrix_2 = FlipMatrix(Data=explode_2.Vertices)
polyline_2 = PolyLine(Vertices=flip_matrix_2, Closed=False)
polyline_3 = PolyLine(Vertices=flip_matrix, Closed=False)
extrado_curve = ClusterOutput(clean_tree)
intrado_curve = ClusterOutput(clean_tree_2)
extrado = ClusterOutput(polyline_3)
intrado = ClusterOutput(polyline_2)
joints = ClusterOutput(line)
