# Grasshopper definition loop counter.gh (Grasshopper 1.0.7)

linear_loop = PythonScript(reset=Toggle(True), Interval="1", Inc="1", Max="10", Min="1", Iterations="20")  # -> Val, Iteration
# ---------- linear_loop: Python ----------
#this timer loop stops when either the number of iterations are reached or the boolean condition is set true.
#The update also stops preventing the last element in the list from being duplicated indefinitely.
import time
import Grasshopper as gh


def updateComponent():
    
    """ Updates this component, similar to using a grasshopper timer """
    
    # Define callback action
    def callBack(e):
        ghenv.Component.ExpireSolution(False)
        
    # Get grasshopper document
    ghDoc = ghenv.Component.OnPingDocument()
    
    # Schedule this component to expire
    ghDoc.ScheduleSolution(int(Interval),gh.Kernel.GH_Document.GH_ScheduleDelegate(callBack))

#sets the starting point of the counter
count = 0
its = 0

if reset:
    counter = float(Min)
    it = 0
#adds the increment to counter
else:
    counter += float(Inc)
    it += float(Inc)
    
#reverses the count in the negative direction
if counter > float(Max):
    counter = -float(Max)
    
#reverses the count in the positive direction
if abs (counter) <  float(Min):
    counter = float(Min)
    
#provides an output
Val = abs(counter)

Iteration = it
print it
#stops and start the update
if it< float(Iterations) and not reset:
    updateComponent()
# ---------- end linear_loop ----------
panel = Panel(linear_loop.Val)
