# Grasshopper definition Animation Group.gh (Grasshopper 1.0.7)
# plug-ins: Human

stream_filter = StreamFilter(Gate=Toggle(False))

# ---- group: Save Frame
animation = Panel("Animation")
file_path = FilePath("C:\Users\marke\Dropbox\Woodbury\2020_Jan\Arch_563\research\animate\")
scale_factor = Panel("4")
file_name = Panel("test")
file_number = Panel(stream_filter)
file_extension = Panel(".png")
file_directory = Panel(file_path)
concatenate = Concatenate(Fragment_A=file_directory, B=file_name, Fragment_B=file_number, A=file_extension)
filepath = Panel(concatenate)
save_viewport_to_file = SaveViewportToFile(Run=stream_filter, ViewportName=animation, Render=False, FilePath=filepath, ScaleFactor=scale_factor)
