# Grasshopper definition Counters.gh (Grasshopper 1.0.7)

r_loop_counter = PythonScript(reset=Toggle(False), Inc=Slider(1, range=0..10), Max=Slider(10, range=0..360))  # -> out, Val
# ---------- r_loop_counter: Python ----------
if reset:
    counter = 0
else:
    counter += Inc
Count = counter
if Count > Max:
    counter = 0
Val = counter
# ---------- end r_loop_counter ----------
counter = PythonScript(reset=Toggle(True), Inc=Slider(1, range=0..10), Max=Slider(54, range=0..360))  # -> out, Count
# ---------- counter: Python ----------
if reset:
    counter = 0
else:
    counter += Inc
Count = counter
if Count > Max:
    counter = Max
# ---------- end counter ----------
l_loop_counter_mod = PythonScript(reset=Toggle(True), Inc=Slider(1, range=0..10), Max=Slider(75, range=0..360), Min=Slider(41.936, range=0..360))  # -> out, Val
# ---------- l_loop_counter_mod: Python ----------
if reset:
    counter = Min
else:
    counter += Inc
Count = counter
if Count > Max:
    counter = -Max
if abs (counter) <  Min:
    counter = Min
Val = counter
Val = abs(Count)
# ---------- end l_loop_counter_mod ----------
counter_2 = PythonScript(reset=Toggle(False), Min=Slider(-90, range=-90..10), Inc=Slider(1, range=0..180), Max=Slider(180, range=0..360))  # -> out, Count
# ---------- counter_2: Python ----------
if reset:
    counter = Min
else:
    counter += Inc
Count = counter
if Count > Max:
    counter = Max
# ---------- end counter_2 ----------
panel = Panel(r_loop_counter.Val)
panel_2 = Panel(counter.Count)
panel_3 = Panel(l_loop_counter_mod.Val)
panel_4 = Panel(counter_2.Count)
