# Grasshopper definition color switch demo.gh (Grasshopper 1.0.7)
# plug-ins: Human

subtraction = Subtraction(A="255", B="100")
multiplication = Multiplication(A=subtraction, B="3")
linear_loop = PythonScript(reset=Toggle(False), Interval="1", Inc="1", Max="255", Min="100", Iterations=multiplication)  # -> Val, Iteration
# ---------- linear_loop: Python ----------
#this timer loop stops when either the number of iterations are reached or the boolean condition is set true.
#The update also stops preventing the last element in the list from being duplicated indefinitely.
import time
import Grasshopper as gh


def updateComponent():
    
    """ Updates this component, similar to using a grasshopper timer """
    
    # Define callback action
    def callBack(e):
        ghenv.Component.ExpireSolution(False)
        
    # Get grasshopper document
    ghDoc = ghenv.Component.OnPingDocument()
    
    # Schedule this component to expire
    ghDoc.ScheduleSolution(int(Interval),gh.Kernel.GH_Document.GH_ScheduleDelegate(callBack))

#sets the starting point of the counter
count = 0
its = 0

if reset:
    counter = float(Min)
    it = 0
#adds the increment to counter
else:
    counter += float(Inc)
    it += float(Inc)
    
#reverses the count in the negative direction
if counter > float(Max):
    counter = -float(Max)
    
#reverses the count in the positive direction
if abs (counter) <  float(Min):
    counter = float(Min)
    
#provides an output
Val = abs(counter)

Iteration = it
print it
#stops and start the update
if it< float(Iterations) and not reset:
    updateComponent()
# ---------- end linear_loop ----------
panel = Panel(linear_loop.Val)
panel_2 = Panel(linear_loop.Val)
panel_3 = Panel(linear_loop.Iteration)
circle = Circle(Plane=PlaneXY(0, 0, 0), Radius=panel_2)
switch = GhPythonScript(Iterations=panel_3, ChangePoint1="0", Gate1=panel, ChangePoint2="155", ChangePoint3="310")  # -> R, G, B
# ---------- switch: Python ----------
__author__ = "marke"
__version__ = "2020.03.22"

import rhinoscriptsyntax as rs


if Iterations >= ChangePoint1 and Iterations < ChangePoint2:
    R = Gate1
    G = 100
    B = 100
elif Iterations >= ChangePoint2 and Iterations < ChangePoint3:
    R = 255
    G = Gate1
    B = 100
elif Iterations > ChangePoint3: 
    R = 255
    G = 255
    B = Gate1
else:
   R = 100
   G = 100
   B = 100
   
print Iterations
# ---------- end switch ----------

# ---- group: Preview and Bake
button = Button()
get_name = GhPythonScript(Component=circle)  # -> Geometry, Name
# ---------- get_name: Python ----------
# Mark Ericson 1.17.19
   #take from forum discussion thread https://www.grasshopper3d.com/forum/topics/python-get-label-name-of-input-components
    #edited version of code  by Mostapha Sadeghipour Roudsari

def GetComponentName():
    Comp = ghenv.Component.Params.Input[0]
    sources = Comp.Sources

    if sources.Count == 0: 
        return components

    for source in sources:
        attr = source.Attributes
        if (attr is None) or (attr.GetTopLevel is None):
            pass
        else:

            component = attr.GetTopLevel.DocObject
            componentName = component.NickName

            return componentName

if Component == None:
    pass
else:
    Name = GetComponentName()
    Geometry = Component
# ---------- end get_name ----------
panel_4 = Panel(switch.R)
panel_5 = Panel(switch.G)
panel_6 = Panel(switch.B)
linear_gradient = GhPythonScript(R=panel_4, G=panel_5, B=panel_6, Percent="1")  # -> Color
# ---------- linear_gradient: Python ----------
__author__ = "ericsonm"
__version__ = "2019.01.15"

import rhinoscriptsyntax as rs

def LinearColorGradient(R,G,B,R2,G2,B2,ColorPercentage):
    
    if ColorPercentage > 1:
        R3 = None
        G3 = None
        B3 = None
    else:
        #This function defines linear color gradient by treating R,G,B as coordinates on a 3D line.
        #The base color that will be altered by the percentage should be entered in the second R2,G2,B2 value
    
        Rdiff = float(R2) - float(R)
        Gdiff = float(G2) - float(G)
        Bdiff = float(B2) - float(B)


        t = float(ColorPercentage)


        R3 = float(R) + Rdiff*t
        G3 = float(G) + Gdiff*t
        B3 = float(B) + Bdiff*t



    return R3,G3,B3


if (R or G or B or Percent) is None:
    Color = None
else: 
    Color1 = LinearColorGradient(255,255,255,R,G,B,Percent)

    R3 = Color1[0]
    G3 = Color1[1]
    B3 = Color1[2]

    Color = rs.CreateColor(R3,G3,B3)
# ---------- end linear_gradient ----------

# ----
custom_preview_lineweights = CustomPreviewLineweights(Geometry=get_name.Geometry, Shader=linear_gradient, Absolute=Toggle(True))
