# Grasshopper definition Plan_section.gh (Grasshopper 1.0.7)

linear_loop = PythonScript(reset=Toggle(False), Interval="1", Inc="1", Max="360", Min="0", Iterations="360")  # -> Val, Iteration
# ---------- linear_loop: Python ----------
#this timer loop stops when either the number of iterations are reached or the boolean condition is set true.
#The update also stops preventing the last element in the list from being duplicated indefinitely.
import time
import Grasshopper as gh


def updateComponent():
    
    """ Updates this component, similar to using a grasshopper timer """
    
    # Define callback action
    def callBack(e):
        ghenv.Component.ExpireSolution(False)
        
    # Get grasshopper document
    ghDoc = ghenv.Component.OnPingDocument()
    
    # Schedule this component to expire
    ghDoc.ScheduleSolution(int(Interval),gh.Kernel.GH_Document.GH_ScheduleDelegate(callBack))

#sets the starting point of the counter
count = 0
its = 0

if reset:
    counter = float(Min)
    it = 0
#adds the increment to counter
else:
    counter += float(Inc)
    it += float(Inc)
    
#reverses the count in the negative direction
if counter > float(Max):
    counter = -float(Max)
    
#reverses the count in the positive direction
if abs (counter) <  float(Min):
    counter = float(Min)
    
#provides an output
Val = abs(counter)

Iteration = it
print it
#stops and start the update
if it< float(Iterations) and not reset:
    updateComponent()
# ---------- end linear_loop ----------
cone = Cone(Base="0,1.5,0", Radius="2", Length="3")  # -> Cone, Tip
cone_2 = Cone(Base=PlaneXY(0, 0, 0), Radius="3", Length="5")  # -> Cone, Tip
cap_holes = CapHoles(Brep=cone_2.Cone)
number_slider = Slider(0, range=0..360)
cap_holes_2 = CapHoles(Brep=cone.Cone)
solid_difference = SolidDifference(BrepsA=cap_holes, BrepsB=cap_holes_2)
xy_plane = XYPlane(Origin=Point(0, 0, 0))
unit_z = UnitZ(Factor=Slider(0, range=0..5))
yz_plane = YZPlane(Origin=Point(0, 0, 0))
rotate = Rotate(Geometry=yz_plane, Angle=degrees(linear_loop.Val), Plane=PlaneXY(0, 0, 0))  # -> Geometry, Transform
move = Move(Geometry=xy_plane, Motion=unit_z)  # -> Geometry, Transform
brep_plane = BrepPlane(Brep=solid_difference, Plane=[rotate.Geometry, move.Geometry])  # -> Curves, Points
panel = Panel("45")
brep = Brep(brep_plane.Curves)
