# Grasshopper definition Round_Gallery.gh (Grasshopper 1.0.7)

radius = Panel("""100
70""")
panel = Panel("""45
75""")
sides = Panel("""9
9""")
multiplication = Multiplication(A="2", B=radius)
division = Division(A=radius, B="3")
polygon = Polygon(origin="0,0,0", angle=panel, radius=radius, sides=sides)  # -> plane, points, polyline_2
deconstruct_plane = DeconstructPlane(Plane=polygon.plane)  # -> Origin, XAxis, YAxis, ZAxis
list_item = ListItem(List=deconstruct_plane.Origin, Index=0, Wrap=True)
line_sdl = LineSDL(Start=list_item, Direction=deconstruct_plane.XAxis, Length=multiplication)
radians = Radians(Degrees="90")
explode = Explode(Curve=polygon.polyline_2, Recursive=True)  # -> Segments, Vertices
tree_statistics = TreeStatistics(Tree=explode.Segments)  # -> Paths, Length, Count
point_on_curve = PointOnCurve(explode.Segments, parameter=0.5)
rotate_axis = RotateAxis(Geometry=polygon.plane, Angle=radians, Axis=line_sdl)  # -> Geometry, Transform
panel_2 = Panel("1")
polygon_2 = Polygon(origin=point_on_curve, angle="60", radius=division, sides="4")  # -> flatten(plane), points, flatten(polyline_2)
unit_z = UnitZ(Factor=1)
list_item_2 = ListItem(List=list_item, Index=flatten(0), Wrap=True)
partition_list = PartitionList(List=polygon_2.polyline_2, Size=tree_statistics.Length)
line_sdl_2 = LineSDL(Start=list_item_2, Direction=unit_z, Length=1)
explode_tree = ExplodeTree(Data=partition_list)  # -> _0000, _0001
explode_tree_2 = ExplodeTree(Data=polygon.polyline_2)  # -> Branch0, Branch1
region_union = RegionUnion(Curves=flatten([explode_tree._0000, explode_tree_2.Branch0]))
curve_curve = CurveCurve(CurveA=region_union, CurveB=line_sdl)  # -> Points, ParamsA, ParamsB
distance = Distance(PointA=list_item, PointB=curve_curve.Points)
arc = Arc(Plane=graft(rotate_axis.Geometry), Radius=distance, Angle=radians)  # -> Arc, Length
region_union_2 = RegionUnion(Curves=flatten([explode_tree._0001, explode_tree_2.Branch1]))
explode_tree_3 = ExplodeTree(Data=arc.Arc)  # -> Branch0, Branch1
rail_revolution = RailRevolution(Curve=explode_tree_3.Branch1, Rail=region_union, Axis=line_sdl_2, Scale=False)
rail_revolution_2 = RailRevolution(Curve=explode_tree_3.Branch0, Rail=region_union_2, Axis=line_sdl_2, Scale=False)
cap_holes = CapHoles(Brep=rail_revolution_2)
cap_holes_2 = CapHoles(Brep=rail_revolution)
solid_difference = SolidDifference(BrepsA=cap_holes_2, BrepsB=cap_holes)
colour_rgb = ColourRGB(Alpha=255, Red="200", Green="200", Blue="200")
custom_preview = CustomPreview(Geometry=solid_difference, Material=colour_rgb)

# ==== cluster Polygon
angle = ClusterInput()
radius = ClusterInput()
origin = ClusterInput()
sides = ClusterInput()
radians = Radians(Degrees=angle)

# ---- group: Polygon
xy_plane = XYPlane(Origin=origin)

# ----
# This cluster builds an oriented closed polygon
rotate_plane = RotatePlane(Plane=xy_plane, Angle=radians)

# ---- group: Polygon (continued)
ellipse = Ellipse(Plane=rotate_plane, Radius1=radius, Radius2=radius)  # -> Ellipse, Focus1, Focus2
divide_curve = DivideCurve(Curve=ellipse.Ellipse, Count=sides, Kinks=False)  # -> Points, Tangents, Parameters
polyline = PolyLine(Vertices=divide_curve.Points, Closed=Toggle(True))

# ----
points = ClusterOutput(divide_curve.Points)
plane = ClusterOutput(rotate_plane)
polyline_2 = ClusterOutput(polyline)
