# Grasshopper definition transparent background.gh (Grasshopper 1.0.7)

# ---- group: transparent background
file_name = Panel("test")
viewport_name = Panel("Animation")
resolution = Panel("8000")
file_extension = Panel(".png")
stream_filter = StreamFilter(Gate=Toggle(True))
panel = Panel(stream_filter)
file_path = FilePath("C:\Users\marke\OneDrive\Desktop\dlayers\")
concatenate = Concatenate(Fragment_A=file_name, B=panel, Fragment_B=file_extension)
file_directory = Panel(file_path)
panel_2 = Panel(concatenate)
captureview = Ladybug_CaptureView(
    fileName=panel_2,
    folder=file_directory,
    viewNames=viewport_name,
    imageWidth=resolution,
    imageHeight=resolution,
    transparBack=Toggle(True),
    capture=stream_filter)  # -> Output; plug-in component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
panel_3 = Panel(captureview)
