# Grasshopper definition Round_Gallery_02.gh (Grasshopper 1.0.7)

# ---- group: Color Parameters
panel = Panel("59")
panel_2 = Panel("12")
panel_3 = Panel("101")

# ---- group: Geometric Parameters
panel_4 = Panel("7")
panel_5 = Panel("2")
panel_6 = Panel("1")
panel_7 = Panel("500")
panel_8 = Panel("7")
panel_9 = Panel(".1")
panel_10 = Panel("4")
panel_11 = Panel("100")

# ----
series = Series(Start=panel_6, Step=1, Count=panel_7)
spherical_motion = GhPythonScript(Stop=series, Sides=panel_8, VerAngle=panel_9, RValue1=panel_5, RValue2=panel_10, RValue3=panel_4, Radius=panel_11)  # -> Points, CenterPts; inputs Stop: Int32, Sides: Int32, RValue1: Int32, RValue2: Int32, RValue3: Int32
# ---------- spherical_motion: Python ----------
"""Provides a scripting component.
    Inputs:
        HorAngle: The HorAngle script variable
        VerAngle: The VerAngle variable
        Radius: The Radius script variable
        Number: The number variable 
        Rot1: The Rot1 script variable
        Rot2: The Rot2 script variable
        Rot3: The Rot3 script variable 
        Sides: The Sides script variable
    Output:
        points: The a output variable"""

__author__ = "ericsonm"
__version__ = "2021.04.06"

import rhinoscriptsyntax as rs

def TrigCirc(HorAngle,VerAngle,Radius,Rotation,CenterX,CenterY,CenterZ,Orient):
    
    from math import radians
    from math import sin
    from math import cos
    

    #loop to create points on sphere
    for i in range(Rotation):
        
        Hor = radians(HorAngle*i)
        Ver = radians(VerAngle*i)
        
        if Orient == "ThreeD":
        
    
            x = cos(Hor)*Radius*sin(Ver) + CenterX
            y = sin(Hor)*Radius*sin(Ver) + CenterY
            z = cos(Ver)*Radius + CenterZ
            
        if Orient == "Top":
            
            x = cos(Hor)*Radius*sin(Ver) + CenterX
            y = sin(Hor)*Radius*sin(Ver) + CenterY
            z = 0 + CenterZ
            
        if Orient == "Front":
        
            x = cos(Hor)*Radius*sin(Ver) + CenterX
            y = cos(Ver)*Radius + CenterZ
            z = 0 + CenterY
            
        if Orient == "Oblique":
        
    
            x = cos(Hor)*Radius*sin(Ver) + CenterX
            y = sin(Hor)*Radius*sin(Ver) - cos(Ver)*Radius*.9 + CenterZ + CenterY
            z = 0 + CenterZ           



    return(x,y,z)



HorAngle = 360/Sides

Points = []


rotation1 = RValue1*Stop
rotation2 = RValue2*Stop
rotation3 = RValue3*Stop


pt1 = TrigCirc(-HorAngle,VerAngle,Radius,rotation1,0,0,0,"ThreeD")
pt2 = TrigCirc(HorAngle,VerAngle,Radius/3,rotation2,pt1[0],pt1[1],pt1[2],"ThreeD")
pt3 = TrigCirc(HorAngle,VerAngle,Radius/5,rotation3,pt2[0],pt2[1],pt2[2],"ThreeD")

CenterPts = rs.AddPoint(0,0,pt3[2])

pts = rs.AddPoint(pt3[0],pt3[1],pt3[2])
Points = pts
# ---------- end spherical_motion ----------
vector_2pt = Vector2Pt(PointA=spherical_motion.CenterPts, PointB=spherical_motion.Points, Unitize=Toggle(True))  # -> Vector, Length
colour_rgb = ColourRGB(Alpha=255, Red=panel_2, Green=panel, Blue=panel_3)
unit_z = UnitZ(Factor="5")
polyline = PolyLine(Vertices=spherical_motion.Points, Closed=False)
amplitude = Amplitude(Vector=vector_2pt.Vector, Amplitude="5")
extrude = Extrude(Base=polyline, Direction=unit_z)
deconstruct_brep = DeconstructBrep(Brep=extrude)  # -> Faces, Edges, Vertices
extrude_2 = Extrude(Base=deconstruct_brep.Faces, Direction=amplitude)
custom_preview = CustomPreview(Geometry=[polyline, extrude_2], Material=colour_rgb)
