# Grasshopper definition 01_Round Classroom.gh (Grasshopper 1.0.7)
# plug-ins: Human

# Variables + Controls
panel = Panel("2")
radius = Panel("100")
sides = Panel("13")
multiplication = Multiplication(A=panel, B=radius)
division = Division(A=radius, B="3")
polygon = Polygon(origin="0,0,0", angle="45", radius=radius, sides=sides)  # -> plane, polyline_2
deconstruct_plane = DeconstructPlane(Plane=polygon.plane)  # -> Origin, XAxis, YAxis, ZAxis
# A
line_sdl = LineSDL(Start=deconstruct_plane.Origin, Direction=deconstruct_plane.XAxis, Length=multiplication)
radians = Radians(Degrees="90")
explode = Explode(Curve=polygon.polyline_2, Recursive=True)  # -> Segments, Vertices
point_on_curve = PointOnCurve(explode.Segments, parameter=0.5)
polygon_2 = Polygon(origin=point_on_curve, angle="60", radius=division, sides="4")  # -> plane, polyline_2
unit_z = UnitZ(Factor=1)
panel_2 = Panel(polygon_2.polyline_2)
rotate_axis = RotateAxis(Geometry=polygon.plane, Angle=radians, Axis=line_sdl)  # -> Geometry, Transform
line_sdl_2 = LineSDL(Start=deconstruct_plane.Origin, Direction=unit_z, Length=1)
region_union = RegionUnion(Curves=flatten([polygon.polyline_2, polygon_2.polyline_2]))  # -> flatten(Result)
curve_curve = CurveCurve(CurveA=region_union, CurveB=line_sdl)  # -> Points, ParamsA, ParamsB
# B
distance = Distance(PointA=deconstruct_plane.Origin, PointB=curve_curve.Points)
arc = Arc(Plane=rotate_axis.Geometry, Radius=distance, Angle=radians)  # -> Arc, Length
# C
# Output Geometry
# Views
rail_revolution = RailRevolution(Curve=arc.Arc, Rail=region_union, Axis=line_sdl_2, Scale=False)
# D
# E
# Line Type
# Layers
list_of_points_to_label = Point()
# F
plan = Geometry(region_union)

# ---- group: TEXT LABELS
text_size = Panel(".02")
point = Point(list_of_points_to_label)
add_text = Panel("a")
list_length = ListLength(List=point)
linear_gradient = GhPythonScript(R="0", G="0", B="0", Percent=".5")  # -> Color
# ---------- linear_gradient: Python ----------
__author__ = "ericsonm"
__version__ = "2019.01.15"

import rhinoscriptsyntax as rs

def LinearColorGradient(R,G,B,R2,G2,B2,ColorPercentage):
    
    if ColorPercentage > 1:
        R3 = None
        G3 = None
        B3 = None
    else:
        #This function defines linear color gradient by treating R,G,B as coordinates on a 3D line.
        #The base color that will be altered by the percentage should be entered in the second R2,G2,B2 valu
    
        Rdiff = float(R2) - float(R)
        Gdiff = float(G2) - float(G)
        Bdiff = float(B2) - float(B)


        t = float(ColorPercentage)


        R3 = float(R) + Rdiff*t
        G3 = float(G) + Gdiff*t
        B3 = float(B) + Bdiff*t



    return R3,G3,B3


if (R or G or B or Percent) is None:
    Color = None
else: 
    Color1 = LinearColorGradient(255,255,255,R,G,B,Percent)

    R3 = Color1[0]
    G3 = Color1[1]
    B3 = Color1[2]

    Color = rs.CreateColor(R3,G3,B3)
# ---------- end linear_gradient ----------
series = Series(Start=0, Step=1, Count=list_length)
integer = Integer(series)
concatenate = Concatenate(FragmentA=integer, FragmentB=add_text)
text_tag_3d = TextTag3D(Location=point, Text=concatenate, Size=text_size, Colour=linear_gradient, Justification=5)

# ---- group: Preview and Bake
# Preview and Bake
button = Button()
get_name = GhPythonScript(Component=plan)  # -> Geometry, Name
# ---------- get_name: Python ----------
# Mark Ericson 1.17.19
   #take from forum discussion thread https://www.grasshopper3d.com/forum/topics/python-get-label-name-of-input-components
    #edited version of code  by Mostapha Sadeghipour Roudsari

def GetComponentName():
    Comp = ghenv.Component.Params.Input[0]
    sources = Comp.Sources

    if sources.Count == 0: 
        return components

    for source in sources:
        attr = source.Attributes
        if (attr is None) or (attr.GetTopLevel is None):
            pass
        else:

            component = attr.GetTopLevel.DocObject
            componentName = component.NickName

            return componentName

if Component == None:
    pass
else:
    Name = GetComponentName()
    Geometry = Component
# ---------- end get_name ----------
linear_gradient_2 = GhPythonScript(R="0", G="0", B="0", Percent="1")  # -> Color; same code as linear_gradient
custom_preview = CustomPreview(Geometry=get_name.Geometry, Material=linear_gradient_2)

# ----
panel_3 = Panel(get_name.Name)
custom_preview_lineweights = CustomPreviewLineweights(Geometry=get_name.Geometry, Shader=linear_gradient_2, Thickness=".05", Absolute=Toggle(True))

# ==== cluster Polygon
angle = ClusterInput()
radius = ClusterInput()
origin = ClusterInput()
sides = ClusterInput()
radians = Radians(Degrees=angle)

# ---- group: Polygon
xy_plane = XYPlane(Origin=origin)

# ----
# This cluster builds an oriented closed polygon
rotate_plane = RotatePlane(Plane=xy_plane, Angle=radians)

# ---- group: Polygon (continued)
ellipse = Ellipse(Plane=rotate_plane, Radius1=radius, Radius2=radius)  # -> Ellipse, Focus1, Focus2
divide_curve = DivideCurve(Curve=ellipse.Ellipse, Count=sides, Kinks=False)  # -> Points, Tangents, Parameters
polyline = PolyLine(Vertices=divide_curve.Points, Closed=Toggle(True))

# ----
plane = ClusterOutput(rotate_plane)
polyline_2 = ClusterOutput(polyline)
