# Grasshopper definition Round_Room_simple.gh (Grasshopper 1.0.7)

series = Series(Start="1", Step=1, Count="200")
ghpython_script = GhPythonScript(Stop=series, Sides="7", VerAngle=".1", RValue1="2", RValue2="5", RValue3="7", Radius="1000")  # -> Points, CenterPts; inputs Stop: Int32, Sides: Int32, RValue1: Int32, RValue2: Int32, RValue3: Int32
# ---------- ghpython_script: Python ----------
"""Provides a scripting component.
    Inputs:
        HorAngle: The HorAngle script variable
        VerAngle: The VerAngle variable
        Radius: The Radius script variable
        Number: The number variable 
        Rot1: The Rot1 script variable
        Rot2: The Rot2 script variable
        Rot3: The Rot3 script variable 
        Sides: The Sides script variable
    Output:
        points: The a output variable"""

__author__ = "ericsonm"
__version__ = "2021.04.06"

import rhinoscriptsyntax as rs

def TrigCirc(HorAngle,VerAngle,Radius,Rotation,CenterX,CenterY,CenterZ,Orient):
    
    from math import radians
    from math import sin
    from math import cos
    

    #loop to create points on sphere
    for i in range(Rotation):
        
        Hor = radians(HorAngle*i)
        Ver = radians(VerAngle*i)
        
        if Orient == "ThreeD":
        
    
            x = cos(Hor)*Radius*sin(Ver) + CenterX
            y = sin(Hor)*Radius*sin(Ver) + CenterY
            z = cos(Ver)*Radius + CenterZ
            
        if Orient == "Top":
            
            x = cos(Hor)*Radius*sin(Ver) + CenterX
            y = sin(Hor)*Radius*sin(Ver) + CenterY
            z = 0 + CenterZ
            
        if Orient == "Front":
        
            x = cos(Hor)*Radius*sin(Ver) + CenterX
            y = cos(Ver)*Radius + CenterZ
            z = 0 + CenterY
            
        if Orient == "Oblique":
        
    
            x = cos(Hor)*Radius*sin(Ver) + CenterX
            y = sin(Hor)*Radius*sin(Ver) - cos(Ver)*Radius*.9 + CenterZ + CenterY
            z = 0 + CenterZ           



    return(x,y,z)



HorAngle = 360/Sides

Points = []


rotation1 = RValue1*Stop
rotation2 = RValue2*Stop
rotation3 = RValue3*Stop


pt1 = TrigCirc(-HorAngle,VerAngle,Radius,rotation1,0,0,0,"ThreeD")
pt2 = TrigCirc(HorAngle,VerAngle,Radius/3,rotation2,pt1[0],pt1[1],pt1[2],"ThreeD")
pt3 = TrigCirc(HorAngle/2,VerAngle,Radius/4,rotation3,pt2[0],pt2[1],pt2[2],"ThreeD")

CenterPts = rs.AddPoint(0,0,pt3[2])

pts = rs.AddPoint(pt3[0],pt3[1],pt3[2])
Points = pts
# ---------- end ghpython_script ----------
partition_list = PartitionList(List=ghpython_script.Points, Size="7")
reverse_list = ReverseList(List=ghpython_script.CenterPts)
flip_matrix = FlipMatrix(Data=partition_list)
list_item = ListItem(List=reverse_list, Index=0, Wrap=True)
polyline = PolyLine(Vertices=partition_list, Closed=False)  # -> flatten(Polyline)
vector_2pt = Vector2Pt(PointA="0,0,0", PointB=list_item, Unitize=False)  # -> Vector, Length
polyline_2 = PolyLine(Vertices=flip_matrix, Closed=False)  # -> flatten(Polyline)
loft_options = LoftOptions(Closed=False, Adjust=False, Rebuild=0, Refit=0, Type="3")
xy_plane = XYPlane(Origin=Point(0, 0, 0))
loft = Loft(Curves=polyline_2, Options=loft_options)
amplitude = Amplitude(Vector=vector_2pt.Vector, Amplitude="40")
move = Move(Geometry=amplitude, Motion=vector_2pt.Vector)  # -> Geometry, Transform
brep_plane = BrepPlane(Brep=loft, Plane=move.Geometry)  # -> Curves, Points
