# Grasshopper definition Sound_Listener_box.gh (Grasshopper 1.0.7)
# plug-ins: Firefly_X

trigger = Trigger(Interval=500, TimerInterval=500, Target=sound_capture)
sound_capture = SoundCapture(TimePeriod=0.1, StartStopSoundCapture=Toggle(True))  # -> WavePressureSamplesFromLeftChannel, WavePressureSamplesFromRightChannel, Volume
panel = Panel(sound_capture.Volume)
data_recorder = DataRecorder(panel, DataLimit=-10, RecordData=True)
list_length = ListLength(List=data_recorder)
larger_than = LargerThan(FirstNumber=list_length, SecondNumber="4")  # -> LargerThan, OrEqualTo
Y = Panel("""-10
-10
10
10""")
X = Panel("""-10
10
10
-10""")
stream_filter = StreamFilter(Gate=larger_than.LargerThan, Stream0="0", Stream1=data_recorder)
list_length_2 = ListLength(List=stream_filter)
list_length_3 = ListLength(List=X)
subtraction = Subtraction(A=list_length_2, B=list_length_3)
split_list = SplitList(List=stream_filter, Index=subtraction)  # -> ListA, ListB
subtraction_2 = Subtraction(A=split_list.ListB, B=Y)
addition = Addition(A=split_list.ListB, B=X)
panel_2 = Panel(addition)
concatenate = Concatenate(Fragment_A=addition, Fragment_B=",", A=subtraction_2)
polyline = PolyLine(Vertices=concatenate, Closed=Toggle(True))
colour_rgb = ColourRGB(Alpha=255, Red="0", Green="0", Blue="0")
brep = Brep(polyline)
custom_preview = CustomPreview(Geometry=brep, Material=colour_rgb)
